# Grasshopper definition gh_frame_writer_conmech_old_data_format.ghx (Grasshopper 1.0.7)
# plug-ins: karambaGH

panel = Panel("C:\Users\yijiangh\Documents\misc\framefab_mpp_test_models\orginal_models\short_beam_test")
panel_2 = Panel("C:\Users\yijiangh\Documents\misc\framefab_mpp_test_models\orginal_models\topopt-100")
panel_3 = Panel("extreme_beam_test_03-06-2018.pwf")

# ----
# parsing the old pwf file
panel_4 = Panel("C:\Users\yijiangh\Documents\misc\framefab_mpp_test_models\orginal_models\extrusion_experiment")
ghpython_script = GhPythonScript(file_dir=panel_2, file_name="topopt101_tiny_S1.0_07-25-2018_wO_layers.pwf")  # -> out, node_points, elements, ground_nodes
# ---------- ghpython_script: Python ----------
import rhinoscriptsyntax as rs
import Rhino.Geometry.Plane as Plane
import Rhino.Geometry.Point3d as Point3d
import Rhino.Geometry.Vector3d as Vector3d
import Rhino.Geometry.Quaternion as Quat
import Grasshopper.DataTree as DataTree # Add, AddRange(list, GHPath(i, j))
import Grasshopper.Kernel.Data.GH_Path as GHPath
import System

from ghpythonlib.treehelpers import list_to_tree, tree_to_list
from collections import defaultdict

import os
import json

def get_node_neighbors(elements):
    node_neighbors = defaultdict(set)
    for e in elements:
        n1, n2 = e
        node_neighbors[n1].add(e)
        node_neighbors[n2].add(e)
    return node_neighbors

###########################
# main program starts here

filepath = os.path.join(file_dir, file_name)

node_points = []
elements = []
ground_nodes = []
ground_elements = []

with open(filepath) as fp:
   line = fp.readline()
   while line:
       char_sep = line.split(' ')
       char_sep[-1] = char_sep[-1].split('\n')[0]
       if char_sep[0] == 'v':
           pt = Point3d(*map(float, char_sep[1:4]))
           node_points.append(pt)
       elif char_sep[0] == 'l':
           elements.append(tuple(map(int, char_sep[1:3])))
       elif char_sep[0] == 'p':
           elements.append(tuple(map(int, char_sep[1:3])))
           ground_elements.append(tuple(map(int, char_sep[1:3])))
       line = fp.readline()

elements = [(n1-1, n2-1) for n1, n2 in elements]
g_nodes = []
for ge in ground_elements:
    g_nodes.extend([ge[0]-1, ge[1]-1])

v_e_nghd = get_node_neighbors(elements)
deg1_nodes = [v_id for v_id, e_nghd in v_e_nghd.items() if len(e_nghd) == 1]
ground_nodes = [v for v in g_nodes if v in deg1_nodes]

elements = list_to_tree(elements)
# ---------- end ghpython_script ----------

panel_5 = Panel("long_beam_test_03-06-2018.pwf")
list_item = ListItem(List=ghpython_script.elements, Index=0, Wrap=True)  # -> Item, Item1
curve = Curve([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])
curve_2 = Curve([<curve referenced from the Rhino model> x158])
curve_3 = Curve([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])
point = Point(ghpython_script.node_points)
scale = Scale(Geometry=curve, Center=Point(0, 0, 0), Factor=Slider(2, range=0..10))  # -> Geometry, Transform
list_item_2 = ListItem(List=point, Index=list_item.Item1, Wrap=True)
list_item_3 = ListItem(List=point, Index=list_item.Item, Wrap=True)
line = Line(StartPoint=list_item_3, EndPoint=list_item_2)
list_item_4 = ListItem(List=point, Index=ghpython_script.ground_nodes, Wrap=True)

# ----
# include self weight load or not
boolean_toggle = BooleanToggle(False)

# ----
# all elements (no duplicates)
curve_4 = Curve(flatten(curve_2))

end_points = EndPoints(Curve=curve_4)  # -> Start, End

# ----
# loaded nodes
point_2 = Point([Point(-78.41459467, -67.90903101, 120), Point(-4.752109817e-10, 67.90903101, 120), Point(78.41459467, -67.90903101, 120)])

remove_duplicate_lines_karamba3d = RemoveDuplicateLinesKaramba3D(Line=curve_4, LimitDistance=0.005)  # -> OutLine, Info, Indexes
remove_duplicate_points_karamba3d = RemoveDuplicatePointsKaramba3D(Point=[end_points.Start, end_points.End], LimitDistance=0.005)  # -> OutPoint, Info, Indexes

# ----
# all nodes (no duplicates)
point_3 = Point(remove_duplicate_points_karamba3d.OutPoint)

length = Length(Curve=curve_4)

# ----
# grounded nodes
point_4 = Point([<point referenced from the Rhino model> x8])

bar_graph = BarGraph(length, BarColor=RGB(255, 0, 90))
deconstruct = Deconstruct(Point=point_4)  # -> XComponent, YComponent, ZComponent
point_5 = Point(point_3)
panel_6 = Panel(deconstruct.ZComponent)

# ----
# get loaded node indices
c_script = CSharpScript(pts=point_5, target_pts=point_2, dist_tol=0.001)  # -> out, A; inputs pts: list of Point3d, target_pts: list of Point3d, dist_tol: Double
# ---------- c_script: C# usings ----------
using System.IO;
using System.Linq;
using System.Data;
using System.Drawing;
using System.Reflection;
using System.Windows.Forms;
using System.Xml;
using System.Xml.Linq;
using System.Runtime.InteropServices;

using Rhino.DocObjects;
using Rhino.Collections;
using GH_IO;
using GH_IO.Serialization;
# ---------- c_script: C# ----------
    List<int> id = new List<int>();

    foreach(Point3d t_pt in target_pts)
    {
      for(int i = 0; i < pts.Count(); i++)
      {
        if(t_pt.DistanceTo(pts[i]) < dist_tol)
        {
          id.Add(i);
          break;
        }
      }
    }

    A = id;
# ---------- end c_script ----------
integer = Integer(c_script.A)
list_item_5 = ListItem(List=point_5, Index=integer, Wrap=True)

curve_5 = Curve(curve_4)

# ----
# moment
panel_7 = Panel("""0.0, 0.0, 0
0.0, 0.0, 0
0.0, 0.0, 0""")

# ----
# force
panel_8 = Panel("""0.0, 0.0, -10
0.0, 0.0, -10
0.0, 0.0, -10""")

curve_6 = Curve(reparameterize(curve_5))

# ----
# material properties
# cross section radius
panel_9 = Panel("0.15")
# young's modules
data = Data(350)
# tensile_yeild_stress
data_2 = Data("kN/cm2")
data_3 = Data("PLA")
data_4 = Data("kN/cm2")
# shear modules
data_5 = Data(240)
data_6 = Data(3.6)
# density
data_7 = Data(12.2582)
data_8 = Data("kN/cm2")
data_9 = Data("kN/m3")
data_10 = Data("centimeter")
panel_10 = Panel(data_5)
panel_11 = Panel(data_4)
panel_12 = Panel(data_10)
panel_13 = Panel(data_7)
panel_14 = Panel(data_9)
panel_15 = Panel(data_3)
panel_16 = Panel(data_2)
panel_17 = Panel(data_6)
panel_18 = Panel(data)
panel_19 = Panel(data_8)
panel_20 = Panel(panel_9)

deconstruct_vector = DeconstructVector(Vector=simplify(graft(panel_8)))  # -> XComponent, YComponent, ZComponent
deconstruct_vector_2 = DeconstructVector(Vector=simplify(graft(panel_7)))  # -> XComponent, YComponent, ZComponent
c_script_2 = CSharpScript(lines=curve_6, pts=point_5, dist_tol="1e-7")  # -> out, connectivity; inputs lines: list of Curve, pts: list of Point3d, dist_tol: Double
# ---------- c_script_2: C# ----------
    DataTree<int> c_id = new DataTree<int>();

    for(int k = 0; k < lines.Count(); k++)
    {
      Curve e = lines[k];
      GH_Path pth = new GH_Path(k);

      Point3d end_u = e.PointAt(0);
      Point3d end_v = e.PointAt(1);

      for(int i = 0; i < pts.Count(); i++)
      {
        if(end_u.DistanceTo(pts[i]) < dist_tol)
        {
          c_id.Add(i, pth);
        }
        if(end_v.DistanceTo(pts[i]) < dist_tol)
        {
          c_id.Add(i, pth);
        }
      }
    }

    connectivity = c_id;
# ---------- end c_script_2 ----------
vector = Vector(panel_8)
panel_21 = Panel(c_script_2.connectivity)
integer_2 = Integer(c_script_2.connectivity)
list_item_6 = ListItem(List=point_5, Index=integer_2, Wrap=True)
merge = Merge(
    Data1=deconstruct_vector.XComponent,
    Data2=deconstruct_vector.YComponent,
    Data3=deconstruct_vector.ZComponent,
    Data4=deconstruct_vector_2.XComponent,
    Data5=deconstruct_vector_2.YComponent,
    Data6=deconstruct_vector_2.ZComponent)
list_item_7 = ListItem(List=list_item_6, Index=0, Wrap=True)  # -> Item, Item1
vector_2 = Vector(vector)
point_6 = Point(list_item_5)
number = Number(panel_20)
number_2 = Number(merge)
line_2 = Line(StartPoint=list_item_7.Item, EndPoint=list_item_7.Item1)
multiplication = Multiplication(A=data_5, B="1")
multiplication_2 = Multiplication(A=data, B="1")
vector_display = VectorDisplay(Anchor=point_6, Vector=vector_2)
radius_cm = Panel(number)
kn_cm2 = Panel(multiplication_2)
kn_cm2_2 = Panel(multiplication)

# ----
# poisson ratio
evaluate = Evaluate(Expression="E/(2*G) - 1", E=multiplication_2, G=multiplication)
panel_22 = Panel(evaluate)

point_7 = Point(flatten(point_4))
point_8 = Point(point_5)

# ----
# grounded nodes
point_9 = Point(point_7)

# ----
# all nodes
point_10 = Point(point_8)

point_11 = Point(point_10)
panel_23 = Panel("C:\Users\yijiangh\Documents\pb_ws\pychoreo\src\pychoreo_examples\data\assembly_instances\extrusion")
distance = Distance(PointA=graft(point_11), PointB=point_9)  # -> simplify(Distance)
panel_24 = Panel("C:\Users\yijiangh\Documents\pb_ws\pb-construction\assembly_instances\extrusion")

# ----
# file name
panel_25 = Panel("compas_fea_truss_frame_rotated")

support = Panel("""1
1
1
1
1
1""")
mass_multiplication = MassMultiplication(Input=distance)  # -> Result, PartialResults
integer_3 = Integer(support)
concatenate = Concatenate(Fragment_A=panel_25, A=".json")
concatenate_2 = Concatenate(Fragment_A=panel_25, B="_load_case", A=".json")
boolean = Boolean(mass_multiplication.Result)
integer_4 = Integer(boolean)
subtraction = Subtraction(A="1", B=integer_4)
integer_5 = Integer(flatten(subtraction))
mass_addition = MassAddition(Input=flatten(subtraction))  # -> Result, PartialResults
dispatch = Dispatch(List=point_11, DispatchPattern=integer_5)  # -> ListA, ListB
panel_26 = Panel(subtraction)
panel_27 = Panel(mass_addition.Result)
duplicate_data = DuplicateData(Data=integer_3, Number=subtraction, Order=True)  # -> simplify(Data)
point_12 = Point(dispatch.ListA)
panel_28 = Panel("700")
concatenate_3 = Concatenate(Fragment_A=panel_24, A="\", Fragment_B=concatenate)
concatenate_4 = Concatenate(Fragment_A=panel_24, A="\", Fragment_B=concatenate_2)
equality = Equality(FirstNumber=mass_multiplication.Result, SecondNumber="0")  # -> Equality, Inequality
construct_point = ConstructPoint(XCoordinate="650", YCoordinate="100", ZCoordinate=Slider(25, range=0..100))

# ----
# node pts
point_13 = Point(point_10)

# ----
# element_ids
integer_6 = Integer(integer_2)

tree_statistics = TreeStatistics(Tree=integer_6)  # -> Paths, Length, Count
sort_list = SortList(Keys=tree_statistics.Length)  # -> Keys, ValuesValuesA
xy_plane = XYPlane(Origin=construct_point)
integer_7 = Integer(flatten(equality.Equality))
panel_29 = Panel(sort_list.Keys)
boolean_toggle_2 = BooleanToggle(False)
text = Text(panel_15)
number_3 = Number(multiplication_2)
integer_8 = Integer("3")
number_4 = Number(multiplication)
number_5 = Number(evaluate)
number_6 = Number(data_6)
panel_30 = Panel(number_5)
panel_31 = Panel(number_4)
panel_32 = Panel(number_3)
number_7 = Number(number_2)

# ----
# write load case
point_14 = Point(point_6)
point_15 = Point(point_14)
point_16 = Point(point_10)
c_script_3 = CSharpScript(pts=point_16, target_pts=point_15, dist_tol=Slider(0.001, range=0..0.001))  # -> out, A; inputs pts: list of Point3d, target_pts: list of Point3d, dist_tol: Double; same code as c_script
integer_9 = Integer(c_script_3.A)
integer_10 = Integer(integer_8)
list_item_8 = ListItem(List=number_7, Index=0, Wrap=True)  # -> flatten(Item), flatten(Item1), flatten(Item2), flatten(Item3), flatten(Item4), flatten(Item5)
text_2 = Text(concatenate)
text_3 = Text(concatenate_4)
integer_11 = Integer(integer_9)
list_item_9 = ListItem(List=point_16, Index=integer_9, Wrap=True)
c_script_4 = CSharpScript(
    toggle=boolean_toggle_2,
    file_path=text_3,
    shape_file_name=text_2,
    dimension=integer_10,
    include_self_weight=boolean_toggle,
    force_unit="kN",
    moment_unit="kN-m",
    load_node_ids=integer_11,
    Fx=list_item_8.Item,
    Fy=list_item_8.Item1,
    Fz=list_item_8.Item2,
    Mx=list_item_8.Item3,
    My=list_item_8.Item4,
    Mz=list_item_8.Item5,
    Reference="D:\CODE_WS\PB_WS\CONMECH\EXAMPLES\GH_SCRIPTS\Newtonsoft.Json.dll")  # -> out, A; inputs toggle: Boolean, file_path: String, shape_file_name: String, dimension: Int32, include_self_weight: Boolean, force_unit: String, moment_unit: String, load_node_ids: list of Int32, Fx: list of Double, Fy: list of Double, Fz: list of Double, Mx: list of Double, My: list of Double, Mz: list of Double; disabled
# ---------- c_script_4: C# usings ----------
using System.IO;
using System.Linq;
using System.Data;
using System.Drawing;
using System.Reflection;
using System.Windows.Forms;
using System.Xml;
using System.Xml.Linq;
using System.Runtime.InteropServices;

using Rhino.DocObjects;
using Rhino.Collections;
using GH_IO;
using GH_IO.Serialization;
using Newtonsoft.Json;
using Newtonsoft.Json.Serialization;
using Newtonsoft.Json.Schema;
using Newtonsoft.Json.Linq;
using Newtonsoft.Json.Converters;
using Newtonsoft.Json.Bson;
# ---------- c_script_4: C# ----------
    if(toggle != true)
    {
      return;
    }

    JsonSerializer serializer = new JsonSerializer();
    serializer.NullValueHandling = NullValueHandling.Ignore;
    serializer.Formatting = Newtonsoft.Json.Formatting.Indented;

    // init assembly sequence obj, wire in global params
    ConmechLoad cas = new ConmechLoad();
    cas.dimension = dimension;
    cas.applied_shape_file = shape_file_name;
    cas.include_self_weight = include_self_weight;
    cas.force_unit = force_unit;
    cas.moment_unit = moment_unit;

    cas.point_load_list = new List<PointLoad>();

    // create nodes
    for(int i = 0; i < load_node_ids.Count(); i++)
    {
      PointLoad nd = new PointLoad();
      nd.applied_node_id = load_node_ids[i];
      nd.Fx = Fx[i];
      nd.Fy = Fy[i];
      nd.Fz = Fz[i];
      nd.Mx = Mx[i];
      nd.My = My[i];
      nd.Mz = Mz[i];

      cas.point_load_list.Add(nd);
    }

    // GH screen output
    //    string json = JsonConvert.SerializeObject(cas, Newtonsoft.Json.Formatting.Indented);
    //    Print(json);

    // serialize to json file
    using (StreamWriter sw = new StreamWriter(@file_path))
    using (JsonWriter writer = new JsonTextWriter(sw))
    {
      serializer.Serialize(writer, cas);
    }
# ---------- c_script_4: C# additional code ----------
  public class PointLoad
  {
    public int applied_node_id { get; set; }
    public double Fx { get; set; }
    public double Fy { get; set; }
    public double Fz { get; set; }
    public double Mx { get; set; }
    public double My { get; set; }
    public double Mz { get; set; }
  }

  public class ConmechLoad
  {
    public string applied_shape_file { get; set; }
    public int dimension { get; set; }
    public string force_unit { get; set; }
    public string moment_unit{ get; set; }
    public bool include_self_weight { get; set; }

    public List<PointLoad> point_load_list { get; set; }
  }
# ---------- end c_script_4 ----------
panel_33 = Panel(c_script_4.out)

number_8 = Number(number)
panel_34 = Panel(number_8)
number_9 = Number(data_7)
panel_35 = Panel(number_9)
integer_12 = Integer(duplicate_data)
boolean_toggle_3 = BooleanToggle(True)
c_script_5 = CSharpScript(
    toggle=boolean_toggle_2,
    file_path=concatenate_3,
    model_name=panel_25,
    model_type="3D_frame",
    assembly_type="extrusion",
    unit="millimeter",
    dimension=integer_8,
    relative_pos_to_robot_base=xy_plane,
    node_pts=point_13,
    ground_nodes_identifier=integer_7,
    fixities=integer_12,
    elements=integer_6,
    material_name=text,
    youngs_modulus=panel_32,
    youngs_modulus_unit="kN/cm2",
    shear_modulus=panel_31,
    shear_modulus_unit="kN/cm2",
    tensile_yeild_stress=number_6,
    tensile_yeild_stress_unit="kN/cm2",
    poisson_ratio=panel_30,
    radius=panel_34,
    radius_unit="centimeter",
    density=panel_35,
    density_unit="kN/m3",
    is_uniform_cross_sec=boolean_toggle_3,
    is_uniform_mat=boolean_toggle_3,
    Reference="D:\CODE_WS\PB_WS\CONMECH\EXAMPLES\GH_SCRIPTS\Newtonsoft.Json.dll")  # -> out, A; inputs toggle: Boolean, file_path: String, model_name: String, model_type: String, assembly_type: String, unit: String, dimension: Int32, relative_pos_to_robot_base: Plane, node_pts: list of Point3d, ground_nodes_identifier: list of Int32, fixities: tree of Int32, elements: tree of Int32, material_name: String, youngs_modulus: Double, youngs_modulus_unit: String, shear_modulus: Double, shear_modulus_unit: String, tensile_yeild_stress: Double, tensile_yeild_stress_unit: String, poisson_ratio: Double, radius: Double, radius_unit: String, density: Double, density_unit: String, is_uniform_cross_sec: Boolean, is_uniform_mat: Boolean
# ---------- c_script_5: C# ----------
    if(toggle == false)
    {
      return;
    }

    JsonSerializer serializer = new JsonSerializer();
    serializer.NullValueHandling = NullValueHandling.Ignore;
    serializer.Formatting = Newtonsoft.Json.Formatting.Indented;

    // init assembly sequence obj, wire in global params
    ChoreoInputModel cas = new ChoreoInputModel();
    cas.model_name = model_name;
    cas.assembly_type = assembly_type;
    cas.model_type = model_type;
    cas.generate_time = DateTime.Now.ToString();
    cas.unit = unit;
    cas.dimension = dimension;
    cas.element_num = elements.BranchCount;
    cas.node_num = node_pts.Count();

    cas.base_frame_in_rob_base = relative_pos_to_robot_base;

    cas.uniform_cross_section = is_uniform_cross_sec;
    cas.uniform_material_properties = is_uniform_mat;
    cas.material_properties = new MaterialProperty();
    cas.material_properties.material_name = material_name;
    cas.material_properties.youngs_modulus = youngs_modulus;
    cas.material_properties.youngs_modulus_unit = youngs_modulus_unit;

    cas.material_properties.shear_modulus = shear_modulus;
    cas.material_properties.shear_modulus_unit = shear_modulus_unit;

    cas.material_properties.tensile_yeild_stress = tensile_yeild_stress;
    cas.material_properties.tensile_yeild_stress_unit = tensile_yeild_stress_unit;

    cas.material_properties.poisson_ratio = poisson_ratio;

    cas.material_properties.density = density;
    cas.material_properties.density_unit = density_unit;

    cas.material_properties.cross_sec_area = radius * radius * Math.PI;
    cas.material_properties.cross_sec_area_unit = "centimeter^2";
    cas.material_properties._cross_sec_area_note = "round_shape, pi * r^2";

    cas.material_properties.Jx = 0.5 * Math.Pow(radius, 4) * Math.PI;
    cas.material_properties.Jx_unit = "centimeter^4";
    cas.material_properties._Jx_note = "0.5 * pi * r^4";

    cas.material_properties.Iy = 0.25 * Math.Pow(radius, 4) * Math.PI;
    cas.material_properties.Iy_unit = "centimeter^4";
    cas.material_properties._Iy_note = "0.25 * pi * r^4";
    
    cas.material_properties.Iz = 0.25 * Math.Pow(radius, 4) * Math.PI;
    cas.material_properties.Iz_unit = "centimeter^4";
    cas.material_properties._Iz_note = "0.25 * pi * r^4";
    
    cas.node_list = new List<FrameNode>(node_pts.Count());
    cas.element_list = new List<FrameElement>(elements.BranchCount);

    // create nodes
    for(int i = 0; i < node_pts.Count(); i++)
    {
      FrameNode nd = new FrameNode();
      nd.point = node_pts[i];
      nd.node_id = i;
      nd.is_grounded = ground_nodes_identifier[i];
      nd.fixities = fixities.Branch(i);

      cas.node_list.Add(nd);
    }

    // create each sequenced element
    for(int i = 0; i < elements.BranchCount; i++)
    {
      FrameElement ne = new FrameElement();
      ne.end_node_ids = new List<int>();
      ne.element_id = i;
      ne.end_node_ids = elements.Branch(i);

      cas.element_list.Add(ne);
    }

    // GH screen output
    //    string json = JsonConvert.SerializeObject(cas, Newtonsoft.Json.Formatting.Indented);
    //    Print(json);

    // serialize to json file
    using (StreamWriter sw = new StreamWriter(@file_path))
    using (JsonWriter writer = new JsonTextWriter(sw))
    {
      serializer.Serialize(writer, cas);
    }
# ---------- c_script_5: C# additional code ----------
  public class FrameNode
  {
    public Point3d point { get; set; }
    public int node_id { get; set; }
    public int is_grounded { get; set; }
    public List<int> fixities { get; set; }
  }

  public class FrameElement
  {
    public List<int> end_node_ids { get; set; }
    public int element_id { get; set; }
    public int layer_id { get; set; }
  }

  public class MaterialProperty
  {
    public string material_name { get; set; }
    public string _source { get; set; }
    public double youngs_modulus { get; set; }
    public string youngs_modulus_unit { get; set; }

    public double shear_modulus { get; set; }
    public string shear_modulus_unit { get; set; }

    public double tensile_yeild_stress { get; set; }
    public string tensile_yeild_stress_unit { get; set; }

    public double density { get; set; }
    public string density_unit { get; set; }

    public double poisson_ratio { get; set; }

//    public double radius { get; set; }
//    public string radius_unit { get; set; }
    public double cross_sec_area { get; set; }
    public string cross_sec_area_unit { get; set; }
    public string _cross_sec_area_note { get; set; }
    
    public double Jx { get; set; }
    public string Jx_unit { get; set; }
    public string _Jx_note { get; set; }
    
    public double Iy { get; set; }
    public string Iy_unit { get; set; }
    public string _Iy_note { get; set; }
    
    public double Iz { get; set; }
    public string Iz_unit { get; set; }
    public string _Iz_note { get; set; }
  }

  public class ChoreoInputModel
  {
    public string model_name { get; set; }
    public string assembly_type { get; set; }
    public string model_type { get; set; }
    public string unit { get; set; }
    public string generate_time { get; set; }

    public int dimension { get; set; }
    public int node_num { get; set; }
    public int element_num { get; set; }

    public Plane base_frame_in_rob_base { get; set; }

    public bool uniform_cross_section { get; set; }
    public bool uniform_material_properties { get; set; }
    public MaterialProperty material_properties { get; set; }

    public List<FrameNode> node_list { get; set; }
    public List<FrameElement> element_list { get; set; }
  }
# ---------- end c_script_5 ----------
panel_36 = Panel(c_script_5.out)
