# Grasshopper definition stiffness_checker_compare_karamba_ghpythonremote.ghx (Grasshopper 1.0.7)
# plug-ins: Karamba

# ---- group: Import remote python modules
python = PythonScript()  # -> rhino_doc_dir
# ---------- python: Python ----------
import scriptcontext as sc
from os import path

rhino_doc_dir = path.abspath(path.dirname(sc.doc.Path))
# ---------- end python ----------
panel = Panel(python)
panel_2 = Panel("""numpy
numpy.linalg
pyconmech""")
list = ValueList({"CRITICAL", "ERROR", "WARNING", "INFO", "DEBUG", "NOTSET"}, selected="DEBUG")
ghpythonremote = GHPythonRemote(location="conda://rhinoremote", run=Toggle(True), modules=panel_2, log_level=list, working_dir=panel)  # -> out, linked_modules, rpy; inputs run: Boolean, modules: list
# ---------- ghpythonremote: Python ----------
import sys
import scriptcontext
import logging
import inspect
import ghpythonremote
from ghpythonremote.connectors import GrasshopperToPythonRemote
from os import path
from time import sleep

local_log_level = getattr(logging, log_level, logging.WARNING)
logger = logging.getLogger('ghpythonremote')
logger.setLevel(local_log_level)
ch = logging.StreamHandler()
ch.setLevel(local_log_level)
formatter = logging.Formatter('%(levelname)s: %(name)s:\n%(message)s')
ch.setFormatter(formatter)
logger.handlers = []
logger.addHandler(ch)
logger = logging.getLogger('ghpythonremote.GH_to_python')

ROOT = path.abspath(path.dirname(inspect.getfile(ghpythonremote)))
rpyc_server_py = path.join(ROOT, 'pythonservice.py')

# Set connection to CLOSED if this is the first run
# and initialize set of linked modules
try:
    remote_python_status
except NameError:
    remote_python_status = 'CLOSED'
    lkd_modules = set()

# Wait for connection to connect or terminate
timer = 0
while remote_python_status == 'CONNECTING' or remote_python_status == 'CLOSING':
    sleep(1)
    timer += 1
    if timer == 10:
        try:
            gh2py_manager.__exit__(*sys.exc_info())
        except Exception:
            pass
        remote_python_status = 'CLOSED'
        lkd_modules = set()
        raise RuntimeError("Connection left in an inconsistent state and not returning. Reset everything.")

if run:
    if not remote_python_status == 'OPEN':
        remote_python_status = 'CONNECTING'
        gh2py_manager = GrasshopperToPythonRemote(rpyc_server_py, location=location, timeout=10,
                                                  port=None, log_level=log_level, working_dir=working_dir)
        gh2py = gh2py_manager.__enter__()
        remote_python_status = 'OPEN'

    # Stuff that we can reach
    rpymod = gh2py.py_remote_modules  # A getter function for a named python module
    rpy = gh2py.connection  # Represents the remote instance root object
    scriptcontext.sticky['rpy'] = rpy
    # Add modules
    for mod in modules:
        try:
            scriptcontext.sticky[mod] = rpymod(mod)
            lkd_modules.add(mod)
        except ImportError:
            gh2py_manager.__exit__(*sys.exc_info())
            raise

elif not remote_python_status == 'CLOSED':
    remote_python_status = 'CLOSING'
    # Remove linked modules
    for mod in lkd_modules:
        del scriptcontext.sticky[mod]
    del scriptcontext.sticky['rpy']
    gh2py_manager.__exit__(*sys.exc_info())
    lkd_modules = set()
    remote_python_status = 'CLOSED'

# Change variable name because ghpython resets outputs to None before each run
linked_modules = lkd_modules

logger.info('GH to python connection is {}'.format(remote_python_status))
# ---------- end ghpythonremote ----------
python_2 = PythonScript(module_names=ghpythonremote.linked_modules)  # -> import_statements; inputs module_names: list
# ---------- python_2: Python ----------
import_statements = ["import scriptcontext as sc"]
for module_name in module_names:
    import_statements.append("{0} = sc.sticky['{0}']".format(module_name))

if len(module_names) == 0:
    import_statements = []
# ---------- end python_2 ----------
panel_3 = Panel(python_2)

# ----
panel_4 = Panel("C:\Users\yijiangh\Documents\pb_ws\pb-construction\assembly_instances\extrusion")
panel_5 = Panel("tre_foil_knot.json")
panel_6 = Panel("klein_bottle_trail_S2.json")
panel_7 = Panel("klein_bottle_trail.json")
number_slider = Slider(1, range=0..100)
panel_8 = Panel("C:\Users\yijiangh\Documents\pb_ws\pychoreo\src\pychoreo_examples\data\assembly_instances\extrusion")

# ---- group: file name
text = Text()

# ----
panel_9 = Panel("C:\Users\yijiangh\Documents\pb_ws\pb-construction\assembly_instances\extrusion")
ghpython_script = GhPythonScript(file_name=text)  # -> out, shape_file_name
# ---------- ghpython_script: Python ----------
shape_file_name = file_name.split('_' + interfix)[0] + '.json'
# ---------- end ghpython_script ----------
number = Number(number_slider)
concatenate = Concatenate(Fragment_A=panel_4, A="\", Fragment_B="tre_foil_knot_S1.5.json")
text_2 = Text(concatenate)
text_3 = Text(panel_9)
conmech_engine = ValueList({"numpy", "cpp"}, selected="numpy")
panel_10 = Panel("1")
text_4 = Text(ghpython_script.shape_file_name)
ghpython_script_2 = GhPythonScript()  # -> a
# ---------- ghpython_script_2: Python ----------
__author__ = "yijiangh"
__version__ = "2019.04.28"

import rhinoscriptsyntax as rs

a = [125, 126, 115, 122, 111, 108, 23, 22, 98, 75, 64, 34, 61, 65, 59, 60, 39, 36, 44, 67]
# ---------- end ghpython_script_2 ----------
concatenate_2 = Concatenate(Fragment_A=text_3, A="\", Fragment_B=text_4)
ghpython_script_3 = GhPythonScript(file_path=text_2, scale=Slider(1, range=0..1000))  # -> out, all_nodes, all_elements, simplify(all_element_node_ids), all_fix_node_ids, material_name, E, E_unit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
# ---------- ghpython_script_3: Python ----------
__author__ = "yijiangh"
__version__ = "2019.04.28"

import json
import os
import rhinoscriptsyntax as rs
import Rhino.Geometry as rg
import ghpythonlib.components as ghcomp
import ghpythonlib.treehelpers as th
import Grasshopper.DataTree as DataTree # Add, AddRange(list, GHPath(i, j))
import Grasshopper.Kernel.Data.GH_Path as GHPath
import System

def parse_point(json_point, scale=1.0):
#    return scale * np.array([json_point['X'], json_point['Y'], json_point['Z']])
    return rg.Point3d(scale*json_point['X'], scale*json_point['Y'], scale*json_point['Z'])

def parse_elements(json_data, parse_layers=False):
    if not parse_layers:
        return [json_element['end_node_ids']
            for json_element in json_data['element_list']]
#    else:
#        return [AssemblyElement(node_ids=json_element['end_node_ids'], layer_id=json_element['layer_id'], e_id=i)
#                for i, json_element in enumerate(json_data['element_list'])]

def parse_node_points(json_data, scale=1.0):
#    origin = parse_origin(json_data)
    return [parse_point(json_node['point'],scale) for json_node in json_data['node_list']]

def parse_ground_nodes(json_data):
    return {i for i, json_node in enumerate(json_data['node_list']) if json_node['is_grounded'] == 1}

# main

fp = os.path.join(file_path, file_name)

with open(fp, 'r') as f:
    json_data = json.loads(f.read())

element_vids = parse_elements(json_data, parse_layers=False)
node_points = parse_node_points(json_data, scale)
ground_nodes = parse_ground_nodes(json_data)

elements = []
for vids in element_vids:
    elements.append(rg.Line(node_points[vids[0]], node_points[vids[1]]))
    
    
print('Assembly: {} | Model: {} | Unit: {}'.format(
json_data['assembly_type'], json_data['model_type'], json_data['unit'])) # extrusion, spatial_frame, millimeter
print('Nodes: {} | Ground: {} | Elements: {}'.format(
len(node_points), len(ground_nodes), len(elements)))

partial_node_ids = set()
partial_elements = []
partial_ground_nodes = []
if not use_partial_ids:
    partial_ids = list(range(len(elements)))
    
for c_e in partial_ids:
    partial_node_ids.update([element_vids[c_e][0], element_vids[c_e][1]])
    partial_elements.append(rg.Line(node_points[element_vids[c_e][0]], node_points[element_vids[c_e][1]]))
    if element_vids[c_e][0] in ground_nodes:
        partial_ground_nodes.append(element_vids[c_e][0])
    if element_vids[c_e][1] in ground_nodes:
        partial_ground_nodes.append(element_vids[c_e][1])
        

material_name = json_data['material_properties']['material_name']
E = json_data['material_properties']['youngs_modulus']
E_unit = json_data['material_properties']['youngs_modulus_unit']

G = json_data['material_properties']['shear_modulus']
G_unit = json_data['material_properties']['shear_modulus_unit']

#sigma = json_data['material_properties']['tensile_yeild_stress']
#sigma_unit = json_data['material_properties']['tensile_yeild_stress_unit']

rho = json_data['material_properties']['density']
rho_unit = json_data['material_properties']['density_unit']

if 'radius' in json_data['material_properties']:
    r = json_data['material_properties']['radius']
    r_unit = json_data['material_properties']['radius_unit']
    
element_vids = th.list_to_tree(element_vids)
# ---------- end ghpython_script_3 ----------

# ----
# parse shape
ghpython_script_4 = GhPythonScript(file_path=text_3, file_name=text_4, use_partial_ids=Toggle(False), partial_ids=ghpython_script_2, scale="1e-3")  # -> out, node_points, ground_nodes, elements, simplify(element_vids), partial_elements, partial_node_ids, partial_ground_nodes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; inputs use_partial_ids: Boolean, partial_ids: list of Int32; same code as ghpython_script_3

data = Data(ghpython_script_4.material_name)
panel_11 = Panel(data)
point = Point(ghpython_script_4.node_points)
curve = Curve(ghpython_script_4.elements)
curve_2 = Curve(curve)
list_length = ListLength(List=curve_2)
series = Series(Start=0, Step=1, Count=list_length)
integer = Integer(series)
ghpython_script_5 = GhPythonScript(
    frame_json_file_path=concatenate,
    existing_ids=integer,
    include_sw=Toggle(True),
    gravity_scale=number,
    engine=conmech_engine)  # -> out, solve_success, element_reaction, node_displacement, fixities_reaction, local_coordinate_frames, compliance, nodal_loads; inputs existing_ids: list of Int32, include_sw: Boolean
# ---------- ghpython_script_5: Python ----------
import rhinoscriptsyntax as rs
import Rhino.Geometry as rg
from Grasshopper import DataTree as datatree
from Grasshopper.Kernel.Data import GH_Path as ghpath
import System
import os
import json

from ghpythonlib.treehelpers import list_to_tree

import scriptcontext as sc
pyconmech = sc.sticky['pyconmech']
#numpy = sc.sticky['numpy']
#numpy.linalg = sc.sticky['numpy.linalg']

sc = pyconmech.frame_analysis.stiffness_checker.StiffnessChecker.from_json(json_file_path=frame_json_file_path, checker_engine=engine)
sc.set_loads(include_self_weight=include_sw, gravity_direction=[0,0,-gravity_scale])
is_stiff = sc.solve(existing_ids)

json_data = sc.get_result_data(output_frame_transf=True)
trans_tol, rot_tol = sc.get_nodal_deformation_tol()
max_trans, max_rot, max_trans_vid, max_rot_vid = sc.get_max_nodal_deformation()
compliance = sc.get_compliance()

#print('trans tol : {}, rot_tol : {}'.format(json_data['trans_tol'], json_data['rot_tol']))
print('Test stiffness on problem: {}'.format(frame_json_file_path))
# The inverse of stiffness is flexibility or compliance
print('Stiff: {} | Compliance: {}'.format(is_stiff, compliance))
print('Max translation deformation: {0:.5f} / {1:.5} = {2:.5}, at node #{3}'.format(
    max_trans, trans_tol, max_trans / trans_tol, max_trans_vid))
print('Max rotation deformation: {0:.5f} / {1:.5} = {2:.5}, at node #{3}'.format(
    max_rot, rot_tol, max_rot / rot_tol, max_rot_vid))


nd_tree = datatree[System.Double]()
er_tree = datatree[System.Double]()
fr_tree = datatree[System.Double]()
local_planes = datatree[System.Double]()

for nd_data in json_data['node_displacement']:
    n_id = nd_data['node_id']
    nd_tree.AddRange(list(nd_data['displacement']), ghpath(n_id))

for fr_data in json_data['fixity_reaction']:
    n_id = fr_data['node_id']
    fr_tree.AddRange(list(fr_data['reaction']), ghpath(n_id))

#for er_data in json_data['element_reaction']:
#    e_id = er_data['element_id']
#    er_tree.AddRange(list(er_data['reaction'][0]), ghpath(e_id, 0))
#    er_tree.AddRange(list(er_data['reaction'][1]), ghpath(e_id, 1))
#    e_LG = er_data['local_to_global_transformation']
#    for i in range(3):
#        for j in range(3):
#            num = e_LG[j][i]
#            local_planes.Add(num, ghpath(e_id, j))

element_reaction = er_tree
node_displacement = nd_tree
fixities_reaction = fr_tree
local_coordinate_frames = local_planes
compliance = sc.get_compliance()

np_nodal_loads = sc.get_nodal_loads()
nodal_loads = datatree[System.Double]()

for node_id, load in np_nodal_loads.items():
    nodal_loads.AddRange(list(load.tolist()), ghpath(node_id))
# ---------- end ghpython_script_5 ----------
integer_2 = Integer(integer)
ghpython_script_6 = GhPythonScript(
    existing_e_ids=integer_2,
    all_element_node_ids=ghpython_script_4.element_vids,
    all_fix_node_ids=ghpython_script_4.partial_ground_nodes)  # -> out, exist_fix_node_ids, existing_node_ids; inputs existing_e_ids: list of Int32, all_element_node_ids: tree of Int32, all_fix_node_ids: list of Int32; disabled
# ---------- ghpython_script_6: Python ----------
from ghpythonlib.treehelpers import list_to_tree, tree_to_list

element_vids = tree_to_list(all_element_node_ids, lambda x : x)
existing_e_ids = existing_e_ids or list(range(len(element_vids)))

existing_node_ids = set()
for e_id, e_tuple in enumerate(element_vids):
    if e_id in existing_e_ids:
        existing_node_ids.update(e_tuple)

print(all_fix_node_ids)

exist_fix_node_ids = [int(v) for v in all_fix_node_ids if v in existing_node_ids]
existing_node_ids = list(existing_node_ids)
#existing_elements = datatree[System.Object]()
#for e_id in existing_ids:
#    existing_elements.Add(rg.Line(all_nodes[element_vids[e_id][0]], all_nodes[element_vids[e_id][1]]), ghpath(e_id))
#
#existing_nodes = datatree[System.Object]()
#for n_id in existing_node_ids:
#    existing_nodes.Add(all_nodes[n_id], ghpath(n_id))
# ---------- end ghpython_script_6 ----------
panel_12 = Panel(ghpython_script_5.out)
number_2 = Number(ghpython_script_5.nodal_loads)
number_3 = Number(ghpython_script_5.local_coordinate_frames)
panel_13 = Panel(number_2)
panel_14 = Panel(ghpython_script_6.exist_fix_node_ids)
list_item = ListItem(List=curve, Index=integer_2, Wrap=True)
data_2 = Data(ghpython_script_4.r)
material_properties_karamba3d = MaterialPropertiesKaramba3D(
    FamilyOfMaterial=panel_11,
    Name="0",
    YoungsModulus_kN_cm2=ghpython_script_4.E,
    InPlaneShearModulus_kN_cm2=ghpython_script_4.G,
    TransverseShearModulus_kN_cm2=ghpython_script_4.G,
    SpecificWeight_kN_m3=ghpython_script_4.rho,
    CoefficientOfThermalExpansion_1_C=1e-05,
    YieldStrength_kN_cm2=23.5,
    mode="Isotrop")
panel_15 = Panel(data_2)
curve_3 = Curve(list_item)
panel_16 = Panel(material_properties_karamba3d)
integer_3 = Integer(ghpython_script_6.existing_node_ids)
integer_4 = Integer(ghpython_script_6.exist_fix_node_ids)

# ----
# all nodes
point_2 = Point(point)

list_item_2 = ListItem(List=point_2, Index=integer_4, Wrap=True)
list_item_3 = ListItem(List=point_2, Index=integer_3, Wrap=True)

# ----
# existing nodes
point_3 = Point(flatten(list_item_3))

# ----
# existing elements
curve_4 = Curve(flatten(curve_3))

# ----
# grounded nodes
point_4 = Point(list_item_2)

cluster = Cluster_3(model=curve_4)
integer_5 = Integer(graft(integer_3))
point_5 = Point(point_3)
cluster_2 = Cluster_4(pts=point_5, target_pts=point_4, list=point_5)
construct_path = ConstructPath(Indices=integer_5)  # -> flatten(Branch)
number_4 = Number(number_2)
split_tree = SplitTree(Data=number_4, Masks=flatten(construct_path))  # -> Positive, Negative
number_5 = Number(panel_15)
material_karamba3d = MaterialKaramba3D(material_properties_karamba3d)
material_karamba3d_2 = MaterialKaramba3D("")
number_6 = Number(ghpython_script_5.compliance)
conmech_compliance = Panel(number_6)
number_7 = Number(ghpython_script_5.fixities_reaction)

applied_force_to_karamba = ValueList({"karamaba gravity": 0, "conmech lumped gravity": 1}, selected="conmech lumped gravity")
order_node_metric = ValueList({"max_coordinate": 0, "max_norm": 1}, selected="max_norm")
visualize_top_nodes = ValueList({"no-show": 0, "karamba": 1, "conmech": 2}, selected="karamba")

number_slider_2 = Slider(10, range=0..90)

# ----
# Partial structure
curve_5 = Curve(curve)  # disabled
integer_6 = Integer(ghpython_script_4.partial_ground_nodes)  # disabled
point_6 = Point(point)  # disabled
list_item_4 = ListItem(List=point_6, Index=integer_6, Wrap=True)  # disabled
number_8 = Number(number_slider)
curve_6 = Curve(curve_5)  # disabled
number_9 = Number(panel_15)  # disabled

# ---- group: full structure
number_10 = Number(0.15)
curve_7 = Curve(curve_4)
cluster_3 = Cluster_2(
    integer=applied_force_to_karamba,
    number_2=number_8,
    number=split_tree.Positive,
    point=point_4,
    point_2=point_5,
    line=curve_7,
    material=material_karamba3d_2,
    thickness=number_10)  # -> result, data, result_2, keys, elastic_energy_knm, calculated_model

# ----
cluster_4 = Cluster_2(
    number_2=number_8,
    point=list_item_4,
    point_2=point_6,
    line=curve_6,
    material=material_properties_karamba3d,
    thickness=number_10)  # -> result, data, result_2, keys, elastic_energy_knm, calculated_model; disabled

number_11 = Number(cluster_3.elastic_energy_knm)
karamba_compliance = Panel(number_11)
model_view_karamba3d = ModelViewKaramba3D(Model=cluster_3.calculated_model, LoadCaseFactorsForLinearSuperposition=1, IndexOfVisibleLoadcase=-1)  # -> Model, DeformedMesh, DeformedAxes, DeformedModel
number_12 = Number(cluster_3.result_2)

number_13 = Number(cluster_3.result)
number_14 = Number(ghpython_script_5.element_reaction)
internal_froce_kn_moment_kn_m = Panel(number_13)
panel_18 = Panel(number_14)

number_15 = Number(ghpython_script_5.node_displacement)
number_16 = Number(cluster_3.data)
karamba = Panel(number_16)
conmech = Panel(number_15)

match_tree = MatchTree(Tree=number_7, Guide=number_12)
reaction_force_kn_reaction_moment_kn_m = Panel(number_12)
panel_19 = Panel(match_tree)
beam_view_karamba3d = BeamViewKaramba3D(Model=model_view_karamba3d.Model)  # -> Model, MeshesOfRenderedBeams, DeformedBeamAxes, LegendColors, LegendTags
subtraction = Subtraction(A=number_16, B=number_15)
absolute = Absolute(Value=number_16)
split_tree_2 = SplitTree(Data=number_13, Masks=flatten("{*;0}"))  # -> Positive, Negative
split_tree_3 = SplitTree(Data=number_14, Masks=flatten("{*;0}"))  # -> Positive, Negative

# ---- group: karamba
cluster_5 = Cluster_5(gate=order_node_metric, list=karamba)  # -> keys, values_a

# ----
cluster_6 = Cluster_5(gate=order_node_metric, list=conmech)  # -> keys, values_a
absolute_2 = Absolute(Value=subtraction)
number_17 = Number(split_tree_2.Positive)
legend = Legend(Colour=beam_view_karamba3d.LegendColors, Tags=beam_view_karamba3d.LegendTags, LegendType=1)
karamba_2 = Panel(cluster_5.values_a)
karamba_3 = Panel(cluster_5.keys)
division = Division(A=absolute_2, B=absolute)

subtraction_2 = Subtraction(A=number_12, B=match_tree)
absolute_3 = Absolute(Value=number_12)
absolute_4 = Absolute(Value=subtraction_2)
division_2 = Division(A=absolute_4, B=absolute_3)
panel_20 = Panel(division_2)
list_item_5 = ListItem(List=division_2, Index=0, Wrap=True)  # -> flatten(Item), flatten(Item1), flatten(Item2), flatten(Item3), flatten(Item4), flatten(Item5)
X = BarGraph(list_item_5.Item, BarColor=RGB(255, 0, 90))
bar_graph = BarGraph(list_item_5.Item1, BarColor=RGB(255, 0, 90))
bar_graph_2 = BarGraph(list_item_5.Item2, BarColor=RGB(255, 0, 90))
bar_graph_3 = BarGraph(list_item_5.Item4, BarColor=RGB(255, 0, 90))
bar_graph_4 = BarGraph(list_item_5.Item5, BarColor=RGB(255, 0, 90))
bar_graph_5 = BarGraph(list_item_5.Item3, BarColor=RGB(255, 0, 90))
number_18 = Number(split_tree_2.Negative)

panel_21 = Panel(cluster_6.keys)
list_item_6 = ListItem(List=division, Index=0, Wrap=True)  # -> flatten(Item), flatten(Item1), flatten(Item2), flatten(Item3), flatten(Item4), flatten(Item5)
panel_22 = Panel(cluster_6.values_a)

subtraction_3 = Subtraction(A=number_17, B=split_tree_3.Positive)
absolute_5 = Absolute(Value=number_17)
absolute_6 = Absolute(Value=subtraction_3)
division_3 = Division(A=absolute_6, B=absolute_5)
panel_23 = Panel(division_3)
list_item_7 = ListItem(List=division_3, Index=0, Wrap=True)  # -> flatten(Item), flatten(Item1), flatten(Item2), flatten(Item3), flatten(Item4), flatten(Item5)
X_2 = BarGraph(list_item_7.Item, BarColor=RGB(255, 0, 90))
bar_graph_6 = BarGraph(list_item_7.Item1, BarColor=RGB(255, 0, 90))
bar_graph_7 = BarGraph(list_item_7.Item2, BarColor=RGB(255, 0, 90))
bar_graph_8 = BarGraph(list_item_7.Item4, BarColor=RGB(255, 0, 90))
bar_graph_9 = BarGraph(list_item_7.Item5, BarColor=RGB(255, 0, 90))
bar_graph_10 = BarGraph(list_item_7.Item3, BarColor=RGB(255, 0, 90))

cluster_7 = Cluster_6(list=cluster_5.values_a, index=number_slider_2, point=point_2)
cluster_8 = Cluster_6(list=cluster_6.values_a, index=number_slider_2, point=point_2)
X_3 = BarGraph(cluster_5.keys, BarColor=RGB(255, 0, 90))
X_4 = BarGraph(cluster_6.keys, BarColor=RGB(255, 0, 90))

X_5 = BarGraph(list_item_6.Item, BarColor=RGB(255, 0, 90))
bar_graph_11 = BarGraph(list_item_6.Item1, BarColor=RGB(255, 0, 90))
bar_graph_12 = BarGraph(list_item_6.Item2, BarColor=RGB(255, 0, 90))
bar_graph_13 = BarGraph(list_item_6.Item4, BarColor=RGB(255, 0, 90))
bar_graph_14 = BarGraph(list_item_6.Item5, BarColor=RGB(255, 0, 90))
bar_graph_15 = BarGraph(list_item_6.Item3, BarColor=RGB(255, 0, 90))

stream_filter = StreamFilter(Gate=visualize_top_nodes, Stream1=cluster_7, Stream2=cluster_8)
list_length_2 = ListLength(List=stream_filter)
sphere = Sphere(Base=stream_filter, Radius=Slider(0.006, range=0..0.01))
series_2 = Series(Start=0, Step=1, Count=list_length_2)  # -> flatten(Series)
list_item_8 = ListItem(List=series_2, Index=0, Wrap=True)  # -> Item1, Item
division_4 = Division(A=series_2, B=list_item_8.Item1)
subtraction_4 = Subtraction(A="1", B=division_4)
multiplication = Multiplication(A=ColourSwatch(SwatchColor=RGB(255, 255, 0)), B=division_4)
multiplication_2 = Multiplication(A=ColourSwatch(SwatchColor=RGB(255, 0, 0)), B=subtraction_4)
number_19 = Number(split_tree_2.Negative)
addition = Addition(A=multiplication, B=multiplication_2)
custom_preview = CustomPreview(Geometry=sphere, Material=addition)

subtraction_5 = Subtraction(A=number_19, B=split_tree_3.Negative)
absolute_7 = Absolute(Value=number_19)
absolute_8 = Absolute(Value=subtraction_5)
division_5 = Division(A=absolute_8, B=absolute_7)
panel_24 = Panel(division_5)
list_item_9 = ListItem(List=division_5, Index=0, Wrap=True)  # -> flatten(Item), flatten(Item1), flatten(Item2), flatten(Item3), flatten(Item4), flatten(Item5)
X_6 = BarGraph(list_item_9.Item, BarColor=RGB(255, 0, 90))
bar_graph_16 = BarGraph(list_item_9.Item1, BarColor=RGB(255, 0, 90))
bar_graph_17 = BarGraph(list_item_9.Item2, BarColor=RGB(255, 0, 90))
bar_graph_18 = BarGraph(list_item_9.Item4, BarColor=RGB(255, 0, 90))
bar_graph_19 = BarGraph(list_item_9.Item5, BarColor=RGB(255, 0, 90))
bar_graph_20 = BarGraph(list_item_9.Item3, BarColor=RGB(255, 0, 90))

# ==== cluster Cluster_2
integer = ClusterInput()
number = ClusterInput()
number_2 = ClusterInput()
point = ClusterInput()
material = ClusterInput()
thickness = ClusterInput()
line = ClusterInput()
point_2 = ClusterInput()
# Gravity load
integer_2 = Integer(integer)
number_3 = Number(number_2)
point_3 = Point(point)
number_4 = Number(number)
tree_statistics = TreeStatistics(Tree=number_4)  # -> Paths, Length, Count
unit_z = UnitZ(Factor=number_3)
# Supports
support_karamba3d = SupportKaramba3D(PosInd=point_3, menu=[buttons(on, on, on, on, on, on)])
list_item = ListItem(List=number_4, Index=0, Wrap=True)  # -> Item, Item1, Item2, Item3, Item4, Item5
negative = Negative(Value=unit_z)
deconstruct_path = DeconstructPath(Branch=tree_statistics.Paths)  # -> simplify(Indices)
multiplication = Multiplication(A=thickness, B="2")
vector_xyz = VectorXYZ(XComponent=list_item.Item, YComponent=list_item.Item1, ZComponent=list_item.Item2)  # -> Vector, Length
vector_xyz_2 = VectorXYZ(XComponent=list_item.Item3, YComponent=list_item.Item4, ZComponent=list_item.Item5)  # -> Vector, Length
panel = Panel(deconstruct_path)
point_4 = Point(point_2)
support_karamba3d_2 = SupportKaramba3D(support_karamba3d)
cross_section_karamba3d = CrossSectionKaramba3D(
    FamilyNameOfCrossSection="DefaultCroSec",
    Material=material,
    Diameter_cm=multiplication,
    WallThickness_cm=thickness,
    mode="Circular Hollow")
stream_filter = StreamFilter(Gate=integer_2, Stream0=<missing>, Stream1=<missing>)  # -> flatten(Stream)
line_to_beam_karamba3d = LineToBeamKaramba3D(Line=line, CrossSection=cross_section_karamba3d, Points=point_4, New=True, Remove=True, LimitDistance_m=0.005)  # -> Element, Points, Info
load_karamba3d = LoadKaramba3D(stream_filter)
assemble_model_karamba3d = AssembleModelKaramba3D(
    Point=point_4,
    Elem=line_to_beam_karamba3d.Element,
    Support=support_karamba3d_2,
    Load=load_karamba3d,
    LimitDistance_m="1e-12")  # -> Model, Info, Mass_kg, CenterOfGravity
license_karamba3d = LicenseKaramba3D()
panel_2 = Panel(license_karamba3d)
analyze_karamba3d = AnalyzeKaramba3D(Model=assemble_model_karamba3d.Model)  # -> CalculatedModel, MaximumDisplacement_cm, ResultingForceOfGravity_kN, ElasticEnergy_kNm
reaction_forces_karamba3d = ReactionForcesKaramba3D(AnalyzedModel=analyze_karamba3d.CalculatedModel, LoadCase=0)  # -> AnalyzedModel, ReactionForces_kN, ReactionMoments_kNm, SupportPosition, SumOfReactionForces_kN, SumOfReactionMoments_kNm
nodal_displacements_karamba3d = NodalDisplacementsKaramba3D(AnalyzedModel=analyze_karamba3d.CalculatedModel, LoadCase=0)  # -> AnalyzedModel, NodalTranslations_m, NodalRotations_rad
beam_forces_karamba3d = BeamForcesKaramba3D(
    AnalyzedModel=analyze_karamba3d.CalculatedModel,
    LCase=-1,
    MaximumDistanceBetweenResults_m=-1,
    NumberOfResultsPerBeamElement=2)  # -> AnalyzedModel, NormalForce_kN, ShearForceVz_kN, ShearForceVy_kN, BendingMomentMt_kNm, BendingMomentMy_kNm, BendingMomentMz_kNm
deconstruct = Deconstruct(Point=simplify(graft(reaction_forces_karamba3d.ReactionForces_kN)))  # -> XComponent, YComponent, ZComponent
deconstruct_2 = Deconstruct(Point=simplify(graft(reaction_forces_karamba3d.ReactionMoments_kNm)))  # -> XComponent, YComponent, ZComponent
merge = Merge(
    Data1=simplify(graft(nodal_displacements_karamba3d.NodalTranslations_m)),
    Data2=simplify(graft(nodal_displacements_karamba3d.NodalRotations_rad)))
evaluate = Evaluate(Expression="format(\"{0:E} {1:E} {2:E}\",x.x,x.y,x.z)", x=merge)
merge_2 = Merge(
    Data1=deconstruct.XComponent,
    Data2=deconstruct.YComponent,
    Data3=deconstruct.ZComponent,
    Data4=deconstruct_2.XComponent,
    Data5=deconstruct_2.YComponent,
    Data6=deconstruct_2.ZComponent)
merge_3 = Merge(
    Data1=graft(beam_forces_karamba3d.NormalForce_kN),
    Data2=graft(beam_forces_karamba3d.ShearForceVz_kN),
    Data3=graft(beam_forces_karamba3d.ShearForceVy_kN),
    Data4=graft(beam_forces_karamba3d.BendingMomentMt_kNm),
    Data5=graft(beam_forces_karamba3d.BendingMomentMy_kNm),
    Data6=graft(beam_forces_karamba3d.BendingMomentMz_kNm))  # -> simplify(Result)
evaluate_2 = Evaluate(Expression="format(\"{0:E}\",x)", x=merge_2)
cluster = Cluster(text=evaluate, separators=" ")
evaluate_3 = Evaluate(Expression="format(\"{0:E}\",x)", x=merge_3)
reaction_force_kn_reaction_moment_kn_m = Panel(merge_2)
shift_paths = ShiftPaths(Data=cluster, Offset=-1)
list_item_2 = ListItem(List=shift_paths, Index=0, Wrap=True)  # -> Item, Item1, Item2
froce_kn_moment_kn_m = Panel(merge_3)
nodal_displacement_m_rad = Panel(shift_paths)
merge_4 = Merge(Data1=list_item_2.Item, Data2=list_item_2.Item1, Data3=list_item_2.Item2)
number_5 = Number(merge_4)
square = Square(Value=number_5)
mass_addition = MassAddition(Input=square)  # -> Result, PartialResults
square_root = SquareRoot(Value=mass_addition.Result)  # -> flatten(Result)
sort_list = SortList(Keys=square_root)  # -> reverse(Keys), ValuesValuesA
elastic_energy_knm = ClusterOutput(analyze_karamba3d.ElasticEnergy_kNm)
calculated_model = ClusterOutput(analyze_karamba3d.CalculatedModel)
result = ClusterOutput(merge_3)
data = ClusterOutput(shift_paths)
result_2 = ClusterOutput(merge_2)
keys = ClusterOutput(sort_list.Keys)

# ==== cluster Cluster_3
curve = Curve()
model = ClusterInput()
entwine = Entwine(Branch00=curve, FlattenInputs=True)
# element id shower
c_script = CSharpScript(model=model, layers=entwine)  # -> out, A, edge_layer_list; inputs model: list of Curve, layers: tree of Curve
# ---------- c_script: C# usings ----------
using System.IO;
using System.Linq;
using System.Data;
using System.Drawing;
using System.Reflection;
using System.Windows.Forms;
using System.Xml;
using System.Xml.Linq;
using System.Runtime.InteropServices;

using Rhino.DocObjects;
using Rhino.Collections;
using GH_IO;
using GH_IO.Serialization;
# ---------- c_script: C# ----------
    DataTree<int> index_tree = new DataTree<int>();
    List<int> edge_layer = new List<int>(new int[model.Count()]);

    foreach(var path in layers.Paths)
    {
      foreach(var line in layers.Branch(path.Indices))
      {
        for(int i = 0; i < model.Count(); i++)
        {
          var compare_line = model[i];

          if(line.PointAt(0) == compare_line.PointAt(0))
          {
            if(line.PointAt(1) == compare_line.PointAt(1))
            {
              index_tree.Add(i, path);
              edge_layer[i] = path.Indices[0];
              //              GH_Path p = new GH_Path(0);
              //              p.Indices
              continue;
            }
          }

          if(line.PointAt(0) == compare_line.PointAt(1))
          {
            if(line.PointAt(1) == compare_line.PointAt(0))
            {
              index_tree.Add(i, path);
              edge_layer[i] = path.Indices[0];
              continue;
            }
          }
        }
      }
    }

    A = index_tree;
    edge_layer_list = edge_layer;
# ---------- end c_script ----------
list_item = ListItem(List=model, Index=c_script.A, Wrap=True)
panel = Panel(c_script.A)
ghpython_script = GhPythonScript(x=panel)  # -> out, a; inputs x: list
# ---------- ghpython_script: Python ----------
__author__ = "harry"
__version__ = "2019.08.22"

import rhinoscriptsyntax as rs

print([int(v) for v in x])
# ---------- end ghpython_script ----------

# ==== cluster Cluster_4
pts = ClusterInput()
target_pts = ClusterInput()
c_script = CSharpScript(pts=pts, target_pts=target_pts, dist_tol=0.001)  # -> out, A; inputs pts: list of Point3d, target_pts: list of Point3d, dist_tol: Double; disabled
# ---------- c_script: C# usings ----------
using System.IO;
using System.Linq;
using System.Data;
using System.Drawing;
using System.Reflection;
using System.Windows.Forms;
using System.Xml;
using System.Xml.Linq;
using System.Runtime.InteropServices;

using Rhino.DocObjects;
using Rhino.Collections;
using GH_IO;
using GH_IO.Serialization;
# ---------- c_script: C# ----------
    List<int> id = new List<int>();

    foreach(Point3d t_pt in target_pts)
    {
      for(int i = 0; i < pts.Count(); i++)
      {
        if(t_pt.DistanceTo(pts[i]) < dist_tol)
        {
          id.Add(i);
          break;
        }
      }
    }

    A = id;
# ---------- end c_script ----------
list = ClusterInput()
list_item = ListItem(List=list, Index=c_script.A, Wrap=True)  # disabled

# ==== cluster Cluster_5
list = ClusterInput()
gate = ClusterInput()
list_item = ListItem(List=list, Index=0, Wrap=True)  # -> Item, Item1, Item2
vector_xyz = VectorXYZ(XComponent=list_item.Item, YComponent=list_item.Item1, ZComponent=list_item.Item2)  # -> Vector, Length
merge = Merge(Data1=list_item.Item, Data2=list_item.Item1, Data3=list_item.Item2)
absolute = Absolute(Value=merge)
stream_filter = StreamFilter(Gate=gate, Stream0=absolute, Stream1=vector_xyz.Length)
sort_list = SortList(Keys=stream_filter)  # -> Keys, ValuesValuesA
list_item_2 = ListItem(List=sort_list.Keys, Index=0, Wrap=True)  # -> Item1, Item
tree_statistics = TreeStatistics(Tree=list_item_2.Item1)  # -> Paths, Length, Count
deconstruct_path = DeconstructPath(Branch=tree_statistics.Paths)  # -> flatten(Indices)
sort_list_2 = SortList(Keys=flatten(list_item_2.Item1), ValuesValuesA=deconstruct_path)  # -> reverse(Keys), reverse(ValuesValuesA)
keys = ClusterOutput(sort_list_2.Keys)
values_a = ClusterOutput(sort_list_2.ValuesValuesA)

# ==== cluster Cluster_6
point = ClusterInput()
list = ClusterInput()
index = ClusterInput()
split_list = SplitList(List=list, Index=index)  # -> ListA, ListB
point_2 = Point(point)
list_item = ListItem(List=point_2, Index=split_list.ListA, Wrap=True)
point_3 = Point(list_item)
point_4 = ClusterOutput(point_3)

# ==== cluster Cluster
text = ClusterInput()
separators = ClusterInput()
text_split = TextSplit(Text=text, Separators=separators)
number = Number(text_split)
clean_tree = CleanTree(RemoveNulls=True, RemoveInvalid=True, RemoveEmpty=False, Tree=number)
tree = ClusterOutput(clean_tree)
