# Grasshopper definition analytical_solution_export.ghx (Grasshopper 1.0.7)
# plug-ins: karambaGH

panel = Panel("""        "material_name": "element_bc_mat",
        "_model_source": "MSA_ex4.8_page79",
        "youngs_modulus": 20000.0,
        "youngs_modulus_unit": "kN/cm2",
        "poisson_ratio": 0.3,
        "density": 78.5,
        "density_unit": "kN/m3",
        "cross_sec_area": 40.0,
        "cross_sec_area_unit": "centimeter^2",
        "Jx": 10.0,
        "Jx_unit": "centimeter^4",
        "Iy": 5000.0,
        "Iy_unit": "centimeter^4",
        "Iz": 5000.0,
        "Iz_unit": "centimeter^4"
""")
panel_2 = Panel("""        "material_name": "element_ab_mat",
        "_model_source": "MSA_ex4.8_page79",
        "youngs_modulus": 20000.0,
        "youngs_modulus_unit": "kN/cm2",
        "poisson_ratio": 0.3,
        "density": 78.5,
        "density_unit": "kN/m3",
        "cross_sec_area": 60.0,
        "cross_sec_area_unit": "centimeter^2",
        "Jx": 30.0,
        "Jx_unit": "centimeter^4",
        "Iy": 20000.0,
        "Iy_unit": "centimeter^4",
        "Iz": 20000.0,
        "Iz_unit": "centimeter^4"
""")
panel_3 = Panel("""0,0,0
5,0,0
5,8,0""")
panel_4 = Panel("""0
1""")
panel_5 = Panel("""1
2""")
panel_6 = Panel("""ab
bc""")
index_to_beam_karamba3d = IndexToBeamKaramba3D(IndexA=panel_4, IndexB=panel_5, Identifier=panel_6)
ghpython_script = GhPythonScript(E="2e4", mu="0.3")  # -> out, a
# ---------- ghpython_script: Python ----------
def mu2G(mu, E):
    """compute shear modulus from poisson ratio mu and Youngs modulus E
    """
    return E/(2*(1+mu))

def G2mu(G, E):
    """compute poisson ratio from shear modulus and Youngs modulus E
    """
    return E/(2*G)-1

def compute_E(G, mu):
    return 2*G*(1+mu)

assert not (E is not None and G is not None and mu is not None), 'confused, at least one of them should be None!'
if E is not None and G is not None:
    a = G2mu(G, E)
elif E is not None and mu is not None:
    a = mu2G(mu, E)
elif G is not None and mu is not None:
    a = compute_E(G, mu)
else:
    assert False, "Data input not valid!"
# ---------- end ghpython_script ----------
text_split = TextSplit(Text="uniform_load_analytical_model.json", Separators=".")
panel_7 = Panel("""0
2""")
point = Point(panel_3)
cross_section_karamba3d = CrossSectionKaramba3D(
    FamilyNameOfCrossSection="DefaultCroSec",
    ElementIdentifier=["ab", "bc"],
    Material=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,
    Diameter_cm=11.43,
    WallThickness_cm=0.4,
    mode="Circular Hollow")
vector = Vector("0,0,-3")
vector_2 = Vector("0,0,-5")
list_item = ListItem(List=text_split, Index=0, Wrap=True)
material_properties_karamba3d = MaterialPropertiesKaramba3D(
    FamilyOfMaterial="Steel",
    Name="mat",
    ElementIdentifier=["bc", "ab"],
    YoungsModulus_kN_cm2="2e4",
    InPlaneShearModulus_kN_cm2=ghpython_script.a,
    TransverseShearModulus_kN_cm2=ghpython_script.a,
    SpecificWeight_kN_m3=78.5,
    CoefficientOfThermalExpansion_1_C=1e-05,
    YieldStrength_kN_cm2=23.5,
    mode="Isotrop")
loads_karamba3d = LoadsKaramba3D(ForceVector=vector_2, Local=False, PosInd="1", LCase=0, mode="Point")
loads_karamba3d_2 = LoadsKaramba3D(Vector=vector, BeamIdentifiers="ab", LCase=0, mode="Uniform Line", menu=[buttons(off, on, off)])
support_karamba3d = SupportKaramba3D(PosInd=panel_7, menu=[buttons(on, on, on, on, on, on)])
load_karamba3d = LoadKaramba3D([loads_karamba3d, loads_karamba3d_2])
modify_cross_section_karamba3d = ModifyCrossSectionKaramba3D(
    CroSec=cross_section_karamba3d,
    TypeNameOfCrossSection="custom",
    FamilyNameOfCrossSection="custom",
    Area_cm2="60",
    Iyy_cm4="20000",
    Izz_cm4="20000",
    Ipp_cm4="30",
    mode="Beam")
material_karamba3d = MaterialKaramba3D(material_properties_karamba3d)
disassemble_cross_section_karamba3d = DisassembleCrossSectionKaramba3D(CroSec=modify_cross_section_karamba3d)  # -> CrossSection, FamilyNameOfCrossSection, TypeNameOfCrossSection, ElemIdentifiers, Color, Material, LocalEccentricity_cm, Heights_cm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
cross_section_karamba3d_2 = CrossSectionKaramba3D(modify_cross_section_karamba3d)
support_karamba3d_2 = SupportKaramba(flatten(support_karamba3d))
material_karamba3d_2 = MaterialKaramba3D(material_karamba3d)
assemble_model_karamba3d = AssembleModelKaramba3D(
    Point=point,
    Elem=index_to_beam_karamba3d,
    Support=support_karamba3d,
    Load=load_karamba3d,
    CrossSection=cross_section_karamba3d_2,
    Material=material_karamba3d_2,
    LimitDistance_m=0.005)  # -> Model, Info, Mass_kg, CenterOfGravity
model_karamba3d = ModelKaramba3D(assemble_model_karamba3d.Model)
rhino_doc_dir = RhinoDocDir()  # -> rhino_doc_dir
# ---------- rhino_doc_dir: Python ----------
import scriptcontext as sc
from os import path

rhino_doc_dir = path.abspath(path.dirname(sc.doc.Path))
# ---------- end rhino_doc_dir ----------
analyze_karamba3d = AnalyzeKaramba3D(Model=assemble_model_karamba3d.Model)  # -> CalculatedModel, MaximumDisplacement_cm, ResultingForceOfGravity_kN, ElasticEnergy_kNm
text = Text(flatten(list_item))
concatenate = Concatenate(FragmentA=rhino_doc_dir, FragmentB="\..\..\tests\test_data")
format_json = BooleanToggle(True)
export_json = BooleanToggle(False)
panel_8 = Panel(text)
panel_9 = Panel(concatenate)

# ---- group: convert a karamba model into conmech format and export
c_script = CSharpScript(
    k_model=model_karamba3d,
    k_grounded_nodes=support_karamba3d_2,
    model_name=panel_8,
    save_path=concatenate,
    export=export_json,
    format_json=format_json,
    Reference=["C:\Program Files\Rhino 6\Plug-ins\karambaCommon.dll", "C:\Program Files\Rhino 6\Plug-ins\karamba.gha", "D:\code_ws\pb_ws\conmech\examples\gh_scripts\karamba\Newtonsoft.Json.dll"])  # -> out, A; inputs k_grounded_nodes: list, model_name: String, save_path: String, export: Boolean, limit_distance: Double, format_json: Boolean
# ---------- c_script: C# usings ----------
using System.IO;
using Karamba.Models;
using Karamba.Nodes;
using Karamba.CrossSections;
using Karamba.Elements;
using Karamba.Loads;
using Karamba.Materials;
using Karamba.Supports;
using Karamba.Geometry;
using Karamba.Joints;
using Newtonsoft.Json;
# ---------- c_script: C# ----------
    var k_model = _k_model as Model;
    if (k_model == null) {
      throw new ArgumentException("The input is not of type karamba model!");
    }
    if (limit_distance == 0) {
      limit_distance = 0.005; // meter
    }

    // initiate nodes with id and position
    var c_nodes = k_model.nodes.ConvertAll(kn => new ConmechFrameNode(kn));

    // support fixities & gounded node tags
    var k_grounded = _k_grounded_nodes.ConvertAll(x => x as Support);

    // tag grounded
    foreach(Support k_supp in k_model.supports) {
      foreach(Support k_g in k_grounded) {
        if (k_g == null) {
          throw new ArgumentException("The input is not of type karamba support!");
        }
        if(k_supp.position.DistanceTo(k_g.position) < limit_distance) {
          c_nodes[k_supp.node_ind].is_grounded = true;
        }
      }
    }

    // element data
    var c_elements = k_model.elems.ConvertAll(ke => new ConmechFrameElement(ke as ModelTruss));

    // support data
    var c_supports = k_model.supports.ConvertAll(ks => new ConmechSupport(ks as Support));

    // material data
    var c_mats = k_model.materials.ConvertAll(km => new ConmechFemMaterial(km));

    // cross section data
    var c_crosecs = k_model.crosecs.ConvertAll(kc => new ConmechCrossSec(kc as CroSec_Beam));

    // load data
    var c_ploads = k_model.ploads.ConvertAll(kl => new ConmechPointLoad(kl as PointLoad));
    var c_eloads = k_model.eloads.ConvertAll(kl => new ConmechUnifDistLoad(kl as UniformlyDistLoad));
    GravityLoad k_grav;
    ConmechGravityLoad c_grav = null;
    k_model.gravities.TryGetValue(0, out k_grav);
    if(k_grav != null){
      c_grav = new ConmechGravityLoad(k_grav);
    }

    // joint data
    var c_joints = k_model.joints.ConvertAll(kj => new ConmechJoint(kj));

    var c_model = new ConmechModel();
    c_model.model_name = model_name;
    c_model.generate_time = DateTime.Now.ToString();
    c_model.unit = "meter";
    c_model.element_num = k_model.elems.Count;
    c_model.node_num = k_model.nodes.Count;

    c_model.nodes = c_nodes;
    c_model.elements = c_elements;
    c_model.joints = c_joints;
    c_model.supports = c_supports;

    c_model.cross_secs = c_crosecs;
    c_model.materials = c_mats;

    var c_loadcase = new ConmechLoadCase();
    c_loadcase.ploads = c_ploads;
    c_loadcase.eloads = c_eloads;
    if(c_grav != null){
      c_loadcase.gravity = c_grav;
    }

    // save to json
    if(export) {
      JsonSerializer serializer = new JsonSerializer();
      serializer.NullValueHandling = NullValueHandling.Ignore;
      if(format_json) {
        serializer.Formatting = Newtonsoft.Json.Formatting.Indented;
      }
      // serialize shape to a json file
      string shape_file_path = String.Concat(save_path, Path.DirectorySeparatorChar,
        model_name, ".json");
      using (StreamWriter sw = new StreamWriter(@shape_file_path))
      using (JsonWriter writer = new JsonTextWriter(sw))
      {
        serializer.Serialize(writer, c_model);
      }
      Print("Shape saved to {0}", shape_file_path);

      // serialize load case to a json file
      string load_file_path = String.Concat(save_path, Path.DirectorySeparatorChar,
        model_name, "_loads.json");
      using (StreamWriter sw = new StreamWriter(@load_file_path))
      using (JsonWriter writer = new JsonTextWriter(sw))
      {
        serializer.Serialize(writer, c_loadcase);
      }
      Print("Load saved to {0}", load_file_path);
    }
# ---------- c_script: C# additional code ----------
  // TODO compile these into a dll
  //  public class cPoint3
  //  {
  //    public cPoint3(Point3 p) {
  //      X = p.X; Y = p.Y; Z = p.Z;
  //    }
  //    public cPoint3(Vector3 p) {
  //      X = p.X; Y = p.Y; Z = p.Z;
  //    }
  //    public double X { get; set; }
  //    public double Y { get; set; }
  //    public double Z { get; set; }
  //  }


  public class ConmechFrameNode
  {
    public ConmechFrameNode(Node k_node) {
      node_ind = -1;
      is_grounded = false;
      node_ind = k_node.ind;
      point = new List<double>(){k_node.pos.X, k_node.pos.Y, k_node.pos.Z};
    }
    public List<double> point { get; set; }
    public int node_ind { get; set; }
    // is_grounded marks if the node is a support node
    public bool is_grounded { get; set; }
  }

  public class ConmechFrameElement
  {
    public ConmechFrameElement(ModelTruss ke) {
      elem_tag = ke.id;
      elem_ind = ke.ind;
      end_node_inds = ke.node_inds as List<int>;
      bending_stiff = ke.bending_stiff;
      // default layer index
      layer_ind = -1;
    }
    public List<int> end_node_inds { get; set; }
    // element identifier
    public string elem_tag { get; set; }
    // zero-based index of element in model
    public int elem_ind { get; set; }
    // an extra tag identify for grouping elements, can be used in sequencing
    public int layer_ind { get; set; }
    public bool bending_stiff { get; set; }

    // TODO: export local coordinate frame and import into conmech
  }

  public class ConmechFemMaterial
  {
    public ConmechFemMaterial(FemMaterial km) {
      // TODO: read unit from Karamba
      E_unit = "kN/m2";
      G12_unit = "kN/m2";
      fy_unit = "kN/m2";
      density_unit = "kN/m3";

      type_name = km.typeName();
      if (type_name != "ISO") {
        throw new ArgumentException("orthotropic material not implemented!!");
      }
      family = km.family;
      name = km.name;
      elem_tags = km.elemIds;
      E = km.E();
      G12 = km.G12();
      fy = km.fy();
      density = km.gamma();
    }

    public string family { get; set; }
    public string name { get; set; }
    public string type_name { get; set; }
    public string _source { get; set; }

    // list of element identifiers to which the cross section is to be attached.
    // applied to all elements if the list is empty
    public List<string> elem_tags { get; set; }

    public double E { get; set; }
    public string E_unit { get; set; }

    // in-plane shear modulus
    public double G12 { get; set; }
    public string G12_unit { get; set; }

    // transverse shear modulus
    //    public double G3 { get; set; }
    //    public string G3_unit { get; set; }

    // tensile yield stress
    public double fy { get; set; }
    public string fy_unit { get; set; }

    // gamma
    public double density { get; set; }
    public string density_unit { get; set; }
  }

  public class ConmechCrossSec {
    public ConmechCrossSec(CroSec_Beam kcs) {
      // TODO: read unit from Karamba
      A_unit = "m2";
      Iy_unit = "m4";
      Iz_unit = "m4";
      Jx_unit = "m4";

      family = kcs.family;
      name = kcs.name;
      elem_tags = kcs.elemIds;
      A = kcs.A;
      Jx = kcs.Ipp;
      Iy = kcs.Iyy;
      Iz = kcs.Izz;
    }

    public string family { get; set; }
    public string name { get; set; }
    public string _source { get; set; }

    // list of element identifiers to which the cross section is to be attached.
    // applied to all elements if the list is empty
    public List<string> elem_tags { get; set; }

    public double A { get; set; }
    public string A_unit { get; set; }
    public string _A_note { get; set; }

    // around local axis
    public double Jx { get; set; }
    public string Jx_unit { get; set; }
    public string _Jx_note { get; set; }

    public double Iy { get; set; }
    public string Iy_unit { get; set; }
    public string _Iy_note { get; set; }

    public double Iz { get; set; }
    public string Iz_unit { get; set; }
    public string _Iz_note { get; set; }
  }

  public class ConmechJoint
  {
    public ConmechJoint(Joint kj){
      c_conditions = new List<List<Nullable<double>>>();
      c_conditions.Add(kj.c_condition(0));
      c_conditions.Add(kj.c_condition(1));
      elem_tags = kj.elemIds;
    }
    public List<List<Nullable<double>>> c_conditions { get; set; }
    // element tags
    public List<string> elem_tags { get; set; }
  }

  public class ConmechSupport
  {
    public ConmechSupport(Support ks){
      condition = ks.Condition as List<bool>;
      node_ind = ks.node_ind;
    }
    public List<bool> condition { get; set; }
    public int node_ind { get; set; }
  }

  public class ConmechPointLoad
  {
    public ConmechPointLoad(PointLoad kf) {
      force = new List<double>(){kf.force.X, kf.force.Y, kf.force.Z};
      force_unit = "kN";
      moment = new List<double>(){kf.moment.X, kf.moment.Y, kf.moment.Z};
      moment_unit = "kNm";
      node_ind = kf.node_ind;
    }
    public List<double> force { get; set; }
    public string force_unit { get; set; }
    public List<double> moment { get; set; }
    public string moment_unit { get; set; }
    public int node_ind { get; set; }
  }

  public class ConmechUnifDistLoad
  {
    public ConmechUnifDistLoad(UniformlyDistLoad  kf) {
      q = new List<double>(){kf.Q.X, kf.Q.Y, kf.Q.Z};
      q_unit = "kN/m";
      load = new List<double>(){kf.Load.X, kf.Load.Y, kf.Load.Z};
      // element tags
      elem_tags = kf.beamIds;
    }
    public List<double> q { get; set; }
    public string q_unit { get; set; }
    public List<double> load { get; set; }
    public List<string> elem_tags { get; set; }
  }

  public class ConmechGravityLoad
  {
    public ConmechGravityLoad(GravityLoad kf) {
      force = new List<double>(){kf.force.X, kf.force.Y, kf.force.Z};
      force_unit = "kN";
    }
    public List<double> force { get; set; }
    public string force_unit { get; set; }
  }

  public class ConmechLoadCase
  {
    public List<ConmechPointLoad> ploads { get; set; }
    // TODO: only support uniformly dist element load for now
    public List<ConmechUnifDistLoad> eloads { get; set; }
    public ConmechGravityLoad gravity { get; set; }
  }

  public class ConmechModel
  {
    public string model_name { get; set; }
    public string unit { get; set; }
    public string generate_time { get; set; }

    public int node_num { get; set; }
    public int element_num { get; set; }

    public List<ConmechFrameNode> nodes { get; set; }
    public List<ConmechFrameElement> elements { get; set; }

    public List<ConmechSupport> supports { get; set; }
    public List<ConmechJoint> joints { get; set; }

    public List<ConmechCrossSec> cross_secs { get; set; }
    public List<ConmechFemMaterial> materials { get; set; }
  }
# ---------- end c_script ----------

# ----
beam_forces_karamba3d = BeamForcesKaramba3D(
    AnalyzedModel=analyze_karamba3d.CalculatedModel,
    LCase=-1,
    MaximumDistanceBetweenResults_m=-1,
    NumberOfResultsPerBeamElement=2)  # -> AnalyzedModel, NormalForce_kN, ShearForceVz_kN, ShearForceVy_kN, BendingMomentMt_kNm, BendingMomentMy_kNm, BendingMomentMz_kNm
reaction_forces_karamba3d = ReactionForcesKaramba3D(AnalyzedModel=analyze_karamba3d.CalculatedModel, ResultCase=0)  # -> AnalyzedModel, ReactionForces_kN, ReactionMoments_kNm, SupportPosition, SumOfReactionForces_kN, SumOfReactionMoments_kNm
nodal_displacements_karamba3d = NodalDisplacementsKaramba3D(AnalyzedModel=analyze_karamba3d.CalculatedModel, ResultCase=0)  # -> AnalyzedModel, NodalTranslations_m, NodalRotations_rad
model_view_karamba3d = ModelViewKaramba3D(Model=analyze_karamba3d.CalculatedModel, ResultFactors=1, ResultCase=-1)  # -> Model, DeformedMesh, DeformedAxes, DeformedModel
panel_10 = Panel(reaction_forces_karamba3d.ReactionForces_kN)
panel_11 = Panel(nodal_displacements_karamba3d.NodalRotations_rad)
panel_12 = Panel(reaction_forces_karamba3d.ReactionMoments_kNm)
beam_view_karamba3d = BeamViewKaramba3D(Model=model_view_karamba3d.Model)  # -> Model, MeshesOfRenderedBeams, DeformedBeamAxes, LegendColors, LegendTags
panel_13 = Panel(nodal_displacements_karamba3d.NodalTranslations_m)
panel_14 = Panel(beam_forces_karamba3d.NormalForce_kN)
panel_15 = Panel(beam_forces_karamba3d.ShearForceVz_kN)
panel_16 = Panel(beam_forces_karamba3d.ShearForceVy_kN)
panel_17 = Panel(beam_forces_karamba3d.BendingMomentMt_kNm)
panel_18 = Panel(beam_forces_karamba3d.BendingMomentMy_kNm)
panel_19 = Panel(beam_forces_karamba3d.BendingMomentMz_kNm)
