# Grasshopper definition export_from_karamba.gh (Grasshopper 1.0.7)
# plug-ins: LunchBox, karambaGH

curve = Curve([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])

# ---- group: Reference Geometry
# to apply to a new model:
# right-click and set multiple curves;
# 
# ** pay close attention to intersections of rhino curves;
# Karamba3D will not read joints if lines are not intersecting
curve_2 = Curve([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])
explode = Explode(Curve=curve, Recursive=True)  # -> flatten(Segments), Vertices
line_line_intersection_karamba3d = LineLineIntersectionKaramba(Line=explode.Segments, LengthTolerance=0.01)  # -> IntersectionPoints, flatten(LineSubSegements)

# ----
list_item = ListItem(List=curve, Index=0, Wrap=True)  # -> Item1, Item

# ---- group: Reference Geometry
# to apply to a new model:
# right-click and set multiple points;
# 
# ** points must be near intended supports;
# definition will automatically snap to closest node in model
point = Point([Point(7.338080932, 0.3633907323, 5.215597679), Point(-0.09269640327, 0.3633907323, 6.072995064), Point(-7.523473739, 0.3633907323, 4.882165363)])

# ----
point_2 = Point(Point(-0.09269640327, 0.3633907323, 6.072995064))

# ---- group: Reference Geometry
# to apply to a new model:
# right-click and set multiple points;
# 
# ** points must be near intended supports;
# definition will automatically snap to closest node in model
point_3 = Point(Point(11.11202754, 0.3633907323, -0.7348876109))

# to apply to a new model:
# right-click and set multiple points;
# 
# ** points must be near intended supports;
# definition will automatically snap to closest node in model
point_4 = Point(Point(-11.8471691, 0.3633907323, -0.4490884826))

# ----
number_slider = Slider(4, range=0..10)
curve_3 = Curve(list_item.Item)
curve_4 = Curve(list_item.Item1)
panel = Panel("6")
random_split_list = RandomSplitList(MasterList=line_line_intersection_karamba3d.LineSubSegements, Seed=number_slider, Split=0.5)  # -> ListA, ListB
split_list = SplitList(List=line_line_intersection_karamba3d.LineSubSegements, Index=number_slider)  # -> ListA, ListB
live_load = Slider(-10, range=-50..-0.04)
unit_y = UnitY(Factor=live_load)

# ---- group: Define Elements
# an ideal truss has hinged joints and
#  members carry only axial loads
boolean_toggle = BooleanToggle(False)  # disabled
panel_2 = Panel("beams")  # disabled
line_to_beam_karamba3d = LineToBeamKaramba3D(
    Line=line_line_intersection_karamba3d.LineSubSegements,
    Identifier=panel_2,
    New=True,
    Remove=True,
    LimitDistance_m=0.005,
    Bending=boolean_toggle)  # -> Element, Points, Info; disabled

# ----
point_5 = Point([Point(-10, 0, 0), Point(0, 0, 5), Point(10, 0, 0)])
element_karamba3d = ElementKaramba3D(line_to_beam_karamba3d.Element)
point_6 = Point(point_5)

# ---- group: Define Loads
# live load applied as uniform distributed (mesh) loads
# ** note: low mesh density can
# result in uneven distribution of load
# LIVE LOAD REFERENCE:
# ref: The Structural Basis of Architecture, Sandaker et al.
# residential (typical) 	2 kN/m2  	.04 kip/ft2
# office (tyipcal)  			3 kN/m2  	.06 kip/ft2
# public plazas  	12 kN/m2  	.25 kip/ft2
# athletic facilities (typical)  5 kN/m2  	.1 kip/ft2
# hospitals (operating rooms)  3 kN/m2   .06 kip/ft2
# libraries (book stacks)  7 kN/m2   .15 kip/ft2
# manufacturing (typical)  6 kN/m2   .125 kip/ft2
# heavy equipment   12 kN/m2   .25 kip/ft2
# schools (classrooms)   2 kN/m2   .04 kip/ft2
# schools (hallways)   5 kN/m2   .1 kip/ft2
live_load_2 = Slider(-10, range=-50..-0.04)
unit_z = UnitZ(Factor=live_load_2)
find_similar_member = FindSimilarMember(Data=point, Set=point_6)  # -> Hit, Index
unit_z_2 = UnitZ(Factor="-1")
loads_karamba3d = LoadsKaramba3D(Vector=unit_z_2, LCase=0, mode="Gravity")
loads_karamba3d_2 = LoadsKaramba3D(ForceVector=unit_z, Local=False, PosInd=find_similar_member.Hit, LCase=0, mode="Point")
load_karamba3d = LoadKaramba3D(flatten(loads_karamba3d_2))

# ---- group: Define Supports
# ROLLER support can translate in the x
# direction and rotate about the y axis
# PIN support cannot translate in any
# direction but  can rotate about the y axis
# out of plane support for all nodes:
# restrain all nodes out of plane for
# 2d analysis
find_similar_member_2 = FindSimilarMember(Data=point_3, Set=point_6)  # -> Hit, Index
find_similar_member_3 = FindSimilarMember(Data=point_4, Set=point_6)  # -> Hit, Index
cull_index = CullIndex(List=point_6, Indices=[find_similar_member_2.Index, find_similar_member_3.Index], Wrap=True)
support_karamba3d = SupportKaramba(PosInd=cull_index, menu=[buttons(off, on, off, on, off, on)])
support_karamba3d_2 = SupportKaramba(PosInd=find_similar_member_2.Hit, menu=[buttons(on, on, on, on, on, on)])
support_karamba3d_3 = SupportKaramba(PosInd=find_similar_member_3.Hit, menu=[buttons(on, on, on, on, on, on)])
support_karamba3d_4 = SupportKaramba(flatten([support_karamba3d_2, support_karamba3d, support_karamba3d_3]))
support_karamba3d_5 = SupportKaramba(flatten([support_karamba3d_3, support_karamba3d_2]))

# ----
loads_karamba3d_3 = LoadsKaramba3D(ForceVector=unit_z, Local=False, PosInd=find_similar_member.Hit, LCase=0, mode="Point")
loads_karamba3d_4 = LoadsKaramba3D(Vector=unit_z_2, LCase=0, mode="Uniform Line", menu=[buttons(off, on, off)])
panel_3 = Panel(loads_karamba3d_4)

beam_truss_bending = BooleanToggle(False)
beam_bending = BooleanToggle(True)
has_joint = BooleanToggle(False)

# ---- group: Define Elements
# an ideal truss has hinged joints and
#  members carry only axial loads
panel_4 = Panel("beams_truss")
line_to_beam_karamba3d_2 = LineToBeamKaramba3D(Line=curve_4, Identifier=panel_4, New=True, Remove=True, LimitDistance_m=0.005, Bending=beam_truss_bending)  # -> Element, Points, Info

# ----
cross_section_karamba3d = CrossSectionKaramba3D(
    FamilyNameOfCrossSection="Hey",
    NameOfCrossSection="Yo",
    ElementIdentifier=panel_4,
    Material=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,
    Height_cm=9.6,
    UpperFlangeWidth_cm=10,
    LowerFlangeWidth_cm=10,
    UpperFlangeThickness_cm=0.8,
    LowerFlangeThickness_cm=0.8,
    WebThickness_cm=0.5,
    FilletRadius_cm=0,
    mode="I")

# ---- group: Define Elements
# an ideal truss has hinged joints and
#  members carry only axial loads
panel_5 = Panel("beams")
line_to_beam_karamba3d_3 = LineToBeamKaramba3D(Line=curve_3, New=True, Remove=True, LimitDistance_m=0.005, Bending=beam_bending)  # -> Element, Points, Info

# ----
panel_6 = Panel(cross_section_karamba3d)
panel_7 = Panel(line_to_beam_karamba3d_3.Points)
rhino_doc_dir = RhinoDocDir()  # -> rhino_doc_dir
# ---------- rhino_doc_dir: Python ----------
import scriptcontext as sc
from os import path

rhino_doc_dir = path.abspath(path.dirname(sc.doc.Path))
# ---------- end rhino_doc_dir ----------
panel_8 = Panel("D:\code_ws\gh_scritps\karamba\Karamba3D_1_3_2_ScriptingGuideExamples\export_example")
merge = Merge(Data1=line_to_beam_karamba3d_3.Element, Data2=line_to_beam_karamba3d_2.Element)
panel_9 = Panel("D:\code_ws\pb_ws\conmech")
ghpython_script = GhPythonScript(x=rhino_doc_dir)  # -> a
# ---------- ghpython_script: Python ----------
import os

a = os.path.join(x, '..', '..', '..', 'tests', 'test_data')
# ---------- end ghpython_script ----------

# ---- group: supports marked as grounded, to differentiate from "2D-stablizing" supports
support_karamba3d_6 = SupportKaramba(flatten(support_karamba3d_5))

# ----
construct_point = ConstructPoint(XCoordinate="0", YCoordinate=Slider(0, range=0..2), ZCoordinate="0")
construct_point_2 = ConstructPoint(XCoordinate="0", YCoordinate=Slider(0, range=0..2), ZCoordinate="0")
panel_10 = Panel(".json")  # disabled
export_json = BooleanToggle(False)
format_json = BooleanToggle(True)
reimport_from_json = BooleanToggle(False)
panel_11 = Panel("\")  # disabled
concatenate = Concatenate(FragmentA="2D_truss", FragmentB=".json")
beam_joints_karamba3d = BeamJointsKaramba3D(
    ElementIdentifiers=panel_5,
    CtKNMAtStartingNode=Vector(0, 0, 0),
    CrKNmRadAtStartingNode=construct_point_2,
    CtKNMAtEndNode=Vector(0, 0, 0),
    CrKNmRadAtEndNode=construct_point_2,
    menu=[buttons(off, off, off, off, off, off), buttons(off, off, off, off, on, off)])
beam_joints_karamba3d_2 = BeamJointsKaramba3D(
    ElementIdentifiers=panel_4,
    CtKNMAtStartingNode=Vector(0, 0, 0),
    CrKNmRadAtStartingNode=construct_point,
    CtKNMAtEndNode=Vector(0, 0, 0),
    CrKNmRadAtEndNode=construct_point,
    menu=[buttons(off, off, off, off, off, off), buttons(off, off, off, off, off, off)])
stream_filter = StreamFilter(Gate=has_joint, Stream1=[beam_joints_karamba3d_2, beam_joints_karamba3d])

# ---- group: Assemble Model
assemble_model_karamba3d = AssembleModelKaramba(
    Point=point_5,
    Elem=merge,
    Support=support_karamba3d_4,
    Load=load_karamba3d,
    CrossSection=cross_section_karamba3d,
    Joint=stream_filter,
    LimitDistance_m=0.005)  # -> Model, Info, Mass_kg, CenterOfGravity

# ----
model_karamba3d = ModelKaramba3D(assemble_model_karamba3d.Model)
concatenate_2 = Concatenate(Fragment_A=panel_8, A=panel_11, Fragment_B="2D_truss", B=panel_10)  # disabled
rhino_doc_dir_2 = RhinoDocDir()  # -> rhino_doc_dir; disabled; same code as rhino_doc_dir
panel_12 = Panel(model_karamba3d)

# ---- group: convert a karamba model into conmech format and export
# Please make sure the nodes
# are in meter!
c_script = CSharpScript(
    k_model=model_karamba3d,
    k_grounded_nodes=support_karamba3d_6,
    model_name="2D_truss",
    save_path=panel_8,
    export=export_json,
    format_json=format_json,
    reimport_from_json=reimport_from_json,
    Reference=["C:\Program Files\Rhino 6\Plug-ins\karambaCommon.dll", "C:\Program Files\Rhino 6\Plug-ins\karamba.gha", "D:\CODE_WS\PB_WS\CONMECH\EXAMPLES\GH_SCRIPTS\KARAMBA\Newtonsoft.Json.dll"])  # -> out, A; inputs k_grounded_nodes: list, model_name: String, save_path: String, export: Boolean, limit_distance: Double, format_json: Boolean, reimport_from_json: Boolean
# ---------- c_script: C# usings ----------
using System.IO;
using Karamba.Models;
using Karamba.Nodes;
using Karamba.CrossSections;
using Karamba.Elements;
using Karamba.Loads;
using Karamba.Materials;
using Karamba.Supports;
using Karamba.Geometry;
using Karamba.Joints;
using Newtonsoft.Json;
# ---------- c_script: C# ----------
    var kmodel = _k_model as Model;
    if (kmodel == null) {
      throw new ArgumentException("The input is not of type karamba model!");
    }
    if (limit_distance == 0) {
      limit_distance = 0.001; // meter
    }
    // support fixities & gounded node tags
    var k_grounded = _k_grounded_nodes.ConvertAll(x => x as Support);

    // Karamba element tag rules:
    // [] (empty list): non is specified, use the default cross_sec and material
    // [""] : one material is specified, apply to ALL elements

    //    foreach(var bs in kmodel.ploads) {
    //      Print(bs.loadcase.ToString());
    //      //      foreach(var i in bs.elemIds){
    //      //        Print("{0}", i);
    //      //      }
    //      Print("---");
    //    }

    var c_model = new ConmechModel(ref kmodel, grounded_supports: k_grounded,
    model_name: model_name, limit_distance: limit_distance);

    // save to json
    string cmodel_file_path = String.Concat(save_path, Path.DirectorySeparatorChar,
      model_name, ".json");
    if(export) {
      JsonSerializer serializer = new JsonSerializer();
      serializer.NullValueHandling = NullValueHandling.Ignore;
      if(format_json) {
        serializer.Formatting = Newtonsoft.Json.Formatting.Indented;
      }
      // serialize shape to a json file
      using (StreamWriter sw = new StreamWriter(@cmodel_file_path))
      using (JsonWriter writer = new JsonTextWriter(sw))
      {
        serializer.Serialize(writer, c_model);
      }
      Print("Shape saved to {0}", cmodel_file_path);

      //      // serialize load case to a json file
      //      string load_file_path = String.Concat(save_path, Path.DirectorySeparatorChar,
      //        model_name, "_loads.json");
      //      using (StreamWriter sw = new StreamWriter(@load_file_path))
      //      using (JsonWriter writer = new JsonTextWriter(sw))
      //      {
      //        serializer.Serialize(writer, c_loadcase);
      //      }
      //      Print("Load saved to {0}", load_file_path);
    }

    // reconstruct karamba model
    if(reimport_from_json) {
      ConmechModel cmodel = JsonConvert.DeserializeObject<ConmechModel>(File.ReadAllText(@cmodel_file_path));

      Print(cmodel.model_name);
    }
# ---------- c_script: C# additional code ----------
  // TODO compile these into a dll
  // TODO compile these into a dll
  public class ConmechFrameNode
  {
    public ConmechFrameNode() {}
    public ConmechFrameNode(Node k_node) {
      node_ind = -1;
      is_grounded = false;
      node_ind = k_node.ind;
      point = new List<double>(){k_node.pos.X, k_node.pos.Y, k_node.pos.Z};
    }

    public List<double> point { get; set; }
    public int node_ind { get; set; }

    // is_grounded marks if the node is a support node
    // used to differentiate the supports to make a 2D structure stable
    public bool is_grounded { get; set; }

    public Node ToKNode() {
      return new Node(this.node_ind, new Point3(this.point[0], this.point[1], this.point[2]));
    }
  }

  public class ConmechFrameElement
  {
    public ConmechFrameElement() {}
    public ConmechFrameElement(ModelTruss ke) {
      // BuilderBeam does not have thenode_inds attributes
      elem_tag = ke.id;
      elem_ind = ke.ind;
      end_node_inds = ke.node_inds as List<int>;
      bending_stiff = ke.bending_stiff;
      // default layer index
      layer_ind = -1;
    }
    public List<int> end_node_inds { get; set; }
    // element identifier
    public string elem_tag { get; set; }
    // zero-based index of element in model
    public int elem_ind { get; set; }
    // an extra tag identify for grouping elements, can be used in sequencing
    public int layer_ind { get; set; }
    public bool bending_stiff { get; set; }

    // TODO: export local coordinate frame and import into conmech

    public BuilderBeam ToKBuilderBeam() {
      return new BuilderBeam(this.end_node_inds[0], this.end_node_inds[1]);
    }
  }

  public class ConmechFemMaterial
  {
    public ConmechFemMaterial() {}
    public ConmechFemMaterial(FemMaterial km) {
      // TODO: read unit from Karamba
      E_unit = "kN/m2";
      G12_unit = "kN/m2";
      fy_unit = "kN/m2";
      density_unit = "kN/m3";

      type_name = km.typeName();
      if (type_name != "ISO") {
        throw new ArgumentException("orthotropic material not implemented!!");
      }
      family = km.family;
      name = km.name;
      //  material's identifiers of elements to which it shall be applied
      elem_tags = km.elemIds;
      E = km.E();
      G12 = km.G12();
      fy = km.fy();
      density = km.gamma();
    }

    public string family { get; set; }
    public string name { get; set; }
    public string type_name { get; set; }
    public string _source { get; set; }

    // list of element identifiers to which the cross section is to be attached.
    // applied to all elements if the list is empty
    public List<string> elem_tags { get; set; }

    public double E { get; set; }
    public string E_unit { get; set; }

    // in-plane shear modulus
    public double G12 { get; set; }
    public string G12_unit { get; set; }

    // transverse shear modulus
    //    public double G3 { get; set; }
    //    public string G3_unit { get; set; }

    // tensile yield stress
    public double fy { get; set; }
    public string fy_unit { get; set; }

    // gamma
    public double density { get; set; }
    public string density_unit { get; set; }
  }

  public class ConmechCrossSec {
    public ConmechCrossSec() {}
    public ConmechCrossSec(CroSec_Beam kcs) {
      // TODO: read unit from Karamba
      A_unit = "m2";
      Iy_unit = "m4";
      Iz_unit = "m4";
      Jx_unit = "m4";

      family = kcs.family;
      name = kcs.name;
      elem_tags = kcs.elemIds;
      A = kcs.A;
      Jx = kcs.Ipp;
      Iy = kcs.Iyy;
      Iz = kcs.Izz;
    }

    public string family { get; set; }
    public string name { get; set; }
    public string _source { get; set; }

    // list of element identifiers to which the cross section is to be attached.
    // applied to all elements if the list is empty
    public List<string> elem_tags { get; set; }

    public double A { get; set; }
    public string A_unit { get; set; }
    public string _A_note { get; set; }

    // around local axis
    public double Jx { get; set; }
    public string Jx_unit { get; set; }
    public string _Jx_note { get; set; }

    public double Iy { get; set; }
    public string Iy_unit { get; set; }
    public string _Iy_note { get; set; }

    public double Iz { get; set; }
    public string Iz_unit { get; set; }
    public string _Iz_note { get; set; }
  }

  public class ConmechJoint
  {
    public ConmechJoint() {}
    public ConmechJoint(Joint kj){
      c_conditions = new List<List<Nullable<double>>>();
      c_conditions.Add(kj.c_condition(0));
      c_conditions.Add(kj.c_condition(1));
      elem_tags = kj.elemIds;
    }
    public List<List<Nullable<double>>> c_conditions { get; set; }
    // element tags
    public List<string> elem_tags { get; set; }
  }

  public class ConmechSupport
  {
    public ConmechSupport() {}
    public ConmechSupport(Support ks){
      condition = ks.Condition as List<bool>;
      node_ind = ks.node_ind;
    }
    public List<bool> condition { get; set; }
    public int node_ind { get; set; }
  }

  public class ConmechLoad
  {
    public int loadcase { get; set; }
  }

  public class ConmechPointLoad : ConmechLoad
  {
    public ConmechPointLoad() {}
    public ConmechPointLoad(PointLoad kf) {
      force = new List<double>(){kf.force.X, kf.force.Y, kf.force.Z};
      force_unit = "kN";
      moment = new List<double>(){kf.moment.X, kf.moment.Y, kf.moment.Z};
      moment_unit = "kNm";
      node_ind = kf.node_ind;
      loadcase = kf.loadcase;
    }
    // force-vector (kN) in global coordinates
    public List<double> force { get; set; }
    public string force_unit { get; set; }
    // moment-vector (kN) in global coordinates
    public List<double> moment { get; set; }
    public string moment_unit { get; set; }
    public int node_ind { get; set; }
  }

  public class ConmechUnifDistLoad : ConmechLoad
  {
    public ConmechUnifDistLoad() {}
    public ConmechUnifDistLoad(UniformlyDistLoad  kf) {
      load_unit = "kN/m";
      load = new List<double>(){kf.Load.X, kf.Load.Y, kf.Load.Z};
      // element tags
      elem_tags = kf.beamIds;
      loadcase = kf.loadcase;

      // Q = new List<double>(){kf.Q.X, kf.Q.Y, kf.Q.Z};
    }
    // load-vector in the global coordinate
    public List<double> load { get; set; }
    public string load_unit { get; set; }
    public List<string> elem_tags { get; set; }

    //    // vector of distributed loads
    //    public List<double> Q { get; set; }
    //    public string Q_unit { get; set; }
    //    // orientation of distributed loads
    //    public int Q_orient { get; set; }
  }

  public class ConmechGravityLoad : ConmechLoad
  {
    public ConmechGravityLoad() {}
    public ConmechGravityLoad(GravityLoad kf) {
      force = new List<double>(){kf.force.X, kf.force.Y, kf.force.Z};
      force_unit = "kN";
      loadcase = kf.loadcase;
    }
    // vector of acceleration due to gravity.
    // A vector length of "1" corresponds to gravity as on earth.
    public List<double> force { get; set; }
    public string force_unit { get; set; }
  }

  public class ConmechLoadCase
  {
    public int lc_ind { get; set; }
    public List<ConmechPointLoad> ploads { get; set; }
    // TODO: only support uniformly dist element load for now
    public List<ConmechUnifDistLoad> eloads { get; set; }
    public ConmechGravityLoad gravity { get; set; }
  }

  public class ConmechModel
  {
    // -----------
    // constructor
    public ConmechModel() {}
    public ConmechModel(ref Model kmodel,
    string model_name = "", List<Support> grounded_supports = null, double limit_distance = 0.001) {
      this.model_name = model_name;
      this.generate_time = DateTime.Now.ToString();
      this.unit = "meter";
      this.element_num = kmodel.elems.Count;
      this.node_num = kmodel.nodes.Count;

      // initiate nodes with id and position
      this.nodes = kmodel.nodes.ConvertAll(kn => new ConmechFrameNode(kn));

      // element data
      this.elements = kmodel.elems.ConvertAll(ke => new ConmechFrameElement(ke as ModelTruss));

      // support data
      this.supports = kmodel.supports.ConvertAll(ks => new ConmechSupport(ks as Support));

      // material data
      this.materials = kmodel.materials.ConvertAll(km => new ConmechFemMaterial(km));

      // cross section data
      this.cross_secs = kmodel.crosecs.ConvertAll(kc => new ConmechCrossSec(kc as CroSec_Beam));

      // joint data
      this.joints = kmodel.joints.ConvertAll(kj => new ConmechJoint(kj));

      // tag grounded 
      if (grounded_supports != null) {
        foreach(Support k_supp in kmodel.supports) {
          foreach(Support k_g in grounded_supports) {
            if(k_supp.position.DistanceTo(k_g.position) < limit_distance) {
              this.nodes[k_supp.node_ind].is_grounded = true;
            }
          }
        }
      }

      // save to attributes
      this.loadcases = new Dictionary<int, ConmechLoadCase>();
      for(int lc = 0; lc < kmodel.numLC; lc++){
        // load data
        var c_ploads = new List<ConmechPointLoad>();
        //          k_model.ploads.ConvertAll(kl => new ConmechPointLoad(kl as PointLoad));
        foreach(var pl in kmodel.ploads){
          if(pl.loadcase == lc) {
            c_ploads.Add(new ConmechPointLoad(pl as PointLoad));
          }
        }

        var c_eloads = new List<ConmechUnifDistLoad>();
        // k_model.eloads.ConvertAll(kl => new ConmechUnifDistLoad(kl as UniformlyDistLoad));
        foreach(var el in kmodel.eloads){
          if(el.loadcase == lc && el.GetType().Equals(typeof(UniformlyDistLoad))) {
            c_eloads.Add(new ConmechUnifDistLoad(el as UniformlyDistLoad));
          }
        }

        ConmechGravityLoad c_grav = null;
        Karamba.Loads.GravityLoad k_grav;
        kmodel.gravities.TryGetValue(lc, out k_grav);
        if(k_grav != null){
          c_grav = new ConmechGravityLoad(k_grav);
        }

        var c_loadcase = new ConmechLoadCase();
        c_loadcase.lc_ind = lc;
        c_loadcase.ploads = c_ploads;
        c_loadcase.eloads = c_eloads;
        c_loadcase.gravity = c_grav;

        this.loadcases[lc] = c_loadcase;
      }
    }

    // -----------
    // attributes
    public string model_name { get; set; }
    public string unit { get; set; }
    public string generate_time { get; set; }

    public int node_num { get; set; }
    public int element_num { get; set; }

    public List<ConmechFrameNode> nodes { get; set; }
    public List<ConmechFrameElement> elements { get; set; }

    public List<ConmechSupport> supports { get; set; }
    public List<ConmechJoint> joints { get; set; }

    public List<ConmechCrossSec> cross_secs { get; set; }
    public List<ConmechFemMaterial> materials { get; set; }

    public Dictionary<int, ConmechLoadCase> loadcases { get; set; }

    // -----------
    // model conversion
    public void ToKarambaModel(ref List<Karamba.Loads.Load> loads, out Model kmodel, double limit_dist=0.001) {
      var logger = new Karamba.Utilities.MessageLogger();
      var k3d = new KarambaCommon.Toolkit();

      double mass;
      Point3 cog; // center of gravity
      bool flag;
      string info;

      var builder_elems = this.elements.ConvertAll(kl => kl.ToKBuilderBeam());

      //      kmodel = k3d.Model.AssembleModel(, this.supports, ploads,
      //        out info, out mass, out cog, out info, out flag,
      //        joints: joints, points: points,
      //      crosecs: crosecs, materials = materials,
      //      limitDist = limitDist, );

      //      AssembleModel(
      //        IReadOnlyList<BuilderElement> elems,
      //        IReadOnlyList<Support> supports,
      //        List<Load > loads,
      //      out string info,
      //      out double mass,
      //      out Point3 cog,
      //      out string msg,
      //      out bool runtimeWarning,
      //
      //        IReadOnlyList<Joint > joints = null,
      //      IReadOnlyList<Point3> points = null,
      //        IReadOnlyList<ElemSet > beamsets = null,
      //      double limitDist = 0,005,
      //      IReadOnlyList<CroSec> crosecs = null,
      //        IReadOnlyList<FemMaterial > materials = null
      //      )

      // replace later
      kmodel = new Model();
    }
  }

  //  public void KarambaModelFromConmechModel(ref ConmechModel cmodel, out Model kmodel)
  //  {
  //
  //    //    var tmp_nodes = new List<Point3>();
  //    //    var beams = new List<BuilderBeam>();
  //    //    foreach(ConmechFrameElement celem in cmodel.elements) {
  //    //      var end_node_inds = celem.end_node_inds;
  //    //      var cnode0 = cmodel.nodes[end_node_inds[0]];
  //    //      var cnode1 = cmodel.nodes[end_node_inds[1]];
  //    //      var p0 = new Point3(cnode0.point[0], cnode0.point[1], cnode0.point[2]);
  //    //      var p1 = new Point3(cnode1.point[0], cnode1.point[1], cnode1.point[2]);
  //    //      var elems = k3d.Part.LineToBeam(new List<Line3>(){new Line3(p0, p1)}, new List<string>(){ celem.elem_tag },
  //    //        new List<CroSec>(), logger, out tmp_nodes, celem.bending_stiff);
  //    //      beams.AddRange(elems);
  //    //    }
  //
  //    //    var cond = new List<bool>(){ true, true, true, true, true, true};
  //    //    var support = k3d.Support.Support(0, cond);
  //    //    var supports = new List<Support>(){support};
  //    //
  //    //    var pload = k3d.Load.PointLoad(1, new Vector3(0, 0, -10), new Vector3());
  //    //    var ploads = new List<Load>(){pload};
  //
  //    kmodel = new Model();
  //    //    Model(List<Node>, List<FemMaterial>, List<CroSec>, List<ModelElement>,
  //    //    List < PointLoad>, List < PointMass>, List < MeshLoad>, List < ElementLoad>,
  //    //    List < Support>, List < ElemSet>, Dictionary < Int32, GravityLoad>,
  //    //    ItemSelector, IdManager, Int32)
  //  }
# ---------- end c_script ----------

# ----
c_script_2 = CSharpScript(
    model_path=concatenate_2,
    Reference=["C:\Program Files\Rhino 6\Plug-ins\karambaCommon.dll", "C:\Program Files\Rhino 6\Plug-ins\karamba.gha", "D:\CODE_WS\PB_WS\CONMECH\EXAMPLES\GH_SCRIPTS\KARAMBA\Newtonsoft.Json.dll"])  # -> out, A; inputs model_path: String, loadcase_path: Boolean; disabled
# ---------- c_script_2: C# usings ----------
using System.IO;
using Karamba.Models;
using Karamba.Nodes;
using Karamba.CrossSections;
using Karamba.Elements;
using Karamba.Loads;
using Karamba.Materials;
using Karamba.Supports;
using Karamba.Geometry;
using Karamba.Joints;
using Karamba.Utilities;
using Newtonsoft.Json;
# ---------- c_script_2: C# ----------
    // read file into a string and deserialize JSON to a type
    ConmechModel cmodel = JsonConvert.DeserializeObject<ConmechModel>(File.ReadAllText(@model_path));
    //    ConmechLoadCase cloadcase = JsonConvert.DeserializeObject<ConmechLoadCase>(File.ReadAllText(@loadcase_path));

    //    Model kmodel;
    //    KarambaModelFromConmechModel(ref cmodel, out kmodel);

    Print(cmodel.model_name);
    //    Model_out = new Karamba.GHopper.Models.GH_Model(model);
# ---------- c_script_2: C# additional code ----------
  // TODO compile these into a dll
  public class ConmechFrameNode
  {
    public ConmechFrameNode() {}
    public ConmechFrameNode(Node k_node) {
      node_ind = -1;
      is_grounded = false;
      node_ind = k_node.ind;
      point = new List<double>(){k_node.pos.X, k_node.pos.Y, k_node.pos.Z};
    }

    public List<double> point { get; set; }
    public int node_ind { get; set; }
    // is_grounded marks if the node is a support node
    // used to differentiate the supports to make a 2D structure stable
    public bool is_grounded { get; set; }

    public void ToKarambaNode(out Node knode) {
      knode = new Node(this.node_ind, new Point3(this.point[0], this.point[1], this.point[2]));
    }
  }

  public class ConmechFrameElement
  {
    public ConmechFrameElement() {}
    public ConmechFrameElement(ModelTruss ke) {
      // BuilderBeam does not have thenode_inds attributes
      elem_tag = ke.id;
      elem_ind = ke.ind;
      end_node_inds = ke.node_inds as List<int>;
      bending_stiff = ke.bending_stiff;
      // default layer index
      layer_ind = -1;
    }
    public List<int> end_node_inds { get; set; }
    // element identifier
    public string elem_tag { get; set; }
    // zero-based index of element in model
    public int elem_ind { get; set; }
    // an extra tag identify for grouping elements, can be used in sequencing
    public int layer_ind { get; set; }
    public bool bending_stiff { get; set; }

    // TODO: export local coordinate frame and import into conmech

    public void ToKarambaBuilderBeam(out BuilderBeam bb) {
      bb = new BuilderBeam(this.end_node_inds[0], this.end_node_inds[1]);
    }
  }

  public class ConmechFemMaterial
  {
    public ConmechFemMaterial() {}
    public ConmechFemMaterial(FemMaterial km) {
      // TODO: read unit from Karamba
      E_unit = "kN/m2";
      G12_unit = "kN/m2";
      fy_unit = "kN/m2";
      density_unit = "kN/m3";

      type_name = km.typeName();
      if (type_name != "ISO") {
        throw new ArgumentException("orthotropic material not implemented!!");
      }
      family = km.family;
      name = km.name;
      elem_tags = km.elemIds;
      E = km.E();
      G12 = km.G12();
      fy = km.fy();
      density = km.gamma();
    }

    public string family { get; set; }
    public string name { get; set; }
    public string type_name { get; set; }
    public string _source { get; set; }

    // list of element identifiers to which the cross section is to be attached.
    // applied to all elements if the list is empty
    public List<string> elem_tags { get; set; }

    public double E { get; set; }
    public string E_unit { get; set; }

    // in-plane shear modulus
    public double G12 { get; set; }
    public string G12_unit { get; set; }

    // transverse shear modulus
    //    public double G3 { get; set; }
    //    public string G3_unit { get; set; }

    // tensile yield stress
    public double fy { get; set; }
    public string fy_unit { get; set; }

    // gamma
    public double density { get; set; }
    public string density_unit { get; set; }
  }

  public class ConmechCrossSec {
    public ConmechCrossSec() {}
    public ConmechCrossSec(CroSec_Beam kcs) {
      // TODO: read unit from Karamba
      A_unit = "m2";
      Iy_unit = "m4";
      Iz_unit = "m4";
      Jx_unit = "m4";

      family = kcs.family;
      name = kcs.name;
      elem_tags = kcs.elemIds;
      A = kcs.A;
      Jx = kcs.Ipp;
      Iy = kcs.Iyy;
      Iz = kcs.Izz;
    }

    public string family { get; set; }
    public string name { get; set; }
    public string _source { get; set; }

    // list of element identifiers to which the cross section is to be attached.
    // applied to all elements if the list is empty
    public List<string> elem_tags { get; set; }

    public double A { get; set; }
    public string A_unit { get; set; }
    public string _A_note { get; set; }

    // around local axis
    public double Jx { get; set; }
    public string Jx_unit { get; set; }
    public string _Jx_note { get; set; }

    public double Iy { get; set; }
    public string Iy_unit { get; set; }
    public string _Iy_note { get; set; }

    public double Iz { get; set; }
    public string Iz_unit { get; set; }
    public string _Iz_note { get; set; }
  }

  public class ConmechJoint
  {
    public ConmechJoint() {}
    public ConmechJoint(Joint kj){
      c_conditions = new List<List<Nullable<double>>>();
      c_conditions.Add(kj.c_condition(0));
      c_conditions.Add(kj.c_condition(1));
      elem_tags = kj.elemIds;
    }
    public List<List<Nullable<double>>> c_conditions { get; set; }
    // element tags
    public List<string> elem_tags { get; set; }
  }

  public class ConmechSupport
  {
    public ConmechSupport() {}
    public ConmechSupport(Support ks){
      condition = ks.Condition as List<bool>;
      node_ind = ks.node_ind;
    }
    public List<bool> condition { get; set; }
    public int node_ind { get; set; }
  }

  public class ConmechPointLoad
  {
    public ConmechPointLoad() {}
    public ConmechPointLoad(PointLoad kf) {
      force = new List<double>(){kf.force.X, kf.force.Y, kf.force.Z};
      force_unit = "kN";
      moment = new List<double>(){kf.moment.X, kf.moment.Y, kf.moment.Z};
      moment_unit = "kNm";
      node_ind = kf.node_ind;
    }
    public List<double> force { get; set; }
    public string force_unit { get; set; }
    public List<double> moment { get; set; }
    public string moment_unit { get; set; }
    public int node_ind { get; set; }
  }

  public class ConmechUnifDistLoad
  {
    public ConmechUnifDistLoad() {}
    public ConmechUnifDistLoad(UniformlyDistLoad  kf) {
      Q = new List<double>(){kf.Q.X, kf.Q.Y, kf.Q.Z};
      Q_unit = "kN/m";
      Load = new List<double>(){kf.Load.X, kf.Load.Y, kf.Load.Z};
      // element tags
      elem_tags = kf.beamIds;
    }
    public List<double> Q { get; set; }
    public string Q_unit { get; set; }
    public List<double> Load { get; set; }
    public List<string> elem_tags { get; set; }
  }

  public class ConmechGravityLoad
  {
    public ConmechGravityLoad() {}
    public ConmechGravityLoad(GravityLoad kf) {
      force = new List<double>(){kf.force.X, kf.force.Y, kf.force.Z};
      force_unit = "kN";
    }
    public List<double> force { get; set; }
    public string force_unit { get; set; }
  }

  public class ConmechLoadCase
  {
    public List<ConmechPointLoad> ploads { get; set; }
    // TODO: only support uniformly dist element load for now
    public List<ConmechUnifDistLoad> eloads { get; set; }
    public ConmechGravityLoad gravity { get; set; }
  }

  public class ConmechModel
  {
    public string model_name { get; set; }
    public string unit { get; set; }
    public string generate_time { get; set; }

    public int node_num { get; set; }
    public int element_num { get; set; }

    public List<ConmechFrameNode> nodes { get; set; }
    public List<ConmechFrameElement> elements { get; set; }

    public List<ConmechSupport> supports { get; set; }
    public List<ConmechJoint> joints { get; set; }

    public List<ConmechCrossSec> cross_secs { get; set; }
    public List<ConmechFemMaterial> materials { get; set; }

    public void ToKarambaModel(ref , out Model kmodel, double limitDist=0.005) {
      var logger = new MessageLogger();
      var k3d = new KarambaCommon.Toolkit();

      double mass;
      Point3 cog; // center of gravity
      bool flag;
      string info;
      kmodel = k3d.Model.AssembleModel(this.elements, this.supports, ploads,
        out info, out mass, out cog, out info, out flag,
        joints: joints, points: points, beamsets = beamsets,
      crosecs: crosecs, materials = materials,
      limitDist = limitDist, );

      //      AssembleModel(
      //        IReadOnlyList<BuilderElement> elems,
      //        IReadOnlyList<Support> supports,
      //        List<Load > loads,
      //      out string info,
      //      out double mass,
      //      out Point3 cog,
      //      out string msg,
      //      out bool runtimeWarning,
      //
      //        IReadOnlyList<Joint > joints = null,
      //      IReadOnlyList<Point3> points = null,
      //        IReadOnlyList<ElemSet > beamsets = null,
      //      double limitDist = 0,005,
      //      IReadOnlyList<CroSec> crosecs = null,
      //        IReadOnlyList<FemMaterial > materials = null
      //      )

      // replace later
      kmodel = new Model();
    }
  }

  public void KarambaModelFromConmechModel(ref ConmechModel cmodel, out Model kmodel)
  {

    //    var tmp_nodes = new List<Point3>();
    //    var beams = new List<BuilderBeam>();
    //    foreach(ConmechFrameElement celem in cmodel.elements) {
    //      var end_node_inds = celem.end_node_inds;
    //      var cnode0 = cmodel.nodes[end_node_inds[0]];
    //      var cnode1 = cmodel.nodes[end_node_inds[1]];
    //      var p0 = new Point3(cnode0.point[0], cnode0.point[1], cnode0.point[2]);
    //      var p1 = new Point3(cnode1.point[0], cnode1.point[1], cnode1.point[2]);
    //      var elems = k3d.Part.LineToBeam(new List<Line3>(){new Line3(p0, p1)}, new List<string>(){ celem.elem_tag },
    //        new List<CroSec>(), logger, out tmp_nodes, celem.bending_stiff);
    //      beams.AddRange(elems);
    //    }

    //    var cond = new List<bool>(){ true, true, true, true, true, true};
    //    var support = k3d.Support.Support(0, cond);
    //    var supports = new List<Support>(){support};
    //
    //    var pload = k3d.Load.PointLoad(1, new Vector3(0, 0, -10), new Vector3());
    //    var ploads = new List<Load>(){pload};

    kmodel = new Model();
    //    Model(List<Node>, List<FemMaterial>, List<CroSec>, List<ModelElement>,
    //    List < PointLoad>, List < PointMass>, List < MeshLoad>, List < ElementLoad>,
    //    List < Support>, List < ElemSet>, Dictionary < Int32, GravityLoad>,
    //    ItemSelector, IdManager, Int32)
  }
# ---------- end c_script_2 ----------
ghpython_script_2 = GhPythonScript(
    conmech_dir=panel_9,
    save_dir=panel_8,
    file_name=concatenate,
    grounded_supports=support_karamba3d_6,
    model_name="2D_truss",
    save_path=panel_8,
    export=export_json,
    format_json=format_json,
    reimport_from_json=reimport_from_json)  # -> out, Model_out; inputs grounded_supports: list, export: Boolean, format_json: Boolean, reimport_from_json: Boolean
# ---------- ghpython_script_2: Python ----------
import rhinoscriptsyntax as rs
import Rhino.Geometry.Plane as Plane
import Rhino.Geometry.Point3d as Point3d
import Rhino.Geometry.Vector3d as Vector3d
import Rhino.Geometry.Quaternion as Quat
import Grasshopper.DataTree as DataTree # Add, AddRange(list, GHPath(i, j))
import Grasshopper.Kernel.Data.GH_Path as GHPath
import System
from System.Collections.Generic import List

from ghpythonlib.treehelpers import list_to_tree, tree_to_list
import os
import json
##############################

import clr
# https://ironpython.net/documentation/dotnet/dotnet.html

clr.AddReferenceToFileAndPath("C:\Program Files\Rhino 6\Plug-ins\Karamba.gha")
clr.AddReferenceToFileAndPath("C:\Program Files\Rhino 6\Plug-ins\KarambaCommon.dll")

import feb # Karamba's C++ library (undocumented in the API)
import Karamba.Models.Model as Model
import Karamba.GHopper.Models.GH_Model as GH_Model
#
import Karamba
import Karamba.Elements.ModelTruss as Truss
from Karamba.Geometry import Point3, Line3, Vector3
from Karamba.CrossSections import CroSec
from Karamba.Supports import Support
from Karamba.Loads import Load
#
from Karamba.Utilities import MessageLogger, UnitsConversionFactories
import KarambaCommon
#
import System
from System import GC
from System.Collections.Generic import List

#####################################
# add path to conmech script folder
import os, sys 
sys.path.append(os.path.join(conmech_dir, "src", "pyconmech", "frame_analysis"))
#from io_base import Model
import io_base
import karamba_io
reload(io_base)
reload(karamba_io)
from karamba_io import KarambaNode, KarambaElement, KarambaSupport, KarambaCrossSec, \
    KarambaMaterialIsotropic, KarambaModel
from io_base import LoadCase

#####################################

with open(os.path.join(save_dir, file_name), 'r') as f:
    data = json.load(f)

km = KarambaModel.from_data(data)
lc = LoadCase.from_data(data['loadcases']['0'])

model = km.to_karamba(lc)

# calculate Th.I response
logger = MessageLogger();
k3d = KarambaCommon.Toolkit();
max_disp = clr.Reference[List[float]]()
out_g = clr.Reference[List[float]]()
out_comp = clr.Reference[List[float]]()
message = clr.Reference[str]()
model = k3d.Algorithms.AnalyzeThI(model, max_disp, out_g, out_comp, message);

ucf = UnitsConversionFactories.Conv();
cm = ucf.cm();
print "max disp: {} {}".format(cm.toUnit(max_disp.Value[0]), cm.unitB)

Model_out = Karamba.GHopper.Models.GH_Model(model);
# ---------- end ghpython_script_2 ----------
c_script_3 = CSharpScript(Reference=["C:\Program Files\Rhino 6\Plug-ins\karambaCommon.dll", "C:\Program Files\Rhino 6\Plug-ins\karamba.gha"])  # -> out, Model_out; disabled
# ---------- c_script_3: C# usings ----------
using Karamba.Utilities;
using Karamba.Geometry;
using Karamba.CrossSections;
using Karamba.Supports;
using Karamba.Loads;
# ---------- c_script_3: C# ----------
    var logger = new MessageLogger();
    var k3d = new KarambaCommon.Toolkit();

    var p0 = new Point3(0, 0, 0);
    var p1 = new Point3(0, 0, 5);
    var L0 = new Line3(p0, p1);

    var nodes = new List<Point3>();

    var elems = k3d.Part.LineToBeam(new List<Line3>(){L0}, new List<string>(){ "B1" },
      new List<CroSec>(), logger, out nodes);

    var cond = new List<bool>(){ true, true, true, true, true, true};
    var support = k3d.Support.Support(0, cond);
    var supports = new List<Support>(){support};

    var pload = k3d.Load.PointLoad(1, new Vector3(0, 0, -10), new Vector3());
    var ploads = new List<Load>(){pload};

    double mass;
    Point3 cog;
    bool flag;
    string info;
    var model = k3d.Model.AssembleModel(elems, supports, ploads,
      out info, out mass, out cog, out info, out flag);

    Model_out = new Karamba.GHopper.Models.GH_Model(model);

    //    // calculate Th.I response
    //    List<double> max_disp;
    //    List<double> out_g;
    //    List<double> out_comp;
    //    string message;
    //    model = k3d.Algorithms.AnalyzeThI(model, out max_disp, out out_g, out out_comp, out message);
    //
    //    var ucf = UnitsConversionFactories.Conv();
    //    UnitConversion cm = ucf.cm();
    //    Print("max disp: " + cm.toUnit(max_disp[0]) + cm.unitB);
    //
    //    Model_out = new Karamba.GHopper.Models.GH_Model(model);
# ---------- end c_script_3 ----------
ghpython_script_3 = GhPythonScript(x=rhino_doc_dir_2)  # -> a; disabled
# ---------- ghpython_script_3: Python ----------
import os

a = os.path.join(x, '..', '..', '..', 'tests', 'test_data', file_name)
# ---------- end ghpython_script_3 ----------
ghpython_script_4 = GhPythonScript(conmech_dir=panel_9)  # -> out, Model_out; disabled
# ---------- ghpython_script_4: Python ----------
# add path to conmech script folder
import os, sys 
sys.path.append(os.path.join(conmech_dir, "src", "pyconmech", "frame_analysis"))
from io_base import Model

print sys.version.lower()

##############################

import clr
# https://ironpython.net/documentation/dotnet/dotnet.html

clr.AddReferenceToFileAndPath("C:\Program Files\Rhino 6\Plug-ins\Karamba.gha")
clr.AddReferenceToFileAndPath("C:\Program Files\Rhino 6\Plug-ins\KarambaCommon.dll")

import feb # Karamba's C++ library (undocumented in the API)
import Karamba.Models.Model as Model
import Karamba.GHopper.Models.GH_Model as GH_Model
#
import Karamba
import Karamba.Elements.ModelTruss as Truss
from Karamba.Geometry import Point3, Line3, Vector3
from Karamba.CrossSections import CroSec
from Karamba.Supports import Support
from Karamba.Loads import Load
#
from Karamba.Utilities import MessageLogger, UnitsConversionFactories
import KarambaCommon
#
import System
from System import GC
from System.Collections.Generic import List

###############################

logger = MessageLogger();
k3d = KarambaCommon.Toolkit();

p0 = Point3(0, 0, 0);
p1 = Point3(0, 0, 5);
L0 = Line3(p0, p1);

# clr trick to handle C# out parameter
# https://ironpython.net/documentation/dotnet/dotnet.html#id52
nodes = clr.Reference[List[Point3]]()
#print(type(nodes))
elems = k3d.Part.LineToBeam(List[Line3]([L0]), List[str](["B1"]), 
    List[CroSec](), logger, nodes);

cond = List[System.Boolean]([True for _ in range(6)]);
support = k3d.Support.Support(0, cond);
supports = List[Support]([support]);

pload = k3d.Load.PointLoad(1, Vector3(0, 0, -10), Vector3());
ploads = List[Load]([pload]);

mass = clr.Reference[float]()
cog = clr.Reference[Point3]()
warning_flag = clr.Reference[bool]()
info = clr.Reference[str]()
msg = clr.Reference[str]()
model = k3d.Model.AssembleModel(elems, supports, ploads,
    info, mass, cog, msg, warning_flag);

# calculate Th.I response
max_disp = clr.Reference[List[float]]()
out_g = clr.Reference[List[float]]()
out_comp = clr.Reference[List[float]]()
message = clr.Reference[str]()
model = k3d.Algorithms.AnalyzeThI(model, max_disp, out_g, out_comp, message);

ucf = UnitsConversionFactories.Conv();
cm = ucf.cm();
print "max disp: {} {}".format(cm.toUnit(max_disp.Value[0]), cm.unitB)

Model_out = Karamba.GHopper.Models.GH_Model(model);
# ---------- end ghpython_script_4 ----------
panel_13 = Panel(c_script_2.out)  # disabled
python_karamba_model_converter = PythonKarambaModelConverter(
    Model_in=ghpython_script_4.Model_out,
    Reference=["C:\Program Files\Rhino 6\Plug-ins\karambaCommon.dll", "C:\Program Files\Rhino 6\Plug-ins\karamba.gha"])  # -> out, Model_out; disabled
# ---------- python_karamba_model_converter: Python usings ----------
using Karamba.Models;
using Karamba.GHopper.Models;
# ---------- python_karamba_model_converter: Python ----------
    var model = Model_in as Model;
    if (model == null) {
      throw new ArgumentException("The input in 'Model_in' is not of type karamba.Models.Model!");
    }
    
    Model_out = new GH_Model(model);

    Print("Everything OK");
# ---------- end python_karamba_model_converter ----------
python_karamba_model_converter_2 = PythonKarambaModelConverter(
    Model_in=ghpython_script_2.Model_out,
    Reference=["C:\Program Files\Rhino 6\Plug-ins\karambaCommon.dll", "C:\Program Files\Rhino 6\Plug-ins\karamba.gha"])  # -> out, Model_out; same code as python_karamba_model_converter
panel_14 = Panel(python_karamba_model_converter_2.Model_out)
stream_filter_2 = StreamFilter(Gate=Slider(0, range=0..1), Stream0=assemble_model_karamba3d.Model, Stream1=python_karamba_model_converter_2.Model_out)

# ---- group: Analyze Model
analyze_karamba3d = AnalyzeKaramba3D(Model=stream_filter_2)  # -> CalculatedModel, MaximumDisplacement_cm, ResultingForceOfGravity_kN, ElasticEnergy_kNm
displacement = Panel(analyze_karamba3d.MaximumDisplacement_cm)

# ----
disassemble_model_karamba3d = DisassembleModelKaramba3D(Model=analyze_karamba3d.CalculatedModel)  # -> Model, Point, Beam, Shell, Support, Load, Line, Mesh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
panel_15 = Panel(disassemble_model_karamba3d.Beam)
panel_16 = Panel(c_script.out)
disassemble_cross_section_karamba3d = DisassembleCrossSectionKaramba3D(CroSec=cross_section_karamba3d)  # -> CrossSection, FamilyNameOfCrossSection, TypeNameOfCrossSection, ElemIdentifiers, Color, Material, LocalEccentricity_cm, Heights_cm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
model_karamba3d_2 = ModelKaramba3D(assemble_model_karamba3d.Model)
model_karamba3d_3 = ModelKaramba3D(python_karamba_model_converter_2.Model_out)
disassemble_model_karamba3d_2 = DisassembleModelKaramba3D(Model=model_karamba3d_2)  # -> Model, Point, Beam, Shell, Support, Load, Line, Mesh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
disassemble_model_karamba3d_3 = DisassembleModelKaramba3D(Model=model_karamba3d_3)  # -> Model, Point, Beam, Shell, Support, Load, Line, Mesh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
panel_17 = Panel(disassemble_cross_section_karamba3d.Area_cm2)
panel_18 = Panel(disassemble_cross_section_karamba3d.Iyy_cm4)
panel_19 = Panel(disassemble_cross_section_karamba3d.Izz_cm4)
panel_20 = Panel(disassemble_cross_section_karamba3d.Ipp_cm4)
panel_21 = Panel(disassemble_cross_section_karamba3d.Material)
disassemble_material_karamba3d = DisassembleMaterialKaramba3D(Material=disassemble_cross_section_karamba3d.Material)  # -> Material, TypeOfMaterial, FamilyNameOfMaterial, NameOfMaterial, ElemIdentifiers, Color, YoungsModulusKNCm2Dir12, InPlaneShearModulus_kN_cm2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
panel_22 = Panel(disassemble_model_karamba3d_3.Beam)
panel_23 = Panel(disassemble_model_karamba3d_2.Beam)
model_karamba3d_4 = ModelKaramba3D(analyze_karamba3d.CalculatedModel)

# ---- group: Check Beam Internal Forces
# In local axis!
# -You can call a specific group of beams using
# the 'BeamIds' input.
# -Adding '3' to the resolution input provides values
# at the middle of each beam in addition to the
# two ends (default).
beam_forces_karamba3d = BeamForcesKaramba(AnalyzedModel=model_karamba3d_4, LCase=-1, MaximumDistanceBetweenResults_m=-1, NumberOfResultsPerBeamElement=2)  # -> AnalyzedModel, simplify(graft(NormalForce_kN)), simplify(graft(ShearForceVz_kN)), simplify(graft(ShearForceVy_kN)), simplify(graft(BendingMomentMt_kNm)), simplify(graft(BendingMomentMy_kNm)), simplify(graft(BendingMomentMz_kNm))

# ---- group: Check Beam Displacements
# In global axis!
# -You can call a specific group of beams using
# the 'BeamIds' input.
# -Adding '3' to the resolution input provides values
# at the middle of each beam in addition to the
# two ends (default).
beam_displacements_karamba3d = BeamDisplacementsKaramba(AnalyzedModel=model_karamba3d_4, LoadCase=-1, MaximumDistanceBetweenResults_ft=-1, NumberOfResultsPerElement=2)  # -> AnalyzedModel, simplify(graft(Translations_ft)), simplify(graft(Rotations_rad))
concatenate_3 = Concatenate(FragmentA=beam_displacements_karamba3d.Translations_ft, FragmentB=beam_displacements_karamba3d.Rotations_rad)
panel_24 = Panel(concatenate_3)

# ----
reaction_forces_karamba3d = ReactionForcesKaramba3D(AnalyzedModel=model_karamba3d_4, ResultCase=0)  # -> AnalyzedModel, simplify(graft(ReactionForces_kN)), simplify(graft(ReactionMoments_kNm)), SupportPosition, SumOfReactionForces_kN, SumOfReactionMoments_kNm
panel_25 = Panel(reaction_forces_karamba3d.SumOfReactionForces_kN)
panel_26 = Panel(reaction_forces_karamba3d.SumOfReactionMoments_kNm)
panel_27 = Panel(reaction_forces_karamba3d.ReactionForces_kN)
panel_28 = Panel(reaction_forces_karamba3d.ReactionMoments_kNm)

# ---- group: View Results
model_view_karamba3d = ModelViewKaramba3D(Model=analyze_karamba3d.CalculatedModel, LoadCaseFactorsForLinearSuperposition=1, IndexOfVisibleLoadcase=-1)  # -> Model, DeformedMesh, DeformedAxes, DeformedModel
beam_view_karamba3d = BeamViewKaramba3D(Model=model_view_karamba3d.Model)  # -> Model, MeshesOfRenderedBeams, DeformedBeamAxes, LegendColors, LegendTags
legend = Legend(Colour=beam_view_karamba3d.LegendColors, Tags=beam_view_karamba3d.LegendTags, LegendType=1)

# ----
concatenate_4 = Concatenate(
    Fragment_A=beam_forces_karamba3d.NormalForce_kN,
    C=" | ",
    Fragment_B=beam_forces_karamba3d.ShearForceVy_kN,
    A=" | ",
    B=beam_forces_karamba3d.ShearForceVz_kN,
    E=" | ",
    D=beam_forces_karamba3d.BendingMomentMt_kNm,
    F=" | ",
    G=beam_forces_karamba3d.BendingMomentMy_kNm,
    H=" | ",
    I=beam_forces_karamba3d.BendingMomentMz_kNm)
panel_29 = Panel(concatenate_4)
concatenate_5 = Concatenate(FragmentA=reaction_forces_karamba3d.ReactionForces_kN, FragmentB=panel_28)
panel_30 = Panel(concatenate_5)
