# Grasshopper definition parse_frame_json_conmech.ghx (Grasshopper 1.0.7)
# plug-ins: karambaGH

panel = Panel("bad_material_properties_model.json")
rhino_doc_dir = RhinoDocDir()  # -> rhino_doc_dir
# ---------- rhino_doc_dir: Python ----------
import scriptcontext as sc
from os import path

rhino_doc_dir = path.abspath(path.dirname(sc.doc.Path))
# ---------- end rhino_doc_dir ----------
panel_3 = Panel("uniform_load_analytical_model.json")
panel_4 = Panel("tower_3D_broken_lines.json")
panel_5 = Panel("four-frame.json")
panel_6 = Panel("fertility.json")
panel_7 = Panel("simple_frame.json")
panel_8 = Panel("tower_3D.json")
text_split = TextSplit(Text="topopt-100.json", Separators=".")
concatenate = Concatenate(FragmentA=rhino_doc_dir, FragmentB="\..\..\tests\test_data\old_data")
panel_9 = Panel("topopt-100.json")
list_item = ListItem(List=text_split, Index=0, Wrap=True)
concatenate_2 = Concatenate(FragmentA=rhino_doc_dir, FragmentB="\..\..\tests\test_data")
panel_10 = Panel(concatenate)
ghpython_script = GhPythonScript()  # -> a
# ---------- ghpython_script: Python ----------
__author__ = "yijiangh"
__version__ = "2019.04.28"

import rhinoscriptsyntax as rs

a = [125, 126, 115, 122, 111, 108, 23, 22, 98, 75, 64, 34, 61, 65, 59, 60, 39, 36, 44, 67]
# ---------- end ghpython_script ----------
ghpython_script_2 = GhPythonScript()  # -> a; same code as ghpython_script

# ---- group: new conmech model
ghpython_script_3 = GhPythonScript(file_path=concatenate_2, file_name="tower_3D.json", use_partial_ids=Toggle(False), partial_ids=ghpython_script_2)  # -> out, node_points, ground_nodes, elements, partial_elements, partial_node_ids, partial_ground_nodes; inputs use_partial_ids: Boolean, partial_ids: list of Int32
# ---------- ghpython_script_3: Python ----------
__author__ = "yijiangh"
__version__ = "2019.04.28"

import json
import os
import rhinoscriptsyntax as rs
import Rhino.Geometry as rg
import ghpythonlib.components as ghcomp
import ghpythonlib.treehelpers as th
import math

def parse_point(json_point, scale=1.0):
    return rg.Point3d(*[scale*json_point['point'][i] for i in range(3)])

def parse_elements(json_data):
    return [json_element['end_node_inds']
        for json_element in json_data['elements']]

def parse_node_points(json_data, scale=1.0):
    return [parse_point(json_node,scale) for json_node in json_data['nodes']]

def parse_ground_nodes(json_data):
    return [int(json_node['node_ind']) for json_node in json_data['nodes'] if json_node['is_grounded']]

######################################
# main
fp = os.path.join(file_path, file_name)

with open(fp, 'r') as f:
    json_data = json.loads(f.read())

scale = 1
unit = json_data['unit']
if unit == 'millimeter' or unit == 'mm':
    scale = 1e-3
print('Unit: {}, converted to METER, scale {}'.format(unit, scale))

element_vids = parse_elements(json_data)
node_points = parse_node_points(json_data, scale)
ground_nodes = parse_ground_nodes(json_data)

elements = []
for vids in element_vids:
    elements.append(rg.Line(node_points[vids[0]], node_points[vids[1]]))
    
print('Nodes: {} | Ground: {} | Elements: {}'.format(
len(node_points), len(ground_nodes), len(elements)))

partial_node_ids = set()
partial_elements = []
partial_ground_nodes = []
if not use_partial_ids:
    partial_ids = list(range(len(elements)))
    
for c_e in partial_ids:
    partial_node_ids.update([element_vids[c_e][0], element_vids[c_e][1]])
    partial_elements.append(rg.Line(node_points[element_vids[c_e][0]], node_points[element_vids[c_e][1]]))
    if element_vids[c_e][0] in ground_nodes:
        partial_ground_nodes.append(element_vids[c_e][0])
    if element_vids[c_e][1] in ground_nodes:
        partial_ground_nodes.append(element_vids[c_e][1])
# ---------- end ghpython_script_3 ----------

# ---- group: old conmech model
ghpython_script_4 = GhPythonScript(file_path=concatenate, file_name="topopt-100.json", use_partial_ids=Toggle(False), partial_ids=ghpython_script)  # -> out, node_points, ground_nodes, elements, partial_elements, partial_node_ids, partial_ground_nodes, material_name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; inputs use_partial_ids: Boolean, partial_ids: list of Int32
# ---------- ghpython_script_4: Python ----------
__author__ = "yijiangh"
__version__ = "2019.04.28"

import json
import os
import rhinoscriptsyntax as rs
import Rhino.Geometry as rg
import ghpythonlib.components as ghcomp
import ghpythonlib.treehelpers as th
import math

def parse_point(json_point, scale=1.0):
#    return scale * np.array([json_point['X'], json_point['Y'], json_point['Z']])
    return rg.Point3d(scale*json_point['X'], scale*json_point['Y'], scale*json_point['Z'])

def parse_elements(json_data, parse_layers=False):
    if not parse_layers:
        return [json_element['end_node_ids']
            for json_element in json_data['element_list']]
#    else:
#        return [AssemblyElement(node_ids=json_element['end_node_ids'], layer_id=json_element['layer_id'], e_id=i)
#                for i, json_element in enumerate(json_data['element_list'])]

def parse_node_points(json_data, scale=1.0):
#    origin = parse_origin(json_data)
    return [parse_point(json_node['point'],scale) for json_node in json_data['node_list']]

def parse_ground_nodes(json_data):
    return {i for i, json_node in enumerate(json_data['node_list']) if json_node['is_grounded'] == 1}


# main

fp = os.path.join(file_path, file_name)

with open(fp, 'r') as f:
    json_data = json.loads(f.read())

scale = 1
unit = json_data['unit']
if unit == 'millimeter' or unit == 'mm':
    scale = 1e-3
print('Unit: {}, converted to METER, scale {}'.format(unit, scale))

element_vids = parse_elements(json_data, parse_layers=False)
node_points = parse_node_points(json_data, scale)
ground_nodes = parse_ground_nodes(json_data)

elements = []
for vids in element_vids:
    elements.append(rg.Line(node_points[vids[0]], node_points[vids[1]]))
    
print('Nodes: {} | Ground: {} | Elements: {}'.format(
len(node_points), len(ground_nodes), len(elements)))

partial_node_ids = set()
partial_elements = []
partial_ground_nodes = []
if not use_partial_ids:
    partial_ids = list(range(len(elements)))
    
for c_e in partial_ids:
    partial_node_ids.update([element_vids[c_e][0], element_vids[c_e][1]])
    partial_elements.append(rg.Line(node_points[element_vids[c_e][0]], node_points[element_vids[c_e][1]]))
    if element_vids[c_e][0] in ground_nodes:
        partial_ground_nodes.append(element_vids[c_e][0])
    if element_vids[c_e][1] in ground_nodes:
        partial_ground_nodes.append(element_vids[c_e][1])
        

material_name = json_data['material_properties']['material_name']
E = json_data['material_properties']['youngs_modulus']
E_unit = json_data['material_properties']['youngs_modulus_unit']

G = json_data['material_properties']['shear_modulus']
G_unit = json_data['material_properties']['shear_modulus_unit']

#sigma = json_data['material_properties']['tensile_yeild_stress']
#sigma_unit = json_data['material_properties']['tensile_yeild_stress_unit']

rho = json_data['material_properties']['density']
rho_unit = json_data['material_properties']['density_unit']

A = json_data['material_properties']['cross_sec_area']
A_unit = json_data['material_properties']['cross_sec_area_unit']
r = math.sqrt(A/math.pi)
r_unit = 'sqrt-'+A_unit
# ---------- end ghpython_script_4 ----------

# ----
integer = Integer(ghpython_script_3.ground_nodes)
point = Point(ghpython_script_3.node_points)
list_item_2 = ListItem(List=point, Index=integer, Wrap=True)
list_item_3 = ListItem(List=point, Index=Slider(7, range=0..10), Wrap=True)
curve = Curve([<curve referenced from the Rhino model> x6])
curve_2 = Curve(flatten(ghpython_script_3.elements))
list_item_4 = ListItem(List=curve_2, Index=integer, Wrap=True)
ghpython_script_5 = GhPythonScript(selected_crvs=curve, crvs=curve_2)  # -> out, ids; inputs selected_crvs: list of Curve, crvs: list of Curve
# ---------- ghpython_script_5: Python ----------
import rhinoscriptsyntax as rs
import Rhino.Geometry.Plane as Plane
import Rhino.Geometry.Point3d as Point3d
import Rhino.Geometry.Vector3d as Vector3d
import Rhino.Geometry.Curve as Curve
import Rhino.Geometry.Quaternion as Quat
import Grasshopper.DataTree as DataTree # Add, AddRange(list, GHPath(i, j))
import Grasshopper.Kernel.Data.GH_Path as GHPath
import System

from ghpythonlib.treehelpers import list_to_tree, tree_to_list
import os
#import json
#from compas.geometry import Frame
#from compas_ghpython import draw_pipes, draw_frame

eps = eps or 1e-6
ids = []
for s_crv in selected_crvs:
    spts = [s_crv.PointAtStart, s_crv.PointAtEnd]
    for i, crv in enumerate(crvs):
        pts = [crv.PointAtStart, crv.PointAtEnd]
        if all([p1.DistanceTo(p2)<eps for p1, p2 in zip(spts, pts)]) or \
            all([p1.DistanceTo(p2)<eps for p1, p2 in zip(spts[::-1], pts)]):
            ids.append(i)
            break
print ids
# ---------- end ghpython_script_5 ----------
number = Number(ghpython_script_4.r)
panel_11 = Panel(ghpython_script_4.material_name)
multiplication = Multiplication(A=number, B=2)
list_item_5 = ListItem(List=curve_2, Index=0, Wrap=True)
list_item_6 = ListItem(List=curve_2, Index=0, Wrap=True)  # -> Item, Item1, Item2, Item3
material_properties_karamba3d = MaterialPropertiesKaramba3D(
    FamilyOfMaterial="Steel",
    Name=panel_11,
    YoungsModulus_kN_cm2=ghpython_script_4.E,
    InPlaneShearModulus_kN_cm2=ghpython_script_4.G,
    TransverseShearModulus_kN_cm2=ghpython_script_4.E,
    SpecificWeight_kN_m3=ghpython_script_4.rho,
    CoefficientOfThermalExpansion_1_C=1e-05,
    YieldStrength_kN_cm2=23.5,
    mode="Isotrop")
point_2 = Point([Point(0.045, 0.045, 0.155), Point(-0.045, 0.045, 0.155), Point(-0.045, 0.015, 0.155), Point(-0.045, -0.015, 0.155), Point(-0.045, -0.045, 0.155), Point(-0.015, -0.045, 0.155), Point(0.015, -0.045, 0.155), Point(0.045, -0.045, 0.155), Point(0.045, -0.015, 0.155), Point(0.045, 0.015, 0.155), Point(0.015, 0.045, 0.155), Point(-0.015, 0.045, 0.155), Point(-0.015, 0.015, 0.155), Point(-0.015, -0.015, 0.155), Point(0.015, 0.015, 0.155), Point(0.015, -0.015, 0.155)])
cross_section_karamba3d = CrossSectionKaramba3D(
    FamilyNameOfCrossSection="DefaultCroSec",
    NameOfCrossSection="round_solid_sec",
    Material=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,
    Diameter_cm=multiplication,
    WallThickness_cm=number,
    mode="Circular Hollow")
panel_12 = Panel(ghpython_script_4.out)
curve_3 = Curve(ghpython_script_4.elements)
point_3 = Point(ghpython_script_4.node_points)
vector = Vector("0,0,-0.020")
curve_4 = Curve(list_item_6.Item)
curve_5 = Curve(list_item_6.Item3)
list_item_7 = ListItem(List=point_3, Index=ghpython_script_4.ground_nodes, Wrap=True)
loads_karamba3d = LoadsKaramba3D(Vector=Vector(0, 0, -1), LCase=0, mode="Gravity")
loads_karamba3d_2 = LoadsKaramba3D(ForceVector=vector, Local=False, PosInd=point_2, LCase=0, mode="Point")
support_karamba3d = SupportKaramba3D(PosInd=list_item_7, menu=[buttons(on, on, on, on, on, on)])
line_to_beam_karamba3d = LineToBeamKaramba3D(Line=curve_3, New=True, Remove=True, LimitDistance_m=0.005)  # -> Element, Points, Info
load_karamba3d = LoadKaramba3D([loads_karamba3d, loads_karamba3d_2])
material_karamba3d = MaterialKaramba3D(material_properties_karamba3d)
cross_section_karamba3d_2 = CrossSectionKaramba3D(cross_section_karamba3d)
assemble_model_karamba3d = AssembleModelKaramba3D(
    Elem=line_to_beam_karamba3d.Element,
    Support=support_karamba3d,
    Load=load_karamba3d,
    CrossSection=cross_section_karamba3d_2,
    Material=material_karamba3d,
    LimitDistance_m=0.005)  # -> Model, Info, Mass_kg, CenterOfGravity
text = Text(flatten(list_item))
concatenate_3 = Concatenate(FragmentA=rhino_doc_dir, FragmentB="\..\..\tests\test_data")
format_json = BooleanToggle(False)
export_json = BooleanToggle(False)
support_karamba3d_2 = SupportKaramba(flatten(support_karamba3d))
panel_13 = Panel(text)
model_karamba3d = ModelKaramba3D(assemble_model_karamba3d.Model)
analyze_karamba3d = AnalyzeKaramba3D(Model=assemble_model_karamba3d.Model)  # -> CalculatedModel, MaximumDisplacement_cm, ResultingForceOfGravity_kN, ElasticEnergy_kNm
panel_14 = Panel(concatenate_3)

# ---- group: convert a karamba model into conmech format and export
c_script = CSharpScript(
    k_model=model_karamba3d,
    k_grounded_nodes=support_karamba3d_2,
    model_name=panel_13,
    save_path=concatenate_3,
    export=export_json,
    format_json=format_json,
    Reference=["C:\Program Files\Rhino 6\Plug-ins\karambaCommon.dll", "C:\Program Files\Rhino 6\Plug-ins\karamba.gha", "D:\CODE_WS\GH_SCRITPS\EXTRUSION_FRAME_CREATOR\Newtonsoft.Json.dll"])  # -> out, A; inputs k_grounded_nodes: list, model_name: String, save_path: String, export: Boolean, limit_distance: Double, format_json: Boolean
# ---------- c_script: C# usings ----------
using System.IO;
using Karamba.Models;
using Karamba.Nodes;
using Karamba.CrossSections;
using Karamba.Elements;
using Karamba.Loads;
using Karamba.Materials;
using Karamba.Supports;
using Karamba.Geometry;
using Karamba.Joints;
using Newtonsoft.Json;
# ---------- c_script: C# ----------
    var k_model = _k_model as Model;
    if (k_model == null) {
      throw new ArgumentException("The input is not of type karamba model!");
    }
    if (limit_distance == 0) {
      limit_distance = 0.005; // meter
    }

    // initiate nodes with id and position
    var c_nodes = k_model.nodes.ConvertAll(kn => new ConmechFrameNode(kn));

    // support fixities & gounded node tags
    var k_grounded = _k_grounded_nodes.ConvertAll(x => x as Support);

    // tag grounded
    foreach(Support k_supp in k_model.supports) {
      foreach(Support k_g in k_grounded) {
        if (k_g == null) {
          throw new ArgumentException("The input is not of type karamba support!");
        }
        if(k_supp.position.DistanceTo(k_g.position) < limit_distance) {
          c_nodes[k_supp.node_ind].is_grounded = true;
        }
      }
    }

    // element data
    var c_elements = k_model.elems.ConvertAll(ke => new ConmechFrameElement(ke as ModelTruss));

    // support data
    var c_supports = k_model.supports.ConvertAll(ks => new ConmechSupport(ks as Support));

    // material data
    var c_mats = k_model.materials.ConvertAll(km => new ConmechFemMaterial(km));

    // cross section data
    var c_crosecs = k_model.crosecs.ConvertAll(kc => new ConmechCrossSec(kc as CroSec_Beam));

    // load data
    var c_ploads = k_model.ploads.ConvertAll(kl => new ConmechPointLoad(kl as PointLoad));
    var c_eloads = k_model.eloads.ConvertAll(kl => new ConmechUnifDistLoad(kl as UniformlyDistLoad));
    GravityLoad k_grav;
    ConmechGravityLoad c_grav = null;
    k_model.gravities.TryGetValue(0, out k_grav);
    if(k_grav != null){
      c_grav = new ConmechGravityLoad(k_grav);
    }

    // joint data
    var c_joints = k_model.joints.ConvertAll(kj => new ConmechJoint(kj));

    var c_model = new ConmechModel();
    c_model.model_name = model_name;
    c_model.generate_time = DateTime.Now.ToString();
    c_model.unit = "meter";
    c_model.element_num = k_model.elems.Count;
    c_model.node_num = k_model.nodes.Count;

    c_model.nodes = c_nodes;
    c_model.elements = c_elements;
    c_model.joints = c_joints;
    c_model.supports = c_supports;

    c_model.cross_secs = c_crosecs;
    c_model.materials = c_mats;

    var c_loadcase = new ConmechLoadCase();
    c_loadcase.ploads = c_ploads;
    c_loadcase.eloads = c_eloads;
    if(c_grav != null){
      c_loadcase.gravity = c_grav;
    }

    // save to json
    if(export) {
      JsonSerializer serializer = new JsonSerializer();
      serializer.NullValueHandling = NullValueHandling.Ignore;
      if(format_json) {
        serializer.Formatting = Newtonsoft.Json.Formatting.Indented;
      }
      // serialize shape to a json file
      string shape_file_path = String.Concat(save_path, Path.DirectorySeparatorChar,
        model_name, ".json");
      using (StreamWriter sw = new StreamWriter(@shape_file_path))
      using (JsonWriter writer = new JsonTextWriter(sw))
      {
        serializer.Serialize(writer, c_model);
      }
      Print("Shape saved to {0}", shape_file_path);

      // serialize load case to a json file
      string load_file_path = String.Concat(save_path, Path.DirectorySeparatorChar,
        model_name, "_loads.json");
      using (StreamWriter sw = new StreamWriter(@load_file_path))
      using (JsonWriter writer = new JsonTextWriter(sw))
      {
        serializer.Serialize(writer, c_loadcase);
      }
      Print("Load saved to {0}", load_file_path);
    }
# ---------- c_script: C# additional code ----------
  // TODO compile these into a dll
//  public class cPoint3
//  {
//    public cPoint3(Point3 p) {
//      X = p.X; Y = p.Y; Z = p.Z;
//    }
//    public cPoint3(Vector3 p) {
//      X = p.X; Y = p.Y; Z = p.Z;
//    }
//    public double X { get; set; }
//    public double Y { get; set; }
//    public double Z { get; set; }
//  }
  
  
  public class ConmechFrameNode
  {
    public ConmechFrameNode(Node k_node) {
      node_ind = -1;
      is_grounded = false;
      node_ind = k_node.ind;
      point = new List<double>(){k_node.pos.X, k_node.pos.Y, k_node.pos.Z};
    }
    public List<double> point { get; set; }
    public int node_ind { get; set; }
    // is_grounded marks if the node is a support node
    public bool is_grounded { get; set; }
  }

  public class ConmechFrameElement
  {
    public ConmechFrameElement(ModelTruss ke) {
      elem_tag = ke.id;
      elem_ind = ke.ind;
      end_node_inds = ke.node_inds as List<int>;
      bending_stiff = ke.bending_stiff;
      // default layer index
      layer_ind = -1;
    }
    public List<int> end_node_inds { get; set; }
    // element identifier
    public string elem_tag { get; set; }
    // zero-based index of element in model
    public int elem_ind { get; set; }
    // an extra tag identify for grouping elements, can be used in sequencing
    public int layer_ind { get; set; }
    public bool bending_stiff { get; set; }

    // TODO: export local coordinate frame and import into conmech
  }

  public class ConmechFemMaterial
  {
    public ConmechFemMaterial(FemMaterial km) {
      // TODO: read unit from Karamba
      E_unit = "kN/m2";
      G12_unit = "kN/m2";
      fy_unit = "kN/m2";
      density_unit = "kN/m3";

      type_name = km.typeName();
      if (type_name != "ISO") {
        throw new ArgumentException("orthotropic material not implemented!!");
      }
      family = km.family;
      name = km.name;
      elem_tags = km.elemIds;
      E = km.E();
      G12 = km.G12();
      fy = km.fy();
      density = km.gamma();
    }

    public string family { get; set; }
    public string name { get; set; }
    public string type_name { get; set; }
    public string _source { get; set; }

    // list of element identifiers to which the cross section is to be attached.
    // applied to all elements if the list is empty
    public List<string> elem_tags { get; set; }

    public double E { get; set; }
    public string E_unit { get; set; }

    // in-plane shear modulus
    public double G12 { get; set; }
    public string G12_unit { get; set; }

    // transverse shear modulus
    //    public double G3 { get; set; }
    //    public string G3_unit { get; set; }

    // tensile yield stress
    public double fy { get; set; }
    public string fy_unit { get; set; }

    // gamma
    public double density { get; set; }
    public string density_unit { get; set; }
  }

  public class ConmechCrossSec {
    public ConmechCrossSec(CroSec_Beam kcs) {
      // TODO: read unit from Karamba
      A_unit = "m2";
      Iy_unit = "m4";
      Iz_unit = "m4";
      Jx_unit = "m4";

      family = kcs.family;
      name = kcs.name;
      elem_tags = kcs.elemIds;
      A = kcs.A;
      Jx = kcs.Ipp;
      Iy = kcs.Iyy;
      Iz = kcs.Izz;
    }

    public string family { get; set; }
    public string name { get; set; }
    public string _source { get; set; }

    // list of element identifiers to which the cross section is to be attached.
    // applied to all elements if the list is empty
    public List<string> elem_tags { get; set; }

    public double A { get; set; }
    public string A_unit { get; set; }
    public string _A_note { get; set; }

    // around local axis
    public double Jx { get; set; }
    public string Jx_unit { get; set; }
    public string _Jx_note { get; set; }

    public double Iy { get; set; }
    public string Iy_unit { get; set; }
    public string _Iy_note { get; set; }

    public double Iz { get; set; }
    public string Iz_unit { get; set; }
    public string _Iz_note { get; set; }
  }

  public class ConmechJoint
  {
    public ConmechJoint(Joint kj){
      c_conditions = new List<List<Nullable<double>>>();
      c_conditions.Add(kj.c_condition(0));
      c_conditions.Add(kj.c_condition(1));
      elem_tags = kj.elemIds;
    }
    public List<List<Nullable<double>>> c_conditions { get; set; }
    // element tags
    public List<string> elem_tags { get; set; }
  }

  public class ConmechSupport
  {
    public ConmechSupport(Support ks){
      condition = ks.Condition as List<bool>;
      node_ind = ks.node_ind;
    }
    public List<bool> condition { get; set; }
    public int node_ind { get; set; }
  }

  public class ConmechPointLoad
  {
    public ConmechPointLoad(PointLoad kf) {
      force = new List<double>(){kf.force.X, kf.force.Y, kf.force.Z};
      force_unit = "kN";
      moment =  new List<double>(){kf.moment.X, kf.moment.Y, kf.moment.Z};
      moment_unit = "kNm";
      node_ind = kf.node_ind;
    }
    public List<double> force { get; set; }
    public string force_unit { get; set; }
    public List<double> moment { get; set; }
    public string moment_unit { get; set; }
    public int node_ind { get; set; }
  }

  public class ConmechUnifDistLoad
  {
    public ConmechUnifDistLoad(UniformlyDistLoad  kf) {
      Q = new List<double>(){kf.Q.X, kf.Q.Y, kf.Q.Z};
      Q_unit = "kN/m";
      Load = new List<double>(){kf.Load.X, kf.Load.Y, kf.Load.Z};
      // element tags
      elem_tags = kf.beamIds;
    }
    public List<double> Q { get; set; }
    public string Q_unit { get; set; }
    public List<double> Load { get; set; }
    public List<string> elem_tags { get; set; }
  }

  public class ConmechGravityLoad
  {
    public ConmechGravityLoad(GravityLoad kf) {
      force = new List<double>(){kf.force.X, kf.force.Y, kf.force.Z};
      force_unit = "kN";
    }
    public List<double> force { get; set; }
    public string force_unit { get; set; }
  }

  public class ConmechLoadCase
  {
    public List<ConmechPointLoad> ploads { get; set; }
    // TODO: only support uniformly dist element load for now
    public List<ConmechUnifDistLoad> eloads { get; set; }
    public ConmechGravityLoad gravity { get; set; }
  }

  public class ConmechModel
  {
    public string model_name { get; set; }
    public string unit { get; set; }
    public string generate_time { get; set; }

    public int node_num { get; set; }
    public int element_num { get; set; }

    public List<ConmechFrameNode> nodes { get; set; }
    public List<ConmechFrameElement> elements { get; set; }

    public List<ConmechSupport> supports { get; set; }
    public List<ConmechJoint> joints { get; set; }

    public List<ConmechCrossSec> cross_secs { get; set; }
    public List<ConmechFemMaterial> materials { get; set; }
  }
# ---------- end c_script ----------

# ----
model_view_karamba3d = ModelViewKaramba3D(Model=analyze_karamba3d.CalculatedModel, ResultFactors=1, ResultCase=-1)  # -> Model, DeformedMesh, DeformedAxes, DeformedModel
