# Grasshopper definition conmech_to_karamba.gh (Grasshopper 1.0.7)
# plug-ins: karambaGH

number_slider = Slider(0.5, range=0..10)
division = Division(A=number_slider, B=2)
panel = Panel("C:\Users\harry\Dropbox (MIT)\code_ws_dropbox\pb_ws\conmech\examples\scripts\cantilever_beam_truss\cantilever_beam_truss.json")
cross_section_karamba3d = CrossSectionKaramba3D(
    FamilyNameOfCrossSection="DefaultCroSec",
    Material=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,
    Diameter_cm=number_slider,
    WallThickness_cm=division,
    mode="Circular Hollow")
material_properties_karamba3d = MaterialPropertiesKaramba3D(
    FamilyOfMaterial="Steel",
    Name="S235",
    YoungsModulus_kN_cm2=21000,
    InPlaneShearModulus_kN_cm2=8076,
    TransverseShearModulus_kN_cm2=8076,
    SpecificWeight_kN_m3=78.5,
    CoefficientOfThermalExpansion_1_C=1e-05,
    YieldStrength_kN_cm2=23.5,
    mode="Isotrop")
rhino_doc_dir = RhinoDocDir()  # -> rhino_doc_dir
# ---------- rhino_doc_dir: Python ----------
import scriptcontext as sc
from os import path

rhino_doc_dir = path.abspath(path.dirname(sc.doc.Path))
# ---------- end rhino_doc_dir ----------
ghpython_script = GhPythonScript(x=rhino_doc_dir)  # -> out, a
# ---------- ghpython_script: Python ----------
import os

a = os.path.abspath(os.path.join(x,"..",".."))
# ---------- end ghpython_script ----------
text = Text(panel)
panel_2 = Panel(ghpython_script.a)
ghpython_script_2 = GhPythonScript(conmech_dir=ghpython_script.a, result_file_path=text, limit_distance="1e-12")  # -> out, Model_out, support_points, load_points, load_vectors
# ---------- ghpython_script_2: Python ----------
import rhinoscriptsyntax as rs
import Rhino.Geometry.Plane as Plane
import Rhino.Geometry.Point3d as Point3d
import Rhino.Geometry.Vector3d as Vector3d
import Rhino.Geometry.Quaternion as Quat
import Grasshopper.DataTree as DataTree # Add, AddRange(list, GHPath(i, j))
import Grasshopper.Kernel.Data.GH_Path as GHPath
import System
from System.Collections.Generic import List

from ghpythonlib.treehelpers import list_to_tree, tree_to_list
import os
import json
##############################

import clr
# https://ironpython.net/documentation/dotnet/dotnet.html

clr.AddReferenceToFileAndPath("C:\Program Files\Rhino 6\Plug-ins\Karamba\Karamba.gha")
clr.AddReferenceToFileAndPath("C:\Program Files\Rhino 6\Plug-ins\Karamba\KarambaCommon.dll")

import feb # Karamba's C++ library (undocumented in the API)
import Karamba.Models.Model as Model
import Karamba.GHopper.Models.GH_Model as GH_Model
#
import Karamba
import Karamba.Elements.ModelTruss as Truss
from Karamba.Geometry import Point3, Line3, Vector3
from Karamba.CrossSections import CroSec
from Karamba.Supports import Support
from Karamba.Loads import Load
#
from Karamba.Utilities import MessageLogger, UnitsConversionFactories
import KarambaCommon
#
import System
from System import GC
from System.Collections.Generic import List

#####################################
# add path to conmech script folder
import os, sys 
sys.path.append(os.path.join(conmech_dir, "src", "pyconmech", "frame_analysis"))
#from io_base import Model
import io_base
import karamba_io
reload(io_base)
reload(karamba_io)
from karamba_io import KarambaModel
from io_base import LoadCase, GravityLoad

#####################################

with open(result_file_path, 'r') as f:
    conmech_data = json.load(f)
with open(result_file_path.split('.json')[0] + '_loadcase.json', 'r') as f:
    lc_data = json.load(f)

print('{} | {}'.format(conmech_data["model_name"], conmech_data['generate_time']))
km = KarambaModel.from_data(conmech_data)
lc = LoadCase.from_data(lc_data)

model = km.to_karamba(lc, limit_dist=limit_distance)

## calculate Th.I response
#logger = MessageLogger();
#k3d = KarambaCommon.Toolkit();
#max_disp = clr.Reference[List[float]]()
#out_g = clr.Reference[List[float]]()
#out_comp = clr.Reference[List[float]]()
#message = clr.Reference[str]()
#model = k3d.Algorithms.AnalyzeThI(model, max_disp, out_g, out_comp, message);
#
#ucf = UnitsConversionFactories.Conv();
#cm = ucf.cm();
#print "max disp: {} {}".format(cm.toUnit(max_disp.Value[0]), cm.unitB)
#
Model_out = Karamba.GHopper.Models.GH_Model(model);

nodes = km.nodes
support_points = [Point3d(*nodes[s.node_ind].point) for s in km.supports.values()]

load_points = [Point3d(*nodes[pl.node_ind].point) for pl in lc.point_loads]
load_vectors = [Vector3d(*pl.force) for pl in lc.point_loads]
# ---------- end ghpython_script_2 ----------
panel_3 = Panel(ghpython_script_2.out)
vector = Vector(ghpython_script_2.load_vectors)
multiplication = Multiplication(A=vector, B=Slider(1.8, range=1..100))
point = Point(ghpython_script_2.load_points)
disassemble_model_karamba3d = DisassembleModelKaramba3D(Model=ghpython_script_2.Model_out)  # -> Model, Point, Beam, Shell, Support, Load, Line, Mesh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
disassemble_element_karamba3d = DisassembleElementKaramba3D(Element=disassemble_model_karamba3d.Beam)  # -> Element, ElementIdentifier, AxisOfElement, CrossSection, Joints, Material, LocalCoordinateSystem, ElementIsActive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
line_to_beam_karamba3d = LineToBeamKaramba3D(
    Line=disassemble_element_karamba3d.AxisOfElement,
    CrossSection=cross_section_karamba3d,
    New=True,
    Remove=True,
    LimitDistance_m="1e-12",
    Bending=Toggle(True))  # -> Element, Points, Info
closest_point = ClosestPoint(Point=ghpython_script_2.support_points, Cloud=line_to_beam_karamba3d.Points)  # -> ClosestPoint, CPIndex, Distance
closest_point_2 = ClosestPoint(Point=point, Cloud=line_to_beam_karamba3d.Points)  # -> ClosestPoint, CPIndex, Distance
support_karamba3d = SupportKaramba3D(PosInd=closest_point.CPIndex, menu=[buttons(on, on, on, on, on, on)])
loads_karamba3d = LoadsKaramba3D(ForceVector=multiplication, Local=False, PosInd=closest_point_2.CPIndex, LCase=0, mode="Point")
panel_4 = Panel(material_properties_karamba3d)
panel_5 = Panel(disassemble_model_karamba3d.Material)
list_item = ListItem(List=disassemble_element_karamba3d.CrossSection, Index=0, Wrap=True)
assemble_model_karamba3d = AssembleModelKaramba3D(
    Elem=line_to_beam_karamba3d.Element,
    Support=support_karamba3d,
    Load=loads_karamba3d,
    CrossSection=disassemble_model_karamba3d.CrossSection,
    Material=disassemble_model_karamba3d.Material,
    LimitDistance_m="1e-12")  # -> Model, Info, Mass_kg, CenterOfGravity; disabled
panel_6 = Panel(list_item)
analyze_karamba3d = AnalyzeKaramba3D(Model=disassemble_model_karamba3d.Model)  # -> CalculatedModel, MaximumDisplacement_cm, ResultingForceOfGravity_kN, ElasticEnergy_kNm
eigen_modes_karamba3d = EigenModesKaramba3D(
    Model=analyze_karamba3d.CalculatedModel,
    FromIndex=Slider(1, range=1..50),
    NumberOfModes=1,
    MaximumNumberOfIterations=300,
    Epsilon=1e-07)  # -> ModelWithEigenModesAsLoadCaseResults, Eigenvalues; disabled
multiplication_2 = Multiplication(A=analyze_karamba3d.MaximumDisplacement_cm, B=0.01)
karamba_max_deform_m = Panel(multiplication_2)
panel_7 = Panel(analyze_karamba3d.ElasticEnergy_kNm)
panel_8 = Panel(eigen_modes_karamba3d.Eigenvalues)  # disabled
point_2 = Point(ghpython_script_2.support_points)
model_view_karamba3d = ModelViewKaramba3D(Model=analyze_karamba3d.CalculatedModel, ResultFactors=1, ResultCase=-1)  # -> Model, DeformedMesh, DeformedAxes, DeformedModel
dot_display = DotDisplay(Point=point_2, Colour=RGB(0, 0, 0), Size=Slider(0.005, range=0..0.01))
beam_view_karamba3d = BeamViewKaramba3D(Model=model_view_karamba3d.Model)  # -> Model, MeshesOfRenderedBeams, DeformedBeamAxes, LegendColors, LegendTags
