# Grasshopper definition 2D_frame.gh (Grasshopper 1.0.7)
# plug-ins: Karamba

# ----
# L
number_slider = Slider(1, range=0..10)

# ----
# manual layer selection
# DON'T FORGET TO INTERNALIZE
# DATA WHEN FINISHED!
panel = Panel("0")
construct_point = ConstructPoint(XCoordinate="7", YCoordinate="1", ZCoordinate=0)
construct_point_2 = ConstructPoint(XCoordinate="8", YCoordinate=panel, ZCoordinate=0)
construct_point_3 = ConstructPoint(XCoordinate=number_slider, YCoordinate=number_slider, ZCoordinate=0)
construct_point_4 = ConstructPoint(XCoordinate="4", YCoordinate="3", ZCoordinate=0)
construct_point_5 = ConstructPoint(XCoordinate="3", YCoordinate="2", ZCoordinate=0)
construct_point_6 = ConstructPoint(XCoordinate=0, YCoordinate=0, ZCoordinate=0)
construct_point_7 = ConstructPoint(XCoordinate="5", YCoordinate="2", ZCoordinate=0)
merge = Merge(
    Data1=construct_point_6,
    Data2=construct_point_3,
    Data3=construct_point_5,
    Data4=construct_point_4,
    Data5=construct_point_7,
    Data6=construct_point,
    Data7=construct_point_2)
shift_list = ShiftList(List=merge, Shift=-1, Wrap=False)
# layer viewer
shift_list_2 = ShiftList(List=merge, Shift=1, Wrap=False)
line = Line(StartPoint=shift_list, EndPoint=shift_list_2)
list_item = ListItem(List=merge, Index=0, Wrap=True)  # -> Item1, Item
list_item_2 = ListItem(List=merge, Index="3", Wrap=True)

# ----
# grounded verts
point = Point([list_item.Item1, list_item.Item])

# ----
# loaded vert
point_2 = Point(list_item_2)

curve = Curve(flatten(line))
list_item_3 = ListItem(List=point, Index=0, Wrap=False)  # -> Item, Item1, Item2
point_3 = Point(list_item_3.Item)
point_4 = Point(list_item_3.Item1)
support_karamba3d = SupportKaramba3D(PosInd=point_3, menu=[buttons(on, on, on, on, on, on)])
support_karamba3d_2 = SupportKaramba3D(PosInd=point_4, menu=[buttons(on, on, on, on, on, on)])
# 1 pa = 1 N/m^2 = 1e-7 kN/cm^2 = 1e-9 kN/mm^2
material_properties_karamba3d = MaterialPropertiesKaramba3D(
    FamilyOfMaterial="Steel",
    Name="S235",
    YoungsModulus_kN_cm2=21000,
    InPlaneShearModulus_kN_cm2=8076,
    TransverseShearModulus_kN_cm2=8076,
    SpecificWeight_kN_m3=78.5,
    CoefficientOfThermalExpansion_1_C=1e-05,
    YieldStrength_kN_cm2=23.5,
    mode="Isotrop")
merge_2 = Merge(Data1=support_karamba3d, Data2=support_karamba3d_2)
panel_2 = Panel(material_properties_karamba3d)
negative = Negative(Value=Slider(1, range=0..1))
disassemble_material_karamba3d = DisassembleMaterialKaramba3D(Material=material_properties_karamba3d)  # -> Material, TypeOfMaterial, FamilyNameOfMaterial, NameOfMaterial, ElemIdentifiers, Color, YoungsModulusKNCm2Dir12, InPlaneShearModulus_kN_cm2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
cm = Panel("5")
unit_y = UnitY(Factor=negative)
division = Division(A=cm, B="2")
panel_3 = Panel(unit_y)
multiplication = Multiplication(A=division, B="1")
cross_section_karamba3d = CrossSectionKaramba3D(
    FamilyNameOfCrossSection="DefaultCroSec",
    Material=material_properties_karamba3d,
    Diameter_cm=cm,
    WallThickness_cm=division,
    mode="Circular Hollow")
unit_y_2 = UnitY(Factor=1)  # disabled
curve_2 = Curve(curve)
radius_cm = Panel(multiplication)
concatenate = Concatenate(
    Fragment_A=disassemble_material_karamba3d.FamilyNameOfMaterial,
    A="-",
    Fragment_B=disassemble_material_karamba3d.NameOfMaterial)
negative_2 = Negative(Value=unit_y_2)  # disabled
length = Length(Curve=curve_2)
panel_4 = Panel("1")  # disabled
panel_5 = Panel(concatenate)
# 1 kN/m^3 = 1000/9.8 kg/m^3
panel_6 = Panel(disassemble_material_karamba3d.SpecificWeight_kN_m3)
# kN
loads_karamba3d = LoadsKaramba3D(ForceVector=unit_y, Local=False, PosInd=point_2, LCase="0", mode="Point")
loads_karamba3d_2 = LoadsKaramba3D(Vector=negative_2, LCase=panel_4, mode="Gravity")  # disabled
multiplication_2 = Multiplication(A=disassemble_material_karamba3d.InPlaneShearModulus_kN_cm2, B="1")
multiplication_3 = Multiplication(A=disassemble_material_karamba3d.YoungsModulusKNCm2Dir12, B="1")
panel_7 = Panel(length)
panel_8 = Panel(cross_section_karamba3d)
multiplication_4 = Multiplication(A=panel_6, B="1000/9.8")
line_to_beam_karamba3d = LineToBeamKaramba3D(Line=curve_2, CrossSection=cross_section_karamba3d, New=True, Remove=True, LimitDistance_m=0.005)  # -> Element, Points, Info
evaluate = Evaluate(Expression="E/(2*G) - 1", E=multiplication_3, G=multiplication_2)
kn_cm2 = Panel(multiplication_3)
kn_cm2_2 = Panel(multiplication_2)
density_kg_m_3 = Panel(panel_6)
panel_9 = Panel(evaluate)
assemble_model_karamba3d = AssembleModelKaramba3D(
    Elem=line_to_beam_karamba3d.Element,
    Support=merge_2,
    Load=[loads_karamba3d, loads_karamba3d_2],
    Material=material_properties_karamba3d,
    LimitDistance_m=0.005)  # -> Model, Info, Mass_kg, CenterOfGravity
curve_3 = Curve(curve_2)
number_slider_2 = Slider(0, range=0..1)
analyze_karamba3d = AnalyzeKaramba3D(Model=assemble_model_karamba3d.Model)  # -> CalculatedModel, MaximumDisplacement_cm, ResultingForceOfGravity_kN, ElasticEnergy_kNm
curve_4 = Curve(flatten(curve_3))
beam_forces_karamba3d = BeamForcesKaramba3D(
    AnalyzedModel=analyze_karamba3d.CalculatedModel,
    LCase=number_slider_2,
    MaximumDistanceBetweenResults_m=-1,
    NumberOfResultsPerBeamElement=2)  # -> AnalyzedModel, NormalForce_kN, ShearForceVz_kN, ShearForceVy_kN, BendingMomentMt_kNm, BendingMomentMy_kNm, BendingMomentMz_kNm
reaction_forces_karamba3d = ReactionForcesKaramba3D(AnalyzedModel=analyze_karamba3d.CalculatedModel, LoadCase=number_slider_2)  # -> AnalyzedModel, ReactionForces_kN, ReactionMoments_kNm, SupportPosition, SumOfReactionForces_kN, SumOfReactionMoments_kNm
nodal_displacements_karamba3d = NodalDisplacementsKaramba3D(AnalyzedModel=analyze_karamba3d.CalculatedModel, LoadCase=number_slider_2)  # -> AnalyzedModel, NodalTranslations_m, NodalRotations_rad
curve_5 = Curve(curve_4)
panel_10 = Panel(beam_forces_karamba3d.NormalForce_kN)

merge_3 = Merge(
    Data1=simplify(graft(reaction_forces_karamba3d.ReactionForces_kN)),
    Data2=simplify(graft(reaction_forces_karamba3d.ReactionMoments_kNm)))
merge_4 = Merge(
    Data1=simplify(graft(nodal_displacements_karamba3d.NodalTranslations_m)),
    Data2=simplify(graft(nodal_displacements_karamba3d.NodalRotations_rad)))
merge_5 = Merge(
    Data1=graft(beam_forces_karamba3d.NormalForce_kN),
    Data2=graft(beam_forces_karamba3d.ShearForceVz_kN),
    Data3=graft(beam_forces_karamba3d.ShearForceVy_kN),
    Data4=graft(beam_forces_karamba3d.BendingMomentMt_kNm),
    Data5=graft(beam_forces_karamba3d.BendingMomentMy_kNm),
    Data6=graft(beam_forces_karamba3d.BendingMomentMz_kNm))  # -> simplify(Result)
evaluate_2 = Evaluate(Expression="format(\"{0:E}\",x)", x=merge_5)
evaluate_3 = Evaluate(Expression="format(\"{0:E},{1:E},{2:E}\",x.x,x.y,x.z)", x=merge_4)
evaluate_4 = Evaluate(Expression="format(\"{0:E},{1:E},{2:E}\",x.x,x.y,x.z)", x=merge_3)
translation_m_rotation_rad = Panel(evaluate_3)
reaction_force_kn_reaction_moment_kn_m = Panel(evaluate_4)
froce_kn_moment_kn_m = Panel(evaluate_2)

cluster = Cluster(curve=curve_5)  # -> output_nodes, output_lines, nodes_data, lines_data, result
panel_11 = Panel(cluster.result)
point_5 = Point(cluster.output_nodes)
curve_6 = Curve(cluster.output_lines)

# ----
# all nodes
point_6 = Point(point_5)

deconstruct = Deconstruct(Point=point_6)  # -> XComponent, YComponent, ZComponent

# ----
# grounded nodes
point_7 = Point(point)

sort_list = SortList(Keys=deconstruct.ZComponent)  # -> Keys, ValuesValuesA
model_view_karamba3d = ModelViewKaramba3D(Model=analyze_karamba3d.CalculatedModel, LoadCaseFactorsForLinearSuperposition=1, IndexOfVisibleLoadcase=number_slider_2)  # -> Model, DeformedMesh, DeformedAxes, DeformedModel
list_item_4 = ListItem(List=sort_list.Keys, Index=0, Wrap=True)  # -> Item1, Item
subtraction = Subtraction(A=list_item_4.Item1, B=sort_list.Keys)
integer = Integer(flatten(cluster.result))
distance = Distance(PointA=graft(point_6), PointB=point_7)  # -> simplify(Distance)
absolute = Absolute(Value=subtraction)
beam_view_karamba3d = BeamViewKaramba3D(Model=model_view_karamba3d.Model)  # -> Model, MeshesOfRenderedBeams, DeformedBeamAxes, LegendColors, LegendTags
average = Average(Input=point_7)
mass_addition = MassAddition(Input=absolute)  # -> Result, PartialResults
mass_multiplication = MassMultiplication(Input=distance)  # -> Result, PartialResults
boolean = Boolean(mass_addition.Result)
boolean_2 = Boolean(mass_multiplication.Result)
integer_2 = Integer(boolean_2)
subtraction_2 = Subtraction(A="1", B=integer_2)
stream_filter = StreamFilter(Gate=boolean, Stream0="2D_frame", Stream1="3D_frame")
stream_filter_2 = StreamFilter(Gate=boolean, Stream0="2", Stream1="3")
stream_filter_3 = StreamFilter(Gate=boolean, Stream0="3", Stream1="6")
dim = Panel(stream_filter_3)
duplicate_data = DuplicateData(Data=subtraction_2, Number=dim, Order=True)  # -> simplify(Data)
integer_3 = Integer(flatten(boolean_2))
panel_12 = Panel(stream_filter)
integer_4 = Integer(stream_filter_2)
merge_6 = Merge(Data1=integer)
multiplication_5 = Multiplication(A="{600, 0, 23.5}", B=0.001)
panel_13 = Panel("D:\Dropbox (MIT)\Projects\conmech\conmech\src\stiffness_checker\matlab\test\problem_instances\")
subtraction_3 = Subtraction(A=point_6, B=average)
subtraction_4 = Subtraction(A="1", B=integer_3)
partition_list = PartitionList(List=merge_6, Size=2)  # -> simplify(Chunks)
panel_14 = Panel(partition_list)
xy_plane = XYPlane(Origin=multiplication_5)  # disabled

# ----
# file name
panel_15 = Panel("2D_frame")

integer_5 = Integer(subtraction_4)
point_8 = Point(subtraction_3)
panel_16 = Panel(integer_5)
point_9 = Point(point_8)
list_item_5 = ListItem(List=point_9, Index=partition_list, Wrap=False)
concatenate_2 = Concatenate(Fragment_A=panel_15, A=".json")
dispatch = Dispatch(List=point_9, DispatchPattern=integer_5)  # -> ListA, ListB
list_item_6 = ListItem(List=list_item_5, Index=0, Wrap=True)  # -> Item, Item1
panel_17 = Panel(list_item_5)
concatenate_3 = Concatenate(FragmentA=panel_13, FragmentB=concatenate_2)
number = Number(evaluate)
number_2 = Number(multiplication)
number_3 = Number(panel_6)
text = Text(concatenate)
integer_6 = Integer(duplicate_data)
number_4 = Number(multiplication_3)
number_5 = Number(multiplication_2)
line_2 = Line(StartPoint=list_item_6.Item, EndPoint=list_item_6.Item1)
integer_7 = Integer(integer_4)
point_10 = Point(dispatch.ListA)
panel_18 = Panel(number_3)
panel_19 = Panel(number)
panel_20 = Panel(number_2)
panel_21 = Panel(number_4)
panel_22 = Panel(number_5)
c_script = CSharpScript(
    file_path=concatenate_3,
    model_type=panel_12,
    assembly_type="extrusion",
    unit="meter",
    dimension=integer_7,
    relative_pos_to_robot_base=xy_plane,
    node_pts=point_8,
    ground_nodes_identifier=integer_5,
    fixities=integer_6,
    elements=partition_list,
    material_name=text,
    youngs_modulus=panel_21,
    youngs_modulus_unit="kN/cm2",
    shear_modulus=panel_22,
    shear_modulus_unit="kN/cm2",
    poisson_ratio=panel_19,
    radius=panel_20,
    radius_unit="centimeter",
    density=panel_18,
    density_unit="kN/m3",
    Reference="C:\USERS\YIJIANGH\DESKTOP\FrameFabGH\Newtonsoft.Json.dll")  # -> out, A; inputs file_path: String, model_type: String, assembly_type: String, unit: String, dimension: Int32, relative_pos_to_robot_base: Plane, node_pts: list of Point3d, ground_nodes_identifier: list of Int32, fixities: tree of Int32, elements: tree of Int32, material_name: String, youngs_modulus: Double, youngs_modulus_unit: String, shear_modulus: Double, shear_modulus_unit: String, poisson_ratio: Double, radius: Double, radius_unit: String, density: Double, density_unit: String; disabled
# ---------- c_script: C# usings ----------
using System.IO;
using System.Linq;
using System.Data;
using System.Drawing;
using System.Reflection;
using System.Windows.Forms;
using System.Xml;
using System.Xml.Linq;
using System.Runtime.InteropServices;

using Rhino.DocObjects;
using Rhino.Collections;
using GH_IO;
using GH_IO.Serialization;
using Newtonsoft.Json;
using Newtonsoft.Json.Serialization;
using Newtonsoft.Json.Schema;
using Newtonsoft.Json.Linq;
using Newtonsoft.Json.Converters;
using Newtonsoft.Json.Bson;
# ---------- c_script: C# ----------
    JsonSerializer serializer = new JsonSerializer();
    serializer.NullValueHandling = NullValueHandling.Ignore;
    serializer.Formatting = Newtonsoft.Json.Formatting.Indented;

    // init assembly sequence obj, wire in global params
    ChoreoInputModel cas = new ChoreoInputModel();
    cas.assembly_type = assembly_type;
    cas.model_type = model_type;
    cas.unit = unit;
    cas.dimension = dimension;

    //    cas.base_frame_in_rob_base = relative_pos_to_robot_base;

    cas.material_properties = new MaterialProperty();
    cas.material_properties.material_name = material_name;
    cas.material_properties.youngs_modulus = youngs_modulus;
    cas.material_properties.youngs_modulus_unit = youngs_modulus_unit;

    cas.material_properties.shear_modulus = shear_modulus;
    cas.material_properties.shear_modulus_unit = shear_modulus_unit;

    cas.material_properties.poisson_ratio = poisson_ratio;

    cas.material_properties.radius = radius;
    cas.material_properties.radius_unit = radius_unit;

    cas.material_properties.density = density;
    cas.material_properties.density_unit = density_unit;

    cas.node_list = new List<FrameNode>(node_pts.Count());
    cas.element_list = new List<FrameElement>(elements.BranchCount);

    // create nodes
    for(int i = 0; i < node_pts.Count(); i++)
    {
      FrameNode nd = new FrameNode();
      nd.point = node_pts[i];
      nd.node_id = i;
      nd.is_grounded = ground_nodes_identifier[i];
      nd.fixities = fixities.Branch(i);

      cas.node_list.Add(nd);
    }

    // create each sequenced element
    for(int i = 0; i < elements.BranchCount; i++)
    {
      FrameElement ne = new FrameElement();
      ne.end_node_ids = new List<int>();
      ne.element_id = i;
      ne.end_node_ids = elements.Branch(i);

      cas.element_list.Add(ne);
    }

    // GH screen output
    //    string json = JsonConvert.SerializeObject(cas, Newtonsoft.Json.Formatting.Indented);
    //    Print(json);

    // serialize to json file
    using (StreamWriter sw = new StreamWriter(@file_path))
    using (JsonWriter writer = new JsonTextWriter(sw))
    {
      serializer.Serialize(writer, cas);
    }
# ---------- c_script: C# additional code ----------
  public class FrameNode
  {
    public Point3d point { get; set; }
    public int node_id { get; set; }
    public int is_grounded { get; set; }
    public List<int> fixities { get; set; }
  }

  public class FrameElement
  {
    public List<int> end_node_ids { get; set; }
    public int element_id { get; set; }
    public int layer_id { get; set; }
  }

  public class MaterialProperty
  {
    public string material_name { get; set; }
    public double youngs_modulus { get; set; }
    public string youngs_modulus_unit { get; set; }

    public double shear_modulus { get; set; }
    public string shear_modulus_unit { get; set; }

    public double density { get; set; }
    public string density_unit { get; set; }

    public double poisson_ratio { get; set; }

    public double radius { get; set; }
    public string radius_unit { get; set; }
  }

  public class ChoreoInputModel
  {
    public string assembly_type { get; set; }
    public string model_type { get; set; }
    public string unit { get; set; }
    public double dimension { get; set; }

    //    public Plane base_frame_in_rob_base { get; set; }

    public MaterialProperty material_properties { get; set; }

    public List<FrameNode> node_list { get; set; }
    public List<FrameElement> element_list { get; set; }
  }
# ---------- end c_script ----------

# ==== cluster Cluster
curve = ClusterInput()
end_points = EndPoints(Curve=curve)  # -> Start, End
merge = Merge(Data1=end_points.Start, Data2=end_points.End)
create_set = CreateSet(List=merge)  # -> Set, Map
number_slider = Slider(1, range=0..1)
member_index = MemberIndex(Set=create_set.Set, Member=end_points.End)  # -> Index, Count
member_index_2 = MemberIndex(Set=create_set.Set, Member=end_points.Start)  # -> Index, Count
deconstruct = Deconstruct(Point=create_set.Set)  # -> XComponent, YComponent, ZComponent
addition = Addition(A=member_index_2.Index, B=number_slider)
addition_2 = Addition(A=member_index.Index, B=number_slider)
integer = Integer(addition)
integer_2 = Integer(addition_2)
merge_2 = Merge(Data1=member_index_2.Index, Data2=member_index.Index)  # -> simplify(Result)
concatenate = Concatenate(
    Fragment_A="v",
    G=" ",
    Fragment_B=deconstruct.XComponent,
    A=" ",
    B=deconstruct.YComponent,
    C=" ",
    D=deconstruct.ZComponent)  # -> flatten(Result)
concatenate_2 = Concatenate(Fragment_A="l", Fragment_B=" ", A=integer, B=" ", C=integer_2)  # -> flatten(Result)
panel = Panel(merge_2)
result = ClusterOutput(merge_2)

# ----
# output_lines
curve_2 = Curve(curve)

# ----
# output_nodes
point = Point(create_set.Set)

# ----
# nodes_data
text = Text(concatenate)

# ----
# lines_data
text_2 = Text(concatenate_2)

output_nodes = ClusterOutput(point)  # output_nodes
output_lines = ClusterOutput(curve_2)
nodes_data = ClusterOutput(text)
lines_data = ClusterOutput(text_2)
