# Grasshopper definition cant_2_frame_3D.gh (Grasshopper 1.0.7)
# plug-ins: Karamba

number_slider = Slider(1, range=0..1)
# manual layer selection
# DON'T FORGET TO INTERNALIZE
# DATA WHEN FINISHED!
xy_plane = XYPlane(Origin=Point(0, 0, 0))
unit_z = UnitZ(Factor=number_slider)
point = Point(xy_plane)
unit_y = UnitY(Factor=1)
move = Move(Geometry=point, Motion=unit_z)  # -> Geometry, Transform

# ----
# L
number_slider_2 = Slider(3.048, range=0..10)

rotate_3d = Rotate3D(Geometry=move.Geometry, Angle=degrees(Slider(27, range=-90..90)), Center=point, Axis=unit_y)  # -> Geometry, Transform
multiplication = Multiplication(A=number_slider_2, B="2")
# layer viewer
unit_x = UnitX(Factor=number_slider)
construct_point = ConstructPoint(XCoordinate=multiplication, YCoordinate=number_slider_2, ZCoordinate=0)
construct_point_2 = ConstructPoint(XCoordinate=0, YCoordinate=number_slider_2, ZCoordinate=0)
construct_point_3 = ConstructPoint(XCoordinate=multiplication, YCoordinate=number_slider_2, ZCoordinate=0)
construct_point_4 = ConstructPoint(XCoordinate=0, YCoordinate=0, ZCoordinate=0)
move_2 = Move(Geometry=rotate_3d.Geometry, Motion=unit_x)  # -> Geometry, Transform
merge = Merge(Data1=construct_point_4, Data2=construct_point_2, Data3=construct_point, Data4=construct_point_3)
merge_2 = Merge(Data1=point, Data2=rotate_3d.Geometry, Data3=move_2.Geometry)
point_2 = Point(merge_2)
shift_list = ShiftList(List=point_2, Shift=1, Wrap=False)
shift_list_2 = ShiftList(List=point_2, Shift=-1, Wrap=False)
line = Line(StartPoint=shift_list_2, EndPoint=shift_list)
# 1 pa = 1 N/m^2 = 1e-7 kN/cm^2 = 1e-9 kN/mm^2
material_properties_karamba3d = MaterialPropertiesKaramba3D(
    FamilyOfMaterial="Steel",
    Name="S235",
    YoungsModulus_kN_cm2=21000,
    InPlaneShearModulus_kN_cm2=8076,
    TransverseShearModulus_kN_cm2=8076,
    SpecificWeight_kN_m3=78.5,
    CoefficientOfThermalExpansion_1_C=1e-05,
    YieldStrength_kN_cm2=23.5,
    mode="Isotrop")
point_3 = Point(point)
point_4 = Point(move_2.Geometry)

# ----
# grounded verts
point_5 = Point(point_3)

# ----
# loaded vert
point_6 = Point(point_4)

panel = Panel(material_properties_karamba3d)
negative = Negative(Value=Slider(0.1, range=0..0.1))
disassemble_material_karamba3d = DisassembleMaterialKaramba3D(Material=material_properties_karamba3d)  # -> Material, TypeOfMaterial, FamilyNameOfMaterial, NameOfMaterial, ElemIdentifiers, Color, YoungsModulusKNCm2Dir12, InPlaneShearModulus_kN_cm2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
cm = Panel("5")
unit_z_2 = UnitZ(Factor=negative)
vector_xyz = VectorXYZ(XComponent=Slider(0.2, range=0..1), YComponent=Slider(0.2, range=0..1), ZComponent=negative)  # -> Vector, Length
division = Division(A=cm, B="2")
multiplication_2 = Multiplication(A=division, B="1")
cross_section_karamba3d = CrossSectionKaramba3D(
    FamilyNameOfCrossSection="DefaultCroSec",
    Material=material_properties_karamba3d,
    Diameter_cm=cm,
    WallThickness_cm=division,
    mode="Circular Hollow")
panel_2 = Panel(vector_xyz.Vector)
length = Length(Curve=line)
radius_cm = Panel(multiplication_2)
concatenate = Concatenate(
    Fragment_A=disassemble_material_karamba3d.FamilyNameOfMaterial,
    A="-",
    Fragment_B=disassemble_material_karamba3d.NameOfMaterial)
panel_3 = Panel(concatenate)
panel_4 = Panel(disassemble_material_karamba3d.SpecificWeight_kN_m3)
loads_karamba3d = LoadsKaramba3D(Vector=Vector(0, 0, -1), LCase="1", mode="Gravity")
multiplication_3 = Multiplication(A=disassemble_material_karamba3d.InPlaneShearModulus_kN_cm2, B="1")
# kN
loads_karamba3d_2 = LoadsKaramba3D(ForceVector=vector_xyz.Vector, Local=False, PosInd=point_6, LCase="0", mode="Point")
panel_5 = Panel(length)
multiplication_4 = Multiplication(A=disassemble_material_karamba3d.YoungsModulusKNCm2Dir12, B="1")
list_item = ListItem(List=line, Index=0, Wrap=False)  # -> Item, Item1
support_karamba3d = SupportKaramba3D(PosInd=point_5, menu=[buttons(on, on, on, on, on, on)])
line_to_beam_karamba3d = LineToBeamKaramba3D(Line=list_item.Item, Identifier="e0", CrossSection=cross_section_karamba3d, New=True, Remove=True, LimitDistance_m=0.005)  # -> Element, Points, Info
line_to_beam_karamba3d_2 = LineToBeamKaramba3D(
    Line=list_item.Item1,
    Identifier="e1",
    CrossSection=cross_section_karamba3d,
    New=True,
    Remove=True,
    LimitDistance_m=0.005)  # -> Element, Points, Info
evaluate = Evaluate(Expression="E/(2*G) - 1", E=multiplication_4, G=multiplication_3)
kn_cm2 = Panel(multiplication_4)
kn_cm2_2 = Panel(multiplication_3)
merge_3 = Merge(Data1=loads_karamba3d_2, Data2=loads_karamba3d)
panel_6 = Panel(evaluate)
merge_4 = Merge(Data1=line_to_beam_karamba3d.Element, Data2=line_to_beam_karamba3d_2.Element)
assemble_model_karamba3d = AssembleModelKaramba3D(Elem=merge_4, Support=support_karamba3d, Load=merge_3, Material=material_properties_karamba3d, LimitDistance_m=0.005)  # -> Model, Info, Mass_kg, CenterOfGravity
panel_7 = Panel("""0            0            0            0            0            0
   9.0067e-04            0  -4.5916e-04            0   1.9045e-03            0
   9.0067e-04            0  -2.8810e-03            0   2.6805e-03            0""")
number_slider_3 = Slider(0, range=0..1)
analyze_karamba3d = AnalyzeKaramba3D(Model=assemble_model_karamba3d.Model)  # -> CalculatedModel, MaximumDisplacement_cm, ResultingForceOfGravity_kN, ElasticEnergy_kNm
curve = Curve(line)
beam_forces_karamba3d = BeamForcesKaramba3D(
    AnalyzedModel=analyze_karamba3d.CalculatedModel,
    LCase=number_slider_3,
    MaximumDistanceBetweenResults_m=-1,
    NumberOfResultsPerBeamElement=2)  # -> AnalyzedModel, NormalForce_kN, ShearForceVz_kN, ShearForceVy_kN, BendingMomentMt_kNm, BendingMomentMy_kNm, BendingMomentMz_kNm
reaction_forces_karamba3d = ReactionForcesKaramba3D(AnalyzedModel=analyze_karamba3d.CalculatedModel, LoadCase=number_slider_3)  # -> AnalyzedModel, ReactionForces_kN, ReactionMoments_kNm, SupportPosition, SumOfReactionForces_kN, SumOfReactionMoments_kNm
nodal_displacements_karamba3d = NodalDisplacementsKaramba3D(AnalyzedModel=analyze_karamba3d.CalculatedModel, LoadCase=number_slider_3)  # -> AnalyzedModel, NodalTranslations_m, NodalRotations_rad
cluster = Cluster_2(text=panel_7)  # -> simplify(tree)
curve_2 = Curve(curve)
panel_8 = Panel(cluster)
merge_5 = Merge(
    Data1=simplify(graft(reaction_forces_karamba3d.ReactionForces_kN)),
    Data2=simplify(graft(reaction_forces_karamba3d.ReactionMoments_kNm)))
merge_6 = Merge(
    Data1=simplify(graft(nodal_displacements_karamba3d.NodalTranslations_m)),
    Data2=simplify(graft(nodal_displacements_karamba3d.NodalRotations_rad)))
merge_7 = Merge(
    Data1=graft(beam_forces_karamba3d.NormalForce_kN),
    Data2=graft(beam_forces_karamba3d.ShearForceVz_kN),
    Data3=graft(beam_forces_karamba3d.ShearForceVy_kN),
    Data4=graft(beam_forces_karamba3d.BendingMomentMt_kNm),
    Data5=graft(beam_forces_karamba3d.BendingMomentMy_kNm),
    Data6=graft(beam_forces_karamba3d.BendingMomentMz_kNm))  # -> simplify(Result)
evaluate_2 = Evaluate(Expression="format(\"{0:E}\",x)", x=merge_7)
evaluate_3 = Evaluate(Expression="format(\"{0:E},{1:E},{2:E}\",x.x,x.y,x.z)", x=merge_5)
evaluate_4 = Evaluate(Expression="format(\"{0:E} {1:E} {2:E}\",x.x,x.y,x.z)", x=merge_6)
cluster_2 = Cluster_2(text=evaluate_4)
reaction_force_kn_reaction_moment_kn_m = Panel(evaluate_3)
froce_kn_moment_kn_m = Panel(evaluate_2)
cluster_3 = Cluster(curve=curve_2)  # -> output_nodes, output_lines, nodes_data, lines_data, result
shift_paths = ShiftPaths(Data=cluster_2, Offset=-1)
number = Number(simplify(shift_paths))
subtraction = Subtraction(A=cluster, B=number)
absolute = Absolute(Value=subtraction)  # -> simplify(Result)
panel_9 = Panel(number)
division_2 = Division(A=absolute, B=number)
panel_10 = Panel(division_2)
model_view_karamba3d = ModelViewKaramba3D(Model=analyze_karamba3d.CalculatedModel, LoadCaseFactorsForLinearSuperposition=1, IndexOfVisibleLoadcase=number_slider_3)  # -> Model, DeformedMesh, DeformedAxes, DeformedModel
panel_11 = Panel(cluster_3.result)
point_7 = Point(cluster_3.output_nodes)
curve_3 = Curve(cluster_3.output_lines)

# ----
# all nodes
point_8 = Point(point_7)

deconstruct = Deconstruct(Point=point_8)  # -> XComponent, YComponent, ZComponent
sort_list = SortList(Keys=deconstruct.ZComponent)  # -> Keys, ValuesValuesA

# ----
# grounded nodes
point_9 = Point(point)

list_item_2 = ListItem(List=sort_list.Keys, Index=0, Wrap=True)  # -> Item1, Item
beam_view_karamba3d = BeamViewKaramba3D(Model=model_view_karamba3d.Model)  # -> Model, MeshesOfRenderedBeams, DeformedBeamAxes, LegendColors, LegendTags
subtraction_2 = Subtraction(A=list_item_2.Item1, B=sort_list.Keys)
integer = Integer(flatten(cluster_3.result))
distance = Distance(PointA=graft(point_8), PointB=point_9)  # -> simplify(Distance)
absolute_2 = Absolute(Value=subtraction_2)
average = Average(Input=point_9)
mass_addition = MassAddition(Input=absolute_2)  # -> Result, PartialResults
mass_multiplication = MassMultiplication(Input=distance)  # -> Result, PartialResults
boolean = Boolean(mass_addition.Result)
boolean_2 = Boolean(mass_multiplication.Result)
integer_2 = Integer(boolean_2)
subtraction_3 = Subtraction(A="1", B=integer_2)
panel_12 = Panel("D:\Dropbox (MIT)\Projects\conmech\conmech\src\stiffness_checker\matlab\test\problem_instances\")
stream_filter = StreamFilter(Gate=boolean, Stream0="2D_frame", Stream1="3D_frame")
stream_filter_2 = StreamFilter(Gate=boolean, Stream0="2", Stream1="3")
stream_filter_3 = StreamFilter(Gate=boolean, Stream0="3", Stream1="6")
dim = Panel(stream_filter_3)
duplicate_data = DuplicateData(Data=subtraction_3, Number=dim, Order=True)  # -> simplify(Data)

# ----
# file name
panel_13 = Panel("cant_2_3D_frame")

integer_3 = Integer(flatten(boolean_2))
panel_14 = Panel(stream_filter)
merge_8 = Merge(Data1=integer)
multiplication_5 = Multiplication(A="{600, 0, 23.5}", B=0.001)
subtraction_4 = Subtraction(A=point_8, B=average)
subtraction_5 = Subtraction(A="1", B=integer_3)
partition_list = PartitionList(List=merge_8, Size=2)  # -> simplify(Chunks)
xy_plane_2 = XYPlane(Origin=multiplication_5)  # disabled
concatenate_2 = Concatenate(Fragment_A=panel_13, A=".json")
panel_15 = Panel(partition_list)
integer_4 = Integer(subtraction_5)
point_10 = Point(subtraction_4)
panel_16 = Panel(integer_4)
concatenate_3 = Concatenate(FragmentA=panel_12, FragmentB=concatenate_2)
point_11 = Point(point_10)
list_item_3 = ListItem(List=point_11, Index=partition_list, Wrap=False)
panel_17 = Panel(concatenate_3)
dispatch = Dispatch(List=point_11, DispatchPattern=integer_4)  # -> ListA, ListB
list_item_4 = ListItem(List=list_item_3, Index=0, Wrap=True)  # -> Item, Item1
panel_18 = Panel(list_item_3)
integer_5 = Integer(duplicate_data)
integer_6 = Integer(stream_filter_2)
number_2 = Number(panel_4)
number_3 = Number(evaluate)
number_4 = Number(multiplication_2)
text = Text(concatenate)
number_5 = Number(multiplication_4)
number_6 = Number(multiplication_3)
line_2 = Line(StartPoint=list_item_4.Item, EndPoint=list_item_4.Item1)
point_12 = Point(dispatch.ListA)
panel_19 = Panel(number_2)
panel_20 = Panel(number_3)
panel_21 = Panel(number_4)
panel_22 = Panel(number_5)
panel_23 = Panel(number_6)
c_script = CSharpScript(
    file_path=concatenate_3,
    model_type=panel_14,
    assembly_type="extrusion",
    unit="meter",
    dimension=integer_6,
    relative_pos_to_robot_base=xy_plane_2,
    node_pts=point_10,
    ground_nodes_identifier=integer_4,
    fixities=integer_5,
    elements=partition_list,
    material_name=text,
    youngs_modulus=panel_22,
    youngs_modulus_unit="kN/cm2",
    shear_modulus=panel_23,
    shear_modulus_unit="kN/cm2",
    poisson_ratio=panel_20,
    radius=panel_21,
    radius_unit="centimeter",
    density=panel_19,
    density_unit="kN/m3",
    Reference="D:\DROPBOX (MIT)\PROJECTS\CONMECH\CONMECH\SRC\STIFFNESS_CHECKER\MATLAB\TEST\KARAMBA\Newtonsoft.Json.dll")  # -> out, A; inputs file_path: String, model_type: String, assembly_type: String, unit: String, dimension: Int32, relative_pos_to_robot_base: Plane, node_pts: list of Point3d, ground_nodes_identifier: list of Int32, fixities: tree of Int32, elements: tree of Int32, material_name: String, youngs_modulus: Double, youngs_modulus_unit: String, shear_modulus: Double, shear_modulus_unit: String, poisson_ratio: Double, radius: Double, radius_unit: String, density: Double, density_unit: String
# ---------- c_script: C# usings ----------
using System.IO;
using System.Linq;
using System.Data;
using System.Drawing;
using System.Reflection;
using System.Windows.Forms;
using System.Xml;
using System.Xml.Linq;
using System.Runtime.InteropServices;

using Rhino.DocObjects;
using Rhino.Collections;
using GH_IO;
using GH_IO.Serialization;
using Newtonsoft.Json;
using Newtonsoft.Json.Serialization;
using Newtonsoft.Json.Schema;
using Newtonsoft.Json.Linq;
using Newtonsoft.Json.Converters;
using Newtonsoft.Json.Bson;
# ---------- c_script: C# ----------
    JsonSerializer serializer = new JsonSerializer();
    serializer.NullValueHandling = NullValueHandling.Ignore;
    serializer.Formatting = Newtonsoft.Json.Formatting.Indented;

    // init assembly sequence obj, wire in global params
    ChoreoInputModel cas = new ChoreoInputModel();
    cas.assembly_type = assembly_type;
    cas.model_type = model_type;
    cas.unit = unit;
    cas.dimension = dimension;

    //    cas.base_frame_in_rob_base = relative_pos_to_robot_base;

    cas.material_properties = new MaterialProperty();
    cas.material_properties.material_name = material_name;
    cas.material_properties.youngs_modulus = youngs_modulus;
    cas.material_properties.youngs_modulus_unit = youngs_modulus_unit;

    cas.material_properties.shear_modulus = shear_modulus;
    cas.material_properties.shear_modulus_unit = shear_modulus_unit;

    cas.material_properties.poisson_ratio = poisson_ratio;

    cas.material_properties.radius = radius;
    cas.material_properties.radius_unit = radius_unit;

    cas.material_properties.density = density;
    cas.material_properties.density_unit = density_unit;

    cas.node_list = new List<FrameNode>(node_pts.Count());
    cas.element_list = new List<FrameElement>(elements.BranchCount);

    // create nodes
    for(int i = 0; i < node_pts.Count(); i++)
    {
      FrameNode nd = new FrameNode();
      nd.point = node_pts[i];
      nd.node_id = i;
      nd.is_grounded = ground_nodes_identifier[i];
      nd.fixities = fixities.Branch(i);

      cas.node_list.Add(nd);
    }

    // create each sequenced element
    for(int i = 0; i < elements.BranchCount; i++)
    {
      FrameElement ne = new FrameElement();
      ne.end_node_ids = new List<int>();
      ne.element_id = i;
      ne.end_node_ids = elements.Branch(i);

      cas.element_list.Add(ne);
    }

    // GH screen output
    //    string json = JsonConvert.SerializeObject(cas, Newtonsoft.Json.Formatting.Indented);
    //    Print(json);

    // serialize to json file
    using (StreamWriter sw = new StreamWriter(@file_path))
    using (JsonWriter writer = new JsonTextWriter(sw))
    {
      serializer.Serialize(writer, cas);
    }
# ---------- c_script: C# additional code ----------
  public class FrameNode
  {
    public Point3d point { get; set; }
    public int node_id { get; set; }
    public int is_grounded { get; set; }
    public List<int> fixities { get; set; }
  }

  public class FrameElement
  {
    public List<int> end_node_ids { get; set; }
    public int element_id { get; set; }
    public int layer_id { get; set; }
  }

  public class MaterialProperty
  {
    public string material_name { get; set; }
    public double youngs_modulus { get; set; }
    public string youngs_modulus_unit { get; set; }

    public double shear_modulus { get; set; }
    public string shear_modulus_unit { get; set; }

    public double density { get; set; }
    public string density_unit { get; set; }

    public double poisson_ratio { get; set; }

    public double radius { get; set; }
    public string radius_unit { get; set; }
  }

  public class ChoreoInputModel
  {
    public string assembly_type { get; set; }
    public string model_type { get; set; }
    public string unit { get; set; }
    
    public int dimension { get; set; }

    //    public Plane base_frame_in_rob_base { get; set; }

    public MaterialProperty material_properties { get; set; }

    public List<FrameNode> node_list { get; set; }
    public List<FrameElement> element_list { get; set; }
  }
# ---------- end c_script ----------

# ==== cluster Cluster
curve = ClusterInput()
end_points = EndPoints(Curve=curve)  # -> Start, End
merge = Merge(Data1=end_points.Start, Data2=end_points.End)
create_set = CreateSet(List=merge)  # -> Set, Map
number_slider = Slider(1, range=0..1)
member_index = MemberIndex(Set=create_set.Set, Member=end_points.End)  # -> Index, Count
member_index_2 = MemberIndex(Set=create_set.Set, Member=end_points.Start)  # -> Index, Count
deconstruct = Deconstruct(Point=create_set.Set)  # -> XComponent, YComponent, ZComponent
addition = Addition(A=member_index_2.Index, B=number_slider)
addition_2 = Addition(A=member_index.Index, B=number_slider)
integer = Integer(addition)
integer_2 = Integer(addition_2)
merge_2 = Merge(Data1=member_index_2.Index, Data2=member_index.Index)  # -> simplify(Result)
concatenate = Concatenate(
    Fragment_A="v",
    G=" ",
    Fragment_B=deconstruct.XComponent,
    A=" ",
    B=deconstruct.YComponent,
    C=" ",
    D=deconstruct.ZComponent)  # -> flatten(Result)
concatenate_2 = Concatenate(Fragment_A="l", Fragment_B=" ", A=integer, B=" ", C=integer_2)  # -> flatten(Result)
panel = Panel(merge_2)
result = ClusterOutput(merge_2)

# ----
# output_lines
curve_2 = Curve(curve)

# ----
# output_nodes
point = Point(create_set.Set)

# ----
# nodes_data
text = Text(concatenate)

# ----
# lines_data
text_2 = Text(concatenate_2)

output_nodes = ClusterOutput(point)  # output_nodes
output_lines = ClusterOutput(curve_2)
nodes_data = ClusterOutput(text)
lines_data = ClusterOutput(text_2)

# ==== cluster Cluster_2
text = ClusterInput()
text_split = TextSplit(Text=text, Separators=" ")
number = Number(text_split)
clean_tree = CleanTree(RemoveNulls=True, RemoveInvalid=True, RemoveEmpty=False, Tree=number)
tree = ClusterOutput(clean_tree)
