# Grasshopper definition sf-3_frame.gh (Grasshopper 1.0.7)
# plug-ins: Karamba

number_slider = Slider(0.5, range=0..1)

# ----
# L
number_slider_2 = Slider(3.048, range=0..10)

# ----
# manual layer selection
# DON'T FORGET TO INTERNALIZE
# DATA WHEN FINISHED!
# layer viewer
number_slider_3 = Slider(0.7, range=0..1)
negative = Negative(Value=number_slider)
xy_plane = XYPlane(Origin=Point(0, 0, 0))
multiplication = Multiplication(A=number_slider_2, B="2")
circle = Circle(Plane=xy_plane, Radius=number_slider_3)
construct_domain = ConstructDomain(DomainStart=negative, DomainEnd=number_slider)
construct_point = ConstructPoint(XCoordinate=multiplication, YCoordinate=number_slider_2, ZCoordinate=0)
construct_point_2 = ConstructPoint(XCoordinate=0, YCoordinate=number_slider_2, ZCoordinate=0)
construct_point_3 = ConstructPoint(XCoordinate=multiplication, YCoordinate=number_slider_2, ZCoordinate=0)
construct_point_4 = ConstructPoint(XCoordinate=0, YCoordinate=0, ZCoordinate=0)
divide_curve = DivideCurve(Curve=circle, Count="3", Kinks=False, UseTasks=True)  # -> Points, Tangents, Parameters
rectangle = Rectangle(Plane=xy_plane, XSize=construct_domain, YSize=construct_domain, Radius=0)  # -> Rectangle, Length
unit_z = UnitZ(Factor=Slider(1, range=0..1))
brep = Brep(rectangle.Rectangle)
merge = Merge(Data1=construct_point_4, Data2=construct_point_2, Data3=construct_point, Data4=construct_point_3)
deconstruct_brep = DeconstructBrep(Brep=brep)  # -> Faces, Edges, Vertices
point = Point(xy_plane)
point_2 = Point(flatten(divide_curve.Points))
move = Move(Geometry=point, Motion=unit_z)  # -> Geometry, Transform
point_3 = Point(flatten(deconstruct_brep.Vertices))
list_item = ListItem(List=point_2, Index=0, Wrap=True)  # -> Item, Item1
merge_2 = Merge(Data1=list_item.Item, Data2=list_item.Item1)
# 1 pa = 1 N/m^2 = 1e-7 kN/cm^2 = 1e-9 kN/mm^2
material_properties_karamba3d = MaterialPropertiesKaramba3D(
    FamilyOfMaterial="Steel",
    Name="S235",
    YoungsModulus_kN_cm2=21000,
    InPlaneShearModulus_kN_cm2=8076,
    TransverseShearModulus_kN_cm2=8076,
    SpecificWeight_kN_m3=78.5,
    CoefficientOfThermalExpansion_1_C=1e-05,
    YieldStrength_kN_cm2=23.5,
    mode="Isotrop")
line = Line(StartPoint=merge_2, EndPoint=move.Geometry)
number_slider_4 = Slider(500, range=0..1000)
number_slider_5 = Slider(0.1, range=0..0.1)

# ----
# grounded verts
point_4 = Point(merge_2)

# ----
# loaded vert
point_5 = Point(move.Geometry)

panel = Panel(material_properties_karamba3d)
negative_2 = Negative(Value=number_slider_5)
unit_x = UnitX(Factor=number_slider_5)
disassemble_material_karamba3d = DisassembleMaterialKaramba3D(Material=material_properties_karamba3d)  # -> Material, TypeOfMaterial, FamilyNameOfMaterial, NameOfMaterial, ElemIdentifiers, Color, YoungsModulusKNCm2Dir12, InPlaneShearModulus_kN_cm2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
cm = Panel("5")
unit_z_2 = UnitZ(Factor=negative_2)
panel_2 = Panel(unit_z_2)
division = Division(A=cm, B="2")
length = Length(Curve=line)
multiplication_2 = Multiplication(A=division, B="10")
cross_section_karamba3d = CrossSectionKaramba3D(
    FamilyNameOfCrossSection="DefaultCroSec",
    Material=material_properties_karamba3d,
    Diameter_cm=cm,
    WallThickness_cm=division,
    mode="Circular Hollow")
radius_mm = Panel(multiplication_2)
concatenate = Concatenate(
    Fragment_A=disassemble_material_karamba3d.FamilyNameOfMaterial,
    A="-",
    Fragment_B=disassemble_material_karamba3d.NameOfMaterial)
beam_joints_karamba3d = BeamJointsKaramba3D(
    ElementIdentifiers="e0",
    CtKNMAtStartingNode=Vector(0, 0, 0),
    CrKNmRadAtStartingNode=Vector(0, 0, 0),
    CtKNMAtEndNode=Vector(0, 0, 0),
    CrKNmRadAtEndNode=Vector(0, 0, 0),
    menu=[buttons(off, off, off, off, off, off), buttons(off, off, off, off, off, off)])
panel_3 = Panel(concatenate)
# 1 kN/m^3 = 1000/9.8 kg/m^3
panel_4 = Panel(disassemble_material_karamba3d.SpecificWeight_kN_m3)
# kN
loads_karamba3d = LoadsKaramba3D(ForceVector=unit_z_2, Local=False, PosInd=point_5, LCase="0", mode="Point")
loads_karamba3d_2 = LoadsKaramba3D(Vector=Vector(0, 0, -1), LCase="1", mode="Gravity")
list_item_2 = ListItem(List=line, Index=0, Wrap=True)  # -> Item, Item1, Item2
multiplication_3 = Multiplication(A=disassemble_material_karamba3d.InPlaneShearModulus_kN_cm2, B="1")
panel_5 = Panel(length)
multiplication_4 = Multiplication(A=disassemble_material_karamba3d.YoungsModulusKNCm2Dir12, B="1")
support_karamba3d = SupportKaramba3D(PosInd=point_4, menu=[buttons(on, on, on, on, on, on)])
multiplication_5 = Multiplication(A=panel_4, B="1000/9.8")
line_to_beam_karamba3d = LineToBeamKaramba3D(
    Line=list_item_2.Item,
    Identifier="e0",
    CrossSection=cross_section_karamba3d,
    New=True,
    Remove=True,
    LimitDistance_m=0.005)  # -> Element, Points, Info
line_to_beam_karamba3d_2 = LineToBeamKaramba3D(
    Line=list_item_2.Item2,
    Identifier="e2",
    CrossSection=cross_section_karamba3d,
    New=True,
    Remove=True,
    LimitDistance_m=0.005)  # -> Element, Points, Info
line_to_beam_karamba3d_3 = LineToBeamKaramba3D(
    Line=list_item_2.Item1,
    Identifier="e1",
    CrossSection=cross_section_karamba3d,
    New=True,
    Remove=True,
    LimitDistance_m=0.005)  # -> Element, Points, Info
evaluate = Evaluate(Expression="E/(2*G) - 1", E=multiplication_4, G=multiplication_3)
kn_cm2 = Panel(multiplication_4)
kn_cm2_2 = Panel(multiplication_3)
density_kg_m_3 = Panel(panel_4)
merge_3 = Merge(Data1=beam_joints_karamba3d)
panel_6 = Panel(evaluate)
merge_4 = Merge(Data1=line_to_beam_karamba3d.Element, Data2=line_to_beam_karamba3d_3.Element, Data3=line_to_beam_karamba3d_2.Element)
point_6 = Point(merge_2)
curve = Curve(line)
assemble_model_karamba3d = AssembleModelKaramba3D(
    Elem=merge_4,
    Support=support_karamba3d,
    Load=[loads_karamba3d, loads_karamba3d_2],
    Material=material_properties_karamba3d,
    Joint=merge_3,
    LimitDistance_m=0.005)  # -> Model, Info, Mass_kg, CenterOfGravity
number_slider_6 = Slider(0, range=0..1)
curve_2 = Curve(flatten(curve))
analyze_karamba3d = AnalyzeKaramba3D(Model=assemble_model_karamba3d.Model)  # -> CalculatedModel, MaximumDisplacement_cm, ResultingForceOfGravity_kN, ElasticEnergy_kNm
beam_forces_karamba3d = BeamForcesKaramba3D(
    AnalyzedModel=analyze_karamba3d.CalculatedModel,
    LCase=number_slider_6,
    MaximumDistanceBetweenResults_m=-1,
    NumberOfResultsPerBeamElement=2)  # -> AnalyzedModel, NormalForce_kN, ShearForceVz_kN, ShearForceVy_kN, BendingMomentMt_kNm, BendingMomentMy_kNm, BendingMomentMz_kNm
reaction_forces_karamba3d = ReactionForcesKaramba3D(AnalyzedModel=analyze_karamba3d.CalculatedModel, LoadCase=number_slider_6)  # -> AnalyzedModel, ReactionForces_kN, ReactionMoments_kNm, SupportPosition, SumOfReactionForces_kN, SumOfReactionMoments_kNm
nodal_displacements_karamba3d = NodalDisplacementsKaramba3D(AnalyzedModel=analyze_karamba3d.CalculatedModel, LoadCase=number_slider_6)  # -> AnalyzedModel, NodalTranslations_m, NodalRotations_rad
list_item_3 = ListItem(List=reaction_forces_karamba3d.SupportPosition, Index=Slider(0, range=0..2), Wrap=True)
multiplication_6 = Multiplication(A=beam_forces_karamba3d.NormalForce_kN, B="1")
axial_kn = Panel(multiplication_6)
multiplication_7 = Multiplication(A=beam_forces_karamba3d.ShearForceVz_kN, B="1")
multiplication_8 = Multiplication(A=beam_forces_karamba3d.ShearForceVy_kN, B="1")
vy_kn = Panel(multiplication_8)
multiplication_9 = Multiplication(A=beam_forces_karamba3d.BendingMomentMt_kNm, B="1")
multiplication_10 = Multiplication(A=beam_forces_karamba3d.BendingMomentMy_kNm, B="1")
point_7 = Point(list_item_3)
multiplication_11 = Multiplication(A=beam_forces_karamba3d.BendingMomentMz_kNm, B="1")
vz_kn = Panel(multiplication_7)
mt_kn_m = Panel(multiplication_9)
multiplication_12 = Multiplication(A=reaction_forces_karamba3d.ReactionForces_kN, B="1")
multiplication_13 = Multiplication(A=reaction_forces_karamba3d.ReactionMoments_kNm, B="1")
multiplication_14 = Multiplication(A=nodal_displacements_karamba3d.NodalTranslations_m, B="1")
my_kn_m = Panel(multiplication_10)
vb_script = VBScript()  # -> A
# ---------- vb_script: VB ----------
    Dim envString As String

    envString = Environ("USERPROFILE")
    A = envString
# ---------- end vb_script ----------

reaction_moment_kn_m = Panel(multiplication_13)
reaction_force_kn = Panel(multiplication_12)

tranlation_m = Panel(multiplication_14)
rotation_rad = Panel(nodal_displacements_karamba3d.NodalRotations_rad)

mz_kn_m = Panel(multiplication_11)
scale = Slider(1, range=0..1)
scale_2 = Scale(Geometry=curve_2, Center=Point(0, 0, 0), Factor=scale)  # -> Geometry, Transform
curve_3 = Curve(scale_2.Geometry)
cluster = Cluster(curve=curve_3)  # -> output_nodes, output_lines, nodes_data, lines_data, result
panel_7 = Panel("S")
concatenate_2 = Concatenate(Fragment_A=vb_script, Fragment_B="\Desktop\", A="framefab_mpp_test_models\")
model_view_karamba3d = ModelViewKaramba3D(Model=analyze_karamba3d.CalculatedModel, LoadCaseFactorsForLinearSuperposition=1, IndexOfVisibleLoadcase=number_slider_6)  # -> Model, DeformedMesh, DeformedAxes, DeformedModel
beam_view_karamba3d = BeamViewKaramba3D(Model=model_view_karamba3d.Model)  # -> Model, MeshesOfRenderedBeams, DeformedBeamAxes, LegendColors, LegendTags
panel_8 = Panel(cluster.result)

# ----
# file name
panel_9 = Panel("sf-test_2D_truss")

point_8 = Point(cluster.output_nodes)
curve_4 = Curve(cluster.output_lines)

# ----
# date suffix
c_script = CSharpScript()  # -> out, A
# ---------- c_script: C# ----------
    //    A = string.Format("{0:HH:mm:ss tt}", DateTime.Now);
    DateTime dateTime = DateTime.UtcNow.Date;
    A = dateTime.ToString("_MM-dd-yyyy");
# ---------- end c_script ----------

text = Text(flatten(concatenate_2))

# ----
# all nodes
point_9 = Point(point_8)

deconstruct = Deconstruct(Point=point_9)  # -> XComponent, YComponent, ZComponent
sort_list = SortList(Keys=deconstruct.ZComponent)  # -> Keys, ValuesValuesA

# ----
# save path
concatenate_3 = Concatenate(FragmentA=text, FragmentC="orginal_models\", FragmentB="sf-test_2D_truss\")

# ----
# grounded nodes
point_10 = Point(point_6)

list_item_4 = ListItem(List=sort_list.Keys, Index=0, Wrap=True)  # -> Item1, Item
concatenate_4 = Concatenate(Fragment_A=panel_9, A=".json")
subtraction = Subtraction(A=list_item_4.Item1, B=sort_list.Keys)
integer = Integer(flatten(cluster.result))
distance = Distance(PointA=graft(point_9), PointB=point_10)  # -> simplify(Distance)
absolute = Absolute(Value=subtraction)
concatenate_5 = Concatenate(FragmentA=concatenate_3, FragmentB=concatenate_4)
average = Average(Input=point_10)
mass_addition = MassAddition(Input=absolute)  # -> Result, PartialResults
mass_multiplication = MassMultiplication(Input=distance)  # -> Result, PartialResults
panel_10 = Panel(concatenate_5)
boolean = Boolean(mass_addition.Result)
boolean_2 = Boolean(mass_multiplication.Result)
integer_2 = Integer(boolean_2)
subtraction_2 = Subtraction(A="1", B=integer_2)
stream_filter = StreamFilter(Gate=boolean, Stream0="2D_frame", Stream1="3D_frame")
stream_filter_2 = StreamFilter(Gate=boolean, Stream0="3", Stream1="6")
dim = Panel(stream_filter_2)
duplicate_data = DuplicateData(Data=subtraction_2, Number=dim, Order=True)  # -> simplify(Data)
integer_3 = Integer(flatten(boolean_2))
panel_11 = Panel(stream_filter)
merge_5 = Merge(Data1=integer)
multiplication_15 = Multiplication(A="{600, 0, 23.5}", B=0.001)
subtraction_3 = Subtraction(A=point_9, B=average)
subtraction_4 = Subtraction(A="1", B=integer_3)
partition_list = PartitionList(List=merge_5, Size=2)  # -> simplify(Chunks)
panel_12 = Panel(partition_list)
xy_plane_2 = XYPlane(Origin=multiplication_15)  # disabled
integer_4 = Integer(subtraction_4)
point_11 = Point(subtraction_3)
panel_13 = Panel(integer_4)
point_12 = Point(point_11)
list_item_5 = ListItem(List=point_12, Index=partition_list, Wrap=False)
dispatch = Dispatch(List=point_12, DispatchPattern=integer_4)  # -> ListA, ListB
list_item_6 = ListItem(List=list_item_5, Index=0, Wrap=True)  # -> Item, Item1
panel_14 = Panel(list_item_5)
number = Number(evaluate)
number_2 = Number(multiplication_2)
number_3 = Number(panel_4)
text_2 = Text(concatenate)
integer_5 = Integer(duplicate_data)
number_4 = Number(multiplication_4)
number_5 = Number(multiplication_3)
line_2 = Line(StartPoint=list_item_6.Item, EndPoint=list_item_6.Item1)
point_13 = Point(dispatch.ListA)
panel_15 = Panel(number_3)
panel_16 = Panel(number)
panel_17 = Panel(number_2)
panel_18 = Panel(number_4)
panel_19 = Panel(number_5)
c_script_2 = CSharpScript(
    file_path=concatenate_5,
    model_type=panel_11,
    assembly_type="extrusion",
    unit="meter",
    relative_pos_to_robot_base=xy_plane_2,
    node_pts=point_11,
    ground_nodes_identifier=integer_4,
    fixities=integer_5,
    elements=partition_list,
    material_name=text_2,
    youngs_modulus=panel_18,
    youngs_modulus_unit="kN/cm2",
    shear_modulus=panel_19,
    shear_modulus_unit="kN/cm2",
    poisson_ratio=panel_16,
    radius=panel_17,
    radius_unit="centimeter",
    density=panel_15,
    density_unit="kN/m3",
    Reference="C:\USERS\YIJIANGH\DESKTOP\FrameFabGH\Newtonsoft.Json.dll")  # -> out, A; inputs file_path: String, model_type: String, assembly_type: String, unit: String, relative_pos_to_robot_base: Plane, node_pts: list of Point3d, ground_nodes_identifier: list of Int32, fixities: tree of Int32, elements: tree of Int32, material_name: String, youngs_modulus: Double, youngs_modulus_unit: String, shear_modulus: Double, shear_modulus_unit: String, poisson_ratio: Double, radius: Double, radius_unit: String, density: Double, density_unit: String; disabled
# ---------- c_script_2: C# usings ----------
using System.IO;
using System.Linq;
using System.Data;
using System.Drawing;
using System.Reflection;
using System.Windows.Forms;
using System.Xml;
using System.Xml.Linq;
using System.Runtime.InteropServices;

using Rhino.DocObjects;
using Rhino.Collections;
using GH_IO;
using GH_IO.Serialization;
using Newtonsoft.Json;
using Newtonsoft.Json.Serialization;
using Newtonsoft.Json.Schema;
using Newtonsoft.Json.Linq;
using Newtonsoft.Json.Converters;
using Newtonsoft.Json.Bson;
# ---------- c_script_2: C# ----------
    JsonSerializer serializer = new JsonSerializer();
    serializer.NullValueHandling = NullValueHandling.Ignore;
    serializer.Formatting = Newtonsoft.Json.Formatting.Indented;

    // init assembly sequence obj, wire in global params
    ChoreoInputModel cas = new ChoreoInputModel();
    cas.assembly_type = assembly_type;
    cas.model_type = model_type;
    cas.unit = unit;

    //    cas.base_frame_in_rob_base = relative_pos_to_robot_base;

    cas.material_properties = new MaterialProperty();
    cas.material_properties.material_name = material_name;
    cas.material_properties.youngs_modulus = youngs_modulus;
    cas.material_properties.youngs_modulus_unit = youngs_modulus_unit;

    cas.material_properties.shear_modulus = shear_modulus;
    cas.material_properties.shear_modulus_unit = shear_modulus_unit;

    cas.material_properties.poisson_ratio = poisson_ratio;

    cas.material_properties.radius = radius;
    cas.material_properties.radius_unit = radius_unit;

    cas.material_properties.density = density;
    cas.material_properties.density_unit = density_unit;

    cas.node_list = new List<FrameNode>(node_pts.Count());
    cas.element_list = new List<FrameElement>(elements.BranchCount);

    // create nodes
    for(int i = 0; i < node_pts.Count(); i++)
    {
      FrameNode nd = new FrameNode();
      nd.point = node_pts[i];
      nd.node_id = i;
      nd.is_grounded = ground_nodes_identifier[i];
      nd.fixities = fixities.Branch(i);

      cas.node_list.Add(nd);
    }

    // create each sequenced element
    for(int i = 0; i < elements.BranchCount; i++)
    {
      FrameElement ne = new FrameElement();
      ne.end_node_ids = new List<int>();
      ne.element_id = i;
      ne.end_node_ids = elements.Branch(i);

      cas.element_list.Add(ne);
    }

    // GH screen output
    //    string json = JsonConvert.SerializeObject(cas, Newtonsoft.Json.Formatting.Indented);
    //    Print(json);

    // serialize to json file
    using (StreamWriter sw = new StreamWriter(@file_path))
    using (JsonWriter writer = new JsonTextWriter(sw))
    {
      serializer.Serialize(writer, cas);
    }
# ---------- c_script_2: C# additional code ----------
  public class FrameNode
  {
    public Point3d point { get; set; }
    public int node_id { get; set; }
    public int is_grounded { get; set; }
    public List<int> fixities { get; set; }
  }

  public class FrameElement
  {
    public List<int> end_node_ids { get; set; }
    public int element_id { get; set; }
    public int layer_id { get; set; }
  }

  public class MaterialProperty
  {
    public string material_name { get; set; }
    public double youngs_modulus { get; set; }
    public string youngs_modulus_unit { get; set; }

    public double shear_modulus { get; set; }
    public string shear_modulus_unit { get; set; }

    public double density { get; set; }
    public string density_unit { get; set; }

    public double poisson_ratio { get; set; }

    public double radius { get; set; }
    public string radius_unit { get; set; }
  }

  public class ChoreoInputModel
  {
    public string assembly_type { get; set; }
    public string model_type { get; set; }
    public string unit { get; set; }

    //    public Plane base_frame_in_rob_base { get; set; }

    public MaterialProperty material_properties { get; set; }

    public List<FrameNode> node_list { get; set; }
    public List<FrameElement> element_list { get; set; }
  }
# ---------- end c_script_2 ----------

# ==== cluster Cluster
curve = ClusterInput()
end_points = EndPoints(Curve=curve)  # -> Start, End
merge = Merge(Data1=end_points.Start, Data2=end_points.End)
create_set = CreateSet(List=merge)  # -> Set, Map
number_slider = Slider(1, range=0..1)
member_index = MemberIndex(Set=create_set.Set, Member=end_points.End)  # -> Index, Count
member_index_2 = MemberIndex(Set=create_set.Set, Member=end_points.Start)  # -> Index, Count
deconstruct = Deconstruct(Point=create_set.Set)  # -> XComponent, YComponent, ZComponent
addition = Addition(A=member_index_2.Index, B=number_slider)
addition_2 = Addition(A=member_index.Index, B=number_slider)
integer = Integer(addition)
integer_2 = Integer(addition_2)
merge_2 = Merge(Data1=member_index_2.Index, Data2=member_index.Index)  # -> simplify(Result)
concatenate = Concatenate(
    Fragment_A="v",
    G=" ",
    Fragment_B=deconstruct.XComponent,
    A=" ",
    B=deconstruct.YComponent,
    C=" ",
    D=deconstruct.ZComponent)  # -> flatten(Result)
concatenate_2 = Concatenate(Fragment_A="l", Fragment_B=" ", A=integer, B=" ", C=integer_2)  # -> flatten(Result)
panel = Panel(merge_2)
result = ClusterOutput(merge_2)

# ----
# output_lines
curve_2 = Curve(curve)

# ----
# output_nodes
point = Point(create_set.Set)

# ----
# nodes_data
text = Text(concatenate)

# ----
# lines_data
text_2 = Text(concatenate_2)

output_nodes = ClusterOutput(point)  # output_nodes
output_lines = ClusterOutput(curve_2)
nodes_data = ClusterOutput(text)
lines_data = ClusterOutput(text_2)
