# Grasshopper definition 2D_beam.gh (Grasshopper 1.0.7)
# plug-ins: Karamba

# ----
# L
# manual layer selection
# DON'T FORGET TO INTERNALIZE
# DATA WHEN FINISHED!
number_slider = Slider(3, range=0..10)

number_slider_2 = Slider(1, range=0..1)
construct_point = ConstructPoint(XCoordinate=number_slider, YCoordinate=0, ZCoordinate=0)
construct_point_2 = ConstructPoint(XCoordinate=number_slider_2, YCoordinate=number_slider_2, ZCoordinate=0)
move = Move(Geometry=construct_point_2, Motion=construct_point)  # -> Geometry, Transform
panel = Panel("""0
1""")
unit_z = UnitZ(Factor=1)
point = Point(move.Geometry)
# layer viewer
partition_list = PartitionList(List=panel, Size=2)  # -> simplify(Chunks)
panel_2 = Panel(partition_list)
panel_3 = Panel("""1
0""")
# 1 pa = 1 N/m^2 = 1e-7 kN/cm^2 = 1e-9 kN/mm^2
material_properties_karamba3d = MaterialPropertiesKaramba3D(
    FamilyOfMaterial="Steel",
    Name="S235",
    YoungsModulus_kN_cm2=21000,
    InPlaneShearModulus_kN_cm2=8076,
    TransverseShearModulus_kN_cm2=8076,
    SpecificWeight_kN_m3=78.5,
    CoefficientOfThermalExpansion_1_C=1e-05,
    YieldStrength_kN_cm2=23.5,
    mode="Isotrop")
panel_4 = Panel(material_properties_karamba3d)
negative = Negative(Value=Slider(0.1, range=0..0.1))
disassemble_material_karamba3d = DisassembleMaterialKaramba3D(Material=material_properties_karamba3d)  # -> Material, TypeOfMaterial, FamilyNameOfMaterial, NameOfMaterial, ElemIdentifiers, Color, YoungsModulusKNCm2Dir12, InPlaneShearModulus_kN_cm2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
cm = Panel("5")
unit_y = UnitY(Factor=negative)
division = Division(A=cm, B="2")
panel_5 = Panel(unit_y)
multiplication = Multiplication(A=division, B="1")
cross_section_karamba3d = CrossSectionKaramba3D(
    FamilyNameOfCrossSection="DefaultCroSec",
    Material=material_properties_karamba3d,
    Diameter_cm=cm,
    WallThickness_cm=division,
    mode="Circular Hollow")
unit_y_2 = UnitY(Factor=1)
radius_cm = Panel(multiplication)
concatenate = Concatenate(
    Fragment_A=disassemble_material_karamba3d.FamilyNameOfMaterial,
    A="-",
    Fragment_B=disassemble_material_karamba3d.NameOfMaterial)
negative_2 = Negative(Value=unit_y_2)
panel_6 = Panel(concatenate)
# 1 kN/m^3 = 1000/9.8 kg/m^3
panel_7 = Panel(disassemble_material_karamba3d.SpecificWeight_kN_m3)
loads_karamba3d = LoadsKaramba3D(Vector=negative_2, LCase="1", mode="Gravity")
multiplication_2 = Multiplication(A=disassemble_material_karamba3d.InPlaneShearModulus_kN_cm2, B="1")
multiplication_3 = Multiplication(A=disassemble_material_karamba3d.YoungsModulusKNCm2Dir12, B="1")
panel_8 = Panel(cross_section_karamba3d)
multiplication_4 = Multiplication(A=panel_7, B="1000/9.8")
beam_joints_karamba3d = BeamJointsKaramba3D(
    CtKNMAtStartingNode=Vector(0, 0, 0),
    CrKNmRadAtStartingNode=Vector(0, 0, 0),
    CtKNMAtEndNode=Vector(0, 0, 0),
    CrKNmRadAtEndNode=Vector(0, 0, 0),
    menu=[buttons(off, off, off, off, off, on), buttons(off, off, off, off, off, on)])
evaluate = Evaluate(Expression="E/(2*G) - 1", E=multiplication_3, G=multiplication_2)
kn_cm2 = Panel(multiplication_3)
kn_cm2_2 = Panel(multiplication_2)
density_kg_m_3 = Panel(panel_7)
panel_9 = Panel(evaluate)
number_slider_3 = Slider(1, range=0..1)
rotate_3d = Rotate3D(Geometry=point, Angle=degrees(Slider(-30, range=-90..90)), Center=construct_point_2, Axis=unit_z)  # -> Geometry, Transform
merge = Merge(Data1=construct_point_2, Data2=rotate_3d.Geometry)
list_item = ListItem(List=merge, Index=partition_list, Wrap=True)
list_item_2 = ListItem(List=list_item, Index=0, Wrap=True)  # -> Item, Item1
dispatch = Dispatch(List=merge, DispatchPattern=panel_3)  # -> ListA, ListB
line = Line(StartPoint=list_item_2.Item, EndPoint=list_item_2.Item1)

# ----
# grounded verts
point_2 = Point(dispatch.ListA)

# ----
# loaded vert
point_3 = Point(dispatch.ListB)

curve = Curve(flatten(line))
list_item_3 = ListItem(List=point_2, Index=0, Wrap=False)  # -> Item, Item1, Item2
point_4 = Point(list_item_3.Item)
point_5 = Point(list_item_3.Item1)  # disabled
point_6 = Point(list_item_3.Item2)  # disabled
support_karamba3d = SupportKaramba3D(PosInd=point_4, menu=[buttons(on, on, on, on, on, on)])
support_karamba3d_2 = SupportKaramba3D(PosInd=point_5, menu=[buttons(on, on, on, on, on, off)])
support_karamba3d_3 = SupportKaramba3D(PosInd=point_6, menu=[buttons(on, on, on, on, on, off)])
merge_2 = Merge(Data1=support_karamba3d, Data2=support_karamba3d_2, Data3=support_karamba3d_3)
curve_2 = Curve(curve)
length = Length(Curve=curve_2)
# kN
loads_karamba3d_2 = LoadsKaramba3D(ForceVector=unit_y, Local=False, PosInd=point_3, LCase="0", mode="Point")
panel_10 = Panel(length)
line_to_beam_karamba3d = LineToBeamKaramba3D(Line=curve_2, CrossSection=cross_section_karamba3d, New=True, Remove=True, LimitDistance_m=0.005)  # -> Element, Points, Info
assemble_model_karamba3d = AssembleModelKaramba3D(
    Elem=line_to_beam_karamba3d.Element,
    Support=merge_2,
    Load=[loads_karamba3d_2, loads_karamba3d],
    Material=material_properties_karamba3d,
    LimitDistance_m=0.005)  # -> Model, Info, Mass_kg, CenterOfGravity
curve_3 = Curve(curve_2)
curve_4 = Curve(flatten(curve_3))
analyze_karamba3d = AnalyzeKaramba3D(Model=assemble_model_karamba3d.Model)  # -> CalculatedModel, MaximumDisplacement_cm, ResultingForceOfGravity_kN, ElasticEnergy_kNm
beam_forces_karamba3d = BeamForcesKaramba3D(
    AnalyzedModel=analyze_karamba3d.CalculatedModel,
    LCase=number_slider_3,
    MaximumDistanceBetweenResults_m=-1,
    NumberOfResultsPerBeamElement=2)  # -> AnalyzedModel, NormalForce_kN, ShearForceVz_kN, ShearForceVy_kN, BendingMomentMt_kNm, BendingMomentMy_kNm, BendingMomentMz_kNm
nodal_displacements_karamba3d = NodalDisplacementsKaramba3D(AnalyzedModel=analyze_karamba3d.CalculatedModel, LoadCase=number_slider_3)  # -> AnalyzedModel, NodalTranslations_m, NodalRotations_rad
cosine = Cosine(Value=degrees(Slider(20, range=0..100)))
reaction_forces_karamba3d = ReactionForcesKaramba3D(AnalyzedModel=analyze_karamba3d.CalculatedModel, LoadCase=number_slider_3)  # -> AnalyzedModel, ReactionForces_kN, ReactionMoments_kNm, SupportPosition, SumOfReactionForces_kN, SumOfReactionMoments_kNm
curve_5 = Curve(curve_4)
cluster = Cluster_2(text="-1.3969e-02  -2.4196e-02  -1.3962e-02")
panel_11 = Panel(cosine)
panel_12 = Panel("""0
1
5""")
list_item_4 = ListItem(List=reaction_forces_karamba3d.SupportPosition, Index=Slider(0, range=0..2), Wrap=True)
merge_3 = Merge(
    Data1=graft(beam_forces_karamba3d.NormalForce_kN),
    Data2=graft(beam_forces_karamba3d.ShearForceVz_kN),
    Data3=graft(beam_forces_karamba3d.ShearForceVy_kN),
    Data4=graft(beam_forces_karamba3d.BendingMomentMt_kNm),
    Data5=graft(beam_forces_karamba3d.BendingMomentMy_kNm),
    Data6=graft(beam_forces_karamba3d.BendingMomentMz_kNm))  # -> simplify(Result)
point_7 = Point(list_item_4)
merge_4 = Merge(
    Data1=simplify(graft(nodal_displacements_karamba3d.NodalTranslations_m)),
    Data2=simplify(graft(nodal_displacements_karamba3d.NodalRotations_rad)))
multiplication_5 = Multiplication(A=reaction_forces_karamba3d.ReactionForces_kN, B="1")
evaluate_2 = Evaluate(Expression="format(\"{0:E}\",x)", x=merge_3)
panel_13 = Panel(cluster)
multiplication_6 = Multiplication(A=reaction_forces_karamba3d.ReactionMoments_kNm, B="1")
evaluate_3 = Evaluate(Expression="format(\"{0:E} {1:E} {2:E}\",x.x,x.y,x.z)", x=merge_4)
froce_kn_moment_kn_m = Panel(evaluate_2)

reaction_moment_kn_m = Panel(multiplication_6)
reaction_force_kn = Panel(multiplication_5)

cluster_2 = Cluster_2(text=evaluate_3)
shift_paths = ShiftPaths(Data=cluster_2, Offset=-1)
cluster_3 = Cluster(curve=curve_5)  # -> output_nodes, output_lines, nodes_data, lines_data, result
tree_branch = TreeBranch(Tree=shift_paths, Path="{1}", MaintainPaths=True)
number = Number(simplify(tree_branch))
list_item_5 = ListItem(List=number, Index=panel_12, Wrap=True)
subtraction = Subtraction(A=cluster, B=list_item_5)
absolute = Absolute(Value=subtraction)  # -> simplify(Result)
panel_14 = Panel(list_item_5)
division_2 = Division(A=absolute, B=list_item_5)
panel_15 = Panel(division_2)
data_dam = DataDam(DataDataA=division_2, BufferDelay=10000000, BufferMode=0)
data_recorder = DataRecorder(data_dam, DataLimit=-10, RecordData=True)
translation_m_rotation_rad = Panel(tree_branch)
partition_list_2 = PartitionList(List=data_recorder, Size=3)  # -> simplify(Chunks)
model_view_karamba3d = ModelViewKaramba3D(Model=analyze_karamba3d.CalculatedModel, LoadCaseFactorsForLinearSuperposition=1, IndexOfVisibleLoadcase=number_slider_3)  # -> Model, DeformedMesh, DeformedAxes, DeformedModel
beam_view_karamba3d = BeamViewKaramba3D(Model=model_view_karamba3d.Model)  # -> Model, MeshesOfRenderedBeams, DeformedBeamAxes, LegendColors, LegendTags
panel_16 = Panel(cluster_3.result)
point_8 = Point(cluster_3.output_nodes)
curve_6 = Curve(cluster_3.output_lines)
panel_17 = Panel(partition_list_2)

# ----
# all nodes
point_9 = Point(point_8)

deconstruct = Deconstruct(Point=point_9)  # -> XComponent, YComponent, ZComponent

# ----
# grounded nodes
point_10 = Point(point_2)

sort_list = SortList(Keys=deconstruct.ZComponent)  # -> Keys, ValuesValuesA
list_item_6 = ListItem(List=partition_list_2, Index=0, Wrap=True)  # -> flatten(Item), flatten(Item1), flatten(Item2)
list_item_7 = ListItem(List=sort_list.Keys, Index=0, Wrap=True)  # -> Item1, Item
quick_graph = QuickGraph(list_item_6.Item2, SortOrder=0)
quick_graph_2 = QuickGraph(list_item_6.Item, SortOrder=0)
quick_graph_3 = QuickGraph(list_item_6.Item1, SortOrder=0)
subtraction_2 = Subtraction(A=list_item_7.Item1, B=sort_list.Keys)
integer = Integer(flatten(cluster_3.result))
distance = Distance(PointA=graft(point_9), PointB=point_10)  # -> simplify(Distance)
absolute_2 = Absolute(Value=subtraction_2)
average = Average(Input=point_10)
mass_addition = MassAddition(Input=absolute_2)  # -> Result, PartialResults
mass_multiplication = MassMultiplication(Input=distance)  # -> Result, PartialResults
boolean = Boolean(mass_addition.Result)
boolean_2 = Boolean(mass_multiplication.Result)
integer_2 = Integer(boolean_2)
subtraction_3 = Subtraction(A="1", B=integer_2)
stream_filter = StreamFilter(Gate=boolean, Stream0="2D_frame", Stream1="3D_frame")
stream_filter_2 = StreamFilter(Gate=boolean, Stream0="2", Stream1="3")
stream_filter_3 = StreamFilter(Gate=boolean, Stream0="3", Stream1="6")
dim = Panel(stream_filter_3)
duplicate_data = DuplicateData(Data=subtraction_3, Number=dim, Order=True)  # -> simplify(Data)
integer_3 = Integer(flatten(boolean_2))
panel_18 = Panel(stream_filter)
integer_4 = Integer(stream_filter_2)
merge_5 = Merge(Data1=integer)
multiplication_7 = Multiplication(A="{600, 0, 23.5}", B=0.001)
panel_19 = Panel("D:\Dropbox (MIT)\Projects\conmech\conmech\src\stiffness_checker\matlab\test\problem_instances\")
subtraction_4 = Subtraction(A=point_9, B=average)
subtraction_5 = Subtraction(A="1", B=integer_3)
partition_list_3 = PartitionList(List=merge_5, Size=2)  # -> simplify(Chunks)
panel_20 = Panel(partition_list_3)
xy_plane = XYPlane(Origin=multiplication_7)  # disabled
integer_5 = Integer(subtraction_5)
point_11 = Point(subtraction_4)

# ----
# file name
panel_21 = Panel("sf-test_2D_beam")

panel_22 = Panel(integer_5)
point_12 = Point(point_11)
list_item_8 = ListItem(List=point_12, Index=partition_list_3, Wrap=False)
concatenate_2 = Concatenate(Fragment_A=panel_21, A=".json")
dispatch_2 = Dispatch(List=point_12, DispatchPattern=integer_5)  # -> ListA, ListB
list_item_9 = ListItem(List=list_item_8, Index=0, Wrap=True)  # -> Item, Item1
panel_23 = Panel(list_item_8)
concatenate_3 = Concatenate(FragmentA=panel_19, FragmentB=concatenate_2)
number_2 = Number(evaluate)
number_3 = Number(multiplication)
number_4 = Number(panel_7)
text = Text(concatenate)
integer_6 = Integer(duplicate_data)
number_5 = Number(multiplication_3)
number_6 = Number(multiplication_2)
line_2 = Line(StartPoint=list_item_9.Item, EndPoint=list_item_9.Item1)
integer_7 = Integer(integer_4)
point_13 = Point(dispatch_2.ListA)
panel_24 = Panel(number_4)
panel_25 = Panel(number_2)
panel_26 = Panel(number_3)
panel_27 = Panel(number_5)
panel_28 = Panel(number_6)
c_script = CSharpScript(
    file_path=concatenate_3,
    model_type=panel_18,
    assembly_type="extrusion",
    unit="meter",
    dimension=integer_7,
    relative_pos_to_robot_base=xy_plane,
    node_pts=point_11,
    ground_nodes_identifier=integer_5,
    fixities=integer_6,
    elements=partition_list_3,
    material_name=text,
    youngs_modulus=panel_27,
    youngs_modulus_unit="kN/cm2",
    shear_modulus=panel_28,
    shear_modulus_unit="kN/cm2",
    poisson_ratio=panel_25,
    radius=panel_26,
    radius_unit="centimeter",
    density=panel_24,
    density_unit="kN/m3",
    Reference="D:\Dropbox (MIT)\Projects\conmech\conmech\src\stiffness_checker\matlab\test\karamba\Newtonsoft.Json.dll")  # -> out, A; inputs file_path: String, model_type: String, assembly_type: String, unit: String, dimension: Int32, relative_pos_to_robot_base: Plane, node_pts: list of Point3d, ground_nodes_identifier: list of Int32, fixities: tree of Int32, elements: tree of Int32, material_name: String, youngs_modulus: Double, youngs_modulus_unit: String, shear_modulus: Double, shear_modulus_unit: String, poisson_ratio: Double, radius: Double, radius_unit: String, density: Double, density_unit: String
# ---------- c_script: C# usings ----------
using System.IO;
using System.Linq;
using System.Data;
using System.Drawing;
using System.Reflection;
using System.Windows.Forms;
using System.Xml;
using System.Xml.Linq;
using System.Runtime.InteropServices;

using Rhino.DocObjects;
using Rhino.Collections;
using GH_IO;
using GH_IO.Serialization;
using Newtonsoft.Json;
using Newtonsoft.Json.Serialization;
using Newtonsoft.Json.Schema;
using Newtonsoft.Json.Linq;
using Newtonsoft.Json.Converters;
using Newtonsoft.Json.Bson;
# ---------- c_script: C# ----------
    JsonSerializer serializer = new JsonSerializer();
    serializer.NullValueHandling = NullValueHandling.Ignore;
    serializer.Formatting = Newtonsoft.Json.Formatting.Indented;

    // init assembly sequence obj, wire in global params
    ChoreoInputModel cas = new ChoreoInputModel();
    cas.assembly_type = assembly_type;
    cas.model_type = model_type;
    cas.unit = unit;
    cas.dimension = dimension;

    //    cas.base_frame_in_rob_base = relative_pos_to_robot_base;

    cas.material_properties = new MaterialProperty();
    cas.material_properties.material_name = material_name;
    cas.material_properties.youngs_modulus = youngs_modulus;
    cas.material_properties.youngs_modulus_unit = youngs_modulus_unit;

    cas.material_properties.shear_modulus = shear_modulus;
    cas.material_properties.shear_modulus_unit = shear_modulus_unit;

    cas.material_properties.poisson_ratio = poisson_ratio;

    cas.material_properties.radius = radius;
    cas.material_properties.radius_unit = radius_unit;

    cas.material_properties.density = density;
    cas.material_properties.density_unit = density_unit;

    cas.node_list = new List<FrameNode>(node_pts.Count());
    cas.element_list = new List<FrameElement>(elements.BranchCount);

    // create nodes
    for(int i = 0; i < node_pts.Count(); i++)
    {
      FrameNode nd = new FrameNode();
      nd.point = node_pts[i];
      nd.node_id = i;
      nd.is_grounded = ground_nodes_identifier[i];
      nd.fixities = fixities.Branch(i);

      cas.node_list.Add(nd);
    }

    // create each sequenced element
    for(int i = 0; i < elements.BranchCount; i++)
    {
      FrameElement ne = new FrameElement();
      ne.end_node_ids = new List<int>();
      ne.element_id = i;
      ne.end_node_ids = elements.Branch(i);

      cas.element_list.Add(ne);
    }

    // GH screen output
    //    string json = JsonConvert.SerializeObject(cas, Newtonsoft.Json.Formatting.Indented);
    //    Print(json);

    // serialize to json file
    using (StreamWriter sw = new StreamWriter(@file_path))
    using (JsonWriter writer = new JsonTextWriter(sw))
    {
      serializer.Serialize(writer, cas);
    }
# ---------- c_script: C# additional code ----------
  public class FrameNode
  {
    public Point3d point { get; set; }
    public int node_id { get; set; }
    public int is_grounded { get; set; }
    public List<int> fixities { get; set; }
  }

  public class FrameElement
  {
    public List<int> end_node_ids { get; set; }
    public int element_id { get; set; }
    public int layer_id { get; set; }
  }

  public class MaterialProperty
  {
    public string material_name { get; set; }
    public double youngs_modulus { get; set; }
    public string youngs_modulus_unit { get; set; }

    public double shear_modulus { get; set; }
    public string shear_modulus_unit { get; set; }

    public double density { get; set; }
    public string density_unit { get; set; }

    public double poisson_ratio { get; set; }

    public double radius { get; set; }
    public string radius_unit { get; set; }
  }

  public class ChoreoInputModel
  {
    public string assembly_type { get; set; }
    public string model_type { get; set; }
    public string unit { get; set; }
    public double dimension { get; set; }

    //    public Plane base_frame_in_rob_base { get; set; }

    public MaterialProperty material_properties { get; set; }

    public List<FrameNode> node_list { get; set; }
    public List<FrameElement> element_list { get; set; }
  }
# ---------- end c_script ----------

# ==== cluster Cluster
curve = ClusterInput()
end_points = EndPoints(Curve=curve)  # -> Start, End
merge = Merge(Data1=end_points.Start, Data2=end_points.End)
create_set = CreateSet(List=merge)  # -> Set, Map
number_slider = Slider(1, range=0..1)
member_index = MemberIndex(Set=create_set.Set, Member=end_points.End)  # -> Index, Count
member_index_2 = MemberIndex(Set=create_set.Set, Member=end_points.Start)  # -> Index, Count
deconstruct = Deconstruct(Point=create_set.Set)  # -> XComponent, YComponent, ZComponent
addition = Addition(A=member_index_2.Index, B=number_slider)
addition_2 = Addition(A=member_index.Index, B=number_slider)
integer = Integer(addition)
integer_2 = Integer(addition_2)
merge_2 = Merge(Data1=member_index_2.Index, Data2=member_index.Index)  # -> simplify(Result)
concatenate = Concatenate(
    Fragment_A="v",
    G=" ",
    Fragment_B=deconstruct.XComponent,
    A=" ",
    B=deconstruct.YComponent,
    C=" ",
    D=deconstruct.ZComponent)  # -> flatten(Result)
concatenate_2 = Concatenate(Fragment_A="l", Fragment_B=" ", A=integer, B=" ", C=integer_2)  # -> flatten(Result)
panel = Panel(merge_2)
result = ClusterOutput(merge_2)

# ----
# output_lines
curve_2 = Curve(curve)

# ----
# output_nodes
point = Point(create_set.Set)

# ----
# nodes_data
text = Text(concatenate)

# ----
# lines_data
text_2 = Text(concatenate_2)

output_nodes = ClusterOutput(point)  # output_nodes
output_lines = ClusterOutput(curve_2)
nodes_data = ClusterOutput(text)
lines_data = ClusterOutput(text_2)

# ==== cluster Cluster_2
text = ClusterInput()
text_split = TextSplit(Text=text, Separators=" ")
number = Number(text_split)
clean_tree = CleanTree(RemoveNulls=True, RemoveInvalid=True, RemoveEmpty=False, Tree=number)
tree = ClusterOutput(clean_tree)
