# Grasshopper definition 2D_truss+frame.gh (Grasshopper 1.0.7)
# plug-ins: Karamba

number_slider = Slider(0.5, range=0..1)
# manual layer selection
# DON'T FORGET TO INTERNALIZE
# DATA WHEN FINISHED!
# layer viewer
number_slider_2 = Slider(0.7, range=0..1)

# ----
# L
number_slider_3 = Slider(3.048, range=0..10)

negative = Negative(Value=number_slider)
xy_plane = XYPlane(Origin=Point(0, 0, 0))
circle = Circle(Plane=xy_plane, Radius=number_slider_2)
construct_domain = ConstructDomain(DomainStart=negative, DomainEnd=number_slider)
multiplication = Multiplication(A=number_slider_3, B="2")
panel = Panel("""0
1
0
2
1
2
2
3""")
divide_curve = DivideCurve(Curve=circle, Count="3", Kinks=False, UseTasks=True)  # -> Points, Tangents, Parameters
partition_list = PartitionList(List=panel, Size=2)  # -> simplify(Chunks)
construct_point = ConstructPoint(XCoordinate=multiplication, YCoordinate=number_slider_3, ZCoordinate=0)
rectangle = Rectangle(Plane=xy_plane, XSize=construct_domain, YSize=construct_domain, Radius=0)  # -> Rectangle, Length
construct_point_2 = ConstructPoint(XCoordinate=0, YCoordinate=number_slider_3, ZCoordinate=0)
construct_point_3 = ConstructPoint(XCoordinate=number_slider_3, YCoordinate=multiplication, ZCoordinate=0)
construct_point_4 = ConstructPoint(XCoordinate=0, YCoordinate=0, ZCoordinate=0)
panel_2 = Panel(partition_list)
unit_z = UnitZ(Factor=Slider(1, range=0..1))
brep = Brep(rectangle.Rectangle)
list_item = ListItem(List=divide_curve.Points, Index=0, Wrap=True)  # -> Item, Item1
deconstruct_brep = DeconstructBrep(Brep=brep)  # -> Faces, Edges, Vertices
merge = Merge(Data1=construct_point_4, Data2=construct_point_2, Data3=construct_point, Data4=construct_point_3)
list_item_2 = ListItem(List=merge, Index=partition_list, Wrap=True)
point = Point(xy_plane)
panel_3 = Panel("""1
1
0
1""")
move = Move(Geometry=point, Motion=unit_z)  # -> Geometry, Transform
list_item_3 = ListItem(List=list_item_2, Index=0, Wrap=True)  # -> Item, Item1
point_2 = Point(flatten(deconstruct_brep.Vertices))
point_3 = Point(flatten(divide_curve.Points))
dispatch = Dispatch(List=merge, DispatchPattern=panel_3)  # -> ListA, ListB
line = Line(StartPoint=list_item_3.Item, EndPoint=list_item_3.Item1)

# ----
# grounded verts
point_4 = Point(dispatch.ListA)

# ----
# loaded vert
point_5 = Point(dispatch.ListB)

curve = Curve(flatten(line))
list_item_4 = ListItem(List=point_4, Index=0, Wrap=True)  # -> Item, Item1, Item2
point_6 = Point(list_item_4.Item1)
point_7 = Point(list_item_4.Item2)
point_8 = Point(list_item_4.Item)
support_karamba3d = SupportKaramba3D(PosInd=point_8, menu=[buttons(on, off, on, on, on, off)])
support_karamba3d_2 = SupportKaramba3D(PosInd=point_6, menu=[buttons(on, on, on, on, on, off)])
support_karamba3d_3 = SupportKaramba3D(PosInd=point_7, menu=[buttons(on, on, on, on, on, off)])
# 1 pa = 1 N/m^2 = 1e-7 kN/cm^2 = 1e-9 kN/mm^2
material_properties_karamba3d = MaterialPropertiesKaramba3D(
    FamilyOfMaterial="Steel",
    Name="S235",
    YoungsModulus_kN_cm2=21000,
    InPlaneShearModulus_kN_cm2=8076,
    TransverseShearModulus_kN_cm2=8076,
    SpecificWeight_kN_m3=78.5,
    CoefficientOfThermalExpansion_1_C=1e-05,
    YieldStrength_kN_cm2=23.5,
    mode="Isotrop")
number_slider_4 = Slider(100, range=0..1000)
number_slider_5 = Slider(0.1, range=0..0.1)
number_slider_6 = Slider(10, range=0..10)
merge_2 = Merge(Data1=support_karamba3d, Data2=support_karamba3d_2, Data3=support_karamba3d_3)
panel_4 = Panel(material_properties_karamba3d)
negative_2 = Negative(Value=number_slider_4)
unit_x = UnitX(Factor=number_slider_4)
disassemble_material_karamba3d = DisassembleMaterialKaramba3D(Material=material_properties_karamba3d)  # -> Material, TypeOfMaterial, FamilyNameOfMaterial, NameOfMaterial, ElemIdentifiers, Color, YoungsModulusKNCm2Dir12, InPlaneShearModulus_kN_cm2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
cm = Panel("5")
unit_y = UnitY(Factor=negative_2)
division = Division(A=cm, B="2")
panel_5 = Panel(unit_y)
multiplication_2 = Multiplication(A=division, B="1")
cross_section_karamba3d = CrossSectionKaramba3D(
    FamilyNameOfCrossSection="DefaultCroSec",
    Material=material_properties_karamba3d,
    Diameter_cm=cm,
    WallThickness_cm=division,
    mode="Circular Hollow")
unit_y_2 = UnitY(Factor=1)
curve_2 = Curve(curve)
radius_cm = Panel(multiplication_2)
concatenate = Concatenate(
    Fragment_A=disassemble_material_karamba3d.FamilyNameOfMaterial,
    A="-",
    Fragment_B=disassemble_material_karamba3d.NameOfMaterial)
negative_3 = Negative(Value=unit_y_2)
length = Length(Curve=curve_2)
panel_6 = Panel(concatenate)
# 1 kN/m^3 = 1000/9.8 kg/m^3
panel_7 = Panel(disassemble_material_karamba3d.SpecificWeight_kN_m3)
# kN
loads_karamba3d = LoadsKaramba3D(ForceVector=unit_y, Local=False, PosInd=point_5, LCase="0", mode="Point")
loads_karamba3d_2 = LoadsKaramba3D(Vector=negative_3, LCase="1", mode="Gravity")
multiplication_3 = Multiplication(A=disassemble_material_karamba3d.InPlaneShearModulus_kN_cm2, B="1")
multiplication_4 = Multiplication(A=disassemble_material_karamba3d.YoungsModulusKNCm2Dir12, B="1")
panel_8 = Panel(length)
panel_9 = Panel(cross_section_karamba3d)
multiplication_5 = Multiplication(A=panel_7, B="1000/9.8")
line_to_beam_karamba3d = LineToBeamKaramba3D(Line=curve_2, CrossSection=cross_section_karamba3d, New=True, Remove=True, LimitDistance_m=0.005)  # -> Element, Points, Info
beam_joints_karamba3d = BeamJointsKaramba3D(
    CtKNMAtStartingNode=Vector(0, 0, 0),
    CrKNmRadAtStartingNode=Vector(0, 0, 0),
    CtKNMAtEndNode=Vector(0, 0, 0),
    CrKNmRadAtEndNode=Vector(0, 0, 0),
    menu=[buttons(off, off, off, off, off, on), buttons(off, off, off, off, off, on)])
evaluate = Evaluate(Expression="E/(2*G) - 1", E=multiplication_4, G=multiplication_3)
kn_cm2 = Panel(multiplication_4)
kn_cm2_2 = Panel(multiplication_3)
density_kg_m_3 = Panel(panel_7)
panel_10 = Panel(evaluate)
assemble_model_karamba3d = AssembleModelKaramba3D(
    Elem=line_to_beam_karamba3d.Element,
    Support=merge_2,
    Load=[loads_karamba3d, loads_karamba3d_2],
    Material=material_properties_karamba3d,
    LimitDistance_m=0.005)  # -> Model, Info, Mass_kg, CenterOfGravity
curve_3 = Curve(curve_2)
number_slider_7 = Slider(0, range=0..1)
curve_4 = Curve(flatten(curve_3))
analyze_karamba3d = AnalyzeKaramba3D(Model=assemble_model_karamba3d.Model)  # -> CalculatedModel, MaximumDisplacement_cm, ResultingForceOfGravity_kN, ElasticEnergy_kNm
beam_forces_karamba3d = BeamForcesKaramba3D(
    AnalyzedModel=analyze_karamba3d.CalculatedModel,
    LCase=number_slider_7,
    MaximumDistanceBetweenResults_m=-1,
    NumberOfResultsPerBeamElement=2)  # -> AnalyzedModel, NormalForce_kN, ShearForceVz_kN, ShearForceVy_kN, BendingMomentMt_kNm, BendingMomentMy_kNm, BendingMomentMz_kNm
reaction_forces_karamba3d = ReactionForcesKaramba3D(AnalyzedModel=analyze_karamba3d.CalculatedModel, LoadCase=number_slider_7)  # -> AnalyzedModel, ReactionForces_kN, ReactionMoments_kNm, SupportPosition, SumOfReactionForces_kN, SumOfReactionMoments_kNm
nodal_displacements_karamba3d = NodalDisplacementsKaramba3D(AnalyzedModel=analyze_karamba3d.CalculatedModel, LoadCase=number_slider_7)  # -> AnalyzedModel, NodalTranslations_m, NodalRotations_rad
list_item_5 = ListItem(List=reaction_forces_karamba3d.SupportPosition, Index=Slider(0, range=0..2), Wrap=True)
multiplication_6 = Multiplication(A=beam_forces_karamba3d.NormalForce_kN, B="1")
axial_kn = Panel(multiplication_6)
multiplication_7 = Multiplication(A=beam_forces_karamba3d.ShearForceVz_kN, B="1")
multiplication_8 = Multiplication(A=beam_forces_karamba3d.ShearForceVy_kN, B="1")
vy_kn = Panel(multiplication_8)
multiplication_9 = Multiplication(A=beam_forces_karamba3d.BendingMomentMt_kNm, B="1")
multiplication_10 = Multiplication(A=beam_forces_karamba3d.BendingMomentMy_kNm, B="1")
point_9 = Point(list_item_5)
multiplication_11 = Multiplication(A=beam_forces_karamba3d.BendingMomentMz_kNm, B="1")
vz_kn = Panel(multiplication_7)
mt_kn_m = Panel(multiplication_9)
multiplication_12 = Multiplication(A=reaction_forces_karamba3d.ReactionForces_kN, B="1")
multiplication_13 = Multiplication(A=reaction_forces_karamba3d.ReactionMoments_kNm, B="1")
multiplication_14 = Multiplication(A=nodal_displacements_karamba3d.NodalTranslations_m, B="1")
my_kn_m = Panel(multiplication_10)
vb_script = VBScript()  # -> A
# ---------- vb_script: VB ----------
    Dim envString As String

    envString = Environ("USERPROFILE")
    A = envString
# ---------- end vb_script ----------

reaction_moment_kn_m = Panel(multiplication_13)
reaction_force_kn = Panel(multiplication_12)

tranlation_m = Panel(multiplication_14)
rotation_rad = Panel(nodal_displacements_karamba3d.NodalRotations_rad)

mz_kn_m = Panel(multiplication_11)
scale = Slider(1, range=0..1)
scale_2 = Scale(Geometry=curve_4, Center=Point(0, 0, 0), Factor=scale)  # -> Geometry, Transform
curve_5 = Curve(scale_2.Geometry)
cluster = Cluster(curve=curve_5)  # -> output_nodes, output_lines, nodes_data, lines_data, result
panel_11 = Panel("S")
concatenate_2 = Concatenate(Fragment_A=vb_script, Fragment_B="\Desktop\", A="framefab_mpp_test_models\")
model_view_karamba3d = ModelViewKaramba3D(Model=analyze_karamba3d.CalculatedModel, LoadCaseFactorsForLinearSuperposition=1, IndexOfVisibleLoadcase=number_slider_7)  # -> Model, DeformedMesh, DeformedAxes, DeformedModel
beam_view_karamba3d = BeamViewKaramba3D(Model=model_view_karamba3d.Model)  # -> Model, MeshesOfRenderedBeams, DeformedBeamAxes, LegendColors, LegendTags
panel_12 = Panel(cluster.result)

# ----
# file name
panel_13 = Panel("sf-test_2D_truss")

point_10 = Point(cluster.output_nodes)
curve_6 = Curve(cluster.output_lines)

# ----
# date suffix
c_script = CSharpScript()  # -> out, A
# ---------- c_script: C# ----------
    //    A = string.Format("{0:HH:mm:ss tt}", DateTime.Now);
    DateTime dateTime = DateTime.UtcNow.Date;
    A = dateTime.ToString("_MM-dd-yyyy");
# ---------- end c_script ----------

text = Text(flatten(concatenate_2))

# ----
# all nodes
point_11 = Point(point_10)

deconstruct = Deconstruct(Point=point_11)  # -> XComponent, YComponent, ZComponent

# ----
# grounded nodes
point_12 = Point(point_4)

sort_list = SortList(Keys=deconstruct.ZComponent)  # -> Keys, ValuesValuesA

# ----
# save path
concatenate_3 = Concatenate(FragmentA=text, FragmentC="orginal_models\", FragmentB="sf-test_2D_truss\")

list_item_6 = ListItem(List=sort_list.Keys, Index=0, Wrap=True)  # -> Item1, Item
concatenate_4 = Concatenate(Fragment_A=panel_13, A=".json")
subtraction = Subtraction(A=list_item_6.Item1, B=sort_list.Keys)
integer = Integer(flatten(cluster.result))
distance = Distance(PointA=graft(point_11), PointB=point_12)  # -> simplify(Distance)
absolute = Absolute(Value=subtraction)
concatenate_5 = Concatenate(FragmentA=concatenate_3, FragmentB=concatenate_4)
average = Average(Input=point_12)
mass_addition = MassAddition(Input=absolute)  # -> Result, PartialResults
mass_multiplication = MassMultiplication(Input=distance)  # -> Result, PartialResults
panel_14 = Panel(concatenate_5)
boolean = Boolean(mass_addition.Result)
boolean_2 = Boolean(mass_multiplication.Result)
integer_2 = Integer(boolean_2)
subtraction_2 = Subtraction(A="1", B=integer_2)
stream_filter = StreamFilter(Gate=boolean, Stream0="2D_frame", Stream1="3D_frame")
stream_filter_2 = StreamFilter(Gate=boolean, Stream0="2", Stream1="3")
stream_filter_3 = StreamFilter(Gate=boolean, Stream0="3", Stream1="6")
dim = Panel(stream_filter_3)
duplicate_data = DuplicateData(Data=subtraction_2, Number=dim, Order=True)  # -> simplify(Data)
integer_3 = Integer(flatten(boolean_2))
panel_15 = Panel(stream_filter)
integer_4 = Integer(stream_filter_2)
merge_3 = Merge(Data1=integer)
multiplication_15 = Multiplication(A="{600, 0, 23.5}", B=0.001)
subtraction_3 = Subtraction(A=point_11, B=average)
subtraction_4 = Subtraction(A="1", B=integer_3)
partition_list_2 = PartitionList(List=merge_3, Size=2)  # -> simplify(Chunks)
panel_16 = Panel(partition_list_2)
xy_plane_2 = XYPlane(Origin=multiplication_15)  # disabled
integer_5 = Integer(subtraction_4)
point_13 = Point(subtraction_3)
panel_17 = Panel(integer_5)
point_14 = Point(point_13)
list_item_7 = ListItem(List=point_14, Index=partition_list_2, Wrap=False)
dispatch_2 = Dispatch(List=point_14, DispatchPattern=integer_5)  # -> ListA, ListB
list_item_8 = ListItem(List=list_item_7, Index=0, Wrap=True)  # -> Item, Item1
panel_18 = Panel(list_item_7)
number = Number(evaluate)
number_2 = Number(multiplication_2)
number_3 = Number(panel_7)
text_2 = Text(concatenate)
integer_6 = Integer(duplicate_data)
number_4 = Number(multiplication_4)
number_5 = Number(multiplication_3)
line_2 = Line(StartPoint=list_item_8.Item, EndPoint=list_item_8.Item1)
integer_7 = Integer(integer_4)
point_15 = Point(dispatch_2.ListA)
panel_19 = Panel(number_3)
panel_20 = Panel(number)
panel_21 = Panel(number_2)
panel_22 = Panel(number_4)
panel_23 = Panel(number_5)
c_script_2 = CSharpScript(
    file_path=concatenate_5,
    model_type=panel_15,
    assembly_type="extrusion",
    unit="meter",
    dimension=integer_7,
    relative_pos_to_robot_base=xy_plane_2,
    node_pts=point_13,
    ground_nodes_identifier=integer_5,
    fixities=integer_6,
    elements=partition_list_2,
    material_name=text_2,
    youngs_modulus=panel_22,
    youngs_modulus_unit="kN/cm2",
    shear_modulus=panel_23,
    shear_modulus_unit="kN/cm2",
    poisson_ratio=panel_20,
    radius=panel_21,
    radius_unit="centimeter",
    density=panel_19,
    density_unit="kN/m3",
    Reference="C:\USERS\YIJIANGH\DESKTOP\FrameFabGH\Newtonsoft.Json.dll")  # -> out, A; inputs file_path: String, model_type: String, assembly_type: String, unit: String, dimension: Int32, relative_pos_to_robot_base: Plane, node_pts: list of Point3d, ground_nodes_identifier: list of Int32, fixities: tree of Int32, elements: tree of Int32, material_name: String, youngs_modulus: Double, youngs_modulus_unit: String, shear_modulus: Double, shear_modulus_unit: String, poisson_ratio: Double, radius: Double, radius_unit: String, density: Double, density_unit: String; disabled
# ---------- c_script_2: C# usings ----------
using System.IO;
using System.Linq;
using System.Data;
using System.Drawing;
using System.Reflection;
using System.Windows.Forms;
using System.Xml;
using System.Xml.Linq;
using System.Runtime.InteropServices;

using Rhino.DocObjects;
using Rhino.Collections;
using GH_IO;
using GH_IO.Serialization;
using Newtonsoft.Json;
using Newtonsoft.Json.Serialization;
using Newtonsoft.Json.Schema;
using Newtonsoft.Json.Linq;
using Newtonsoft.Json.Converters;
using Newtonsoft.Json.Bson;
# ---------- c_script_2: C# ----------
    JsonSerializer serializer = new JsonSerializer();
    serializer.NullValueHandling = NullValueHandling.Ignore;
    serializer.Formatting = Newtonsoft.Json.Formatting.Indented;

    // init assembly sequence obj, wire in global params
    ChoreoInputModel cas = new ChoreoInputModel();
    cas.assembly_type = assembly_type;
    cas.model_type = model_type;
    cas.unit = unit;
    cas.dimension = dimension;

    //    cas.base_frame_in_rob_base = relative_pos_to_robot_base;

    cas.material_properties = new MaterialProperty();
    cas.material_properties.material_name = material_name;
    cas.material_properties.youngs_modulus = youngs_modulus;
    cas.material_properties.youngs_modulus_unit = youngs_modulus_unit;

    cas.material_properties.shear_modulus = shear_modulus;
    cas.material_properties.shear_modulus_unit = shear_modulus_unit;

    cas.material_properties.poisson_ratio = poisson_ratio;

    cas.material_properties.radius = radius;
    cas.material_properties.radius_unit = radius_unit;

    cas.material_properties.density = density;
    cas.material_properties.density_unit = density_unit;

    cas.node_list = new List<FrameNode>(node_pts.Count());
    cas.element_list = new List<FrameElement>(elements.BranchCount);

    // create nodes
    for(int i = 0; i < node_pts.Count(); i++)
    {
      FrameNode nd = new FrameNode();
      nd.point = node_pts[i];
      nd.node_id = i;
      nd.is_grounded = ground_nodes_identifier[i];
      nd.fixities = fixities.Branch(i);

      cas.node_list.Add(nd);
    }

    // create each sequenced element
    for(int i = 0; i < elements.BranchCount; i++)
    {
      FrameElement ne = new FrameElement();
      ne.end_node_ids = new List<int>();
      ne.element_id = i;
      ne.end_node_ids = elements.Branch(i);

      cas.element_list.Add(ne);
    }

    // GH screen output
    //    string json = JsonConvert.SerializeObject(cas, Newtonsoft.Json.Formatting.Indented);
    //    Print(json);

    // serialize to json file
    using (StreamWriter sw = new StreamWriter(@file_path))
    using (JsonWriter writer = new JsonTextWriter(sw))
    {
      serializer.Serialize(writer, cas);
    }
# ---------- c_script_2: C# additional code ----------
  public class FrameNode
  {
    public Point3d point { get; set; }
    public int node_id { get; set; }
    public int is_grounded { get; set; }
    public List<int> fixities { get; set; }
  }

  public class FrameElement
  {
    public List<int> end_node_ids { get; set; }
    public int element_id { get; set; }
    public int layer_id { get; set; }
  }

  public class MaterialProperty
  {
    public string material_name { get; set; }
    public double youngs_modulus { get; set; }
    public string youngs_modulus_unit { get; set; }

    public double shear_modulus { get; set; }
    public string shear_modulus_unit { get; set; }

    public double density { get; set; }
    public string density_unit { get; set; }

    public double poisson_ratio { get; set; }

    public double radius { get; set; }
    public string radius_unit { get; set; }
  }

  public class ChoreoInputModel
  {
    public string assembly_type { get; set; }
    public string model_type { get; set; }
    public string unit { get; set; }
    public double dimension { get; set; }

    //    public Plane base_frame_in_rob_base { get; set; }

    public MaterialProperty material_properties { get; set; }

    public List<FrameNode> node_list { get; set; }
    public List<FrameElement> element_list { get; set; }
  }
# ---------- end c_script_2 ----------

# ==== cluster Cluster
curve = ClusterInput()
end_points = EndPoints(Curve=curve)  # -> Start, End
merge = Merge(Data1=end_points.Start, Data2=end_points.End)
create_set = CreateSet(List=merge)  # -> Set, Map
number_slider = Slider(1, range=0..1)
member_index = MemberIndex(Set=create_set.Set, Member=end_points.End)  # -> Index, Count
member_index_2 = MemberIndex(Set=create_set.Set, Member=end_points.Start)  # -> Index, Count
deconstruct = Deconstruct(Point=create_set.Set)  # -> XComponent, YComponent, ZComponent
addition = Addition(A=member_index_2.Index, B=number_slider)
addition_2 = Addition(A=member_index.Index, B=number_slider)
integer = Integer(addition)
integer_2 = Integer(addition_2)
merge_2 = Merge(Data1=member_index_2.Index, Data2=member_index.Index)  # -> simplify(Result)
concatenate = Concatenate(
    Fragment_A="v",
    G=" ",
    Fragment_B=deconstruct.XComponent,
    A=" ",
    B=deconstruct.YComponent,
    C=" ",
    D=deconstruct.ZComponent)  # -> flatten(Result)
concatenate_2 = Concatenate(Fragment_A="l", Fragment_B=" ", A=integer, B=" ", C=integer_2)  # -> flatten(Result)
panel = Panel(merge_2)
result = ClusterOutput(merge_2)

# ----
# output_lines
curve_2 = Curve(curve)

# ----
# output_nodes
point = Point(create_set.Set)

# ----
# nodes_data
text = Text(concatenate)

# ----
# lines_data
text_2 = Text(concatenate_2)

output_nodes = ClusterOutput(point)  # output_nodes
output_lines = ClusterOutput(curve_2)
nodes_data = ClusterOutput(text)
lines_data = ClusterOutput(text_2)
