# Grasshopper definition 4-bending.gh (Grasshopper 1.0.7)
# plug-ins: TTToolbox, Karamba

# manual layer selection
# DON'T FORGET TO INTERNALIZE
# DATA WHEN FINISHED!
number_slider = Slider(2, range=0..5)
negative = Negative(Value=number_slider)
construct_domain = ConstructDomain(DomainStart=negative, DomainEnd=number_slider)
construct_domain_2 = ConstructDomain(DomainStart=negative, DomainEnd=number_slider)
xy_plane = XYPlane(Origin=Point(0, 0, 0))
rectangle = Rectangle(Plane=xy_plane, XSize=construct_domain, YSize=construct_domain_2, Radius=0)  # -> Rectangle, Length
explode = Explode(Curve=rectangle.Rectangle, Recursive=True)  # -> Segments, Vertices
# layer viewer
point = Point(xy_plane)
point_2 = Point(explode.Vertices)
remove_duplicate_points = RemoveDuplicatePoints(InputPoints=point_2, Tolerance=0.001)  # -> OutputPoints, FirstPointIndexes
clean_tree = CleanTree(RemoveNulls=True, RemoveInvalid=True, RemoveEmpty=False, Tree=remove_duplicate_points.OutputPoints)
line = Line(StartPoint=clean_tree, EndPoint=point)
curve = Curve(explode.Segments)
merge = Merge(Data1=clean_tree, Data2=point)  # -> flatten(Result)
merge_2 = Merge(Data1=curve, Data2=line)  # -> flatten(Result)
point_3 = Point(merge)

# ----
# all elements
curve_2 = Curve(reparameterize(merge_2))

# ----
# all nodes
point_4 = Point(flatten(point_3))

# ----
# hand selected load pts
point_5 = Point(Point(0, 0, 0))

c_script = CSharpScript(lines=curve_2, pts=point_4, dist_tol=0.001)  # -> out, connectivity; inputs lines: list of Curve, pts: list of Point3d, dist_tol: Double
# ---------- c_script: C# usings ----------
using System.IO;
using System.Linq;
using System.Data;
using System.Drawing;
using System.Reflection;
using System.Windows.Forms;
using System.Xml;
using System.Xml.Linq;
using System.Runtime.InteropServices;

using Rhino.DocObjects;
using Rhino.Collections;
using GH_IO;
using GH_IO.Serialization;
# ---------- c_script: C# ----------
    DataTree<int> c_id = new DataTree<int>();

    for(int k = 0; k < lines.Count(); k++)
    {
      Curve e = lines[k];
      GH_Path pth = new GH_Path(k);

      Point3d end_u = e.PointAt(0);
      Point3d end_v = e.PointAt(1);

      for(int i = 0; i < pts.Count(); i++)
      {
        if(end_u.DistanceTo(pts[i]) < dist_tol)
        {
          c_id.Add(i, pth);
        }
        if(end_v.DistanceTo(pts[i]) < dist_tol)
        {
          c_id.Add(i, pth);
        }
      }
    }

    connectivity = c_id;
# ---------- end c_script ----------
panel = Panel("""1
2
3
4""")
c_script_2 = CSharpScript(pts=point_4, target_pts=point_5, dist_tol=0.001)  # -> out, A; inputs pts: list of Point3d, target_pts: list of Point3d, dist_tol: Double
# ---------- c_script_2: C# ----------
    List<int> id = new List<int>();

    foreach(Point3d t_pt in target_pts)
    {
      for(int i = 0; i < pts.Count(); i++)
      {
        if(t_pt.DistanceTo(pts[i]) < dist_tol)
        {
          id.Add(i);
          break;
        }
      }
    }

    A = id;
# ---------- end c_script_2 ----------
integer = Integer(c_script.connectivity)
addition = Addition(A=integer, B=1)
panel_2 = Panel(addition)
list_item = ListItem(List=point_3, Index=panel, Wrap=False)
integer_2 = Integer(0)
point_6 = Point(point_4)
addition_2 = Addition(A=integer_2, B=1)
point_7 = Point(flatten(list_item))
list_item_2 = ListItem(List=point_4, Index=integer_2, Wrap=True)
panel_3 = Panel(point_6)
number_slider_2 = Slider(0, range=0..3)
panel_4 = Panel(addition_2)
material_properties_karamba3d = MaterialPropertiesKaramba3D(
    FamilyOfMaterial="Steel",
    Name="S235",
    YoungsModulus_kN_cm2=21000,
    InPlaneShearModulus_kN_cm2=8076,
    TransverseShearModulus_kN_cm2=8076,
    SpecificWeight_kN_m3=78.5,
    CoefficientOfThermalExpansion_1_C=1e-05,
    YieldStrength_kN_cm2=23.5,
    mode="Isotrop")
multiplication = Multiplication(A="{0,0,-1}", B=Slider(1, range=0..10))
point_8 = Point(point_7)
vector = Vector(multiplication)
panel_5 = Panel(vector)
point_9 = Point(list_item_2)
list_item_3 = ListItem(List=vector, Index=number_slider_2, Wrap=True)  # -> Item, Item1, Item2, Item3
list_item_4 = ListItem(List=list_item_2, Index=number_slider_2, Wrap=True)  # -> Item, Item1, Item2, Item3

# ----
# grounded verts
point_10 = Point(point_8)

point_11 = Point(point_8)
panel_6 = Panel(material_properties_karamba3d)
vector_display = VectorDisplay(Anchor=list_item_4.Item, Vector=list_item_3.Item)
disassemble_material_karamba3d = DisassembleMaterialKaramba3D(Material=material_properties_karamba3d)  # -> Material, TypeOfMaterial, FamilyNameOfMaterial, NameOfMaterial, ElemIdentifiers, Color, YoungsModulusKNCm2Dir12, InPlaneShearModulus_kN_cm2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
cm = Panel("5")
loads_karamba3d = LoadsKaramba3D(ForceVector=vector, Local=False, PosInd=point_9, LCase="0", mode="Point")  # -> flatten(Load)
division = Division(A=cm, B="2")
support = Panel("""1
1
1
1
1
1""")
multiplication_2 = Multiplication(A=division, B="1")
cross_section_karamba3d = CrossSectionKaramba3D(
    FamilyNameOfCrossSection="DefaultCroSec",
    Material=material_properties_karamba3d,
    Diameter_cm=cm,
    WallThickness_cm=division,
    mode="Circular Hollow")
support_karamba3d = SupportKaramba3D(PosInd=point_10, menu=[buttons(on, on, on, off, off, off)])
support_2 = Panel("""1
1
1
0
0
0""")
length = Length(Curve=curve_2)
radius_cm = Panel(multiplication_2)
concatenate = Concatenate(
    Fragment_A=disassemble_material_karamba3d.FamilyNameOfMaterial,
    A="-",
    Fragment_B=disassemble_material_karamba3d.NameOfMaterial)
panel_7 = Panel("E:\Dropbox (MIT)\Projects\conmech\conmech\src\stiffness_checker\matlab\test\cm_results")
panel_8 = Panel("D:\Dropbox (MIT)\Projects\conmech\conmech\src\stiffness_checker\test\validation\cm_results")
panel_9 = Panel(concatenate)
panel_10 = Panel(disassemble_material_karamba3d.SpecificWeight_kN_m3)
curve_3 = Curve(curve_2)
multiplication_3 = Multiplication(A=disassemble_material_karamba3d.InPlaneShearModulus_kN_cm2, B="1")
panel_11 = Panel(length)
multiplication_4 = Multiplication(A=disassemble_material_karamba3d.YoungsModulusKNCm2Dir12, B="1")
loads_karamba3d_2 = LoadsKaramba3D(Vector=Vector(0, 0, -1), LCase="1", mode="Gravity")
panel_12 = Panel("e0")
line_to_beam_karamba3d = LineToBeamKaramba3D(Line=curve_3, CrossSection=cross_section_karamba3d, New=True, Remove=True, LimitDistance_m=0.005)  # -> Element, Points, Info
evaluate = Evaluate(Expression="E/(2*G) - 1", E=multiplication_4, G=multiplication_3)
kn_cm2 = Panel(multiplication_4)
kn_cm2_2 = Panel(multiplication_3)
point_load = Panel("""0.0	0.0	0.0	0.0	-293.8E-6	567.2E-6	6.036E-6
0.0	0.0	0.0	0.0	159.7E-6	546.1E-6	-28.37E-6	
0.0	0.0	0.0	0.0	-245.5E-6	604.3E-6	-50.95E-6
0.0	0.0	0.0	0.0	111.4E-6	583.2E-6	73.28E-6
9.425	1.617	-4.418	10.53	-70.47E-6	0.001245	159.6E-6
8.989	1.562	2.864	9.563	-72.84E-6	0.001341	-170.4E-6
8.851	0.1805	2.472	9.191	-98.94E-6	0.001350	206.0E-6
9.287	0.1263	-4.026	10.12	-101.3E-6	0.001254	-195.2E-6
22.07	0.9900	-1.580	22.15	47.39E-6	0.002277	153.2E-6
22.07	2.374	-2.262	22.31	-335.6E-6	0.002277	-153.2E-6""")
gravity_load = Panel("""0.0	0.0	0.0	0.0	-0.03027	-0.03039	523.7E-6
0.0	0.0	0.0	0.0	0.03027	-0.03039	-523.7E-6
0.0	0.0	0.0	0.0	0.03027	0.03039	523.7E-6
0.0	0.0	0.0	0.0	-0.03027	0.03039	-523.7E-6
0.006337	0.003688	-0.08428	0.08460	0.01181	-0.01143	-0.001800
-0.006337	-0.003688	-0.08428	0.08460	-0.01181	0.01143	-0.001800
-0.006337	0.003688	-0.08428	0.08460	0.01181	0.01143	0.001800
0.006337	-0.003688	-0.08428	0.08460	-0.01181	-0.01143	0.001800
0.0	-0.007648	-0.1089	0.1091	-0.01226	0.0	0.0
0.0	0.007648	-0.1089	0.1091	0.01226	0.0	0.0""")
merge_3 = Merge(Data1=loads_karamba3d, Data2=loads_karamba3d_2)
panel_13 = Panel(evaluate)
point_12 = Point(point_4)
concatenate_2 = Concatenate(Fragment_A=panel_8, A="\", Fragment_B="bending_4_result.json")
construct_path = ConstructPath(Indices=Slider(11, range=0..23))
assemble_model_karamba3d = AssembleModelKaramba3D(
    Point=point_12,
    Elem=line_to_beam_karamba3d.Element,
    Support=support_karamba3d,
    Load=merge_3,
    Material=material_properties_karamba3d,
    LimitDistance_m=0.005)  # -> Model, Info, Mass_kg, CenterOfGravity
number_slider_3 = Slider(1, range=0..1)
c_script_3 = CSharpScript(
    json_file_path=concatenate_2,
    Reference="D:\DROPBOX (MIT)\PROJECTS\CONMECH\CONMECH\SRC\STIFFNESS_CHECKER\TEST\VALIDATION\KARAMBA\Newtonsoft.Json.dll")  # -> out, node_displ, element_reaction, fixity_reaction, fixity_node; inputs json_file_path: String
# ---------- c_script_3: C# usings ----------
using System.IO;
using System.Linq;
using System.Data;
using System.Drawing;
using System.Reflection;
using System.Windows.Forms;
using System.Xml;
using System.Xml.Linq;
using System.Runtime.InteropServices;

using Rhino.DocObjects;
using Rhino.Collections;
using GH_IO;
using GH_IO.Serialization;
using Newtonsoft.Json;
using Newtonsoft.Json.Serialization;
using Newtonsoft.Json.Schema;
using Newtonsoft.Json.Linq;
using Newtonsoft.Json.Converters;
using Newtonsoft.Json.Bson;
# ---------- c_script_3: C# ----------
    // read JSON directly from a file
    StreamReader file = File.OpenText(@json_file_path);
    JsonTextReader reader = new JsonTextReader(file);
    JObject json_data = (JObject) JToken.ReadFrom(reader);

    DataTree<double> n_D = new DataTree<double>();
    DataTree<double> e_R = new DataTree<double>();
    DataTree<double> f_R = new DataTree<double>();
    DataTree<Point3d> f_node = new DataTree<Point3d>();

    var n_D_json = json_data["node_displacement"];
    foreach(var n_d in n_D_json)
    {
      GH_Path pth = new GH_Path((int) n_d["node_id"]);
      foreach(double d in n_d["displacement"])
      {
        n_D.Add(d, pth);
      }
    }

    var e_R_json = json_data["element_reaction"];
    foreach(var e_r in e_R_json)
    {
      GH_Path pth = new GH_Path((int) e_r["element_id"]);
      foreach(double r in e_r["reaction"])
      {
        e_R.Add(r, pth);
      }
    }

    var f_R_json = json_data["fixity_reaction"];
    int cnt = 0;
    foreach(var f_r in f_R_json)
    {
      GH_Path pth = new GH_Path(cnt); //(int) f_r["node_id"]);
      foreach(double r in f_r["reaction"])
      {
        f_R.Add(r, pth);
      }
      var pt_data = f_r["node_pose"];
      Point3d f_p = new Point3d((double) pt_data[0], (double) pt_data[1], (double) pt_data[2]);
      f_node.Add(f_p, pth);

      cnt++;
    }

    node_displ = n_D;
    element_reaction = e_R;
    fixity_reaction = f_R;
    fixity_node = f_node;
# ---------- end c_script_3 ----------
tree_branch = TreeBranch(Tree=c_script_3.element_reaction, Path=construct_path, MaintainPaths=True)
analyze_karamba3d = AnalyzeKaramba3D(Model=assemble_model_karamba3d.Model)  # -> CalculatedModel, MaximumDisplacement_cm, ResultingForceOfGravity_kN, ElasticEnergy_kNm
panel_14 = Panel(tree_branch)
curve_4 = Curve(curve_2)
cluster = Cluster(text=gravity_load, separators="\t")  # -> simplify(tree)
reaction_forces_karamba3d = ReactionForcesKaramba3D(AnalyzedModel=analyze_karamba3d.CalculatedModel, LoadCase=number_slider_3)  # -> AnalyzedModel, ReactionForces_kN, ReactionMoments_kNm, SupportPosition, SumOfReactionForces_kN, SumOfReactionMoments_kNm
beam_forces_karamba3d = BeamForcesKaramba3D(
    AnalyzedModel=analyze_karamba3d.CalculatedModel,
    LCase=number_slider_3,
    MaximumDistanceBetweenResults_m=-1,
    NumberOfResultsPerBeamElement=2)  # -> AnalyzedModel, NormalForce_kN, ShearForceVz_kN, ShearForceVy_kN, BendingMomentMt_kNm, BendingMomentMy_kNm, BendingMomentMz_kNm
nodal_displacements_karamba3d = NodalDisplacementsKaramba3D(AnalyzedModel=analyze_karamba3d.CalculatedModel, LoadCase=number_slider_3)  # -> AnalyzedModel, NodalTranslations_m, NodalRotations_rad
cluster_2 = Cluster_2(list=cluster)
curve_5 = Curve(curve_4)
partition_list = PartitionList(List=cluster_2, Size="3")  # -> simplify(Chunks)
number = Number(c_script_3.node_displ)
deconstruct = Deconstruct(Point=simplify(graft(reaction_forces_karamba3d.ReactionForces_kN)))  # -> XComponent, YComponent, ZComponent
deconstruct_2 = Deconstruct(Point=simplify(graft(reaction_forces_karamba3d.ReactionMoments_kNm)))  # -> XComponent, YComponent, ZComponent
panel_15 = Panel(nodal_displacements_karamba3d.NodalTranslations_m)

# ----
# cm fix
point_13 = Point(flatten(c_script_3.fixity_node))
number_2 = Number(c_script_3.fixity_reaction)

# ----
# GSA translation
# unit is mm, convert to m
panel_16 = Panel("{*;0}")
split_tree = SplitTree(Data=partition_list, Masks=flatten(panel_16))  # -> Positive, Negative
multiplication_5 = Multiplication(A=split_tree.Positive, B="0.001")

merge_4 = Merge(
    Data1=simplify(graft(nodal_displacements_karamba3d.NodalTranslations_m)),
    Data2=simplify(graft(nodal_displacements_karamba3d.NodalRotations_rad)))
merge_5 = Merge(
    Data1=graft(beam_forces_karamba3d.NormalForce_kN),
    Data2=graft(beam_forces_karamba3d.ShearForceVz_kN),
    Data3=graft(beam_forces_karamba3d.ShearForceVy_kN),
    Data4=graft(beam_forces_karamba3d.BendingMomentMt_kNm),
    Data5=graft(beam_forces_karamba3d.BendingMomentMy_kNm),
    Data6=graft(beam_forces_karamba3d.BendingMomentMz_kNm))  # -> simplify(Result)
number_3 = Number(merge_5)
shift_paths = ShiftPaths(Data=number_3, Offset=-1)
tree_branch_2 = TreeBranch(Tree=shift_paths, Path=construct_path, MaintainPaths=True)
panel_17 = Panel(tree_branch_2)
merge_6 = Merge(
    Data1=deconstruct.XComponent,
    Data2=deconstruct.YComponent,
    Data3=deconstruct.ZComponent,
    Data4=deconstruct_2.XComponent,
    Data5=deconstruct_2.YComponent,
    Data6=deconstruct_2.ZComponent)

# ----
# K fixities
point_14 = Point(flatten(reaction_forces_karamba3d.SupportPosition))
number_4 = Number(merge_6)

panel_18 = Panel(number_4)

# ----
# math the fixity nodes
number_slider_4 = Slider(0.001, range=0..0.001)
c_script_4 = CSharpScript(pts=point_14, target_pts=point_13, dist_tol=number_slider_4)  # -> out, flatten(A); inputs pts: list of Point3d, target_pts: list of Point3d, dist_tol: Double; same code as c_script_2
integer_3 = Integer(graft(c_script_4.A))
number_5 = Number(number_2)
construct_path_2 = ConstructPath(Indices=integer_3)  # -> flatten(Branch)
tree_statistics = TreeStatistics(Tree=number_5)  # -> Paths, Length, Count
replace_paths = ReplacePaths(Data=number_5, Search=tree_statistics.Paths, Replace=construct_path_2)
number_6 = Number(number_4)

evaluate_2 = Evaluate(Expression="format(\"{0:E} {1:E} {2:E}\",x.x,x.y,x.z)", x=merge_4)
evaluate_3 = Evaluate(Expression="format(\"{0:E}\",x)", x=merge_6)
panel_19 = Panel(number_2)
evaluate_4 = Evaluate(Expression="format(\"{0:E}\",x)", x=merge_5)
cluster_3 = Cluster(text=evaluate_2, separators=" ")
merge_7 = Merge(Data1=multiplication_5, Data2=split_tree.Negative)
froce_kn_moment_kn_m = Panel(evaluate_4)
shift_paths_2 = ShiftPaths(Data=cluster_3, Offset=-1)

# ----
# compare nodal displ.
number_7 = Number(simplify(shift_paths_2))
number_8 = Number(c_script_3.node_displ)
c_script_5 = CSharpScript(x=number_8, y=number_7)  # -> out, A; inputs x: Double, y: Double
# ---------- c_script_5: C# ----------
    if(Math.Abs(y) < 1e-12)
    {
      A = Math.Abs(x - y);
    }
    else
    {
      A = Math.Abs(x - y) / Math.Abs(y);
    }
# ---------- end c_script_5 ----------

panel_20 = Panel(number_8)
panel_21 = Panel(number_7)
number_9 = Number(flatten(c_script_5.A))
sort_list = SortList(Keys=number_9, ValuesValuesA=number_9)  # -> Keys, reverse(ValuesValuesA)
shift_paths_3 = ShiftPaths(Data=merge_7, Offset=-1)

# ----
# compare to GSA
number_10 = Number(shift_paths_3)
c_script_6 = CSharpScript(x=number, y=number_10)  # -> out, A; inputs x: Double, y: Double; same code as c_script_5
c_script_7 = CSharpScript(x=number_7, y=number_10)  # -> out, A; inputs x: Double, y: Double; same code as c_script_5

panel_22 = Panel(sort_list.ValuesValuesA)
panel_23 = Panel(shift_paths_3)
number_11 = Number(flatten(c_script_7.A))
point_15 = Point(point_6)
model_view_karamba3d = ModelViewKaramba3D(Model=analyze_karamba3d.CalculatedModel, LoadCaseFactorsForLinearSuperposition=1, IndexOfVisibleLoadcase=number_slider_3)  # -> Model, DeformedMesh, DeformedAxes, DeformedModel

# ----
# grounded nodes
point_16 = Point(point_11)

sort_list_2 = SortList(Keys=number_11, ValuesValuesA=number_11)  # -> Keys, reverse(ValuesValuesA)

# ----
# all nodes
point_17 = Point(point_15)

deconstruct_3 = Deconstruct(Point=point_17)  # -> XComponent, YComponent, ZComponent
sort_list_3 = SortList(Keys=deconstruct_3.ZComponent)  # -> Keys, ValuesValuesA

# ----
# compare fix_reaction
# relative err
c_script_8 = CSharpScript(x=replace_paths, y=number_6)  # -> out, A; inputs x: Double, y: Double; same code as c_script_5

panel_24 = Panel(sort_list_2.ValuesValuesA)
list_item_5 = ListItem(List=sort_list_3.Keys, Index=0, Wrap=True)  # -> Item1, Item
beam_view_karamba3d = BeamViewKaramba3D(Model=model_view_karamba3d.Model)  # -> Model, MeshesOfRenderedBeams, DeformedBeamAxes, LegendColors, LegendTags
distance = Distance(PointA=graft(point_17), PointB=point_16)  # -> simplify(Distance)
panel_25 = Panel(c_script_8.A)
subtraction = Subtraction(A=list_item_5.Item1, B=sort_list_3.Keys)
absolute = Absolute(Value=subtraction)
mass_multiplication = MassMultiplication(Input=distance)  # -> Result, PartialResults
mass_addition = MassAddition(Input=absolute)  # -> Result, PartialResults
integer_4 = Integer(support_2)
boolean = Boolean(mass_addition.Result)
boolean_2 = Boolean(mass_multiplication.Result)
integer_5 = Integer(boolean_2)
subtraction_2 = Subtraction(A="1", B=integer_5)
panel_26 = Panel(subtraction_2)
duplicate_data = DuplicateData(Data=integer_4, Number=subtraction_2, Order=True)  # -> simplify(Data)
panel_27 = Panel("D:\Dropbox (MIT)\Projects\conmech\conmech\src\stiffness_checker\test\validation\problem_instances\")
panel_28 = Panel("E:\Dropbox (MIT)\Projects\conmech\conmech\src\stiffness_checker\matlab\test\problem_instances\")
stream_filter = StreamFilter(Gate=boolean, Stream0="2D_frame", Stream1="3D_frame")
stream_filter_2 = StreamFilter(Gate=boolean, Stream0="2", Stream1="3")
stream_filter_3 = StreamFilter(Gate=boolean, Stream0="3", Stream1="6")

# ----
# file name
panel_29 = Panel("bending_4")

integer_6 = Integer(flatten(boolean_2))
panel_30 = Panel(stream_filter)
subtraction_3 = Subtraction(A="1", B=integer_6)
concatenate_3 = Concatenate(Fragment_A=panel_29, A=".json")
concatenate_4 = Concatenate(Fragment_A=panel_29, B="_load_case", A=".json")

# ----
# node pts
point_18 = Point(point_17)

concatenate_5 = Concatenate(Fragment_A=panel_29, A=".csv")
integer_7 = Integer(subtraction_3)
concatenate_6 = Concatenate(FragmentA=panel_27, FragmentB=concatenate_3)
concatenate_7 = Concatenate(FragmentA=panel_27, FragmentB=concatenate_4)
concatenate_8 = Concatenate(FragmentA=panel_27, FragmentB=concatenate_5)

# ----
# dim
integer_8 = Integer("3")

integer_9 = Integer(integer)
number_12 = Number(panel_10)
number_13 = Number(evaluate)
number_14 = Number(multiplication_2)
boolean_toggle = BooleanToggle(False)
text = Text(concatenate)
number_15 = Number(multiplication_4)
number_16 = Number(multiplication_3)
integer_10 = Integer(duplicate_data)
panel_31 = Panel(number_12)
panel_32 = Panel(integer_9)
panel_33 = Panel(number_13)
panel_34 = Panel(number_14)
panel_35 = Panel(number_15)
panel_36 = Panel(number_16)
point_19 = Point(point_9)
point_20 = Point(point_19)
point_21 = Point(point_17)
c_script_9 = CSharpScript(
    toggle=boolean_toggle,
    file_path=concatenate_6,
    model_type=panel_30,
    assembly_type="extrusion",
    unit="meter",
    dimension=integer_8,
    node_pts=point_18,
    ground_nodes_identifier=integer_7,
    fixities=integer_10,
    elements=integer_9,
    material_name=text,
    youngs_modulus=panel_35,
    youngs_modulus_unit="kN/cm2",
    shear_modulus=panel_36,
    shear_modulus_unit="kN/cm2",
    poisson_ratio=panel_33,
    radius=panel_34,
    radius_unit="centimeter",
    density=panel_31,
    density_unit="kN/m3",
    Reference="D:\DROPBOX (MIT)\PROJECTS\CONMECH\CONMECH\SRC\STIFFNESS_CHECKER\TEST\VALIDATION\KARAMBA\Newtonsoft.Json.dll")  # -> out, A; inputs toggle: Boolean, file_path: String, model_type: String, assembly_type: String, unit: String, dimension: Int32, relative_pos_to_robot_base: Plane, node_pts: list of Point3d, ground_nodes_identifier: list of Int32, fixities: tree of Int32, elements: tree of Int32, material_name: String, youngs_modulus: Double, youngs_modulus_unit: String, shear_modulus: Double, shear_modulus_unit: String, poisson_ratio: Double, radius: Double, radius_unit: String, density: Double, density_unit: String
# ---------- c_script_9: C# ----------
    if(toggle == false)
    {
      return;
    }
    
    JsonSerializer serializer = new JsonSerializer();
    serializer.NullValueHandling = NullValueHandling.Ignore;
    serializer.Formatting = Newtonsoft.Json.Formatting.Indented;

    // init assembly sequence obj, wire in global params
    ChoreoInputModel cas = new ChoreoInputModel();
    cas.assembly_type = assembly_type;
    cas.model_type = model_type;
    cas.unit = unit;
    cas.dimension = dimension;

    //    cas.base_frame_in_rob_base = relative_pos_to_robot_base;

    cas.material_properties = new MaterialProperty();
    cas.material_properties.material_name = material_name;
    cas.material_properties.youngs_modulus = youngs_modulus;
    cas.material_properties.youngs_modulus_unit = youngs_modulus_unit;

    cas.material_properties.shear_modulus = shear_modulus;
    cas.material_properties.shear_modulus_unit = shear_modulus_unit;

    cas.material_properties.poisson_ratio = poisson_ratio;

    cas.material_properties.radius = radius;
    cas.material_properties.radius_unit = radius_unit;

    cas.material_properties.density = density;
    cas.material_properties.density_unit = density_unit;

    cas.node_list = new List<FrameNode>(node_pts.Count());
    cas.element_list = new List<FrameElement>(elements.BranchCount);

    // create nodes
    for(int i = 0; i < node_pts.Count(); i++)
    {
      FrameNode nd = new FrameNode();
      nd.point = node_pts[i];
      nd.node_id = i;
      nd.is_grounded = ground_nodes_identifier[i];
      nd.fixities = fixities.Branch(i);

      cas.node_list.Add(nd);
    }

    // create each sequenced element
    for(int i = 0; i < elements.BranchCount; i++)
    {
      FrameElement ne = new FrameElement();
      ne.end_node_ids = new List<int>();
      ne.element_id = i;
      ne.end_node_ids = elements.Branch(i);

      cas.element_list.Add(ne);
    }

    // GH screen output
    //    string json = JsonConvert.SerializeObject(cas, Newtonsoft.Json.Formatting.Indented);
    //    Print(json);

    // serialize to json file
    using (StreamWriter sw = new StreamWriter(@file_path))
    using (JsonWriter writer = new JsonTextWriter(sw))
    {
      serializer.Serialize(writer, cas);
    }
# ---------- c_script_9: C# additional code ----------
  public class FrameNode
  {
    public Point3d point { get; set; }
    public int node_id { get; set; }
    public int is_grounded { get; set; }
    public List<int> fixities { get; set; }
  }

  public class FrameElement
  {
    public List<int> end_node_ids { get; set; }
    public int element_id { get; set; }
    public int layer_id { get; set; }
  }

  public class MaterialProperty
  {
    public string material_name { get; set; }
    public double youngs_modulus { get; set; }
    public string youngs_modulus_unit { get; set; }

    public double shear_modulus { get; set; }
    public string shear_modulus_unit { get; set; }

    public double density { get; set; }
    public string density_unit { get; set; }

    public double poisson_ratio { get; set; }

    public double radius { get; set; }
    public string radius_unit { get; set; }
  }

  public class ChoreoInputModel
  {
    public string assembly_type { get; set; }
    public string model_type { get; set; }
    public string unit { get; set; }

    public int dimension { get; set; }

    //    public Plane base_frame_in_rob_base { get; set; }

    public MaterialProperty material_properties { get; set; }

    public List<FrameNode> node_list { get; set; }
    public List<FrameElement> element_list { get; set; }
  }
# ---------- end c_script_9 ----------
c_script_10 = CSharpScript(pts=point_21, target_pts=point_20, dist_tol=Slider(0.001, range=0..0.001))  # -> out, A; inputs pts: list of Point3d, target_pts: list of Point3d, dist_tol: Double; same code as c_script_2
xy_plane_2 = XYPlane(Origin=Point(0, 0, 0))
stream_filter_4 = StreamFilter(Gate=number_slider_3, Stream0=0, Stream1=1)
integer_11 = Integer(c_script_10.A)
vector_2 = Vector(vector)
longest_list = LongestList(ListListA=xy_plane_2, ListListB=vector_2, PaddingMode=2)  # -> ListListA, ListListB
list_item_6 = ListItem(List=point_21, Index=integer_11, Wrap=True)
integer_12 = Integer(integer_8)
text_2 = Text(concatenate_3)
text_3 = Text(concatenate_7)
integer_13 = Integer(integer_11)
deconstruct_4 = Deconstruct(Point=vector_2)  # -> XComponent, YComponent, ZComponent
deconstruct_5 = Deconstruct(Point=longest_list.ListListA)  # -> XComponent, YComponent, ZComponent
c_script_11 = CSharpScript(
    toggle=boolean_toggle,
    file_path=text_3,
    shape_file_name=text_2,
    dimension=integer_12,
    include_self_weight=stream_filter_4,
    force_unit="kN",
    moment_unit="kN-m",
    load_node_ids=integer_13,
    Fx=deconstruct_4.XComponent,
    Fy=deconstruct_4.YComponent,
    Fz=deconstruct_4.ZComponent,
    Mx=deconstruct_5.XComponent,
    My=deconstruct_5.YComponent,
    Mz=deconstruct_5.ZComponent,
    Reference="D:\DROPBOX (MIT)\PROJECTS\CONMECH\CONMECH\SRC\STIFFNESS_CHECKER\TEST\VALIDATION\KARAMBA\Newtonsoft.Json.dll")  # -> out, A; inputs toggle: Boolean, file_path: String, shape_file_name: String, dimension: Int32, include_self_weight: Boolean, force_unit: String, moment_unit: String, load_node_ids: list of Int32, Fx: list of Double, Fy: list of Double, Fz: list of Double, Mx: list of Double, My: list of Double, Mz: list of Double
# ---------- c_script_11: C# ----------
    if(toggle != true)
    {
      return;
    }

    JsonSerializer serializer = new JsonSerializer();
    serializer.NullValueHandling = NullValueHandling.Ignore;
    serializer.Formatting = Newtonsoft.Json.Formatting.Indented;

    // init assembly sequence obj, wire in global params
    ConmechLoad cas = new ConmechLoad();
    cas.dimension = dimension;
    cas.applied_shape_file = shape_file_name;
    cas.include_self_weight = include_self_weight;
    cas.force_unit = force_unit;
    cas.moment_unit = moment_unit;

    cas.point_load_list = new List<PointLoad>();

    // create nodes
    for(int i = 0; i < load_node_ids.Count(); i++)
    {
      PointLoad nd = new PointLoad();
      nd.applied_node_id = load_node_ids[i];
      nd.Fx = Fx[i];
      nd.Fy = Fy[i];
      nd.Fz = Fz[i];
      nd.Mx = Mx[i];
      nd.My = My[i];
      nd.Mz = Mz[i];

      cas.point_load_list.Add(nd);
    }

    // GH screen output
    //    string json = JsonConvert.SerializeObject(cas, Newtonsoft.Json.Formatting.Indented);
    //    Print(json);

    // serialize to json file
    using (StreamWriter sw = new StreamWriter(@file_path))
    using (JsonWriter writer = new JsonTextWriter(sw))
    {
      serializer.Serialize(writer, cas);
    }
# ---------- c_script_11: C# additional code ----------
  public class PointLoad
  {
    public int applied_node_id { get; set; }
    public double Fx { get; set; }
    public double Fy { get; set; }
    public double Fz { get; set; }
    public double Mx { get; set; }
    public double My { get; set; }
    public double Mz { get; set; }
  }

  public class ConmechLoad
  {
    public string applied_shape_file { get; set; }
    public int dimension { get; set; }
    public string force_unit { get; set; }
    public string moment_unit{ get; set; }
    public bool include_self_weight { get; set; }

    public List<PointLoad> point_load_list { get; set; }
  }
# ---------- end c_script_11 ----------
panel_37 = Panel(c_script_11.out)

# ==== cluster Cluster
text = ClusterInput()
separators = ClusterInput()
text_split = TextSplit(Text=text, Separators=separators)
number = Number(text_split)
clean_tree = CleanTree(RemoveNulls=True, RemoveInvalid=True, RemoveEmpty=False, Tree=number)
tree = ClusterOutput(clean_tree)

# ==== cluster Cluster_2
list = ClusterInput()
replace_items = ReplaceItems(List=list, Indices="3", Wrap=False)
clean_tree = CleanTree(RemoveNulls=True, RemoveInvalid=True, RemoveEmpty=False, Tree=replace_items)
tree = ClusterOutput(clean_tree)
