# Grasshopper definition topopt100_3D.gh (Grasshopper 1.0.7)
# plug-ins: TTToolbox, Karamba

# manual layer selection
# DON'T FORGET TO INTERNALIZE
# DATA WHEN FINISHED!
number_slider = Slider(4, range=0..10)
multiplication = Multiplication(A=Slider(0.001, range=0..0.001), B=number_slider)
curve = Curve(flatten([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]))
scale = Scale(Geometry=curve, Center=Point(0, 0, 0), Factor=multiplication)  # -> Geometry, Transform
end_points = EndPoints(Curve=scale.Geometry)  # -> Start, End
merge = Merge(Data1=end_points.Start, Data2=end_points.End)
remove_duplicate_points = RemoveDuplicatePoints(InputPoints=merge, Tolerance=0.001)  # -> OutputPoints, FirstPointIndexes
clean_tree = CleanTree(RemoveNulls=True, RemoveInvalid=True, RemoveEmpty=False, Tree=remove_duplicate_points.OutputPoints)
deconstruct = Deconstruct(Point=clean_tree)  # -> XComponent, YComponent, ZComponent
sort_list = SortList(Keys=deconstruct.ZComponent, ValuesValuesA=clean_tree)  # -> Keys, ValuesValuesA
# layer viewer
curve_2 = Curve(scale.Geometry)
series = Series(Start="-1", Step="-1", Count=Slider(16, range=1..20))
series_2 = Series(Start=0, Step=1, Count=4)
list_item = ListItem(List=sort_list.ValuesValuesA, Index=series, Wrap=True)
list_item_2 = ListItem(List=sort_list.ValuesValuesA, Index=series_2, Wrap=True)
# 1 pa = 1 N/m^2 = 1e-7 kN/cm^2 = 1e-9 kN/mm^2
point = Point(flatten(list_item))
point_2 = Point(flatten(list_item_2))
material_properties_karamba3d = MaterialPropertiesKaramba3D(
    FamilyOfMaterial="Steel",
    Name="S235",
    YoungsModulus_kN_cm2=21000,
    InPlaneShearModulus_kN_cm2=8076,
    TransverseShearModulus_kN_cm2=8076,
    SpecificWeight_kN_m3=78.5,
    CoefficientOfThermalExpansion_1_C=1e-05,
    YieldStrength_kN_cm2=23.5,
    mode="Isotrop")
point_3 = Point(point_2)
point_4 = Point(point)
number_slider_2 = Slider(0.1, range=0..0.1)

# ----
# grounded verts
point_5 = Point(point_3)

point_6 = Point(point_3)

# ----
# loaded vert
point_7 = Point(point_4)

panel = Panel(material_properties_karamba3d)
panel_2 = Panel(point_7)
negative = Negative(Value=Slider(1, range=0..10))
disassemble_material_karamba3d = DisassembleMaterialKaramba3D(Material=material_properties_karamba3d)  # -> Material, TypeOfMaterial, FamilyNameOfMaterial, NameOfMaterial, ElemIdentifiers, Color, YoungsModulusKNCm2Dir12, InPlaneShearModulus_kN_cm2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
cm = Panel("5")
unit_z = UnitZ(Factor=negative)
division = Division(A=cm, B="2")
multiplication_2 = Multiplication(A=division, B="1")
panel_3 = Panel(unit_z)
cross_section_karamba3d = CrossSectionKaramba3D(
    FamilyNameOfCrossSection="DefaultCroSec",
    Material=material_properties_karamba3d,
    Diameter_cm=cm,
    WallThickness_cm=division,
    mode="Circular Hollow")
length = Length(Curve=curve_2)
radius_cm = Panel(multiplication_2)
concatenate = Concatenate(
    Fragment_A=disassemble_material_karamba3d.FamilyNameOfMaterial,
    A="-",
    Fragment_B=disassemble_material_karamba3d.NameOfMaterial)
panel_4 = Panel(concatenate)
panel_5 = Panel(disassemble_material_karamba3d.SpecificWeight_kN_m3)
loads_karamba3d = LoadsKaramba3D(Vector=Vector(0, 0, -1), LCase="1", mode="Gravity")
multiplication_3 = Multiplication(A=disassemble_material_karamba3d.InPlaneShearModulus_kN_cm2, B="1")
panel_6 = Panel(length)
multiplication_4 = Multiplication(A=disassemble_material_karamba3d.YoungsModulusKNCm2Dir12, B="1")
# kN
loads_karamba3d_2 = LoadsKaramba3D(ForceVector=unit_z, Local=False, PosInd=point_7, LCase="0", mode="Point")
curve_3 = Curve(curve_2)
support_karamba3d = SupportKaramba3D(PosInd=point_5, menu=[buttons(on, on, on, on, on, on)])
panel_7 = Panel("e0")
line_to_beam_karamba3d = LineToBeamKaramba3D(Line=curve_3, CrossSection=cross_section_karamba3d, New=True, Remove=True, LimitDistance_m=0.005)  # -> Element, Points, Info
evaluate = Evaluate(Expression="E/(2*G) - 1", E=multiplication_4, G=multiplication_3)
kn_cm2 = Panel(multiplication_4)
kn_cm2_2 = Panel(multiplication_3)
merge_2 = Merge(Data1=loads_karamba3d_2, Data2=loads_karamba3d)
panel_8 = Panel(evaluate)
assemble_model_karamba3d = AssembleModelKaramba3D(
    Elem=line_to_beam_karamba3d.Element,
    Support=support_karamba3d,
    Load=merge_2,
    Material=material_properties_karamba3d,
    LimitDistance_m=0.005)  # -> Model, Info, Mass_kg, CenterOfGravity
panel_9 = Panel("""0            0            0            0            0            0
   9.0067e-04            0  -4.5916e-04            0   1.9045e-03            0
   9.0067e-04            0  -2.8810e-03            0   2.6805e-03            0""")
number_slider_3 = Slider(1, range=0..1)
analyze_karamba3d = AnalyzeKaramba3D(Model=assemble_model_karamba3d.Model)  # -> CalculatedModel, MaximumDisplacement_cm, ResultingForceOfGravity_kN, ElasticEnergy_kNm
curve_4 = Curve(curve_2)
beam_forces_karamba3d = BeamForcesKaramba3D(
    AnalyzedModel=analyze_karamba3d.CalculatedModel,
    LCase=number_slider_3,
    MaximumDistanceBetweenResults_m=-1,
    NumberOfResultsPerBeamElement=2)  # -> AnalyzedModel, NormalForce_kN, ShearForceVz_kN, ShearForceVy_kN, BendingMomentMt_kNm, BendingMomentMy_kNm, BendingMomentMz_kNm
reaction_forces_karamba3d = ReactionForcesKaramba3D(AnalyzedModel=analyze_karamba3d.CalculatedModel, LoadCase=number_slider_3)  # -> AnalyzedModel, ReactionForces_kN, ReactionMoments_kNm, SupportPosition, SumOfReactionForces_kN, SumOfReactionMoments_kNm
nodal_displacements_karamba3d = NodalDisplacementsKaramba3D(AnalyzedModel=analyze_karamba3d.CalculatedModel, LoadCase=number_slider_3)  # -> AnalyzedModel, NodalTranslations_m, NodalRotations_rad
list_item_3 = ListItem(Index=0, Wrap=True)
cluster = Cluster_2(text=panel_9)  # -> simplify(tree)
curve_5 = Curve(curve_4)
panel_10 = Panel(cluster)
merge_3 = Merge(
    Data1=simplify(graft(reaction_forces_karamba3d.ReactionForces_kN)),
    Data2=simplify(graft(reaction_forces_karamba3d.ReactionMoments_kNm)))
merge_4 = Merge(
    Data1=simplify(graft(nodal_displacements_karamba3d.NodalTranslations_m)),
    Data2=simplify(graft(nodal_displacements_karamba3d.NodalRotations_rad)))
merge_5 = Merge(
    Data1=graft(beam_forces_karamba3d.NormalForce_kN),
    Data2=graft(beam_forces_karamba3d.ShearForceVz_kN),
    Data3=graft(beam_forces_karamba3d.ShearForceVy_kN),
    Data4=graft(beam_forces_karamba3d.BendingMomentMt_kNm),
    Data5=graft(beam_forces_karamba3d.BendingMomentMy_kNm),
    Data6=graft(beam_forces_karamba3d.BendingMomentMz_kNm))  # -> simplify(Result)
evaluate_2 = Evaluate(Expression="format(\"{0:E}\",x)", x=merge_5)
evaluate_3 = Evaluate(Expression="format(\"{0:E},{1:E},{2:E}\",x.x,x.y,x.z)", x=merge_3)
evaluate_4 = Evaluate(Expression="format(\"{0:E} {1:E} {2:E}\",x.x,x.y,x.z)", x=merge_4)
cluster_2 = Cluster_2(text=evaluate_4)
reaction_force_kn_reaction_moment_kn_m = Panel(evaluate_3)
cluster_3 = Cluster(curve=curve_5)  # -> output_nodes, output_lines, nodes_data, lines_data, result
froce_kn_moment_kn_m = Panel(evaluate_2)
shift_paths = ShiftPaths(Data=cluster_2, Offset=-1)
number = Number(simplify(shift_paths))
number_2 = Number(number)
multiplication_5 = Multiplication(A=number_2, B=number_2)
panel_11 = Panel(number_2)
mass_addition = MassAddition(Input=multiplication_5)  # -> flatten(Result), PartialResults
list_length = ListLength(List=mass_addition.Result)
subtraction = Subtraction(A=cluster, B=number)
series_3 = Series(Start=0, Step=1, Count=list_length)
absolute = Absolute(Value=subtraction)  # -> simplify(Result)
sort_list_2 = SortList(Keys=mass_addition.Result, ValuesValuesA=series_3)  # -> Keys, reverse(ValuesValuesA)
construct_path = ConstructPath(Indices=graft(sort_list_2.ValuesValuesA))  # -> flatten(Branch)
panel_12 = Panel(number)
division_2 = Division(A=absolute, B=number)
split_tree = SplitTree(Data=number_2, Masks=flatten(construct_path))  # -> Positive, Negative
panel_13 = Panel(division_2)
panel_14 = Panel(split_tree.Positive)
model_view_karamba3d = ModelViewKaramba3D(Model=analyze_karamba3d.CalculatedModel, LoadCaseFactorsForLinearSuperposition=1, IndexOfVisibleLoadcase=number_slider_3)  # -> Model, DeformedMesh, DeformedAxes, DeformedModel
panel_15 = Panel(cluster_3.result)
point_8 = Point(cluster_3.output_nodes)
curve_6 = Curve(cluster_3.output_lines)

# ----
# grounded nodes
point_9 = Point(point_6)

# ----
# all nodes
point_10 = Point(point_8)

deconstruct_2 = Deconstruct(Point=point_10)  # -> XComponent, YComponent, ZComponent
sort_list_3 = SortList(Keys=deconstruct_2.ZComponent)  # -> Keys, ValuesValuesA
list_item_4 = ListItem(List=sort_list_3.Keys, Index=0, Wrap=True)  # -> Item1, Item
beam_view_karamba3d = BeamViewKaramba3D(Model=model_view_karamba3d.Model)  # -> Model, MeshesOfRenderedBeams, DeformedBeamAxes, LegendColors, LegendTags
subtraction_2 = Subtraction(A=list_item_4.Item1, B=sort_list_3.Keys)
distance = Distance(PointA=graft(point_10), PointB=point_9)  # -> simplify(Distance)
integer = Integer(flatten(cluster_3.result))
absolute_2 = Absolute(Value=subtraction_2)
average = Average(Input=point_9)  # disabled
mass_multiplication = MassMultiplication(Input=distance)  # -> Result, PartialResults
mass_addition_2 = MassAddition(Input=absolute_2)  # -> Result, PartialResults
subtraction_3 = Subtraction(A=point_10, B=average)  # disabled
boolean = Boolean(mass_addition_2.Result)
boolean_2 = Boolean(mass_multiplication.Result)
integer_2 = Integer(boolean_2)
subtraction_4 = Subtraction(A="1", B=integer_2)
panel_16 = Panel("D:\Dropbox (MIT)\Projects\conmech\conmech\src\stiffness_checker\matlab\test\problem_instances\")
stream_filter = StreamFilter(Gate=boolean, Stream0="2D_frame", Stream1="3D_frame")
stream_filter_2 = StreamFilter(Gate=boolean, Stream0="2", Stream1="3")
stream_filter_3 = StreamFilter(Gate=boolean, Stream0="3", Stream1="6")
dim = Panel(stream_filter_3)
duplicate_data = DuplicateData(Data=subtraction_4, Number=dim, Order=True)  # -> simplify(Data)

# ----
# file name
panel_17 = Panel("topopt100_3D")

integer_3 = Integer(flatten(boolean_2))
panel_18 = Panel(stream_filter)
merge_6 = Merge(Data1=integer)
multiplication_6 = Multiplication(A="{600, 0, 23.5}", B=0.001)
subtraction_5 = Subtraction(A="1", B=integer_3)
partition_list = PartitionList(List=merge_6, Size=2)  # -> simplify(Chunks)
xy_plane = XYPlane(Origin=multiplication_6)  # disabled
concatenate_2 = Concatenate(Fragment_A=panel_17, A=".json")
concatenate_3 = Concatenate(Fragment_A=panel_17, B="_load_case", A=".json")
point_11 = Point(point_10)
panel_19 = Panel(partition_list)
integer_4 = Integer(subtraction_5)
panel_20 = Panel(integer_4)
concatenate_4 = Concatenate(FragmentA=panel_16, FragmentB=concatenate_2)
concatenate_5 = Concatenate(FragmentA=panel_16, FragmentB=concatenate_3)
point_12 = Point(point_11)
list_item_5 = ListItem(List=point_12, Index=partition_list, Wrap=False)
dispatch = Dispatch(List=point_12, DispatchPattern=integer_4)  # -> ListA, ListB
list_item_6 = ListItem(List=list_item_5, Index=0, Wrap=True)  # -> Item, Item1
panel_21 = Panel(list_item_5)
integer_5 = Integer(duplicate_data)
integer_6 = Integer(stream_filter_2)
number_3 = Number(panel_5)
number_4 = Number(evaluate)
number_5 = Number(multiplication_2)
text = Text(concatenate)
number_6 = Number(multiplication_4)
number_7 = Number(multiplication_3)
line = Line(StartPoint=list_item_6.Item, EndPoint=list_item_6.Item1)
point_13 = Point(dispatch.ListA)
panel_22 = Panel(number_3)
panel_23 = Panel(number_4)
panel_24 = Panel(number_5)
panel_25 = Panel(number_6)
panel_26 = Panel(number_7)
point_14 = Point(point_7)
point_15 = Point(point_10)
c_script = CSharpScript(
    file_path=concatenate_4,
    model_type=panel_18,
    assembly_type="extrusion",
    unit="meter",
    dimension=integer_6,
    relative_pos_to_robot_base=xy_plane,
    node_pts=point_11,
    ground_nodes_identifier=integer_4,
    fixities=integer_5,
    elements=partition_list,
    material_name=text,
    youngs_modulus=panel_25,
    youngs_modulus_unit="kN/cm2",
    shear_modulus=panel_26,
    shear_modulus_unit="kN/cm2",
    poisson_ratio=panel_23,
    radius=panel_24,
    radius_unit="centimeter",
    density=panel_22,
    density_unit="kN/m3",
    Reference="E:\DROPBOX (MIT)\PROJECTS\CONMECH\CONMECH\SRC\STIFFNESS_CHECKER\MATLAB\TEST\KARAMBA\Newtonsoft.Json.dll")  # -> out, A; inputs file_path: String, model_type: String, assembly_type: String, unit: String, dimension: Int32, relative_pos_to_robot_base: Plane, node_pts: list of Point3d, ground_nodes_identifier: list of Int32, fixities: tree of Int32, elements: tree of Int32, material_name: String, youngs_modulus: Double, youngs_modulus_unit: String, shear_modulus: Double, shear_modulus_unit: String, poisson_ratio: Double, radius: Double, radius_unit: String, density: Double, density_unit: String
# ---------- c_script: C# usings ----------
using System.IO;
using System.Linq;
using System.Data;
using System.Drawing;
using System.Reflection;
using System.Windows.Forms;
using System.Xml;
using System.Xml.Linq;
using System.Runtime.InteropServices;

using Rhino.DocObjects;
using Rhino.Collections;
using GH_IO;
using GH_IO.Serialization;
using Newtonsoft.Json;
using Newtonsoft.Json.Serialization;
using Newtonsoft.Json.Schema;
using Newtonsoft.Json.Linq;
using Newtonsoft.Json.Converters;
using Newtonsoft.Json.Bson;
# ---------- c_script: C# ----------
    JsonSerializer serializer = new JsonSerializer();
    serializer.NullValueHandling = NullValueHandling.Ignore;
    serializer.Formatting = Newtonsoft.Json.Formatting.Indented;

    // init assembly sequence obj, wire in global params
    ChoreoInputModel cas = new ChoreoInputModel();
    cas.assembly_type = assembly_type;
    cas.model_type = model_type;
    cas.unit = unit;
    cas.dimension = dimension;

    //    cas.base_frame_in_rob_base = relative_pos_to_robot_base;

    cas.material_properties = new MaterialProperty();
    cas.material_properties.material_name = material_name;
    cas.material_properties.youngs_modulus = youngs_modulus;
    cas.material_properties.youngs_modulus_unit = youngs_modulus_unit;

    cas.material_properties.shear_modulus = shear_modulus;
    cas.material_properties.shear_modulus_unit = shear_modulus_unit;

    cas.material_properties.poisson_ratio = poisson_ratio;

    cas.material_properties.radius = radius;
    cas.material_properties.radius_unit = radius_unit;

    cas.material_properties.density = density;
    cas.material_properties.density_unit = density_unit;

    cas.node_list = new List<FrameNode>(node_pts.Count());
    cas.element_list = new List<FrameElement>(elements.BranchCount);

    // create nodes
    for(int i = 0; i < node_pts.Count(); i++)
    {
      FrameNode nd = new FrameNode();
      nd.point = node_pts[i];
      nd.node_id = i;
      nd.is_grounded = ground_nodes_identifier[i];
      nd.fixities = fixities.Branch(i);

      cas.node_list.Add(nd);
    }

    // create each sequenced element
    for(int i = 0; i < elements.BranchCount; i++)
    {
      FrameElement ne = new FrameElement();
      ne.end_node_ids = new List<int>();
      ne.element_id = i;
      ne.end_node_ids = elements.Branch(i);

      cas.element_list.Add(ne);
    }

    // GH screen output
    //    string json = JsonConvert.SerializeObject(cas, Newtonsoft.Json.Formatting.Indented);
    //    Print(json);

    // serialize to json file
    using (StreamWriter sw = new StreamWriter(@file_path))
    using (JsonWriter writer = new JsonTextWriter(sw))
    {
      serializer.Serialize(writer, cas);
    }
# ---------- c_script: C# additional code ----------
  public class FrameNode
  {
    public Point3d point { get; set; }
    public int node_id { get; set; }
    public int is_grounded { get; set; }
    public List<int> fixities { get; set; }
  }

  public class FrameElement
  {
    public List<int> end_node_ids { get; set; }
    public int element_id { get; set; }
    public int layer_id { get; set; }
  }

  public class MaterialProperty
  {
    public string material_name { get; set; }
    public double youngs_modulus { get; set; }
    public string youngs_modulus_unit { get; set; }

    public double shear_modulus { get; set; }
    public string shear_modulus_unit { get; set; }

    public double density { get; set; }
    public string density_unit { get; set; }

    public double poisson_ratio { get; set; }

    public double radius { get; set; }
    public string radius_unit { get; set; }
  }

  public class ChoreoInputModel
  {
    public string assembly_type { get; set; }
    public string model_type { get; set; }
    public string unit { get; set; }
    
    public int dimension { get; set; }

    //    public Plane base_frame_in_rob_base { get; set; }

    public MaterialProperty material_properties { get; set; }

    public List<FrameNode> node_list { get; set; }
    public List<FrameElement> element_list { get; set; }
  }
# ---------- end c_script ----------
c_script_2 = CSharpScript(pts=point_15, target_pts=point_14, dist_tol=Slider(0.001, range=0..0.001))  # -> out, A; inputs pts: list of Point3d, target_pts: list of Point3d, dist_tol: Double
# ---------- c_script_2: C# usings ----------
using System.IO;
using System.Linq;
using System.Data;
using System.Drawing;
using System.Reflection;
using System.Windows.Forms;
using System.Xml;
using System.Xml.Linq;
using System.Runtime.InteropServices;

using Rhino.DocObjects;
using Rhino.Collections;
using GH_IO;
using GH_IO.Serialization;
# ---------- c_script_2: C# ----------
    List<int> id = new List<int>();

    foreach(Point3d t_pt in target_pts)
    {
      for(int i = 0; i < pts.Count(); i++)
      {
        if(t_pt.DistanceTo(pts[i]) < dist_tol)
        {
          id.Add(i);
          break;
        }
      }
    }

    A = id;
# ---------- end c_script_2 ----------
fx = Panel("0")
fz = Panel("-0.1")
fy = Panel("0")
fx_2 = Panel("0")
stream_filter_4 = StreamFilter(Gate=number_slider_3, Stream0=0, Stream1=1)
integer_7 = Integer(c_script_2.A)
longest_list = LongestList(ListListA=fx_2, ListListB=integer_7, PaddingMode=2)  # -> ListListA, ListListB
list_item_7 = ListItem(List=point_15, Index=integer_7, Wrap=True)
longest_list_2 = LongestList(ListListA=fy, ListListB=integer_7, PaddingMode=2)  # -> ListListA, ListListB
longest_list_3 = LongestList(ListListA=fz, ListListB=integer_7, PaddingMode=2)  # -> ListListA, ListListB
longest_list_4 = LongestList(ListListA=fx, ListListB=integer_7, PaddingMode=2)  # -> ListListA, ListListB
integer_8 = Integer(integer_7)
text_2 = Text(concatenate_2)
text_3 = Text(concatenate_5)
integer_9 = Integer(integer_6)
c_script_3 = CSharpScript(
    toggle=Toggle(True),
    file_path=text_3,
    shape_file_name=text_2,
    dimension=integer_9,
    include_self_weight=stream_filter_4,
    force_unit="kN",
    moment_unit="kN-m",
    load_node_ids=integer_8,
    Fx=longest_list_4.ListListA,
    Fy=longest_list_2.ListListA,
    Fz=longest_list_3.ListListA,
    Mx=longest_list.ListListA,
    My=longest_list.ListListA,
    Mz=longest_list.ListListA,
    Reference="E:\DROPBOX (MIT)\PROJECTS\CONMECH\CONMECH\SRC\STIFFNESS_CHECKER\MATLAB\TEST\KARAMBA\Newtonsoft.Json.dll")  # -> out, A; inputs toggle: Boolean, file_path: String, shape_file_name: String, dimension: Int32, include_self_weight: Boolean, force_unit: String, moment_unit: String, load_node_ids: list of Int32, Fx: list of Double, Fy: list of Double, Fz: list of Double, Mx: list of Double, My: list of Double, Mz: list of Double
# ---------- c_script_3: C# ----------
    if(toggle != true)
    {
      return;
    }

    JsonSerializer serializer = new JsonSerializer();
    serializer.NullValueHandling = NullValueHandling.Ignore;
    serializer.Formatting = Newtonsoft.Json.Formatting.Indented;

    // init assembly sequence obj, wire in global params
    ConmechLoad cas = new ConmechLoad();
    cas.dimension = dimension;
    cas.applied_shape_file = shape_file_name;
    cas.include_self_weight = include_self_weight;
    cas.force_unit = force_unit;
    cas.moment_unit = moment_unit;

    cas.point_load_list = new List<PointLoad>();

    // create nodes
    for(int i = 0; i < load_node_ids.Count(); i++)
    {
      PointLoad nd = new PointLoad();
      nd.applied_node_id = load_node_ids[i];
      nd.Fx = Fx[i];
      nd.Fy = Fy[i];
      nd.Fz = Fz[i];
      nd.Mx = Mx[i];
      nd.My = My[i];
      nd.Mz = Mz[i];

      cas.point_load_list.Add(nd);
    }

    // GH screen output
    //    string json = JsonConvert.SerializeObject(cas, Newtonsoft.Json.Formatting.Indented);
    //    Print(json);

    // serialize to json file
    using (StreamWriter sw = new StreamWriter(@file_path))
    using (JsonWriter writer = new JsonTextWriter(sw))
    {
      serializer.Serialize(writer, cas);
    }
# ---------- c_script_3: C# additional code ----------
  public class PointLoad
  {
    public int applied_node_id { get; set; }
    public double Fx { get; set; }
    public double Fy { get; set; }
    public double Fz { get; set; }
    public double Mx { get; set; }
    public double My { get; set; }
    public double Mz { get; set; }
  }

  public class ConmechLoad
  {
    public string applied_shape_file { get; set; }
    public int dimension { get; set; }
    public string force_unit { get; set; }
    public string moment_unit{ get; set; }
    public bool include_self_weight { get; set; }

    public List<PointLoad> point_load_list { get; set; }
  }
# ---------- end c_script_3 ----------
panel_27 = Panel(c_script_3.out)

# ==== cluster Cluster
curve = ClusterInput()
end_points = EndPoints(Curve=curve)  # -> Start, End
merge = Merge(Data1=end_points.Start, Data2=end_points.End)
create_set = CreateSet(List=merge)  # -> Set, Map
number_slider = Slider(1, range=0..1)
member_index = MemberIndex(Set=create_set.Set, Member=end_points.End)  # -> Index, Count
member_index_2 = MemberIndex(Set=create_set.Set, Member=end_points.Start)  # -> Index, Count
deconstruct = Deconstruct(Point=create_set.Set)  # -> XComponent, YComponent, ZComponent
addition = Addition(A=member_index_2.Index, B=number_slider)
addition_2 = Addition(A=member_index.Index, B=number_slider)
integer = Integer(addition)
integer_2 = Integer(addition_2)
merge_2 = Merge(Data1=member_index_2.Index, Data2=member_index.Index)  # -> simplify(Result)
concatenate = Concatenate(
    Fragment_A="v",
    G=" ",
    Fragment_B=deconstruct.XComponent,
    A=" ",
    B=deconstruct.YComponent,
    C=" ",
    D=deconstruct.ZComponent)  # -> flatten(Result)
concatenate_2 = Concatenate(Fragment_A="l", Fragment_B=" ", A=integer, B=" ", C=integer_2)  # -> flatten(Result)
panel = Panel(merge_2)
result = ClusterOutput(merge_2)

# ----
# output_lines
curve_2 = Curve(curve)

# ----
# output_nodes
point = Point(create_set.Set)

# ----
# nodes_data
text = Text(concatenate)

# ----
# lines_data
text_2 = Text(concatenate_2)

output_nodes = ClusterOutput(point)  # output_nodes
output_lines = ClusterOutput(curve_2)
nodes_data = ClusterOutput(text)
lines_data = ClusterOutput(text_2)

# ==== cluster Cluster_2
text = ClusterInput()
text_split = TextSplit(Text=text, Separators=" ")
number = Number(text_split)
clean_tree = CleanTree(RemoveNulls=True, RemoveInvalid=True, RemoveEmpty=False, Tree=number)
tree = ClusterOutput(clean_tree)
