# Grasshopper definition gh_frame+load_case_generator.ghx (Grasshopper 1.0.7)

# ----
# include self weight load or not
boolean_toggle = BooleanToggle(False)

# ----
# all elements (no duplicates)
curve = Curve([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])

# ----
# all nodes (no duplicates)
point = Point([Point(7.971856814, -27.23889735, 116), Point(-7.971856814, -27.23889735, 116), Point(-1.728039933e-10, -13.43123631, 116), Point(11.87045744, 19.00597147, 116), Point(-11.87045744, 19.00597147, 116), Point(41.9985315, -33.17738354, 116)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])

# ----
# loaded nodes
point_2 = Point([Point(-78.41459467, -67.90903101, 120), Point(-4.752109817e-10, 67.90903101, 120), Point(78.41459467, -67.90903101, 120)])

# ----
# grounded nodes
point_3 = Point([Point(7.44572673, -26.935136, 0), Point(-1.591615728e-10, -14.03875901, 0), Point(-7.445726731, -26.935136, 0), Point(7.44572673, -26.935136, 0), Point(-1.591615728e-10, -14.03875901, 0), Point(-7.445726731, -26.935136, 0)])

point_4 = Point(point)

# ----
# get loaded node indices
c_script = CSharpScript(pts=point_4, target_pts=point_2, dist_tol=0.001)  # -> out, A; inputs pts: list of Point3d, target_pts: list of Point3d, dist_tol: Double
# ---------- c_script: C# usings ----------
using System.IO;
using System.Linq;
using System.Data;
using System.Drawing;
using System.Reflection;
using System.Windows.Forms;
using System.Xml;
using System.Xml.Linq;
using System.Runtime.InteropServices;

using Rhino.DocObjects;
using Rhino.Collections;
using GH_IO;
using GH_IO.Serialization;
# ---------- c_script: C# ----------
    List<int> id = new List<int>();

    foreach(Point3d t_pt in target_pts)
    {
      for(int i = 0; i < pts.Count(); i++)
      {
        if(t_pt.DistanceTo(pts[i]) < dist_tol)
        {
          id.Add(i);
          break;
        }
      }
    }

    A = id;
# ---------- end c_script ----------
integer = Integer(c_script.A)
list_item = ListItem(List=point_4, Index=integer, Wrap=True)

curve_2 = Curve(curve)

# ----
# moment
panel = Panel("""0.0, 0.0, 0
0.0, 0.0, 0
0.0, 0.0, 0""")

# ----
# force
panel_2 = Panel("""0.0, 0.0, -10
0.0, 0.0, -10
0.0, 0.0, -10""")

curve_3 = Curve(reparameterize(curve_2))

# ----
# material properties
# cross section radius
panel_3 = Panel("0.15")
# young's modules
data = Data(350)
# tensile_yeild_stress
data_2 = Data("kN/cm2")
data_3 = Data("PLA")
data_4 = Data("kN/cm2")
# shear modules
data_5 = Data(240)
data_6 = Data(3.6)
# density
data_7 = Data(12.2582)
data_8 = Data("kN/cm2")
data_9 = Data("kN/m3")
data_10 = Data("centimeter")
panel_4 = Panel(data_5)
panel_5 = Panel(data_4)
panel_6 = Panel(data_10)
panel_7 = Panel(data_7)
panel_8 = Panel(data_9)
panel_9 = Panel(data_3)
panel_10 = Panel(data_2)
panel_11 = Panel(data_6)
panel_12 = Panel(data)
panel_13 = Panel(data_8)
panel_14 = Panel(panel_3)

deconstruct_vector = DeconstructVector(Vector=simplify(graft(panel_2)))  # -> XComponent, YComponent, ZComponent
deconstruct_vector_2 = DeconstructVector(Vector=simplify(graft(panel)))  # -> XComponent, YComponent, ZComponent
c_script_2 = CSharpScript(lines=curve_3, pts=point_4, dist_tol="1e-20")  # -> out, connectivity; inputs lines: list of Curve, pts: list of Point3d, dist_tol: Double
# ---------- c_script_2: C# ----------
    DataTree<int> c_id = new DataTree<int>();

    for(int k = 0; k < lines.Count(); k++)
    {
      Curve e = lines[k];
      GH_Path pth = new GH_Path(k);

      Point3d end_u = e.PointAt(0);
      Point3d end_v = e.PointAt(1);

      for(int i = 0; i < pts.Count(); i++)
      {
        if(end_u.DistanceTo(pts[i]) < dist_tol)
        {
          c_id.Add(i, pth);
        }
        if(end_v.DistanceTo(pts[i]) < dist_tol)
        {
          c_id.Add(i, pth);
        }
      }
    }

    connectivity = c_id;
# ---------- end c_script_2 ----------
vector = Vector(panel_2)
panel_15 = Panel(c_script_2.connectivity)
integer_2 = Integer(c_script_2.connectivity)
list_item_2 = ListItem(List=point_4, Index=integer_2, Wrap=True)
merge = Merge(
    Data1=deconstruct_vector.XComponent,
    Data2=deconstruct_vector.YComponent,
    Data3=deconstruct_vector.ZComponent,
    Data4=deconstruct_vector_2.XComponent,
    Data5=deconstruct_vector_2.YComponent,
    Data6=deconstruct_vector_2.ZComponent)
list_item_3 = ListItem(List=list_item_2, Index=0, Wrap=True)  # -> Item, Item1
vector_2 = Vector(vector)
point_5 = Point(list_item)
number = Number(panel_14)
number_2 = Number(merge)
line = Line(StartPoint=list_item_3.Item, EndPoint=list_item_3.Item1)
multiplication = Multiplication(A=data_5, B="1")
multiplication_2 = Multiplication(A=data, B="1")
vector_display = VectorDisplay(Anchor=point_5, Vector=vector_2)
radius_cm = Panel(number)
kn_cm2 = Panel(multiplication_2)
kn_cm2_2 = Panel(multiplication)

# ----
# poisson ratio
evaluate = Evaluate(Expression="E/(2*G) - 1", E=multiplication_2, G=multiplication)
panel_16 = Panel(evaluate)

point_6 = Point(flatten(point_3))
point_7 = Point(point_4)

# ----
# grounded nodes
point_8 = Point(point_6)

# ----
# all nodes
point_9 = Point(point_7)

distance = Distance(PointA=graft(point_9), PointB=point_8)  # -> simplify(Distance)

# ----
# file name
panel_17 = Panel("compas_fea_beam_tree")

support = Panel("""1
1
1
1
1
1""")
mass_multiplication = MassMultiplication(Input=distance)  # -> Result, PartialResults
integer_3 = Integer(support)
concatenate = Concatenate(Fragment_A=panel_17, A=".json")
concatenate_2 = Concatenate(Fragment_A=panel_17, B="_load_case", A=".json")
boolean = Boolean(mass_multiplication.Result)
integer_4 = Integer(boolean)
subtraction = Subtraction(A="1", B=integer_4)
panel_18 = Panel(subtraction)
duplicate_data = DuplicateData(Data=integer_3, Number=subtraction, Order=True)  # -> simplify(Data)
concatenate_3 = Concatenate(Fragment_A="C:\Users\harry\Desktop", A="\", Fragment_B=concatenate)
concatenate_4 = Concatenate(Fragment_A="C:\Users\harry\Desktop", A="\", Fragment_B=concatenate_2)
construct_point = ConstructPoint(XCoordinate="600", YCoordinate=0, ZCoordinate=Slider(23.5, range=0..100))
equality = Equality(FirstNumber=mass_multiplication.Result, SecondNumber="0")  # -> Equality, Inequality

# ----
# node pts
point_10 = Point(point_9)

# ----
# element_ids
integer_5 = Integer(integer_2)

xy_plane = XYPlane(Origin=construct_point)
integer_6 = Integer(flatten(equality.Equality))
boolean_toggle_2 = BooleanToggle(False)
text = Text(panel_9)
number_3 = Number(multiplication_2)
integer_7 = Integer("3")
number_4 = Number(multiplication)
number_5 = Number(evaluate)
number_6 = Number(data_6)
panel_19 = Panel(number_5)
panel_20 = Panel(number_4)
panel_21 = Panel(number_3)
number_7 = Number(number_2)

# ----
# write load case
point_11 = Point(point_5)
point_12 = Point(point_11)
point_13 = Point(point_9)
c_script_3 = CSharpScript(pts=point_13, target_pts=point_12, dist_tol=Slider(0.001, range=0..0.001))  # -> out, A; inputs pts: list of Point3d, target_pts: list of Point3d, dist_tol: Double; same code as c_script
integer_8 = Integer(c_script_3.A)
integer_9 = Integer(integer_7)
list_item_4 = ListItem(List=number_7, Index=0, Wrap=True)  # -> flatten(Item), flatten(Item1), flatten(Item2), flatten(Item3), flatten(Item4), flatten(Item5)
text_2 = Text(concatenate)
text_3 = Text(concatenate_4)
integer_10 = Integer(integer_8)
list_item_5 = ListItem(List=point_13, Index=integer_8, Wrap=True)
c_script_4 = CSharpScript(
    toggle=boolean_toggle_2,
    file_path=text_3,
    shape_file_name=text_2,
    dimension=integer_9,
    include_self_weight=boolean_toggle,
    force_unit="kN",
    moment_unit="kN-m",
    load_node_ids=integer_10,
    Fx=list_item_4.Item,
    Fy=list_item_4.Item1,
    Fz=list_item_4.Item2,
    Mx=list_item_4.Item3,
    My=list_item_4.Item4,
    Mz=list_item_4.Item5,
    Reference="C:\USERS\HARRY\DROPBOX (MIT)\PROJECTS\CHOREO\SOFTWARE\GH_INPUT_PARSER\Newtonsoft.Json.dll")  # -> out, A; inputs toggle: Boolean, file_path: String, shape_file_name: String, dimension: Int32, include_self_weight: Boolean, force_unit: String, moment_unit: String, load_node_ids: list of Int32, Fx: list of Double, Fy: list of Double, Fz: list of Double, Mx: list of Double, My: list of Double, Mz: list of Double
# ---------- c_script_4: C# usings ----------
using System.IO;
using System.Linq;
using System.Data;
using System.Drawing;
using System.Reflection;
using System.Windows.Forms;
using System.Xml;
using System.Xml.Linq;
using System.Runtime.InteropServices;

using Rhino.DocObjects;
using Rhino.Collections;
using GH_IO;
using GH_IO.Serialization;
using Newtonsoft.Json;
using Newtonsoft.Json.Serialization;
using Newtonsoft.Json.Schema;
using Newtonsoft.Json.Linq;
using Newtonsoft.Json.Converters;
using Newtonsoft.Json.Bson;
# ---------- c_script_4: C# ----------
    if(toggle != true)
    {
      return;
    }

    JsonSerializer serializer = new JsonSerializer();
    serializer.NullValueHandling = NullValueHandling.Ignore;
    serializer.Formatting = Newtonsoft.Json.Formatting.Indented;

    // init assembly sequence obj, wire in global params
    ConmechLoad cas = new ConmechLoad();
    cas.dimension = dimension;
    cas.applied_shape_file = shape_file_name;
    cas.include_self_weight = include_self_weight;
    cas.force_unit = force_unit;
    cas.moment_unit = moment_unit;

    cas.point_load_list = new List<PointLoad>();

    // create nodes
    for(int i = 0; i < load_node_ids.Count(); i++)
    {
      PointLoad nd = new PointLoad();
      nd.applied_node_id = load_node_ids[i];
      nd.Fx = Fx[i];
      nd.Fy = Fy[i];
      nd.Fz = Fz[i];
      nd.Mx = Mx[i];
      nd.My = My[i];
      nd.Mz = Mz[i];

      cas.point_load_list.Add(nd);
    }

    // GH screen output
    //    string json = JsonConvert.SerializeObject(cas, Newtonsoft.Json.Formatting.Indented);
    //    Print(json);

    // serialize to json file
    using (StreamWriter sw = new StreamWriter(@file_path))
    using (JsonWriter writer = new JsonTextWriter(sw))
    {
      serializer.Serialize(writer, cas);
    }
# ---------- c_script_4: C# additional code ----------
  public class PointLoad
  {
    public int applied_node_id { get; set; }
    public double Fx { get; set; }
    public double Fy { get; set; }
    public double Fz { get; set; }
    public double Mx { get; set; }
    public double My { get; set; }
    public double Mz { get; set; }
  }

  public class ConmechLoad
  {
    public string applied_shape_file { get; set; }
    public int dimension { get; set; }
    public string force_unit { get; set; }
    public string moment_unit{ get; set; }
    public bool include_self_weight { get; set; }

    public List<PointLoad> point_load_list { get; set; }
  }
# ---------- end c_script_4 ----------
panel_22 = Panel(c_script_4.out)

number_8 = Number(number)
panel_23 = Panel(number_8)
number_9 = Number(data_7)
panel_24 = Panel(number_9)
integer_11 = Integer(duplicate_data)
c_script_5 = CSharpScript(
    toggle=boolean_toggle_2,
    file_path=concatenate_3,
    model_name=panel_17,
    model_type="3D_frame",
    assembly_type="extrusion",
    unit="millimeter",
    dimension=integer_7,
    relative_pos_to_robot_base=xy_plane,
    node_pts=point_10,
    ground_nodes_identifier=integer_6,
    fixities=integer_11,
    elements=integer_5,
    material_name=text,
    youngs_modulus=panel_21,
    youngs_modulus_unit="kN/cm2",
    shear_modulus=panel_20,
    shear_modulus_unit="kN/cm2",
    tensile_yeild_stress=number_6,
    tensile_yeild_stress_unit="kN/cm2",
    poisson_ratio=panel_19,
    radius=panel_23,
    radius_unit="centimeter",
    density=panel_24,
    density_unit="kN/m3",
    Reference="C:\USERS\HARRY\DROPBOX (MIT)\PROJECTS\CHOREO\SOFTWARE\GH_INPUT_PARSER\Newtonsoft.Json.dll")  # -> out, A; inputs toggle: Boolean, file_path: String, model_name: String, model_type: String, assembly_type: String, unit: String, dimension: Int32, relative_pos_to_robot_base: Plane, node_pts: list of Point3d, ground_nodes_identifier: list of Int32, fixities: tree of Int32, elements: tree of Int32, material_name: String, youngs_modulus: Double, youngs_modulus_unit: String, shear_modulus: Double, shear_modulus_unit: String, tensile_yeild_stress: Double, tensile_yeild_stress_unit: String, poisson_ratio: Double, radius: Double, radius_unit: String, density: Double, density_unit: String
# ---------- c_script_5: C# ----------
    if(toggle == false)
    {
      return;
    }

    JsonSerializer serializer = new JsonSerializer();
    serializer.NullValueHandling = NullValueHandling.Ignore;
    serializer.Formatting = Newtonsoft.Json.Formatting.Indented;

    // init assembly sequence obj, wire in global params
    ChoreoInputModel cas = new ChoreoInputModel();
    cas.model_name = model_name;
    cas.assembly_type = assembly_type;
    cas.model_type = model_type;
    cas.generate_time = DateTime.Now.ToString();
    cas.unit = unit;
    cas.dimension = dimension;
    cas.element_num = elements.BranchCount;
    cas.node_num = node_pts.Count();

    cas.base_frame_in_rob_base = relative_pos_to_robot_base;

    cas.material_properties = new MaterialProperty();
    cas.material_properties.material_name = material_name;
    cas.material_properties.youngs_modulus = youngs_modulus;
    cas.material_properties.youngs_modulus_unit = youngs_modulus_unit;

    cas.material_properties.shear_modulus = shear_modulus;
    cas.material_properties.shear_modulus_unit = shear_modulus_unit;

    cas.material_properties.tensile_yeild_stress = tensile_yeild_stress;
    cas.material_properties.tensile_yeild_stress_unit = tensile_yeild_stress_unit;

    cas.material_properties.poisson_ratio = poisson_ratio;

    cas.material_properties.radius = radius;
    cas.material_properties.radius_unit = radius_unit;

    cas.material_properties.density = density;
    cas.material_properties.density_unit = density_unit;

    cas.node_list = new List<FrameNode>(node_pts.Count());
    cas.element_list = new List<FrameElement>(elements.BranchCount);

    // create nodes
    for(int i = 0; i < node_pts.Count(); i++)
    {
      FrameNode nd = new FrameNode();
      nd.point = node_pts[i];
      nd.node_id = i;
      nd.is_grounded = ground_nodes_identifier[i];
      nd.fixities = fixities.Branch(i);

      cas.node_list.Add(nd);
    }

    // create each sequenced element
    for(int i = 0; i < elements.BranchCount; i++)
    {
      FrameElement ne = new FrameElement();
      ne.end_node_ids = new List<int>();
      ne.element_id = i;
      ne.end_node_ids = elements.Branch(i);

      cas.element_list.Add(ne);
    }

    // GH screen output
    //    string json = JsonConvert.SerializeObject(cas, Newtonsoft.Json.Formatting.Indented);
    //    Print(json);

    // serialize to json file
    using (StreamWriter sw = new StreamWriter(@file_path))
    using (JsonWriter writer = new JsonTextWriter(sw))
    {
      serializer.Serialize(writer, cas);
    }
# ---------- c_script_5: C# additional code ----------
  public class FrameNode
  {
    public Point3d point { get; set; }
    public int node_id { get; set; }
    public int is_grounded { get; set; }
    public List<int> fixities { get; set; }
  }

  public class FrameElement
  {
    public List<int> end_node_ids { get; set; }
    public int element_id { get; set; }
    public int layer_id { get; set; }
  }

  public class MaterialProperty
  {
    public string material_name { get; set; }
    public double youngs_modulus { get; set; }
    public string youngs_modulus_unit { get; set; }

    public double shear_modulus { get; set; }
    public string shear_modulus_unit { get; set; }

    public double tensile_yeild_stress { get; set; }
    public string tensile_yeild_stress_unit { get; set; }

    public double density { get; set; }
    public string density_unit { get; set; }

    public double poisson_ratio { get; set; }

    public double radius { get; set; }
    public string radius_unit { get; set; }
  }

  public class ChoreoInputModel
  {
    public string model_name { get; set; }
    public string assembly_type { get; set; }
    public string model_type { get; set; }
    public string unit { get; set; }
    public string generate_time { get; set; }

    public int dimension { get; set; }
    public int node_num { get; set; }
    public int element_num { get; set; }

    public Plane base_frame_in_rob_base { get; set; }

    public MaterialProperty material_properties { get; set; }

    public List<FrameNode> node_list { get; set; }
    public List<FrameElement> element_list { get; set; }
  }
# ---------- end c_script_5 ----------
panel_25 = Panel(c_script_5.out)
