# Grasshopper definition stiffness_checker_compare_karamba.ghx (Grasshopper 1.0.7)
# plug-ins: Karamba

number_slider = Slider(3, range=0..10)
number_slider_2 = Slider(-2.3, range=-3..3)
division = Division(A="6", B=number_slider)
addition = Addition(A=number_slider, B="1")
series = Series(Start="0", Step=division, Count=addition)
division_2 = Division(A="6", B=Slider(2, range=0..10))
merge = Merge(Data1="0", Data2=number_slider_2, Data3=Slider(1.843, range=-3..3), Data4=number_slider_2, Data5="0")
insert_items = InsertItems(List=series, Item=division_2, Indices=Slider(2, range=0..10), Wrap=True)
panel = Panel("C:\Users\harry\Documents\pb-construction\conmech\tests\test_data")
construct_point = ConstructPoint(XCoordinate=insert_items, YCoordinate=merge, ZCoordinate=0)  # -> flatten(Point)
ghpython_script = GhPythonScript()  # -> a
# ---------- ghpython_script: Python ----------
__author__ = "yijiangh"
__version__ = "2019.04.28"

import rhinoscriptsyntax as rs

a = [125, 126, 115, 122, 111, 108, 23, 22, 98, 75, 64, 34, 61, 65, 59, 60, 39, 36, 44, 67]
# ---------- end ghpython_script ----------
ghpython_script_2 = GhPythonScript(file_path=panel, file_name="tower_3D.json", use_partial_ids=Toggle(False), partial_ids=ghpython_script, scale="1")  # -> out, node_points, ground_nodes, elements, partial_elements, partial_node_ids, partial_ground_nodes, material_name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; inputs use_partial_ids: Boolean, partial_ids: list of Int32
# ---------- ghpython_script_2: Python ----------
__author__ = "yijiangh"
__version__ = "2019.04.28"

import json
import os
import rhinoscriptsyntax as rs
import Rhino.Geometry as rg
import ghpythonlib.components as ghcomp
import ghpythonlib.treehelpers as th

def parse_point(json_point, scale=1.0):
#    return scale * np.array([json_point['X'], json_point['Y'], json_point['Z']])
    return rg.Point3d(scale*json_point['X'], scale*json_point['Y'], scale*json_point['Z'])

def parse_elements(json_data, parse_layers=False):
    if not parse_layers:
        return [json_element['end_node_ids']
            for json_element in json_data['element_list']]
#    else:
#        return [AssemblyElement(node_ids=json_element['end_node_ids'], layer_id=json_element['layer_id'], e_id=i)
#                for i, json_element in enumerate(json_data['element_list'])]

def parse_node_points(json_data, scale=1.0):
#    origin = parse_origin(json_data)
    return [parse_point(json_node['point'],scale) for json_node in json_data['node_list']]

def parse_ground_nodes(json_data):
    return {i for i, json_node in enumerate(json_data['node_list']) if json_node['is_grounded'] == 1}


# main

fp = os.path.join(file_path, file_name)

with open(fp, 'r') as f:
    json_data = json.loads(f.read())

element_vids = parse_elements(json_data, parse_layers=False)
node_points = parse_node_points(json_data, scale)
ground_nodes = parse_ground_nodes(json_data)

elements = []
for vids in element_vids:
    elements.append(rg.Line(node_points[vids[0]], node_points[vids[1]]))
    
    
print('Assembly: {} | Model: {} | Unit: {}'.format(
json_data['assembly_type'], json_data['model_type'], json_data['unit'])) # extrusion, spatial_frame, millimeter
print('Nodes: {} | Ground: {} | Elements: {}'.format(
len(node_points), len(ground_nodes), len(elements)))

partial_node_ids = set()
partial_elements = []
partial_ground_nodes = []
if not use_partial_ids:
    partial_ids = list(range(len(elements)))
    
for c_e in partial_ids:
    partial_node_ids.update([element_vids[c_e][0], element_vids[c_e][1]])
    partial_elements.append(rg.Line(node_points[element_vids[c_e][0]], node_points[element_vids[c_e][1]]))
    if element_vids[c_e][0] in ground_nodes:
        partial_ground_nodes.append(element_vids[c_e][0])
    if element_vids[c_e][1] in ground_nodes:
        partial_ground_nodes.append(element_vids[c_e][1])
        

material_name = json_data['material_properties']['material_name']
E = json_data['material_properties']['youngs_modulus']
E_unit = json_data['material_properties']['youngs_modulus_unit']

G = json_data['material_properties']['shear_modulus']
G_unit = json_data['material_properties']['shear_modulus_unit']

#sigma = json_data['material_properties']['tensile_yeild_stress']
#sigma_unit = json_data['material_properties']['tensile_yeild_stress_unit']

rho = json_data['material_properties']['density']
rho_unit = json_data['material_properties']['density_unit']

r = json_data['material_properties']['radius']
r_unit = json_data['material_properties']['radius_unit']
# ---------- end ghpython_script_2 ----------
panel_2 = Panel(ghpython_script_2.out)
point = Point([Point(0, 0, 0), Point(10, 0, 0), Point(0, 10, 0), Point(10, 10, 0)])
curve = Curve([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])
curve_2 = Curve([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])
panel_3 = Panel("""5
7
8
9""")
point_2 = Point(ghpython_script_2.node_points)
curve_3 = Curve(ghpython_script_2.elements)
list_item = ListItem(List=point_2, Index=panel_3, Wrap=True)
point_3 = Point(list_item)
curve_4 = Curve([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])
merge_2 = Merge(Data1=construct_point)  # -> flatten(Result)
end_points = EndPoints(Curve=curve_4)  # -> Start, End
point_4 = Point(end_points.Start)
point_5 = Point(end_points.End)
c_script = CSharpScript(pts=merge_2, target_pts=point_4, dist_tol=0.001)  # -> out, index; inputs pts: list of Point3d, target_pts: list of Point3d, dist_tol: Double
# ---------- c_script: C# usings ----------
using System.IO;
using System.Linq;
using System.Data;
using System.Drawing;
using System.Reflection;
using System.Windows.Forms;
using System.Xml;
using System.Xml.Linq;
using System.Runtime.InteropServices;

using Rhino.DocObjects;
using Rhino.Collections;
using GH_IO;
using GH_IO.Serialization;
# ---------- c_script: C# ----------
    List<int> id = new List<int>();

    foreach(Point3d t_pt in target_pts)
    {
      for(int i = 0; i < pts.Count(); i++)
      {
        if(t_pt.DistanceTo(pts[i]) < dist_tol)
        {
          id.Add(i);
          break;
        }
      }
    }

    index = id;
# ---------- end c_script ----------
c_script_2 = CSharpScript(pts=merge_2, target_pts=point_5, dist_tol=0.001)  # -> out, index; inputs pts: list of Point3d, target_pts: list of Point3d, dist_tol: Double; same code as c_script
integer = Integer([0, 1, 3, 0, 2, 2, 2])
integer_2 = Integer([1, 3, 4, 2, 1, 3, 4])
curve_5 = Curve(reparameterize([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]))
point_6 = Point([Point(-108.4034303, -67.67182583, 0), Point(-107.5034303, -84.09682583, 0), Point(-120.6284303, -81.47182583, 0), Point(73.29456966, 124.7031581, 0), Point(85.27656966, 123.8781742, 0), Point(73.80156966, 132.9531742, 0), Point(176.8290697, -182.8718258, 0), Point(183.3540697, -188.4218258, 0), Point(157.0290697, -186.9968258, 0)])
list_item_2 = ListItem(List=merge_2, Index=integer, Wrap=False)
curve_6 = Curve([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])
list_item_3 = ListItem(List=merge_2, Index=integer_2, Wrap=False)

curve_7 = Curve([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])
point_7 = Point([Point(-4.312031388, -4.501904548, 0), Point(-4.312031388, 8.337478253, 0), Point(0.2435964878, 1.210680071, 0.002196378175), Point(0.2435964878, 2.624893634, 0.002196378175), Point(1.243596488, 1.917786853, 0.004518025977), Point(15.24359649, 1.917786853, 0.004518025977), Point(16.24359649, 1.210680071, 0.002196378175), Point(16.24359649, 2.624893634, 0.002196378175)])

line = Line(StartPoint=list_item_2, EndPoint=list_item_3)
line_line_intersection_karamba3d = LineLineIntersectionKaramba3D(Line=curve_6, LengthTolerance=0.01)  # -> IntersectionPoints, flatten(LineSubSegements)
point_8 = Point(merge_2)
list_item_4 = ListItem(List=point_8, Index=0, Wrap=True)  # -> Item, Item1, Item2
point_9 = Point(construct_point)
point_10 = Point(list_item_4.Item2)
list_item_5 = ListItem(List=point_9, Index=0, Wrap=True)  # -> Item1, Item
point_11 = Point(point_10)
curve_8 = Curve(line)
point_12 = Point(point_8)
remove_duplicate_lines_karamba3d = RemoveDuplicateLinesKaramba3D(Line=line_line_intersection_karamba3d.LineSubSegements, LimitDistance=0.005)  # -> OutLine, Info, Indexes
point_13 = Point([list_item_5.Item1, list_item_5.Item])
support_karamba3d = SupportKaramba3D(PosInd=list_item_5.Item1, menu=[buttons(off, on, on, on, on, off)])
support_karamba3d_2 = SupportKaramba3D(PosInd=list_item_5.Item, menu=[buttons(on, on, on, on, on, off)])
curve_9 = Curve(remove_duplicate_lines_karamba3d.OutLine)
cluster = Cluster_3(curve=curve_9)
curve_10 = Curve(cluster)
curve_11 = Curve(reparameterize(flatten(curve_10)))
support_karamba3d_3 = SupportKaramba3D([support_karamba3d, support_karamba3d_2])
end_points_2 = EndPoints(Curve=curve_11)  # -> Start, End
merge_3 = Merge(Data1=end_points_2.Start, Data2=end_points_2.End)
remove_duplicate_points_karamba3d = RemoveDuplicatePointsKaramba3D(Point=merge_3, LimitDistance=0.005)  # -> OutPoint, Info, Indexes
number_slider_3 = Slider(0.025, range=0.001..0.1)
point_14 = Point(flatten(remove_duplicate_points_karamba3d.OutPoint))
number_slider_4 = Slider(4, range=1..4)
c_script_3 = CSharpScript(lines=curve_11, pts=point_14, dist_tol=1e-06)  # -> out, connectivity; inputs lines: list of Curve, pts: list of Point3d, dist_tol: Double
# ---------- c_script_3: C# ----------
    DataTree<int> c_id = new DataTree<int>();

    for(int k = 0; k < lines.Count(); k++)
    {
      Curve e = lines[k];
      GH_Path pth = new GH_Path(k);

      Point3d end_u = e.PointAt(0);
      Point3d end_v = e.PointAt(1);

      for(int i = 0; i < pts.Count(); i++)
      {
        if(end_u.DistanceTo(pts[i]) < dist_tol)
        {
          c_id.Add(i, pth);
        }
        if(end_v.DistanceTo(pts[i]) < dist_tol)
        {
          c_id.Add(i, pth);
        }
      }
    }

    connectivity = c_id;
# ---------- end c_script_3 ----------
multiplication = Multiplication(A=point_14, B=Slider(40, range=10..1000))
panel_4 = Panel("2.5")
panel_5 = Panel("1")
integer_3 = Integer(c_script_3.connectivity)
point_15 = Point(multiplication)
panel_6 = Panel(multiplication)
list_item_6 = ListItem(List=point_15, Index=integer_3, Wrap=False)
data = Data("kN/cm2")
data_2 = Data("PLA")
data_3 = Data(350)
data_4 = Data("kN/cm2")
data_5 = Data(240)
data_6 = Data(0.15)
data_7 = Data(3.6)
data_8 = Data(12.2582)
data_9 = Data("kN/cm2")
data_10 = Data("kN/m3")
point_16 = Point([<point referenced from the Rhino model> x3])
data_11 = Data("centimeter")
panel_7 = Panel(data_3)
panel_8 = Panel(data_5)
panel_9 = Panel(data_11)
panel_10 = Panel(data_4)
panel_11 = Panel(data_10)
panel_12 = Panel(data_2)
panel_13 = Panel(data)
panel_14 = Panel(data_7)
panel_15 = Panel(data_8)
panel_16 = Panel(data_9)
list_item_7 = ListItem(List=list_item_6, Index=0, Wrap=False)  # -> Item, Item1
panel_17 = Panel("0.15")
line_2 = Line(StartPoint=list_item_7.Item, EndPoint=list_item_7.Item1)  # -> flatten(Line)
end_points_3 = EndPoints(Curve=line_2)  # -> Start, End
point_17 = Point([end_points_3.Start, end_points_3.End])
remove_duplicate_points_karamba3d_2 = RemoveDuplicatePointsKaramba3D(Point=point_17, LimitDistance=0.005)  # -> OutPoint, Info, Indexes
bounding_box = BoundingBox(Content=line_2, Plane=PlaneXY(0, 0, 0), UnionBox=True)  # -> Box, Box_2
material_properties_karamba3d = MaterialPropertiesKaramba3D(
    FamilyOfMaterial="Steel",
    Name="S235",
    YoungsModulus_kN_cm2=21000,
    InPlaneShearModulus_kN_cm2=8076,
    TransverseShearModulus_kN_cm2=8076,
    SpecificWeight_kN_m3=78.5,
    CoefficientOfThermalExpansion_1_C=1e-05,
    YieldStrength_kN_cm2=23.5,
    mode="Isotrop")
material_properties_karamba3d_2 = MaterialPropertiesKaramba3D(
    FamilyOfMaterial=panel_12,
    Name="0",
    YoungsModulus_kN_cm2=panel_7,
    InPlaneShearModulus_kN_cm2=panel_8,
    TransverseShearModulus_kN_cm2=panel_8,
    SpecificWeight_kN_m3=panel_15,
    CoefficientOfThermalExpansion_1_C=1e-05,
    YieldStrength_kN_cm2=panel_14,
    mode="Isotrop")
curve_12 = Curve(line_2)
deconstruct_box = DeconstructBox(Box=bounding_box.Box)  # -> Plane, X, Y, Z

curve_13 = Curve(curve_12)
point_18 = Point()
point_19 = Point(point_16)
curve_14 = Curve(curve_13)

curve_15 = Curve(curve_14)
panel_18 = Panel([deconstruct_box.X, deconstruct_box.Y, deconstruct_box.Z])

end_points_4 = EndPoints(Curve=curve_13)  # -> Start, End
remove_duplicate_points_karamba3d_3 = RemoveDuplicatePointsKaramba3D(Point=flatten([end_points_4.Start, end_points_4.End]), LimitDistance=1e-10)  # -> OutPoint, Info, Indexes
point_20 = Point(remove_duplicate_points_karamba3d_3.OutPoint)

point_21 = Point(point_20)
point_22 = Point(point_21)
merge_4 = Merge(Data1=point_22)  # -> flatten(Result)
curve_16 = Curve(reparameterize(curve_15))
panel_19 = Panel(material_properties_karamba3d_2)
point_23 = Point(merge_4)
point_24 = Point(point_19)
c_script_4 = CSharpScript(lines=curve_16, pts=point_23, dist_tol="1e-20")  # -> out, connectivity; inputs lines: list of Curve, pts: list of Point3d, dist_tol: Double; same code as c_script_3
point_25 = Point(point_18)
panel_20 = Panel(c_script_4.connectivity)
integer_4 = Integer(c_script_4.connectivity)
list_item_8 = ListItem(List=point_23, Index=integer_4, Wrap=True)
list_item_9 = ListItem(List=list_item_8, Index=0, Wrap=True)  # -> Item, Item1
point_26 = Point(flatten(point_24))
list_length = ListLength(List=point_25)
line_3 = Line(StartPoint=list_item_9.Item, EndPoint=list_item_9.Item1)
point_27 = Point(point_23)
unit_y = UnitY(Factor=1)
duplicate_data = DuplicateData(Data=Slider(10, range=0..1000), Number=list_length, Order=True)  # -> simplify(Data)
negative = Negative(Value=unit_y)
panel_21 = Panel("""0.0, 11.125, 0.0
0.0, 11.125, 0.0
222.5, 0, -111.25
222.5, 0, -111.25""")
point_28 = Point(point_26)
vector = Vector(panel_21)

c_script_5 = CSharpScript(pts=point_23, target_pts=point_25, dist_tol=0.001)  # -> out, A; inputs pts: list of Point3d, target_pts: list of Point3d, dist_tol: Double
# ---------- c_script_5: C# ----------
    List<int> id = new List<int>();

    foreach(Point3d t_pt in target_pts)
    {
      for(int i = 0; i < pts.Count(); i++)
      {
        if(t_pt.DistanceTo(pts[i]) < dist_tol)
        {
          id.Add(i);
          break;
        }
      }
    }

    A = id;
# ---------- end c_script_5 ----------
integer_5 = Integer(c_script_5.A)
list_item_10 = ListItem(List=point_23, Index=integer_5, Wrap=True)
multiplication_2 = Multiplication(A=negative, B=duplicate_data)
point_29 = Point(list_item_10)
vector_2 = Vector(vector)
panel_22 = Panel(vector_2)
vector_display = VectorDisplay(Anchor=point_29, Vector=vector_2)
loads_karamba3d = LoadsKaramba3D(ForceVector=vector_2, Local=False, PosInd=point_29, LCase="0", mode="Point")  # -> flatten(Load)

vector_3 = Vector(multiplication_2)
unit_z = UnitZ(Factor=1)
multiplication_3 = Multiplication(B=0.001)
number = Number(panel_17)
point_30 = Point(point_28)
evaluate = Evaluate(Expression="π * r^3 / 4", r=number)
evaluate_2 = Evaluate(Expression="π * r^2", r=number)
negative_2 = Negative(Value=unit_z)
disassemble_material_karamba3d = DisassembleMaterialKaramba3D(Material=material_properties_karamba3d_2)  # -> Material, TypeOfMaterial, FamilyNameOfMaterial, NameOfMaterial, ElemIdentifiers, Color, YoungsModulusKNCm2Dir12, InPlaneShearModulus_kN_cm2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
support_karamba3d_4 = SupportKaramba3D(PosInd=point_30, menu=[buttons(on, on, on, on, on, on)])
radius_cm = Panel(number)
multiplication_4 = Multiplication(A=number, B="2")
loads_karamba3d_2 = LoadsKaramba3D(Vector=negative_2, LCase=0, mode="Gravity")  # -> flatten(Load)
support = Panel("""1
1
1
1
1
1""")
support_karamba3d_5 = SupportKaramba3D(support_karamba3d_3)
division_3 = Division(A=disassemble_material_karamba3d.YieldStrengthKNCm2Dir12, B="0.0001")
cross_section_karamba3d = CrossSectionKaramba3D(
    FamilyNameOfCrossSection="DefaultCroSec",
    Material=material_properties_karamba3d_2,
    Diameter_cm=multiplication_4,
    WallThickness_cm=number,
    mode="Circular Hollow")
length = Length(Curve=curve_16)
concatenate = Concatenate(
    Fragment_A=disassemble_material_karamba3d.FamilyNameOfMaterial,
    A="-",
    Fragment_B=disassemble_material_karamba3d.NameOfMaterial)
curve_17 = Curve(curve_16)
list_length_2 = ListLength(List=curve_17)
series_2 = Series(Start=0, Step=1, Count=list_length_2)
panel_23 = Panel("E:\Dropbox (MIT)\Projects\conmech\conmech\src\bindings\pyconmech\test")
panel_24 = Panel(concatenate)
panel_25 = Panel(disassemble_material_karamba3d.SpecificWeight_kN_m3)
concatenate_2 = Concatenate(FragmentA="e", FragmentB=series_2)
multiplication_5 = Multiplication(A=disassemble_material_karamba3d.InPlaneShearModulus_kN_cm2, B="1")
multiplication_6 = Multiplication(A=disassemble_material_karamba3d.YoungsModulusKNCm2Dir12, B="1")
panel_26 = Panel(length)
merge_5 = Merge(Data1=loads_karamba3d_2)
point_31 = Point(point_23)
line_to_beam_karamba3d = LineToBeamKaramba3D(
    Line=curve_17,
    Identifier=concatenate_2,
    CrossSection=cross_section_karamba3d,
    Points=point_31,
    New=True,
    Remove=True,
    LimitDistance_m=0.005)  # -> Element, Points, Info
list_item_11 = ListItem(List=concatenate_2, Index=0, Wrap=True)  # -> Item, Item1
evaluate_3 = Evaluate(Expression="E/(2*G) - 1", E=multiplication_6, G=multiplication_5)
kn_cm2 = Panel(multiplication_6)
kn_cm2_2 = Panel(multiplication_5)
point_load = Panel("""0.0	0.0	0.0	0.0	-293.8E-6	567.2E-6	6.036E-6
0.0	0.0	0.0	0.0	159.7E-6	546.1E-6	-28.37E-6	
0.0	0.0	0.0	0.0	-245.5E-6	604.3E-6	-50.95E-6
0.0	0.0	0.0	0.0	111.4E-6	583.2E-6	73.28E-6
9.425	1.617	-4.418	10.53	-70.47E-6	0.001245	159.6E-6
8.989	1.562	2.864	9.563	-72.84E-6	0.001341	-170.4E-6
8.851	0.1805	2.472	9.191	-98.94E-6	0.001350	206.0E-6
9.287	0.1263	-4.026	10.12	-101.3E-6	0.001254	-195.2E-6
22.07	0.9900	-1.580	22.15	47.39E-6	0.002277	153.2E-6
22.07	2.374	-2.262	22.31	-335.6E-6	0.002277	-153.2E-6""")
gravity_load = Panel("""0.0	0.0	0.0	0.0	-0.03027	-0.03039	523.7E-6
0.0	0.0	0.0	0.0	0.03027	-0.03039	-523.7E-6
0.0	0.0	0.0	0.0	0.03027	0.03039	523.7E-6
0.0	0.0	0.0	0.0	-0.03027	0.03039	-523.7E-6
0.006337	0.003688	-0.08428	0.08460	0.01181	-0.01143	-0.001800
-0.006337	-0.003688	-0.08428	0.08460	-0.01181	0.01143	-0.001800
-0.006337	0.003688	-0.08428	0.08460	0.01181	0.01143	0.001800
0.006337	-0.003688	-0.08428	0.08460	-0.01181	-0.01143	0.001800
0.0	-0.007648	-0.1089	0.1091	-0.01226	0.0	0.0
0.0	0.007648	-0.1089	0.1091	0.01226	0.0	0.0""")
number_slider_5 = Slider(0, range=0..23)
merge_6 = Merge(Data1=list_item_11.Item, Data2=list_item_11.Item1)
panel_27 = Panel(evaluate_3)
concatenate_3 = Concatenate(Fragment_A=panel_23, A="\", Fragment_B="sf-test_result.json")
construct_path = ConstructPath(Indices=number_slider_5)
beam_joints_karamba3d = BeamJointsKaramba3D(
    ElementIdentifiers=merge_6,
    CtKNMAtStartingNode=Vector(0, 0, 0),
    CrKNmRadAtStartingNode=Vector(0, 0, 0),
    CtKNMAtEndNode=Vector(0, 0, 0),
    CrKNmRadAtEndNode=Vector(0, 0, 0),
    menu=[buttons(off, off, off, off, off, off), buttons(off, off, off, off, off, off)])
assemble_model_karamba3d = AssembleModelKaramba3D(
    Point=point_31,
    Elem=line_to_beam_karamba3d.Element,
    Support=support_karamba3d_4,
    Load=merge_5,
    Material=material_properties_karamba3d_2,
    Joint=beam_joints_karamba3d,
    LimitDistance_m=0.005)  # -> Model, Info, Mass_kg, CenterOfGravity
c_script_6 = CSharpScript(
    json_file_path=concatenate_3,
    Reference="C:\USERS\HARRY\DROPBOX (MIT)\PROJECTS\CHOREO\SOFTWARE\GH_INPUT_PARSER\Newtonsoft.Json.dll")  # -> out, node_displ, element_reaction, fixity_reaction, fixity_node; inputs json_file_path: String
# ---------- c_script_6: C# usings ----------
using System.IO;
using System.Linq;
using System.Data;
using System.Drawing;
using System.Reflection;
using System.Windows.Forms;
using System.Xml;
using System.Xml.Linq;
using System.Runtime.InteropServices;

using Rhino.DocObjects;
using Rhino.Collections;
using GH_IO;
using GH_IO.Serialization;
using Newtonsoft.Json;
using Newtonsoft.Json.Serialization;
using Newtonsoft.Json.Schema;
using Newtonsoft.Json.Linq;
using Newtonsoft.Json.Converters;
using Newtonsoft.Json.Bson;
# ---------- c_script_6: C# ----------
    // read JSON directly from a file
    StreamReader file = File.OpenText(@json_file_path);
    JsonTextReader reader = new JsonTextReader(file);
    JObject json_data = (JObject) JToken.ReadFrom(reader);

    DataTree<double> n_D = new DataTree<double>();
    DataTree<double> e_R = new DataTree<double>();
    DataTree<double> f_R = new DataTree<double>();
    DataTree<Point3d> f_node = new DataTree<Point3d>();

    var n_D_json = json_data["node_displacement"];
    foreach(var n_d in n_D_json)
    {
      GH_Path pth = new GH_Path((int) n_d["node_id"]);
      foreach(double d in n_d["displacement"])
      {
        n_D.Add(d, pth);
      }
    }

    var e_R_json = json_data["element_reaction"];
    foreach(var e_r in e_R_json)
    {
      GH_Path pth = new GH_Path((int) e_r["element_id"]);
      foreach(double r in e_r["reaction"])
      {
        e_R.Add(r, pth);
      }
    }

    var f_R_json = json_data["fixity_reaction"];
    int cnt = 0;
    foreach(var f_r in f_R_json)
    {
      GH_Path pth = new GH_Path(cnt); //(int) f_r["node_id"]);
      foreach(double r in f_r["reaction"])
      {
        f_R.Add(r, pth);
      }
      var pt_data = f_r["node_pose"];
      Point3d f_p = new Point3d((double) pt_data[0], (double) pt_data[1], (double) pt_data[2]);
      f_node.Add(f_p, pth);

      cnt++;
    }

    node_displ = n_D;
    element_reaction = e_R;
    fixity_reaction = f_R;
    fixity_node = f_node;
# ---------- end c_script_6 ----------
tree_statistics = TreeStatistics(Tree=c_script_6.element_reaction)  # -> Paths, Length, Count
list_item_12 = ListItem(List=tree_statistics.Paths, Index=number_slider_5, Wrap=True)
tree_branch = TreeBranch(Tree=c_script_6.element_reaction, Path=list_item_12, MaintainPaths=True)
analyze_karamba3d = AnalyzeKaramba3D(Model=assemble_model_karamba3d.Model)  # -> CalculatedModel, MaximumDisplacement_cm, ResultingForceOfGravity_kN, ElasticEnergy_kNm
panel_28 = Panel(tree_branch)
cluster_2 = Cluster(text=gravity_load, separators="\t")  # -> simplify(tree)
reaction_forces_karamba3d = ReactionForcesKaramba3D(AnalyzedModel=analyze_karamba3d.CalculatedModel, LoadCase=0)  # -> AnalyzedModel, ReactionForces_kN, ReactionMoments_kNm, SupportPosition, SumOfReactionForces_kN, SumOfReactionMoments_kNm
beam_forces_karamba3d = BeamForcesKaramba3D(
    AnalyzedModel=analyze_karamba3d.CalculatedModel,
    LCase=-1,
    MaximumDistanceBetweenResults_m=-1,
    NumberOfResultsPerBeamElement=2)  # -> AnalyzedModel, NormalForce_kN, ShearForceVz_kN, ShearForceVy_kN, BendingMomentMt_kNm, BendingMomentMy_kNm, BendingMomentMz_kNm
nodal_displacements_karamba3d = NodalDisplacementsKaramba3D(AnalyzedModel=analyze_karamba3d.CalculatedModel, LoadCase=0)  # -> AnalyzedModel, NodalTranslations_m, NodalRotations_rad
deconstruct = Deconstruct(Point=nodal_displacements_karamba3d.NodalTranslations_m)  # -> XComponent, YComponent, ZComponent
cluster_3 = Cluster_2(list=cluster_2)
merge_7 = Merge(Data1=deconstruct.XComponent, Data2=deconstruct.YComponent, Data3=deconstruct.ZComponent)

number_2 = Number(c_script_6.fixity_reaction)
point_32 = Point(flatten(c_script_6.fixity_node))

number_3 = Number(evaluate)
partition_list = PartitionList(List=cluster_3, Size="3")  # -> simplify(Chunks)
absolute = Absolute(Value=merge_7)
deconstruct_2 = Deconstruct(Point=simplify(graft(reaction_forces_karamba3d.ReactionForces_kN)))  # -> XComponent, YComponent, ZComponent
deconstruct_3 = Deconstruct(Point=simplify(graft(reaction_forces_karamba3d.ReactionMoments_kNm)))  # -> XComponent, YComponent, ZComponent
merge_8 = Merge(Data1=deconstruct_2.XComponent, Data2=deconstruct_2.YComponent, Data3=deconstruct_2.ZComponent)
number_4 = Number(c_script_6.node_displ)
number_5 = Number(flatten(absolute))
panel_29 = Panel(merge_7)
multiplication_7 = Multiplication(A=number_3, B="0.000001")
merge_9 = Merge(
    Data1=simplify(graft(nodal_displacements_karamba3d.NodalTranslations_m)),
    Data2=simplify(graft(nodal_displacements_karamba3d.NodalRotations_rad)))

split_tree = SplitTree(Data=partition_list, Masks=flatten("{*;0}"))  # -> Positive, Negative
multiplication_8 = Multiplication(A=split_tree.Positive, B="0.001")

sort_list = SortList(Keys=number_5)  # -> Keys, ValuesValuesA

merge_10 = Merge(Data1=deconstruct_3.XComponent, Data2=deconstruct_3.YComponent, Data3=deconstruct_3.ZComponent)
number_6 = Number(merge_10)

evaluate_4 = Evaluate(Expression="format(\"{0:E}\",x)", x=merge_8)
number_7 = Number(multiplication_7)
merge_11 = Merge(
    Data1=deconstruct_2.XComponent,
    Data2=deconstruct_2.YComponent,
    Data3=deconstruct_2.ZComponent,
    Data4=deconstruct_3.XComponent,
    Data5=deconstruct_3.YComponent,
    Data6=deconstruct_3.ZComponent)

point_33 = Point(flatten(reaction_forces_karamba3d.SupportPosition))
number_8 = Number(merge_11)

c_script_7 = CSharpScript(pts=point_33, target_pts=point_32, dist_tol=Slider(0.001, range=0..0.001))  # -> out, flatten(A); inputs pts: list of Point3d, target_pts: list of Point3d, dist_tol: Double; same code as c_script_5
integer_6 = Integer(graft(c_script_7.A))
number_9 = Number(number_2)
construct_path_2 = ConstructPath(Indices=integer_6)  # -> flatten(Branch)
tree_statistics_2 = TreeStatistics(Tree=number_9)  # -> Paths, Length, Count
replace_paths = ReplacePaths(Data=number_9, Search=tree_statistics_2.Paths, Replace=construct_path_2)
number_10 = Number(number_8)

panel_30 = Panel(replace_paths)
merge_12 = Merge(
    Data1=graft(beam_forces_karamba3d.NormalForce_kN),
    Data2=graft(beam_forces_karamba3d.ShearForceVz_kN),
    Data3=graft(beam_forces_karamba3d.ShearForceVy_kN),
    Data4=graft(beam_forces_karamba3d.BendingMomentMt_kNm),
    Data5=graft(beam_forces_karamba3d.BendingMomentMy_kNm),
    Data6=graft(beam_forces_karamba3d.BendingMomentMz_kNm))  # -> simplify(Result)
number_11 = Number(merge_12)
shift_paths = ShiftPaths(Data=number_11, Offset=-1)
tree_branch_2 = TreeBranch(Tree=shift_paths, Path=construct_path, MaintainPaths=True)
panel_31 = Panel(tree_branch_2)
panel_32 = Panel(number_10)
evaluate_5 = Evaluate(Expression="format(\"{0:E} {1:E} {2:E}\",x.x,x.y,x.z)", x=merge_9)
panel_33 = Panel(sort_list.Keys)
evaluate_6 = Evaluate(Expression="format(\"{0:E}\",x)", x=merge_11)
number_12 = Number(evaluate_2)
evaluate_7 = Evaluate(Expression="format(\"{0:E}\",x)", x=merge_12)
number_13 = Number(division_3)
division_4 = Division(A=number_6, B=number_7)
merge_13 = Merge(Data1=multiplication_8, Data2=split_tree.Negative)
cluster_4 = Cluster(text=evaluate_5, separators=" ")
reaction_force_kn_reaction_moment_kn_m = Panel(evaluate_6)
evaluate_8 = Evaluate(Expression="format(\"{0:E}\",x)", x=division_4)
shift_paths_2 = ShiftPaths(Data=merge_13, Offset=-1)
multiplication_9 = Multiplication(A=number_13, B="0.1")
froce_kn_moment_kn_m = Panel(evaluate_7)
shift_paths_3 = ShiftPaths(Data=cluster_4, Offset=-1)

number_14 = Number(simplify(shift_paths_3))
number_15 = Number(c_script_6.node_displ)
c_script_8 = CSharpScript(x=number_15, y=number_14)  # -> out, A; inputs x: Double, y: Double
# ---------- c_script_8: C# ----------
    if(Math.Abs(y) < 1e-12)
    {
      A = Math.Abs(x - y);
    }
    else
    {
      A = Math.Abs(x - y) / Math.Abs(y);
    }
# ---------- end c_script_8 ----------

panel_34 = Panel(number_14)
panel_35 = Panel(number_15)
number_16 = Number(flatten(c_script_8.A))
sort_list_2 = SortList(Keys=number_16, ValuesValuesA=number_16)  # -> Keys, reverse(ValuesValuesA)

number_17 = Number(shift_paths_2)
c_script_9 = CSharpScript(x=number_14, y=number_17)  # -> out, A; inputs x: Double, y: Double; same code as c_script_8
c_script_10 = CSharpScript(x=number_4, y=number_17)  # -> out, A; inputs x: Double, y: Double; same code as c_script_8

panel_36 = Panel(sort_list_2.ValuesValuesA)
panel_37 = Panel(shift_paths_2)
number_18 = Number(flatten(c_script_9.A))
panel_38 = Panel(multiplication_9)
panel_39 = Panel(division_4)
sort_list_3 = SortList(Keys=number_18, ValuesValuesA=number_18)  # -> Keys, reverse(ValuesValuesA)
model_view_karamba3d = ModelViewKaramba3D(Model=analyze_karamba3d.CalculatedModel, LoadCaseFactorsForLinearSuperposition=1, IndexOfVisibleLoadcase=-1)  # -> Model, DeformedMesh, DeformedAxes, DeformedModel
c_script_11 = CSharpScript(x=replace_paths, y=number_10)  # -> out, A; inputs x: Double, y: Double; same code as c_script_8
panel_40 = Panel(sort_list_3.ValuesValuesA)
panel_41 = Panel(c_script_11.A)
beam_view_karamba3d = BeamViewKaramba3D(Model=model_view_karamba3d.Model)  # -> Model, MeshesOfRenderedBeams, DeformedBeamAxes, LegendColors, LegendTags
legend = Legend(Colour=beam_view_karamba3d.LegendColors, Tags=beam_view_karamba3d.LegendTags, LegendType=1)
point_34 = Point(point_28)
point_35 = Point(point_27)

# ----
# grounded nodes
point_36 = Point(point_34)

# ----
# all nodes
point_37 = Point(point_35)

deconstruct_4 = Deconstruct(Point=point_37)  # -> XComponent, YComponent, ZComponent
sort_list_4 = SortList(Keys=deconstruct_4.ZComponent)  # -> Keys, ValuesValuesA
list_item_13 = ListItem(List=sort_list_4.Keys, Index=0, Wrap=True)  # -> Item1, Item
c_script_12 = CSharpScript(pts=point_37, target_pts=point_36, dist_tol=0.001)  # -> out, index; inputs pts: list of Point3d, target_pts: list of Point3d, dist_tol: Double; same code as c_script
distance = Distance(PointA=graft(point_37), PointB=point_36)  # -> simplify(Distance)
subtraction = Subtraction(A=list_item_13.Item1, B=sort_list_4.Keys)
absolute_2 = Absolute(Value=subtraction)
list_item_14 = ListItem(List=point_37, Index=c_script_12.index, Wrap=True)
panel_42 = Panel("C:\Users\harry\Documents\pb-construction\conmech\tests\assembly_instances\extrusion")
mass_multiplication = MassMultiplication(Input=distance)  # -> Result, PartialResults
mass_addition = MassAddition(Input=absolute_2)  # -> Result, PartialResults
panel_43 = Panel("3D_truss")
panel_44 = Panel("2D_truss")
panel_45 = Panel("C:\Users\harry\Documents\pb-construction\conmech\tests\test_data")
integer_7 = Integer(support)

# ----
# file name
panel_46 = Panel("compas_fea_beam_tree_S")

boolean = Boolean(mass_addition.Result)
boolean_2 = Boolean(mass_multiplication.Result)
integer_8 = Integer(boolean_2)
subtraction_2 = Subtraction(A="1", B=integer_8)
panel_47 = Panel(subtraction_2)
duplicate_data_2 = DuplicateData(Data=integer_7, Number=subtraction_2, Order=True)  # -> simplify(Data)
stream_filter = StreamFilter(Gate=boolean, Stream0="2D_frame", Stream1="3D_frame")
stream_filter_2 = StreamFilter(Gate=boolean, Stream0="2", Stream1="3")
stream_filter_3 = StreamFilter(Gate=boolean, Stream0="3", Stream1="6")
panel_48 = Panel(stream_filter)
concatenate_4 = Concatenate(Fragment_A=panel_46, A=".json")
concatenate_5 = Concatenate(Fragment_A=panel_46, B="_load_case", A=".json")
equality = Equality(FirstNumber=mass_multiplication.Result, SecondNumber="0")  # -> Equality, Inequality
concatenate_6 = Concatenate(Fragment_A=panel_42, A="\", Fragment_B=concatenate_4)
concatenate_7 = Concatenate(Fragment_A=panel_42, A="\", Fragment_B=concatenate_5)
integer_9 = Integer(flatten(equality.Equality))

# ----
# node pts
point_38 = Point(point_37)

# ----
# element_ids
integer_10 = Integer(integer_4)

construct_point_2 = ConstructPoint(XCoordinate="600", YCoordinate=0, ZCoordinate=Slider(23.5, range=0..100))
list_item_15 = ListItem(List=point_38, Index=integer_10, Wrap=True)
xy_plane = XYPlane(Origin=construct_point_2)
list_item_16 = ListItem(List=list_item_15, Index=0, Wrap=True)  # -> Item, Item1
line_4 = Line(StartPoint=list_item_16.Item, EndPoint=list_item_16.Item1)
text = Text(concatenate)
number_19 = Number(multiplication_6)
integer_11 = Integer(stream_filter_2)
number_20 = Number(number)
number_21 = Number(multiplication_5)
boolean_toggle = BooleanToggle(False)
number_22 = Number(panel_25)
number_23 = Number(evaluate_3)
number_24 = Number(disassemble_material_karamba3d.YieldStrengthKNCm2Dir12)
integer_12 = Integer(duplicate_data_2)
panel_49 = Panel(number_22)
panel_50 = Panel(number_19)
panel_51 = Panel(number_23)
panel_52 = Panel(number_21)
panel_53 = Panel(number_20)

# ----
# write load case
point_39 = Point(point_29)
point_40 = Point(point_39)
point_41 = Point(point_37)
c_script_13 = CSharpScript(pts=point_41, target_pts=point_40, dist_tol=Slider(0.001, range=0..0.001))  # -> out, A; inputs pts: list of Point3d, target_pts: list of Point3d, dist_tol: Double; same code as c_script_5
xy_plane_2 = XYPlane(Origin=Point(0, 0, 0))
stream_filter_4 = StreamFilter(Gate=0, Stream0=0, Stream1=1)
integer_13 = Integer(c_script_13.A)
vector_4 = Vector(vector_2)
longest_list = LongestList(ListListA=xy_plane_2, ListListB=vector_4, PaddingMode=2)  # -> ListListA, ListListB
integer_14 = Integer(integer_11)
text_2 = Text(concatenate_4)
text_3 = Text(concatenate_7)
deconstruct_5 = Deconstruct(Point=vector_4)  # -> XComponent, YComponent, ZComponent
integer_15 = Integer(integer_13)
list_item_17 = ListItem(List=point_41, Index=integer_13, Wrap=True)
deconstruct_6 = Deconstruct(Point=longest_list.ListListA)  # -> XComponent, YComponent, ZComponent
c_script_14 = CSharpScript(
    toggle=boolean_toggle,
    file_path=text_3,
    shape_file_name=text_2,
    dimension=integer_14,
    include_self_weight=stream_filter_4,
    force_unit="kN",
    moment_unit="kN-m",
    load_node_ids=integer_15,
    Fx=deconstruct_5.XComponent,
    Fy=deconstruct_5.YComponent,
    Fz=deconstruct_5.ZComponent,
    Mx=deconstruct_6.XComponent,
    My=deconstruct_6.YComponent,
    Mz=deconstruct_6.ZComponent,
    Reference="C:\USERS\HARRY\DROPBOX (MIT)\PROJECTS\CHOREO\SOFTWARE\GH_INPUT_PARSER\Newtonsoft.Json.dll")  # -> out, A; inputs toggle: Boolean, file_path: String, shape_file_name: String, dimension: Int32, include_self_weight: Boolean, force_unit: String, moment_unit: String, load_node_ids: list of Int32, Fx: list of Double, Fy: list of Double, Fz: list of Double, Mx: list of Double, My: list of Double, Mz: list of Double; disabled
# ---------- c_script_14: C# ----------
    if(toggle != true)
    {
      return;
    }

    JsonSerializer serializer = new JsonSerializer();
    serializer.NullValueHandling = NullValueHandling.Ignore;
    serializer.Formatting = Newtonsoft.Json.Formatting.Indented;

    // init assembly sequence obj, wire in global params
    ConmechLoad cas = new ConmechLoad();
    cas.dimension = dimension;
    cas.applied_shape_file = shape_file_name;
    cas.include_self_weight = include_self_weight;
    cas.force_unit = force_unit;
    cas.moment_unit = moment_unit;

    cas.point_load_list = new List<PointLoad>();

    // create nodes
    for(int i = 0; i < load_node_ids.Count(); i++)
    {
      PointLoad nd = new PointLoad();
      nd.applied_node_id = load_node_ids[i];
      nd.Fx = Fx[i];
      nd.Fy = Fy[i];
      nd.Fz = Fz[i];
      nd.Mx = Mx[i];
      nd.My = My[i];
      nd.Mz = Mz[i];

      cas.point_load_list.Add(nd);
    }

    // GH screen output
    //    string json = JsonConvert.SerializeObject(cas, Newtonsoft.Json.Formatting.Indented);
    //    Print(json);

    // serialize to json file
    using (StreamWriter sw = new StreamWriter(@file_path))
    using (JsonWriter writer = new JsonTextWriter(sw))
    {
      serializer.Serialize(writer, cas);
    }
# ---------- c_script_14: C# additional code ----------
  public class PointLoad
  {
    public int applied_node_id { get; set; }
    public double Fx { get; set; }
    public double Fy { get; set; }
    public double Fz { get; set; }
    public double Mx { get; set; }
    public double My { get; set; }
    public double Mz { get; set; }
  }

  public class ConmechLoad
  {
    public string applied_shape_file { get; set; }
    public int dimension { get; set; }
    public string force_unit { get; set; }
    public string moment_unit{ get; set; }
    public bool include_self_weight { get; set; }

    public List<PointLoad> point_load_list { get; set; }
  }
# ---------- end c_script_14 ----------
panel_54 = Panel(c_script_14.out)

c_script_15 = CSharpScript(
    toggle=boolean_toggle,
    file_path=concatenate_6,
    model_name=panel_46,
    model_type=panel_48,
    assembly_type="extrusion",
    unit="millimeter",
    dimension=integer_11,
    relative_pos_to_robot_base=xy_plane,
    node_pts=point_38,
    ground_nodes_identifier=integer_9,
    fixities=integer_12,
    elements=integer_10,
    material_name=text,
    youngs_modulus=panel_50,
    youngs_modulus_unit="kN/cm2",
    shear_modulus=panel_52,
    shear_modulus_unit="kN/cm2",
    tensile_yeild_stress=number_24,
    tensile_yeild_stress_unit="kN/cm2",
    poisson_ratio=panel_51,
    radius=panel_53,
    radius_unit="centimeter",
    density=panel_49,
    density_unit="kN/m3",
    Reference="C:\USERS\HARRY\DROPBOX (MIT)\PROJECTS\CHOREO\SOFTWARE\GH_INPUT_PARSER\Newtonsoft.Json.dll")  # -> out, A; inputs toggle: Boolean, file_path: String, model_name: String, model_type: String, assembly_type: String, unit: String, dimension: Int32, relative_pos_to_robot_base: Plane, node_pts: list of Point3d, ground_nodes_identifier: list of Int32, fixities: tree of Int32, elements: tree of Int32, material_name: String, youngs_modulus: Double, youngs_modulus_unit: String, shear_modulus: Double, shear_modulus_unit: String, tensile_yeild_stress: Double, tensile_yeild_stress_unit: String, poisson_ratio: Double, radius: Double, radius_unit: String, density: Double, density_unit: String
# ---------- c_script_15: C# ----------
    if(toggle == false)
    {
      return;
    }

    JsonSerializer serializer = new JsonSerializer();
    serializer.NullValueHandling = NullValueHandling.Ignore;
    serializer.Formatting = Newtonsoft.Json.Formatting.Indented;

    // init assembly sequence obj, wire in global params
    ChoreoInputModel cas = new ChoreoInputModel();
    cas.model_name = model_name;
    cas.assembly_type = assembly_type;
    cas.model_type = model_type;
    cas.generate_time = DateTime.Now.ToString();
    cas.unit = unit;
    cas.dimension = dimension;
    cas.element_num = elements.BranchCount;
    cas.node_num = node_pts.Count();

    cas.base_frame_in_rob_base = relative_pos_to_robot_base;

    cas.material_properties = new MaterialProperty();
    cas.material_properties.material_name = material_name;
    cas.material_properties.youngs_modulus = youngs_modulus;
    cas.material_properties.youngs_modulus_unit = youngs_modulus_unit;

    cas.material_properties.shear_modulus = shear_modulus;
    cas.material_properties.shear_modulus_unit = shear_modulus_unit;

    cas.material_properties.tensile_yeild_stress = tensile_yeild_stress;
    cas.material_properties.tensile_yeild_stress_unit = tensile_yeild_stress_unit;

    cas.material_properties.poisson_ratio = poisson_ratio;

    cas.material_properties.radius = radius;
    cas.material_properties.radius_unit = radius_unit;

    cas.material_properties.density = density;
    cas.material_properties.density_unit = density_unit;

    cas.node_list = new List<FrameNode>(node_pts.Count());
    cas.element_list = new List<FrameElement>(elements.BranchCount);

    // create nodes
    for(int i = 0; i < node_pts.Count(); i++)
    {
      FrameNode nd = new FrameNode();
      nd.point = node_pts[i];
      nd.node_id = i;
      nd.is_grounded = ground_nodes_identifier[i];
      nd.fixities = fixities.Branch(i);

      cas.node_list.Add(nd);
    }

    // create each sequenced element
    for(int i = 0; i < elements.BranchCount; i++)
    {
      FrameElement ne = new FrameElement();
      ne.end_node_ids = new List<int>();
      ne.element_id = i;
      ne.end_node_ids = elements.Branch(i);

      cas.element_list.Add(ne);
    }

    // GH screen output
    //    string json = JsonConvert.SerializeObject(cas, Newtonsoft.Json.Formatting.Indented);
    //    Print(json);

    // serialize to json file
    using (StreamWriter sw = new StreamWriter(@file_path))
    using (JsonWriter writer = new JsonTextWriter(sw))
    {
      serializer.Serialize(writer, cas);
    }
# ---------- c_script_15: C# additional code ----------
  public class FrameNode
  {
    public Point3d point { get; set; }
    public int node_id { get; set; }
    public int is_grounded { get; set; }
    public List<int> fixities { get; set; }
  }

  public class FrameElement
  {
    public List<int> end_node_ids { get; set; }
    public int element_id { get; set; }
    public int layer_id { get; set; }
  }

  public class MaterialProperty
  {
    public string material_name { get; set; }
    public double youngs_modulus { get; set; }
    public string youngs_modulus_unit { get; set; }

    public double shear_modulus { get; set; }
    public string shear_modulus_unit { get; set; }

    public double tensile_yeild_stress { get; set; }
    public string tensile_yeild_stress_unit { get; set; }

    public double density { get; set; }
    public string density_unit { get; set; }

    public double poisson_ratio { get; set; }

    public double radius { get; set; }
    public string radius_unit { get; set; }
  }

  public class ChoreoInputModel
  {
    public string model_name { get; set; }
    public string assembly_type { get; set; }
    public string model_type { get; set; }
    public string unit { get; set; }
    public string generate_time { get; set; }

    public int dimension { get; set; }
    public int node_num { get; set; }
    public int element_num { get; set; }

    public Plane base_frame_in_rob_base { get; set; }

    public MaterialProperty material_properties { get; set; }

    public List<FrameNode> node_list { get; set; }
    public List<FrameElement> element_list { get; set; }
  }
# ---------- end c_script_15 ----------
panel_55 = Panel(c_script_15.out)

# ==== cluster Cluster
text = ClusterInput()
separators = ClusterInput()
text_split = TextSplit(Text=text, Separators=separators)
number = Number(text_split)
clean_tree = CleanTree(RemoveNulls=True, RemoveInvalid=True, RemoveEmpty=False, Tree=number)
tree = ClusterOutput(clean_tree)

# ==== cluster Cluster_2
list = ClusterInput()
replace_items = ReplaceItems(List=list, Indices="3", Wrap=False)
clean_tree = CleanTree(RemoveNulls=True, RemoveInvalid=True, RemoveEmpty=False, Tree=replace_items)
tree = ClusterOutput(clean_tree)

# ==== cluster Cluster_3
curve = ClusterInput()
curve_2 = Curve(curve)
bounding_box = BoundingBox(Content=curve_2, Plane=PlaneXY(0, 0, 0), UnionBox=True)  # -> Box, Box_2
volume = Volume(Geometry=bounding_box.Box)  # -> Volume, Centroid
deconstruct = Deconstruct(Point=volume.Centroid)  # -> XComponent, YComponent, ZComponent
construct_point = ConstructPoint(XCoordinate=deconstruct.XComponent, YCoordinate=deconstruct.YComponent, ZCoordinate=0)
negative = Negative(Value=construct_point)
move = Move(Geometry=curve_2, Motion=negative)  # -> Geometry, Transform
geometry = ClusterOutput(move.Geometry)
