# Grasshopper definition stiffness_checker_compare_karamba_compas_rpc_play_around.ghx (Grasshopper 1.0.7)
# plug-ins: karambaGH

# ---- group: load log json
panel = Panel("C:\Users\yijiangh\Documents\pb_ws\pb-construction\extrusion\extrusion_log")
concatenate = Concatenate(Fragment_A=panel, A="\", Fragment_B="voronoi_S1_03-14-2019_w_layer_log_regression-z.json")
ghpython_script = GhPythonScript(seq_result_file_path=concatenate)  # -> out, seq_e_ids
# ---------- ghpython_script: Python ----------
import rhinoscriptsyntax as rs
import json

import Grasshopper.DataTree as datatree
import System

with open(seq_result_file_path, 'r') as f:
    json_data = json.loads(f.read())

search_log_data = json_data['search_log_data']
print('search method: {}'.format(search_log_data['search_method']))
print('heuristic: {}'.format(search_log_data['heuristic']))

queue_ids_tree = datatree[System.Object]()
queue_scores_tree = datatree[System.Object]()

for search_data in search_log_data['search']:
    queue_ids = []
    queue_scores = []
# ---------- end ghpython_script ----------

# ---- group: load plan json
panel_2 = Panel("C:\Users\yijiangh\Documents\pb_ws\pb-construction\extrusion\extrusion_results")
concatenate_2 = Concatenate(Fragment_A=panel_2, A="\", Fragment_B="voronoi_solution_regression-z.json")
ghpython_script_2 = GhPythonScript(seq_result_file_path=concatenate_2)  # -> out, seq_e_ids
# ---------- ghpython_script_2: Python ----------
__author__ = "harry"
__version__ = "2019.08.22"

import rhinoscriptsyntax as rs
import json

with open(seq_result_file_path, 'r') as f:
    json_data = json.loads(f.read())

seq_e_ids = json_data['plan']
del json_data['plan']
print(json_data)
# ---------- end ghpython_script_2 ----------

# ----
panel_3 = Panel(ghpython_script.out)
panel_4 = Panel("C:\Users\yijiangh\Documents\pb_ws\conmech\tests\assembly_instances\extrusion")
panel_5 = Panel("simple_frame.json")
integer = Integer(reverse(ghpython_script_2.seq_e_ids))
list_item = ListItem(List=integer, Index=Slider(156, range=0..305), Wrap=True)
concatenate_3 = Concatenate(Fragment_A=panel_4, A="\", Fragment_B="voronoi_S1_03-14-2019_w_layer.json")
ghpython_script_3 = GhPythonScript(frame_json_file_path=concatenate_3, use_rpc=Toggle(False), scale=Slider(1, range=0..1000))  # -> out, all_nodes, all_elements, simplify(all_element_node_ids), all_fix_node_ids, material_name, E, E_unit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
# ---------- ghpython_script_3: Python ----------
import rhinoscriptsyntax as rs
import Rhino.Geometry as rg
from Grasshopper import DataTree as datatree
from Grasshopper.Kernel.Data import GH_Path as ghpath
import System
import math

from ghpythonlib.treehelpers import list_to_tree, tree_to_list

def rvector2list(rv):
    return [rv.X, rv.Y, rv.Z]

if use_rpc:
    from compas.rpc import Proxy
    cm = Proxy('pyconmech.frame_analysis.frame_file_io')
    frame_info = cm.read_frame_json(frame_json_file_path, verbose=True)
else:
    from compas.utilities.xfunc import XFunc
    xfunc = XFunc('pyconmech.frame_analysis.frame_file_io.read_frame_json')
    frame_info = xfunc(frame_json_file_path, verbose=True)
    

node_points, element_vids, fix_node_ids, fix_specs, model_type, material_dicts, model_name = frame_info

all_nodes = [rs.CreatePoint(scale*pt[0], scale*pt[1], scale*pt[2]) for pt in node_points]
all_elements = [rg.Line(all_nodes[n1], all_nodes[n2]) for n1, n2 in element_vids]

all_element_node_ids = list_to_tree(element_vids)
all_fix_node_ids = [int(v) for v in fix_node_ids]

material_name = material_dicts[0]['material_name']
E = material_dicts[0]['youngs_modulus']
E_unit = material_dicts[0]['youngs_modulus_unit']

G = material_dicts[0]['shear_modulus']
G_unit = material_dicts[0]['shear_modulus_unit']

if 'tensile_yeild_stress' in material_dicts[0]:
    sigma = material_dicts[0]['tensile_yeild_stress']
    sigma_unit = material_dicts[0]['tensile_yeild_stress_unit']

rho = material_dicts[0]['density']
rho_unit = material_dicts[0]['density_unit']

r = math.sqrt(material_dicts[0]['cross_sec_area'] / math.pi)
r_unit = 'centimeter'
# ---------- end ghpython_script_3 ----------
split_list = SplitList(List=integer, Index=Slider(0, range=0..307))  # -> flatten(ListA), ListB
cluster = Cluster_4()
data = Data(ghpython_script_3.G_unit)
data_2 = Data(ghpython_script_3.material_name)
data_3 = Data(ghpython_script_3.E)
data_4 = Data(ghpython_script_3.E_unit)
data_5 = Data(ghpython_script_3.G)
data_6 = Data(ghpython_script_3.r)
data_7 = Data(ghpython_script_3.sigma)
data_8 = Data(ghpython_script_3.rho)
data_9 = Data(ghpython_script_3.sigma_unit)
data_10 = Data(ghpython_script_3.rho_unit)
data_11 = Data(ghpython_script_3.r_unit)
panel_6 = Panel(data_3)
panel_7 = Panel(data_5)
panel_8 = Panel(data_11)
panel_9 = Panel(data_4)
panel_10 = Panel(data_10)
panel_11 = Panel(data_2)
panel_12 = Panel(data)
panel_13 = Panel(data_7)
panel_14 = Panel(data_8)
panel_15 = Panel(data_9)
panel_16 = Panel(data_6)
point = Point(ghpython_script_3.all_nodes)
curve = Curve(ghpython_script_3.all_elements)
list_length = ListLength(List=curve)
series = Series(Start=0, Step=1, Count=list_length)
replace_items = ReplaceItems(List=series, Indices=list_item, Wrap=False)
integer_2 = Integer(replace_items)
integer_3 = Integer(integer_2)
ghpython_script_4 = GhPythonScript(
    existing_e_ids=integer_3,
    all_element_node_ids=ghpython_script_3.all_element_node_ids,
    all_fix_node_ids=ghpython_script_3.all_fix_node_ids)  # -> out, exist_fix_node_ids; inputs existing_e_ids: list of Int32, all_element_node_ids: tree of Int32, all_fix_node_ids: list of Int32
# ---------- ghpython_script_4: Python ----------
from ghpythonlib.treehelpers import list_to_tree, tree_to_list

element_vids = tree_to_list(all_element_node_ids, lambda x : x)
existing_e_ids = existing_e_ids or list(range(len(element_vids)))

existing_node_ids = set()
for e_id, e_tuple in enumerate(element_vids):
    if e_id in existing_e_ids:
        existing_node_ids.update(e_tuple)

print(all_fix_node_ids)

exist_fix_node_ids = [int(v) for v in all_fix_node_ids if v in existing_node_ids]

#existing_elements = datatree[System.Object]()
#for e_id in existing_ids:
#    existing_elements.Add(rg.Line(all_nodes[element_vids[e_id][0]], all_nodes[element_vids[e_id][1]]), ghpath(e_id))
#
#existing_nodes = datatree[System.Object]()
#for n_id in existing_node_ids:
#    existing_nodes.Add(all_nodes[n_id], ghpath(n_id))
# ---------- end ghpython_script_4 ----------
ghpython_script_5 = GhPythonScript(
    frame_json_file_path=concatenate_3,
    result_file_path=cluster,
    existing_ids=integer_2,
    include_sw=Toggle(True),
    python_path="F:\Miniconda\envs\coop_assembly_ws\python.exe",
    restart_rpc_server=Toggle(False))  # -> out, solve_success, element_reaction, node_displacement, fixities_reaction, local_coordinate_frames, compliance; inputs existing_ids: list of Int32, include_sw: Boolean, restart_rpc_server: Boolean; disabled
# ---------- ghpython_script_5: Python ----------
import rhinoscriptsyntax as rs
import Rhino.Geometry as rg
from Grasshopper import DataTree as datatree
from Grasshopper.Kernel.Data import GH_Path as ghpath
import System
import os
import json

from ghpythonlib.treehelpers import list_to_tree
from compas.rpc import Proxy
cm = Proxy('pyconmech.frame_analysis.stiffness_solve_fn', python=python_path, url='http://127.0.0.1')
if restart_rpc_server:
    cm.stop_server()
    cm.start_server()

json_data = cm.stiffness_checker_parse_and_solve(frame_json_file_path, \
    existing_ids=existing_ids, include_sw=include_sw, result_file_path=result_file_path)

if result_file_path:
    assert os.path.exists(result_file_path) and "json file path does not exist!"
    with open(result_file_path, 'r') as f:
        json_data = json.loads(f.read())

solve_success = json_data['solve_success']

print('trans tol : {}, rot_tol : {}'.format(json_data['trans_tol'], json_data['rot_tol']))

er_tree = datatree[System.Double]()
nd_tree = datatree[System.Double]()
fr_tree = datatree[System.Double]()
local_planes = datatree[System.Double]()

for nd_data in json_data['node_displacement']:
    n_id = nd_data['node_id']
    for val in nd_data['displacement']:
        nd_tree.Add(val, ghpath(n_id))

for fr_data in json_data['fixity_reaction']:
    n_id = fr_data['node_id']
    for val in fr_data['reaction']:
        fr_tree.Add(val, ghpath(n_id))

for er_data in json_data['element_reaction']:
    e_id = er_data['element_id']
    for val in er_data['reaction']['0']:
        er_tree.Add(val, ghpath(e_id, 0))
    for val in er_data['reaction']['1']:
        er_tree.Add(val, ghpath(e_id, 1))
    if 'local_to_global_transformation' in er_data:
        e_LG = er_data['local_to_global_transformation']
        for i in range(3):
            for j in range(3):
                num = e_LG[j][i]
                local_planes.Add(num, ghpath(e_id, j))

element_reaction = er_tree
node_displacement = nd_tree
fixities_reaction = fr_tree
local_coordinate_frames = local_planes
compliance = json_data['compliance']
# ---------- end ghpython_script_5 ----------
panel_17 = Panel(ghpython_script_4.exist_fix_node_ids)
panel_18 = Panel(ghpython_script_5.out)
division = Division(A=ghpython_script_5.compliance, B=2)
integer_4 = Integer(list_item)
list_item_2 = ListItem(List=curve, Index=integer_3, Wrap=True)
panel_19 = Panel(division)
number = Number(ghpython_script_5.local_coordinate_frames)
material_properties_karamba3d = MaterialPropertiesKaramba3D(
    FamilyOfMaterial=panel_11,
    Name="0",
    YoungsModulus_kN_cm2=panel_6,
    InPlaneShearModulus_kN_cm2=panel_7,
    TransverseShearModulus_kN_cm2=panel_7,
    SpecificWeight_kN_m3=panel_14,
    CoefficientOfThermalExpansion_1_C=1e-05,
    YieldStrength_kN_cm2=Slider(23.5, range=0..100),
    mode="Isotrop")
list_item_3 = ListItem(List=curve, Index=integer_4, Wrap=True)
material_properties_karamba3d_2 = MaterialPropertiesKaramba3D(
    FamilyOfMaterial="Steel",
    Name="S235",
    YoungsModulus_kN_cm2=21000,
    InPlaneShearModulus_kN_cm2=8076,
    TransverseShearModulus_kN_cm2=8076,
    SpecificWeight_kN_m3=78.5,
    CoefficientOfThermalExpansion_1_C=1e-05,
    YieldStrength_kN_cm2=23.5,
    mode="Isotrop")
curve_2 = Curve(list_item_2)
end_points = EndPoints(Curve=curve_2)  # -> Start, End
pipe = Pipe(Curve=list_item_3, Radius=Slider(0.002, range=0..0.005), Caps=0)
colour_cmyk = ColourCMYK(Cyan=Slider(1, range=0..1), Magenta=0, Yellow=0, Key=0)
split_tree = SplitTree(Data=ghpython_script_5.element_reaction, Masks=flatten("{*;1}"))  # -> Positive, Negative
split_tree_2 = SplitTree(Data=ghpython_script_5.element_reaction, Masks=flatten("{*;0}"))  # -> Positive, Negative
remove_duplicate_points_karamba3d = RemoveDuplicatePointsKaramba3D(Point=[end_points.Start, end_points.End], LimitDistance=0.005)  # -> OutPoint, Info, Indexes
panel_20 = Panel(material_properties_karamba3d)
panel_21 = Panel(material_properties_karamba3d_2)
custom_preview = CustomPreview(Geometry=pipe, Material=colour_cmyk)
shift_paths = ShiftPaths(Data=split_tree.Positive, Offset=-1)
shift_paths_2 = ShiftPaths(Data=split_tree_2.Positive, Offset=-1)
point_2 = Point(remove_duplicate_points_karamba3d.OutPoint)
integer_5 = Integer(ghpython_script_4.exist_fix_node_ids)

# ----
# all nodes
point_3 = Point(point)

list_item_4 = ListItem(List=point_3, Index=integer_5, Wrap=True)

# ----
# existing nodes
point_4 = Point(flatten(point_2))

# ----
# existing elements
curve_3 = Curve(flatten(curve_2))

# ----
# grounded nodes
point_5 = Point(list_item_4)

integer_6 = Integer(integer_2)
cluster_2 = Cluster_7(model=curve_3)
curve_4 = Curve(reparameterize(simplify(curve_2)))
point_6 = Point(point_4)
tree_statistics = TreeStatistics(Tree=curve_4)  # -> Paths, Length, Count
cluster_3 = Cluster_8(pts=point_6, target_pts=point_5, list=point_6)
cluster_4 = Cluster_2(branch=tree_statistics.Paths)
curve_5 = Curve(curve)
integer_7 = Integer(ghpython_script_3.all_fix_node_ids)
point_7 = Point(point)
list_item_5 = ListItem(List=point_7, Index=integer_7, Wrap=True)
split_tree_3 = SplitTree(Data=number, Masks=flatten(cluster_4))  # -> Positive, Negative
number_2 = Number(panel_16)
curve_6 = Curve(curve_3)
curve_7 = Curve(curve_5)
number_3 = Number(panel_16)
cluster_5 = Cluster_6(point=point_5, point_2=point_6, line=curve_6, material=material_properties_karamba3d, thickness=number_2)  # -> result, data, result_2, keys, elastic_energy_knm, calculated_model
max_deformation_l2_on_trans = Panel(cluster_5.keys)
model_view_karamba3d = ModelViewKaramba3D(Model=cluster_5.calculated_model, LoadCaseFactorsForLinearSuperposition=1, IndexOfVisibleLoadcase=-1)  # -> Model, DeformedMesh, DeformedAxes, DeformedModel
beam_view_karamba3d = BeamViewKaramba3D(Model=model_view_karamba3d.Model)  # -> Model, MeshesOfRenderedBeams, DeformedBeamAxes, LegendColors, LegendTags
legend = Legend(Colour=beam_view_karamba3d.LegendColors, Tags=beam_view_karamba3d.LegendTags, LegendType=1)
cluster_6 = Cluster_6(point=list_item_5, point_2=point_7, line=curve_7, material=material_properties_karamba3d, thickness=number_2)  # -> result, data, result_2, keys, elastic_energy_knm, calculated_model
cluster_7 = Cluster_3(
    data_2=split_tree_3.Positive,
    fragment_a_2=integer_6,
    data=split_tree_3.Positive,
    fragment_a=integer_6,
    indices=integer_6,
    curve=curve_4)  # -> vector_4, vector_6, vector_3
tree_statistics_2 = TreeStatistics(Tree=shift_paths_2)  # -> Paths, Length, Count
curve_8 = Curve(curve_4)
number_4 = Number(shift_paths)
list_item_6 = ListItem(List=shift_paths_2, Index=0, Wrap=True)  # -> Item, Item1, Item2, Item3, Item4, Item5
list_item_7 = ListItem(List=number_4, Index=0, Wrap=True)  # -> Item, Item1, Item2, Item3, Item4, Item5
split_tree_4 = SplitTree(Data=curve_8, Masks=flatten(tree_statistics_2.Paths))  # -> Positive, Negative

internal_froce_kn_moment_kn_m = Panel(cluster_5.result)
panel_22 = Panel(ghpython_script_5.element_reaction)
reaction_force_kn_reaction_moment_kn_m = Panel(cluster_5.result_2)
panel_23 = Panel(ghpython_script_5.fixities_reaction)
nodal_displacement_m_rad = Panel(cluster_5.data)
panel_24 = Panel(ghpython_script_5.node_displacement)

# ----
# local z axis
vector = Vector(cluster_7.vector_6)

# ----
# local y axis
vector_2 = Vector(cluster_7.vector_3)

# ----
# local x axis
vector_3 = Vector(cluster_7.vector_4)

vector_4 = Vector(unitize(vector))
vector_5 = Vector(unitize(vector_2))
curve_9 = Curve(split_tree_4.Positive)
vector_6 = Vector(vector)
curve_10 = Curve(split_tree_4.Positive)
number_5 = Number(list_item_6.Item)
negative = Negative(Value=vector_4)
negative_2 = Negative(Value=vector_5)
curve_11 = Curve(split_tree_4.Positive)
number_6 = Number(list_item_6.Item1)

# ----
# Vy (shear force along local y axis)
# scaling
number_slider = Slider(0, range=0..1)
c_script = CSharpScript(data_tree=number_6, threshold=number_slider)  # -> out, positive_branches, negative_branches; inputs data_tree: tree of Double, threshold: Double
# ---------- c_script: C# usings ----------
using System.IO;
using System.Linq;
using System.Data;
using System.Drawing;
using System.Reflection;
using System.Windows.Forms;
using System.Xml;
using System.Xml.Linq;
using System.Runtime.InteropServices;

using Rhino.DocObjects;
using Rhino.Collections;
using GH_IO;
using GH_IO.Serialization;
# ---------- c_script: C# ----------
    DataTree<double> data_tree_pos = new DataTree<double>();
    DataTree<double> data_tree_neg = new DataTree<double>();

    foreach(var path in data_tree.Paths)
    {
      double val = data_tree.Branch(path)[0];
      if (val > threshold)
      {
        data_tree_pos.Add(val, path);
      }
      else
      {
        data_tree_neg.Add(val, path);
      }
    }

    negative_branches = data_tree_neg;
    positive_branches = data_tree_pos;
# ---------- end c_script ----------
cluster_8 = Cluster(data=curve_11, tree=c_script.positive_branches)  # -> positive, negative
cluster_9 = Cluster(data=negative_2, tree=c_script.positive_branches)  # -> positive, negative
curve_12 = Curve(cluster_8.negative)
curve_13 = Curve(cluster_8.positive)
number_slider_2 = Slider(256, range=0..256)
number_slider_3 = Slider(9.171, range=0..10)
multiplication = Multiplication(A=cluster_9.negative, B=c_script.negative_branches)
multiplication_2 = Multiplication(A=cluster_9.positive, B=c_script.positive_branches)
multiplication_3 = Multiplication(A=multiplication_2, B=number_slider_3)
multiplication_4 = Multiplication(A=multiplication, B=number_slider_3)
colour_rgb = ColourRGB(Alpha=255, Red=0, Green=number_slider_2, Blue=0)
colour_rgb_2 = ColourRGB(Alpha=255, Red=number_slider_2, Green=0, Blue=0)
extrude = Extrude(Base=curve_13, Direction=multiplication_3)
extrude_2 = Extrude(Base=curve_12, Direction=multiplication_4)
colour = Colour(colour_rgb_2)
colour_2 = Colour(colour_rgb)
custom_preview_2 = CustomPreview(Geometry=extrude, Material=colour)
custom_preview_3 = CustomPreview(Geometry=extrude_2, Material=colour_2)

# ----
# scaling
number_slider_4 = Slider(0.392, range=0..5)

# ----
# Nx (axial force)
# at node 0,
# force > 0 tension
# force < 0 compression
number_slider_5 = Slider(0, range=0..1)
c_script_2 = CSharpScript(data_tree=number_5, threshold=number_slider_5)  # -> out, positive_branches, negative_branches; inputs data_tree: tree of Double, threshold: Double; same code as c_script
cluster_10 = Cluster(data=curve_10, tree=c_script_2.positive_branches)  # -> positive, negative
cluster_11 = Cluster(data=negative, tree=c_script_2.positive_branches)  # -> positive, negative
curve_14 = Curve(cluster_10.negative)
curve_15 = Curve(cluster_10.positive)
number_slider_6 = Slider(256, range=0..256)
multiplication_5 = Multiplication(A=cluster_11.negative, B=c_script_2.negative_branches)
multiplication_6 = Multiplication(A=cluster_11.positive, B=c_script_2.positive_branches)
multiplication_7 = Multiplication(A=multiplication_6, B=number_slider_4)
multiplication_8 = Multiplication(A=multiplication_5, B=number_slider_4)
colour_rgb_3 = ColourRGB(Alpha=255, Red=number_slider_6, Green=0, Blue=0)
colour_rgb_4 = ColourRGB(Alpha=255, Red=0, Green=0, Blue=number_slider_6)
extrude_3 = Extrude(Base=curve_15, Direction=multiplication_7)
extrude_4 = Extrude(Base=curve_14, Direction=multiplication_8)
colour_3 = Colour(colour_rgb_4)
colour_4 = Colour(colour_rgb_3)
custom_preview_4 = CustomPreview(Geometry=extrude_3, Material=colour_3)
custom_preview_5 = CustomPreview(Geometry=extrude_4, Material=colour_4)

panel_25 = Panel(multiplication_4)

# ----
# scaling
number_slider_7 = Slider(37.617, range=0..70)

# ----
# My
# https://mechanicalc.com/reference/beam-deflection-tables
vector_7 = Vector(unitize(vector_6))
negative_3 = Negative(Value=vector_7)
number_slider_8 = Slider(81, range=0..100)
curve_16 = Curve(curve_9)
subtraction = Subtraction(A=number_slider_8, B="0")
curve_17 = Curve(curve_16)
number_slider_9 = Slider(256, range=0..256)
divide_curve = DivideCurve(Curve=curve_17, Count=subtraction, Kinks=False)  # -> Points, Tangents, Parameters
shatter = Shatter(Curve=curve_17, Parameters=divide_curve.Parameters)  # -> simplify(Segments)
colour_rgb_5 = ColourRGB(Alpha=255, Red=0, Green=number_slider_9, Blue=0)
colour_rgb_6 = ColourRGB(Alpha=255, Red=number_slider_9, Green=0, Blue=0)
colour_5 = Colour(colour_rgb_6)
colour_6 = Colour(colour_rgb_5)
curve_18 = Curve(curve_4)
length = Length(Curve=curve_18)
number_7 = Number(list_item_6.Item4)
number_8 = Number(list_item_7.Item4)
ghpython_script_6 = GhPythonScript(beam_end_moment_0=number_7, beam_end_moment_1=number_8, e_len=length, disc=number_slider_8)  # -> out, simplify(moment_crv_pt_coord); inputs disc: Int32
# ---------- ghpython_script_6: Python ----------
__author__ = "harry"
__version__ = "2019.08.28"

import rhinoscriptsyntax as rs

assert beam_end_moment_0 == beam_end_moment_1

w = beam_end_moment_0 * (-12) / (e_len**2)

def compute_moment(x):
    return (w / 12.0) * (6*e_len*x - 6*x**2 - e_len**2)

moment_crv_pt_coord = []
for i in range(disc):
    moment_crv_pt_coord.append(compute_moment(i * (e_len/disc)))
# ---------- end ghpython_script_6 ----------
multiplication_9 = Multiplication(A=vector_7, B=ghpython_script_6.moment_crv_pt_coord)
panel_26 = Panel(ghpython_script_6.moment_crv_pt_coord)
multiplication_10 = Multiplication(A=multiplication_9, B=number_slider_7)
curve_19 = Curve(shatter)
extrude_5 = Extrude(Base=curve_19, Direction=multiplication_10)
custom_preview_6 = CustomPreview(Geometry=extrude_5, Material=colour_5)

full_structure_compliance = Panel(cluster_6.elastic_energy_knm)
partial_structure_compliance = Panel(cluster_5.elastic_energy_knm)

subtraction_2 = Subtraction(A=panel_19, B=partial_structure_compliance)
absolute = Absolute(Value=subtraction_2)
division_2 = Division(A=absolute, B=full_structure_compliance)

partial_full_compliance = Panel(division_2)

# ==== cluster Cluster
tree = ClusterInput()
tree_statistics = TreeStatistics(Tree=tree)  # -> Paths, Length, Count
data = ClusterInput()
split_tree = SplitTree(Data=data, Masks=flatten(tree_statistics.Paths))  # -> Positive, Negative
positive = ClusterOutput(split_tree.Positive)
negative = ClusterOutput(split_tree.Negative)

# ==== cluster Cluster_2
branch = ClusterInput()
deconstruct_path = DeconstructPath(Branch=branch)
concatenate = Concatenate(A="{", Fragment_A=deconstruct_path, B=";", Fragment_B="*", C="}")  # -> flatten(Result)
result = ClusterOutput(concatenate)

# ==== cluster Cluster_3
fragment_a = ClusterInput()
fragment_a_2 = ClusterInput()
concatenate = Concatenate(B="{", Fragment_A=fragment_a, A=";", Fragment_B="1", C="}")
concatenate_2 = Concatenate(B="{", Fragment_A=fragment_a_2, A=";", Fragment_B="0", C="}")
data = ClusterInput()
data_2 = ClusterInput()
split_tree = SplitTree(Data=data, Masks=flatten(concatenate))  # -> Positive, Negative
split_tree_2 = SplitTree(Data=data_2, Masks=flatten(concatenate_2))  # -> Positive, Negative
indices = ClusterInput()
curve = ClusterInput()
list_item = ListItem(List=split_tree.Positive, Index=0, Wrap=True)  # -> Item, Item1, Item2
list_item_2 = ListItem(List=split_tree_2.Positive, Index=0, Wrap=True)  # -> Item, Item1, Item2
construct_path = ConstructPath(Indices=simplify(graft(indices)))  # -> flatten(Branch)
evaluate_curve = EvaluateCurve(Curve=curve, Parameter=Slider(0.5, range=0..1))  # -> Point, Tangent, Angle
vector_xyz = VectorXYZ(XComponent=list_item.Item, YComponent=list_item.Item1, ZComponent=list_item.Item2)  # -> simplify(Vector), Length
# element local axis
vector_xyz_2 = VectorXYZ(XComponent=list_item_2.Item, YComponent=list_item_2.Item1, ZComponent=list_item_2.Item2)  # -> simplify(Vector), Length
split_tree_3 = SplitTree(Data=evaluate_curve.Point, Masks=flatten(construct_path))  # -> Positive, Negative
vector = Vector(vector_xyz.Vector)
vector_2 = Vector(vector_xyz_2.Vector)
point = Point(split_tree_3.Positive)
cross_product = CrossProduct(VectorA=vector_2, VectorB=vector, Unitize=True)  # -> Vector, Length
vector_3 = ClusterOutput(vector)
vector_4 = ClusterOutput(vector_2)
vector_5 = Vector(cross_product.Vector)
vector_6 = ClusterOutput(vector_5)
colour_rgb = ColourRGB(Alpha=255, Red="256", Green=0, Blue=0)
construct_plane = ConstructPlane(Origin=point, XAxis=vector_2, YAxis=vector)
colour_rgb_2 = ColourRGB(Alpha=255, Red=0, Green="256", Blue=0)
colour_rgb_3 = ColourRGB(Alpha=255, Red=0, Green=0, Blue="256")
vector_display_ex = VectorDisplayEx(Point=point, Vector=vector_2, Colour=colour_rgb, Width=2)
vector_display_ex_2 = VectorDisplayEx(Point=point, Vector=vector, Colour=colour_rgb_2, Width=2)
vector_display_ex_3 = VectorDisplayEx(Point=point, Vector=vector_5, Colour=colour_rgb_3, Width=2)

# ==== cluster Cluster_4
concatenate = Concatenate(Fragment_A="C:\Users\yijiangh\Desktop\conmech_results", A="\", Fragment_B="conmech_result.json")
result = ClusterOutput(concatenate)

# ==== cluster Cluster_6
point = ClusterInput()
material = ClusterInput()
thickness = ClusterInput()
line = ClusterInput()
point_2 = ClusterInput()
point_3 = Point(point)
# Gravity load
unit_z = UnitZ(Factor=1)
# Supports
support_karamba3d = SupportKaramba3D(PosInd=point_3, menu=[buttons(on, on, on, on, on, on)])
negative = Negative(Value=unit_z)
multiplication = Multiplication(A=thickness, B="2")
loads_karamba3d = LoadsKaramba3D(Vector=negative, LCase=0, mode="Gravity")
support_karamba3d_2 = SupportKaramba3D(support_karamba3d)
cross_section_karamba3d = CrossSectionKaramba3D(
    FamilyNameOfCrossSection="DefaultCroSec",
    Material=material,
    Diameter_cm=multiplication,
    WallThickness_cm=thickness,
    mode="Circular Hollow")
point_4 = Point(point_2)
line_to_beam_karamba3d = LineToBeamKaramba3D(Line=line, CrossSection=cross_section_karamba3d, Points=point_4, New=True, Remove=True, LimitDistance_m=0.005)  # -> Element, Points, Info
load_karamba3d = LoadKaramba3D(loads_karamba3d)
assemble_model_karamba3d = AssembleModelKaramba3D(
    Point=point_4,
    Elem=line_to_beam_karamba3d.Element,
    Support=support_karamba3d_2,
    Load=load_karamba3d,
    LimitDistance_m=0.005)  # -> Model, Info, Mass_kg, CenterOfGravity
analyze_karamba3d = AnalyzeKaramba3D(Model=assemble_model_karamba3d.Model)  # -> CalculatedModel, MaximumDisplacement_cm, ResultingForceOfGravity_kN, ElasticEnergy_kNm
reaction_forces_karamba3d = ReactionForcesKaramba3D(AnalyzedModel=analyze_karamba3d.CalculatedModel, LoadCase=0)  # -> AnalyzedModel, ReactionForces_kN, ReactionMoments_kNm, SupportPosition, SumOfReactionForces_kN, SumOfReactionMoments_kNm
nodal_displacements_karamba3d = NodalDisplacementsKaramba3D(AnalyzedModel=analyze_karamba3d.CalculatedModel, LoadCase=0)  # -> AnalyzedModel, NodalTranslations_m, NodalRotations_rad
beam_forces_karamba3d = BeamForcesKaramba3D(
    AnalyzedModel=analyze_karamba3d.CalculatedModel,
    LCase=-1,
    MaximumDistanceBetweenResults_m=-1,
    NumberOfResultsPerBeamElement=2)  # -> AnalyzedModel, NormalForce_kN, ShearForceVz_kN, ShearForceVy_kN, BendingMomentMt_kNm, BendingMomentMy_kNm, BendingMomentMz_kNm
deconstruct = Deconstruct(Point=simplify(graft(reaction_forces_karamba3d.ReactionForces_kN)))  # -> XComponent, YComponent, ZComponent
deconstruct_2 = Deconstruct(Point=simplify(graft(reaction_forces_karamba3d.ReactionMoments_kNm)))  # -> XComponent, YComponent, ZComponent
merge = Merge(
    Data1=simplify(graft(nodal_displacements_karamba3d.NodalTranslations_m)),
    Data2=simplify(graft(nodal_displacements_karamba3d.NodalRotations_rad)))
evaluate = Evaluate(Expression="format(\"{0:E} {1:E} {2:E}\",x.x,x.y,x.z)", x=merge)
merge_2 = Merge(
    Data1=deconstruct.XComponent,
    Data2=deconstruct.YComponent,
    Data3=deconstruct.ZComponent,
    Data4=deconstruct_2.XComponent,
    Data5=deconstruct_2.YComponent,
    Data6=deconstruct_2.ZComponent)
merge_3 = Merge(
    Data1=graft(beam_forces_karamba3d.NormalForce_kN),
    Data2=graft(beam_forces_karamba3d.ShearForceVz_kN),
    Data3=graft(beam_forces_karamba3d.ShearForceVy_kN),
    Data4=graft(beam_forces_karamba3d.BendingMomentMt_kNm),
    Data5=graft(beam_forces_karamba3d.BendingMomentMy_kNm),
    Data6=graft(beam_forces_karamba3d.BendingMomentMz_kNm))  # -> simplify(Result)
evaluate_2 = Evaluate(Expression="format(\"{0:E}\",x)", x=merge_2)
cluster = Cluster_5(text=evaluate, separators=" ")
evaluate_3 = Evaluate(Expression="format(\"{0:E}\",x)", x=merge_3)
reaction_force_kn_reaction_moment_kn_m = Panel(merge_2)
shift_paths = ShiftPaths(Data=cluster, Offset=-1)
list_item = ListItem(List=shift_paths, Index=0, Wrap=True)  # -> Item, Item1, Item2
froce_kn_moment_kn_m = Panel(merge_3)
nodal_displacement_m_rad = Panel(shift_paths)
merge_4 = Merge(Data1=list_item.Item, Data2=list_item.Item1, Data3=list_item.Item2)
number = Number(merge_4)
square = Square(Value=number)
mass_addition = MassAddition(Input=square)  # -> Result, PartialResults
square_root = SquareRoot(Value=mass_addition.Result)  # -> flatten(Result)
sort_list = SortList(Keys=square_root)  # -> reverse(Keys), ValuesValuesA
elastic_energy_knm = ClusterOutput(analyze_karamba3d.ElasticEnergy_kNm)
calculated_model = ClusterOutput(analyze_karamba3d.CalculatedModel)
result = ClusterOutput(merge_3)
data = ClusterOutput(shift_paths)
result_2 = ClusterOutput(merge_2)
keys = ClusterOutput(sort_list.Keys)

# ==== cluster Cluster_7
curve = Curve()
model = ClusterInput()
entwine = Entwine(Branch00=curve, FlattenInputs=True)
# element id shower
c_script = CSharpScript(model=model, layers=entwine)  # -> out, A, edge_layer_list; inputs model: list of Curve, layers: tree of Curve
# ---------- c_script: C# usings ----------
using System.IO;
using System.Linq;
using System.Data;
using System.Drawing;
using System.Reflection;
using System.Windows.Forms;
using System.Xml;
using System.Xml.Linq;
using System.Runtime.InteropServices;

using Rhino.DocObjects;
using Rhino.Collections;
using GH_IO;
using GH_IO.Serialization;
# ---------- c_script: C# ----------
    DataTree<int> index_tree = new DataTree<int>();
    List<int> edge_layer = new List<int>(new int[model.Count()]);

    foreach(var path in layers.Paths)
    {
      foreach(var line in layers.Branch(path.Indices))
      {
        for(int i = 0; i < model.Count(); i++)
        {
          var compare_line = model[i];

          if(line.PointAt(0) == compare_line.PointAt(0))
          {
            if(line.PointAt(1) == compare_line.PointAt(1))
            {
              index_tree.Add(i, path);
              edge_layer[i] = path.Indices[0];
              //              GH_Path p = new GH_Path(0);
              //              p.Indices
              continue;
            }
          }

          if(line.PointAt(0) == compare_line.PointAt(1))
          {
            if(line.PointAt(1) == compare_line.PointAt(0))
            {
              index_tree.Add(i, path);
              edge_layer[i] = path.Indices[0];
              continue;
            }
          }
        }
      }
    }

    A = index_tree;
    edge_layer_list = edge_layer;
# ---------- end c_script ----------
list_item = ListItem(List=model, Index=c_script.A, Wrap=True)
panel = Panel(c_script.A)
ghpython_script = GhPythonScript(x=panel)  # -> out, a; inputs x: list
# ---------- ghpython_script: Python ----------
__author__ = "harry"
__version__ = "2019.08.22"

import rhinoscriptsyntax as rs

print([int(v) for v in x])
# ---------- end ghpython_script ----------

# ==== cluster Cluster_8
pts = ClusterInput()
target_pts = ClusterInput()
c_script = CSharpScript(pts=pts, target_pts=target_pts, dist_tol=0.001)  # -> out, A; inputs pts: list of Point3d, target_pts: list of Point3d, dist_tol: Double; disabled
# ---------- c_script: C# usings ----------
using System.IO;
using System.Linq;
using System.Data;
using System.Drawing;
using System.Reflection;
using System.Windows.Forms;
using System.Xml;
using System.Xml.Linq;
using System.Runtime.InteropServices;

using Rhino.DocObjects;
using Rhino.Collections;
using GH_IO;
using GH_IO.Serialization;
# ---------- c_script: C# ----------
    List<int> id = new List<int>();

    foreach(Point3d t_pt in target_pts)
    {
      for(int i = 0; i < pts.Count(); i++)
      {
        if(t_pt.DistanceTo(pts[i]) < dist_tol)
        {
          id.Add(i);
          break;
        }
      }
    }

    A = id;
# ---------- end c_script ----------
list = ClusterInput()
list_item = ListItem(List=list, Index=c_script.A, Wrap=True)  # disabled

# ==== cluster Cluster_5
text = ClusterInput()
separators = ClusterInput()
text_split = TextSplit(Text=text, Separators=separators)
number = Number(text_split)
clean_tree = CleanTree(RemoveNulls=True, RemoveInvalid=True, RemoveEmpty=False, Tree=number)
tree = ClusterOutput(clean_tree)
