# Grasshopper definition stiffness_checker_compare_karamba_ghpythonremote-subdivision.ghx (Grasshopper 1.0.7)
# plug-ins: karambaGH

# ---- group: Import remote python modules
panel = Panel("C:\Users\yijiangh\Software\Miniconda\envs\rhinoremote\python.exe")
python = PythonScript()  # -> rhino_doc_dir
# ---------- python: Python ----------
import scriptcontext as sc
from os import path

rhino_doc_dir = path.abspath(path.dirname(sc.doc.Path))
# ---------- end python ----------
panel_2 = Panel(python)
panel_3 = Panel("""numpy
numpy.linalg
pyconmech""")
list = ValueList({"CRITICAL", "ERROR", "WARNING", "INFO", "DEBUG", "NOTSET"}, selected="DEBUG")
ghpythonremote = GHPythonRemote(location=panel, run=Toggle(False), modules=panel_3, log_level=list, working_dir=panel_2)  # -> out, linked_modules, rpy; inputs run: Boolean, modules: list
# ---------- ghpythonremote: Python ----------
import sys
import scriptcontext
import logging
import inspect
import ghpythonremote
from ghpythonremote.connectors import GrasshopperToPythonRemote
from os import path
from time import sleep

local_log_level = getattr(logging, log_level, logging.WARNING)
logger = logging.getLogger('ghpythonremote')
logger.setLevel(local_log_level)
ch = logging.StreamHandler()
ch.setLevel(local_log_level)
formatter = logging.Formatter('%(levelname)s: %(name)s:\n%(message)s')
ch.setFormatter(formatter)
logger.handlers = []
logger.addHandler(ch)
logger = logging.getLogger('ghpythonremote.GH_to_python')

ROOT = path.abspath(path.dirname(inspect.getfile(ghpythonremote)))
rpyc_server_py = path.join(ROOT, 'pythonservice.py')

# Set connection to CLOSED if this is the first run
# and initialize set of linked modules
try:
    remote_python_status
except NameError:
    remote_python_status = 'CLOSED'
    lkd_modules = set()

# Wait for connection to connect or terminate
timer = 0
while remote_python_status == 'CONNECTING' or remote_python_status == 'CLOSING':
    sleep(1)
    timer += 1
    if timer == 10:
        try:
            gh2py_manager.__exit__(*sys.exc_info())
        except Exception:
            pass
        remote_python_status = 'CLOSED'
        lkd_modules = set()
        raise RuntimeError("Connection left in an inconsistent state and not returning. Reset everything.")

if run:
    if not remote_python_status == 'OPEN':
        remote_python_status = 'CONNECTING'
        gh2py_manager = GrasshopperToPythonRemote(rpyc_server_py, location=location, timeout=10,
                                                  port=None, log_level=log_level, working_dir=working_dir)
        gh2py = gh2py_manager.__enter__()
        remote_python_status = 'OPEN'

    # Stuff that we can reach
    rpymod = gh2py.py_remote_modules  # A getter function for a named python module
    rpy = gh2py.connection  # Represents the remote instance root object
    scriptcontext.sticky['rpy'] = rpy
    # Add modules
    for mod in modules:
        try:
            scriptcontext.sticky[mod] = rpymod(mod)
            lkd_modules.add(mod)
        except ImportError:
            gh2py_manager.__exit__(*sys.exc_info())
            raise

elif not remote_python_status == 'CLOSED':
    remote_python_status = 'CLOSING'
    # Remove linked modules
    for mod in lkd_modules:
        del scriptcontext.sticky[mod]
    del scriptcontext.sticky['rpy']
    gh2py_manager.__exit__(*sys.exc_info())
    lkd_modules = set()
    remote_python_status = 'CLOSED'

# Change variable name because ghpython resets outputs to None before each run
linked_modules = lkd_modules

logger.info('GH to python connection is {}'.format(remote_python_status))
# ---------- end ghpythonremote ----------
python_2 = PythonScript(module_names=ghpythonremote.linked_modules)  # -> import_statements; inputs module_names: list
# ---------- python_2: Python ----------
import_statements = ["import scriptcontext as sc"]
for module_name in module_names:
    import_statements.append("{0} = sc.sticky['{0}']".format(module_name))

if len(module_names) == 0:
    import_statements = []
# ---------- end python_2 ----------
panel_4 = Panel(python_2)

# ----
division_len = Slider(0.016, range=0.001..0.1)
use_subdivided_element = BooleanToggle(False)
division_num = Slider(7, range=1..20)
show_karamba_viz = BooleanToggle(True)
save_frame_json = BooleanToggle(False)
value_list = ValueList({"divide num": 0, "divide len": 1}, selected="divide len")

panel_5 = Panel("C:\Users\yijiangh\Documents\pb_ws\pb-construction\src\pb_construction\data\assembly_instances\extrusion")
panel_6 = Panel("voronoi_S1_03-14-2019_w_layer.json")

number_slider = Slider(100, range=0..100)
concatenate = Concatenate(Fragment_A=panel_5, A="\", Fragment_B="topopt-100_S1_03-14-2019_w_layer.json")
number = Number(number_slider)
wirecleaner = WireCleaner(on=Button(), wire_type=Slider(1, range=0..2))  # -> out, a
# ---------- wirecleaner: Python ----------
from Grasshopper.Kernel import GH_ParamWireDisplay
from Grasshopper.Kernel import GH_RuntimeMessageLevel 

# A dictionary of wire types 
wire_display = {'0':GH_ParamWireDisplay.default, 
                '1':GH_ParamWireDisplay.faint,
                '2':GH_ParamWireDisplay.hidden}

# Get selected components and change the wire display
if on:
    doc = ghenv.Component.OnPingDocument()
    sel_objs = doc.SelectedObjects()
    if not len(sel_objs):
        ghenv.Component.AddRuntimeMessage(GH_RuntimeMessageLevel.Warning, 'Nothing was selected')
    for sel_obj  in sel_objs:
        if hasattr(sel_obj, 'Params'):
            for p in sel_obj.Params.Input:
                p.WireDisplay = wire_display[wire_type]
        else:
                sel_obj.WireDisplay = wire_display[wire_type]
# ---------- end wirecleaner ----------
boolean = Boolean(value_list)
boolean_2 = Boolean(use_subdivided_element)
concatenate_2 = Concatenate(FragmentA="len", FragmentB=division_len)
concatenate_3 = Concatenate(FragmentA="num", FragmentB=division_num)
ghpython_script = GhPythonScript()  # -> out, exist_fix_node_ids; inputs existing_e_ids: list of Int32, all_element_node_ids: tree of Int32, all_fix_node_ids: list of Int32; disabled
# ---------- ghpython_script: Python ----------
from ghpythonlib.treehelpers import list_to_tree, tree_to_list

element_vids = tree_to_list(all_element_node_ids, lambda x : x)
existing_e_ids = existing_e_ids or list(range(len(element_vids)))

existing_node_ids = set()
for e_id, e_tuple in enumerate(element_vids):
    if e_id in existing_e_ids:
        existing_node_ids.update(e_tuple)

print(all_fix_node_ids)

exist_fix_node_ids = [int(v) for v in all_fix_node_ids if v in existing_node_ids]

#existing_elements = datatree[System.Object]()
#for e_id in existing_ids:
#    existing_elements.Add(rg.Line(all_nodes[element_vids[e_id][0]], all_nodes[element_vids[e_id][1]]), ghpath(e_id))
#
#existing_nodes = datatree[System.Object]()
#for n_id in existing_node_ids:
#    existing_nodes.Add(all_nodes[n_id], ghpath(n_id))
# ---------- end ghpython_script ----------
construct_path = ConstructPath(Indices=Slider(64, range=0..132))
number_2 = Number(number_slider)

multiplication = Multiplication(A=Slider(1, range=1..8), B="0.002")
panel_7 = Panel("C:\Users\yijiangh\Documents\pb_ws\conmech\tests\test_data\subdivided")
replace_text = ReplaceText(Text="topopt100_subd_len*.json", Find="*", Replace=multiplication, RecursiveReplace=False)

replace_text_2 = ReplaceText(Text="topopt100_subd_num*.json", Find="*", Replace=Slider(1, range=1..7), RecursiveReplace=False)

panel_8 = Panel(replace_text_2)

concatenate_4 = Concatenate(Fragment_A=panel_7, A="\", Fragment_B=panel_8)
text = Text(concatenate_4)
ghpython_script_2 = GhPythonScript(frame_json_file_path=text, include_sw=Toggle(True), gravity_scale=number, load_transf=Toggle(False))  # -> out, solve_success, element_reaction, node_displacement, fixities_reaction, local_coordinate_frames, compliance; inputs existing_ids: list of Int32, include_sw: Boolean, load_transf: Boolean, parse_full_result: Boolean
# ---------- ghpython_script_2: Python ----------
import rhinoscriptsyntax as rs
import Rhino.Geometry as rg
from Grasshopper import DataTree as datatree
from Grasshopper.Kernel.Data import GH_Path as ghpath
import System
import os
import json

from ghpythonlib.treehelpers import list_to_tree

import scriptcontext as sc
pyconmech = sc.sticky['pyconmech']
#numpy = sc.sticky['numpy']
#numpy.linalg = sc.sticky['numpy.linalg']

sc = pyconmech.frame_analysis.stiffness_checker.StiffnessChecker(json_file_path=frame_json_file_path)
sc.set_loads(include_self_weight=include_sw, gravity_direction=[0,0,-gravity_scale])
success = sc.solve(existing_ids)

print(success)
print(sc.has_stored_result())

if parse_full_result:
    json_data = sc.get_result_data(output_frame_transf=load_transf)
    #json_data = {k.decode('utf8') : v.decode('utf8') if isinstance(v, str) else v \
    #        for k, v in json_data.items()}
    
    print('trans tol : {}, rot_tol : {}'.format(json_data['trans_tol'], json_data['rot_tol']))
    
    nd_tree = datatree[System.Double]()
    er_tree = datatree[System.Double]()
    fr_tree = datatree[System.Double]()
    local_planes = datatree[System.Double]()
    
    for nd_data in json_data['node_displacement']:
        n_id = nd_data['node_id']
        nd_tree.AddRange(list(nd_data['displacement']), ghpath(n_id))
    
    for fr_data in json_data['fixity_reaction']:
        n_id = fr_data['node_id']
        fr_tree.AddRange(list(fr_data['reaction']), ghpath(n_id))
    
    for er_data in json_data['element_reaction']:
        e_id = er_data['element_id']
        er_tree.AddRange(list(er_data['reaction'][0]), ghpath(e_id, 0))
        er_tree.AddRange(list(er_data['reaction'][1]), ghpath(e_id, 1))
        if 'local_to_global_transformation' in er_data:
            e_LG = er_data['local_to_global_transformation']
            for i in range(3):
                for j in range(3):
                    num = e_LG[j][i]
                    local_planes.Add(num, ghpath(e_id, j))
    
    element_reaction = er_tree
    node_displacement = nd_tree
    fixities_reaction = fr_tree
    local_coordinate_frames = local_planes

compliance = sc.get_compliance()
# ---------- end ghpython_script_2 ----------
text_2 = Text(text)
panel_9 = Panel(ghpython_script_2.out)
ghpython_script_3 = GhPythonScript(frame_json_file_path=text_2, scale=Slider(1, range=0..1000))  # -> out, all_nodes, all_elements, simplify(all_element_node_ids), all_fix_node_ids, material_name, E, E_unit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
# ---------- ghpython_script_3: Python ----------
import rhinoscriptsyntax as rs
import Rhino.Geometry as rg
from Grasshopper import DataTree as datatree
from Grasshopper.Kernel.Data import GH_Path as ghpath
import System
import math

from ghpythonlib.treehelpers import list_to_tree, tree_to_list

import scriptcontext as sc
pyconmech = sc.sticky['pyconmech']
np = sc.sticky['numpy']

def rvector2list(rv):
    return [rv.X, rv.Y, rv.Z]

frame_info = pyconmech.frame_analysis.frame_file_io.read_frame_json(frame_json_file_path, verbose=True)

node_points, element_vids, fix_node_ids, fix_specs, model_type, material_dicts, model_name = frame_info

all_nodes = [rs.CreatePoint(scale*pt[0], scale*pt[1], scale*pt[2]) for pt in node_points]
all_elements = [rg.Line(all_nodes[n1], all_nodes[n2]) for n1, n2 in element_vids]

all_element_node_ids = list_to_tree(element_vids)
all_fix_node_ids = [int(v) for v in fix_node_ids]

material_name = material_dicts[0]['material_name']
E = material_dicts[0]['youngs_modulus']
E_unit = material_dicts[0]['youngs_modulus_unit']

G = material_dicts[0]['shear_modulus']
G_unit = material_dicts[0]['shear_modulus_unit']

if 'tensile_yeild_stress' in material_dicts[0]:
    sigma = material_dicts[0]['tensile_yeild_stress']
    sigma_unit = material_dicts[0]['tensile_yeild_stress_unit']

rho = material_dicts[0]['density']
rho_unit = material_dicts[0]['density_unit']

r = math.sqrt(material_dicts[0]['cross_sec_area'] / math.pi)
r_unit = 'centimeter'

material_dict = material_dicts[0]
# ---------- end ghpython_script_3 ----------
number_3 = Number(ghpython_script_2.compliance)

# ---- group: compliance from conmech
number_4 = Number(flatten(number_3))
data_recorder = DataRecorder(number_4, DataLimit=-10, RecordData=True)
quick_graph = QuickGraph(data_recorder, SortOrder=0)
panel_10 = Panel(data_recorder)

# ----
number_5 = Number(ghpython_script_2.local_coordinate_frames)
panel_11 = Panel(number_3)
cluster = Cluster_4(
    point=ghpython_script_3.all_nodes,
    data_2=ghpython_script_3.material_name,
    curve=ghpython_script_3.all_elements,
    data_3=ghpython_script_3.E,
    data_5=ghpython_script_3.E_unit,
    data_4=ghpython_script_3.G,
    data=ghpython_script_3.G_unit,
    data_7=ghpython_script_3.sigma,
    data_9=ghpython_script_3.sigma_unit,
    data_8=ghpython_script_3.rho,
    data_10=ghpython_script_3.rho_unit,
    data_6=ghpython_script_3.r,
    data_11=ghpython_script_3.r_unit,
    number=ghpython_script_3.r)  # -> point_3, curve_3, material, number_3

# ---- group: original grounded nodes
integer = Integer(ghpython_script_3.all_fix_node_ids)
point = Point(cluster.point_3)
list_item = ListItem(List=point, Index=integer, Wrap=True)

# ---- group: original elements
curve = Curve(cluster.curve_3)

# ----
curve_2 = Curve(curve)
stream_filter = StreamFilter(Gate=boolean_2, Stream1=curve_2)
stream_gate = StreamGate(Stream=stream_filter, Gate=boolean)  # -> Target0, Target1
stream_filter_2 = StreamFilter(Gate=boolean_2, Stream1=curve)
divide_distance = DivideDistance(Curve=stream_gate.Target1, Distance=division_len)  # -> simplify(Points), Tangents, Parameters
divide_curve = DivideCurve(Curve=reparameterize(stream_gate.Target0), Count=division_num, Kinks=False)  # -> simplify(Points), Tangents, Parameters
end_points = EndPoints(Curve=stream_filter_2)  # -> Start, End
stream_filter_3 = StreamFilter(Gate=boolean, Stream0=divide_curve.Points, Stream1=divide_distance.Points)
point_2 = Point(simplify(graft(end_points.Start)))
point_3 = Point(simplify(graft(end_points.End)))
merge = Merge(Data1=stream_filter_3, Data2=point_3, Data3=point_2)  # -> simplify(Result)
create_set = CreateSet(List=merge)  # -> Set, Map
polyline = PolyLine(Vertices=create_set.Set, Closed=False)
explode = Explode(Curve=polyline, Recursive=True)  # -> simplify(Segments), Vertices
tree_branch = TreeBranch(Tree=explode.Segments, Path=construct_path, MaintainPaths=True)
list_item_2 = ListItem(List=tree_branch, Index=Slider(0, range=0..20), Wrap=False)
curve_3 = Curve(flatten(explode.Segments))
length = Length(Curve=curve_3)
length_2 = Length(Curve=curve_3)
sort_list = SortList(Keys=length)  # -> Keys, ValuesValuesA
sort_list_2 = SortList(Keys=length_2)  # -> Keys, ValuesValuesA
list_item_3 = ListItem(List=sort_list.Keys, Index=0, Wrap=True)  # -> Item1, Item, Item1_2
list_item_4 = ListItem(List=sort_list_2.Keys, Index=0, Wrap=True)
panel_12 = Panel([list_item_3.Item, list_item_3.Item1])
division = Division(A=list_item_4, B=2)
remove_duplicate_lines_karamba3d = RemoveDuplicateLinesKaramba3D(Line=curve_3, LimitDistance=division)  # -> OutLine, Info, Indexes
end_points_2 = EndPoints(Curve=remove_duplicate_lines_karamba3d.OutLine)  # -> Start, End
point_4 = Point(flatten([end_points_2.Start, end_points_2.End]))
remove_duplicate_points_karamba3d = RemoveDuplicatePointsKaramba3D(Point=point_4, LimitDistance=division)  # -> OutPoint, Info, Indexes

curve_4 = Curve(remove_duplicate_lines_karamba3d.OutLine)
point_5 = Point(remove_duplicate_points_karamba3d.OutPoint)
c_script = CSharpScript(pts=point_5, target_pts=list_item, dist_tol=division)  # -> out, A; inputs pts: list of Point3d, target_pts: list of Point3d, dist_tol: Double
# ---------- c_script: C# usings ----------
using System.IO;
using System.Linq;
using System.Data;
using System.Drawing;
using System.Reflection;
using System.Windows.Forms;
using System.Xml;
using System.Xml.Linq;
using System.Runtime.InteropServices;

using Rhino.DocObjects;
using Rhino.Collections;
using GH_IO;
using GH_IO.Serialization;
# ---------- c_script: C# ----------
    List<int> id = new List<int>();

    foreach(Point3d t_pt in target_pts)
    {
      for(int i = 0; i < pts.Count(); i++)
      {
        if(t_pt.DistanceTo(pts[i]) < dist_tol)
        {
          id.Add(i);
          break;
        }
      }
    }

    A = id;
# ---------- end c_script ----------
list_item_5 = ListItem(List=point_5, Index=c_script.A, Wrap=True)

point_6 = Point(point_5)
point_7 = Point(point)
stream_filter_4 = StreamFilter(Gate=use_subdivided_element, Stream0=curve, Stream1=curve_4)
stream_filter_5 = StreamFilter(Gate=use_subdivided_element, Stream0=list_item, Stream1=list_item_5)
stream_filter_6 = StreamFilter(Gate=use_subdivided_element, Stream0=point_7, Stream1=point_6)
point_8 = Point(stream_filter_6)
curve_5 = Curve(stream_filter_4)
point_9 = Point(stream_filter_5)
cluster_2 = Cluster_5(curve=curve_5)
number_6 = Number(cluster_2)
number_7 = Number(cluster.number_3)
cluster_3 = Cluster_2(
    number=number_2,
    point=point_9,
    line=curve_5,
    point_2=point_8,
    number_2=number_6,
    material=cluster.material,
    thickness=number_7)  # -> model_karamba3d_2, result, data, result_2, keys, elastic_energy_knm, calculated_model

# ---- group: compliance from karamba
number_8 = Number(flatten(cluster_3.elastic_energy_knm))
analyze_karamba3d = AnalyzeKaramba3D(Model=cluster_3.model_karamba3d_2)  # -> CalculatedModel, MaximumDisplacement_cm, ResultingForceOfGravity_kN, ElasticEnergy_kNm
data_recorder_2 = DataRecorder(number_8, DataLimit=-10, RecordData=True)
quick_graph_2 = QuickGraph(data_recorder_2, SortOrder=0)
panel_13 = Panel(data_recorder_2)

# ---- group: relative value
division_2 = Division(A=data_recorder_2, B=data_recorder)
quick_graph_3 = QuickGraph(division_2, SortOrder=0)

# ----
panel_14 = Panel(division_2)
stream_filter_7 = StreamFilter(Gate=show_karamba_viz, Stream1=cluster_3.calculated_model)

# ---- group: export frame json
stream_filter_8 = StreamFilter(Gate=value_list, Stream0=concatenate_3, Stream1=concatenate_2)
panel_15 = Panel("C:\Users\yijiangh\Documents\pb_ws\conmech\tests\test_data\subdivided")
concatenate_5 = Concatenate(Fragment_A="topopt100_subd_", B=stream_filter_8, Fragment_B=".json")
panel_16 = Panel(concatenate_5)
concatenate_6 = Concatenate(Fragment_A=panel_15, A="\", Fragment_B=concatenate_5)
data = Data(ghpython_script_3.material_dicts)
curve_6 = Curve(reparameterize(curve_4))
integer_2 = Integer(c_script.A)
point_10 = Point(point_5)
list_item_6 = ListItem(List=data, Index=0, Wrap=True)
ghpython_script_4 = GhPythonScript(
    save=save_frame_json,
    frame_json_file_path=concatenate_6,
    material_dict=list_item_6,
    nodes=point_10,
    elements=curve_6,
    fixed_node_ids=integer_2,
    indent=Slider(2, range=0..10))  # -> out, e_id_tree; inputs nodes: list of Point3d, elements: list of Curve, fixed_node_ids: list of Int32, indent: Int32
# ---------- ghpython_script_4: Python ----------
import rhinoscriptsyntax as rs
import Grasshopper.DataTree as datatree
import Grasshopper.Kernel.Data.GH_Path as ghpath
import System

from ghpythonlib.treehelpers import list_to_tree, tree_to_list

import scriptcontext as sc
pyconmech = sc.sticky['pyconmech']
np = sc.sticky['numpy']

def rvector2list(rv):
    return [rv.X, rv.Y, rv.Z]

nodes_list = [rvector2list(n) for n in nodes]

tol = 1e-8
e_ids = []
for i, e in enumerate(elements):
    e_id_pair = set()
    for pt_id, pt in enumerate(nodes):
        if e.PointAt(0).DistanceTo(pt) < tol:
            e_id_pair.add(pt_id)
        if e.PointAt(1).DistanceTo(pt) < tol:
            e_id_pair.add(pt_id)
    assert len(e_id_pair) == 2
    e_ids.append(tuple(e_id_pair))

if save:
    material_dict_decoded = {k.decode('utf8') : v.decode('utf8') if isinstance(v, str) else v \
        for k, v in material_dict[0].items()}
    
    frame_info = pyconmech.frame_analysis.frame_file_io.write_frame_json(\
        frame_json_file_path, nodes_list, e_ids, fixed_node_ids, [material_dict_decoded] * len(e_ids), indent=indent, 
            unif_cross_sec=True, unif_material=True)

e_id_tree = list_to_tree(e_ids, [])
# ---------- end ghpython_script_4 ----------

# ----
model_view_karamba3d = ModelViewKaramba3D(Model=stream_filter_7, LoadCaseFactorsForLinearSuperposition=1, IndexOfVisibleLoadcase=-1)  # -> Model, DeformedMesh, DeformedAxes, DeformedModel
cluster_4 = Cluster_3(
    number_8=cluster_3.data,
    number_7=ghpython_script_2.node_displacement,
    number_3=cluster_3.result,
    number_4=ghpython_script_2.element_reaction,
    number_2=cluster_3.result_2,
    number=ghpython_script_2.fixities_reaction)
beam_view_karamba3d = BeamViewKaramba3D(Model=model_view_karamba3d.Model)  # -> Model, MeshesOfRenderedBeams, DeformedBeamAxes, LegendColors, LegendTags
curve_7 = Curve(beam_view_karamba3d.DeformedBeamAxes)
legend = Legend(Colour=beam_view_karamba3d.LegendColors, Tags=beam_view_karamba3d.LegendTags, LegendType=1)
integer_3 = Integer(simplify(ghpython_script_4.e_id_tree))
list_item_7 = ListItem(List=point_10, Index=integer_3, Wrap=True)
list_item_8 = ListItem(List=point_10, Index=integer_2, Wrap=True)
list_item_9 = ListItem(List=list_item_7, Index=0, Wrap=True)  # -> Item, Item1
line = Line(StartPoint=list_item_9.Item, EndPoint=list_item_9.Item1)

# ==== cluster Cluster_2
number = ClusterInput()
point = ClusterInput()
material = ClusterInput()
thickness = ClusterInput()
number_2 = ClusterInput()
line = ClusterInput()
point_2 = ClusterInput()
number_3 = Number(number)
point_3 = Point(point)
# Gravity load
unit_z = UnitZ(Factor=number_3)
# Supports
support_karamba3d = SupportKaramba3D(PosInd=point_3, menu=[buttons(on, on, on, on, on, on)])
negative = Negative(Value=unit_z)
multiplication = Multiplication(A=thickness, B="2")
loads_karamba3d = LoadsKaramba3D(Vector=negative, LCase=0, mode="Gravity")
support_karamba3d_2 = SupportKaramba3D(support_karamba3d)
cross_section_karamba3d = CrossSectionKaramba3D(
    FamilyNameOfCrossSection="DefaultCroSec",
    Material=material,
    Diameter_cm=multiplication,
    WallThickness_cm=thickness,
    mode="Circular Hollow")
point_4 = Point(point_2)
number_4 = Number(number_2)
line_to_beam_karamba3d = LineToBeamKaramba3D(
    Line=line,
    CrossSection=cross_section_karamba3d,
    Points=point_4,
    New=Toggle(False),
    Remove=Toggle(False),
    LimitDistance_m=number_4,
    Bending=Toggle(True))  # -> Element, Points, Info
load_karamba3d = LoadKaramba3D(loads_karamba3d)
assemble_model_karamba3d = AssembleModelKaramba3D(Elem=line_to_beam_karamba3d.Element, Support=support_karamba3d_2, Load=load_karamba3d, LimitDistance_m=number_4)  # -> Model, Info, Mass_kg, CenterOfGravity
analyze_karamba3d = AnalyzeKaramba3D(Model=assemble_model_karamba3d.Model)  # -> CalculatedModel, MaximumDisplacement_cm, ResultingForceOfGravity_kN, ElasticEnergy_kNm
reaction_forces_karamba3d = ReactionForcesKaramba3D(AnalyzedModel=analyze_karamba3d.CalculatedModel, LoadCase=0)  # -> AnalyzedModel, ReactionForces_kN, ReactionMoments_kNm, SupportPosition, SumOfReactionForces_kN, SumOfReactionMoments_kNm
nodal_displacements_karamba3d = NodalDisplacementsKaramba3D(AnalyzedModel=analyze_karamba3d.CalculatedModel, LoadCase=0)  # -> AnalyzedModel, NodalTranslations_m, NodalRotations_rad
beam_forces_karamba3d = BeamForcesKaramba3D(
    AnalyzedModel=analyze_karamba3d.CalculatedModel,
    LCase=-1,
    MaximumDistanceBetweenResults_m=-1,
    NumberOfResultsPerBeamElement=2)  # -> AnalyzedModel, NormalForce_kN, ShearForceVz_kN, ShearForceVy_kN, BendingMomentMt_kNm, BendingMomentMy_kNm, BendingMomentMz_kNm
deconstruct = Deconstruct(Point=simplify(graft(reaction_forces_karamba3d.ReactionForces_kN)))  # -> XComponent, YComponent, ZComponent
deconstruct_2 = Deconstruct(Point=simplify(graft(reaction_forces_karamba3d.ReactionMoments_kNm)))  # -> XComponent, YComponent, ZComponent
merge = Merge(
    Data1=simplify(graft(nodal_displacements_karamba3d.NodalTranslations_m)),
    Data2=simplify(graft(nodal_displacements_karamba3d.NodalRotations_rad)))
evaluate = Evaluate(Expression="format(\"{0:E} {1:E} {2:E}\",x.x,x.y,x.z)", x=merge)
merge_2 = Merge(
    Data1=deconstruct.XComponent,
    Data2=deconstruct.YComponent,
    Data3=deconstruct.ZComponent,
    Data4=deconstruct_2.XComponent,
    Data5=deconstruct_2.YComponent,
    Data6=deconstruct_2.ZComponent)
merge_3 = Merge(
    Data1=graft(beam_forces_karamba3d.NormalForce_kN),
    Data2=graft(beam_forces_karamba3d.ShearForceVz_kN),
    Data3=graft(beam_forces_karamba3d.ShearForceVy_kN),
    Data4=graft(beam_forces_karamba3d.BendingMomentMt_kNm),
    Data5=graft(beam_forces_karamba3d.BendingMomentMy_kNm),
    Data6=graft(beam_forces_karamba3d.BendingMomentMz_kNm))  # -> simplify(Result)
evaluate_2 = Evaluate(Expression="format(\"{0:E}\",x)", x=merge_2)
cluster = Cluster(text=evaluate, separators=" ")
evaluate_3 = Evaluate(Expression="format(\"{0:E}\",x)", x=merge_3)
reaction_force_kn_reaction_moment_kn_m = Panel(merge_2)
shift_paths = ShiftPaths(Data=cluster, Offset=-1)
list_item = ListItem(List=shift_paths, Index=0, Wrap=True)  # -> Item, Item1, Item2
froce_kn_moment_kn_m = Panel(merge_3)
nodal_displacement_m_rad = Panel(shift_paths)
merge_4 = Merge(Data1=list_item.Item, Data2=list_item.Item1, Data3=list_item.Item2)
number_5 = Number(merge_4)
square = Square(Value=number_5)
mass_addition = MassAddition(Input=square)  # -> Result, PartialResults
model_karamba3d = ModelKaramba3D(assemble_model_karamba3d.Model)
square_root = SquareRoot(Value=mass_addition.Result)  # -> flatten(Result)
sort_list = SortList(Keys=square_root)  # -> reverse(Keys), ValuesValuesA
model_karamba3d_2 = ClusterOutput(model_karamba3d)
elastic_energy_knm = ClusterOutput(analyze_karamba3d.ElasticEnergy_kNm)
calculated_model = ClusterOutput(analyze_karamba3d.CalculatedModel)
result = ClusterOutput(merge_3)
data = ClusterOutput(shift_paths)
result_2 = ClusterOutput(merge_2)
keys = ClusterOutput(sort_list.Keys)

# ==== cluster Cluster_3
number = ClusterInput()
number_2 = ClusterInput()
number_3 = ClusterInput()
number_4 = ClusterInput()
number_5 = Number(number)
number_6 = Number(number_2)
number_7 = ClusterInput()
number_8 = ClusterInput()

number_9 = Number(number_3)
number_10 = Number(number_4)
internal_froce_kn_moment_kn_m = Panel(number_9)
panel = Panel(number_10)

match_tree = MatchTree(Tree=number_5, Guide=number_6)

number_11 = Number(number_7)
number_12 = Number(number_8)
nodal_displacement_m_rad = Panel(number_12)
panel_2 = Panel(number_11)

reaction_force_kn_reaction_moment_kn_m = Panel(number_6)
panel_3 = Panel(match_tree)
absolute = Absolute(Value=number_12)
subtraction = Subtraction(A=number_12, B=number_11)
split_tree = SplitTree(Data=number_9, Masks=flatten("{*;0}"))  # -> Positive, Negative
split_tree_2 = SplitTree(Data=number_10, Masks=flatten("{*;0}"))  # -> Positive, Negative
absolute_2 = Absolute(Value=subtraction)
number_13 = Number(split_tree.Positive)
division = Division(A=absolute_2, B=absolute)

subtraction_2 = Subtraction(A=number_6, B=match_tree)
absolute_3 = Absolute(Value=number_6)
absolute_4 = Absolute(Value=subtraction_2)
division_2 = Division(A=absolute_4, B=absolute_3)
panel_4 = Panel(division_2)
list_item = ListItem(List=division_2, Index=0, Wrap=True)  # -> flatten(Item), flatten(Item1), flatten(Item2), flatten(Item3), flatten(Item4), flatten(Item5)
X = BarGraph(list_item.Item, BarColor=RGB(255, 0, 90))
bar_graph = BarGraph(list_item.Item1, BarColor=RGB(255, 0, 90))
bar_graph_2 = BarGraph(list_item.Item2, BarColor=RGB(255, 0, 90))
bar_graph_3 = BarGraph(list_item.Item4, BarColor=RGB(255, 0, 90))
bar_graph_4 = BarGraph(list_item.Item5, BarColor=RGB(255, 0, 90))
bar_graph_5 = BarGraph(list_item.Item3, BarColor=RGB(255, 0, 90))
number_14 = Number(split_tree.Negative)

list_item_2 = ListItem(List=division, Index=0, Wrap=True)  # -> flatten(Item), flatten(Item1), flatten(Item2), flatten(Item3), flatten(Item4), flatten(Item5)
panel_5 = Panel(division)

subtraction_3 = Subtraction(A=number_13, B=split_tree_2.Positive)
absolute_5 = Absolute(Value=number_13)
absolute_6 = Absolute(Value=subtraction_3)
division_3 = Division(A=absolute_6, B=absolute_5)
panel_6 = Panel(division_3)
list_item_3 = ListItem(List=division_3, Index=0, Wrap=True)  # -> flatten(Item), flatten(Item1), flatten(Item2), flatten(Item3), flatten(Item4), flatten(Item5)
X_2 = BarGraph(list_item_3.Item, BarColor=RGB(255, 0, 90))
bar_graph_6 = BarGraph(list_item_3.Item1, BarColor=RGB(255, 0, 90))
bar_graph_7 = BarGraph(list_item_3.Item2, BarColor=RGB(255, 0, 90))
bar_graph_8 = BarGraph(list_item_3.Item4, BarColor=RGB(255, 0, 90))
bar_graph_9 = BarGraph(list_item_3.Item5, BarColor=RGB(255, 0, 90))
bar_graph_10 = BarGraph(list_item_3.Item3, BarColor=RGB(255, 0, 90))

X_3 = BarGraph(list_item_2.Item, BarColor=RGB(255, 0, 90))
bar_graph_11 = BarGraph(list_item_2.Item1, BarColor=RGB(255, 0, 90))
bar_graph_12 = BarGraph(list_item_2.Item2, BarColor=RGB(255, 0, 90))
bar_graph_13 = BarGraph(list_item_2.Item4, BarColor=RGB(255, 0, 90))
bar_graph_14 = BarGraph(list_item_2.Item5, BarColor=RGB(255, 0, 90))
bar_graph_15 = BarGraph(list_item_2.Item3, BarColor=RGB(255, 0, 90))

number_15 = Number(split_tree.Negative)

subtraction_4 = Subtraction(A=number_15, B=split_tree_2.Negative)
absolute_7 = Absolute(Value=number_15)
absolute_8 = Absolute(Value=subtraction_4)
division_4 = Division(A=absolute_8, B=absolute_7)
panel_7 = Panel(division_4)
list_item_4 = ListItem(List=division_4, Index=0, Wrap=True)  # -> flatten(Item), flatten(Item1), flatten(Item2), flatten(Item3), flatten(Item4), flatten(Item5)
X_4 = BarGraph(list_item_4.Item, BarColor=RGB(255, 0, 90))
bar_graph_16 = BarGraph(list_item_4.Item1, BarColor=RGB(255, 0, 90))
bar_graph_17 = BarGraph(list_item_4.Item2, BarColor=RGB(255, 0, 90))
bar_graph_18 = BarGraph(list_item_4.Item4, BarColor=RGB(255, 0, 90))
bar_graph_19 = BarGraph(list_item_4.Item5, BarColor=RGB(255, 0, 90))
bar_graph_20 = BarGraph(list_item_4.Item3, BarColor=RGB(255, 0, 90))

# ==== cluster Cluster_4
data = ClusterInput()
data_2 = ClusterInput()
data_3 = ClusterInput()
data_4 = ClusterInput()
data_5 = ClusterInput()
data_6 = ClusterInput()
data_7 = ClusterInput()
data_8 = ClusterInput()
data_9 = ClusterInput()
data_10 = ClusterInput()
data_11 = ClusterInput()
number = ClusterInput()
data_12 = Data(data)
data_13 = Data(data_2)
data_14 = Data(data_3)
data_15 = Data(data_4)
data_16 = Data(data_5)
data_17 = Data(data_6)
data_18 = Data(data_7)
data_19 = Data(data_8)
data_20 = Data(data_9)
data_21 = Data(data_10)
data_22 = Data(data_11)
number_2 = Number(number)
panel = Panel(data_14)
panel_2 = Panel(data_15)
panel_3 = Panel(data_16)
panel_4 = Panel(data_22)
panel_5 = Panel(data_21)
panel_6 = Panel(data_13)
panel_7 = Panel(data_12)
panel_8 = Panel(data_18)
panel_9 = Panel(data_19)
panel_10 = Panel(data_20)
panel_11 = Panel(data_17)
number_3 = ClusterOutput(number_2)
material_properties_karamba3d = MaterialPropertiesKaramba3D(
    FamilyOfMaterial=panel_6,
    Name="0",
    YoungsModulus_kN_cm2=panel,
    InPlaneShearModulus_kN_cm2=panel_2,
    TransverseShearModulus_kN_cm2=panel_2,
    SpecificWeight_kN_m3=panel_9,
    CoefficientOfThermalExpansion_1_C=1e-05,
    YieldStrength_kN_cm2=Slider(23.5, range=0..100),
    mode="Isotrop")
point = ClusterInput()
curve = ClusterInput()
point_2 = Point(point)
curve_2 = Curve(curve)
point_3 = ClusterOutput(point_2)
curve_3 = ClusterOutput(curve_2)
material = ClusterOutput(material_properties_karamba3d)
panel_12 = Panel(material_properties_karamba3d)

# ==== cluster Cluster_5
curve = ClusterInput()
length = Length(Curve=curve)
sort_list = SortList(Keys=length)  # -> Keys, ValuesValuesA
list_item = ListItem(List=sort_list.Keys, Index=0, Wrap=True)
division = Division(A=list_item, B=2)
result = ClusterOutput(division)

# ==== cluster Cluster
text = ClusterInput()
separators = ClusterInput()
text_split = TextSplit(Text=text, Separators=separators)
number = Number(text_split)
clean_tree = CleanTree(RemoveNulls=True, RemoveInvalid=True, RemoveEmpty=False, Tree=number)
tree = ClusterOutput(clean_tree)
