# Grasshopper definition stiffness_checker_compare_karamba_ghpythonremote.ghx (Grasshopper 1.0.7)
# plug-ins: karambaGH

# ---- group: Import remote python modules
panel = Panel("C:\Users\yijiangh\Software\Miniconda\envs\rhinoremote\python.exe")
python = PythonScript()  # -> rhino_doc_dir
# ---------- python: Python ----------
import scriptcontext as sc
from os import path

rhino_doc_dir = path.abspath(path.dirname(sc.doc.Path))
# ---------- end python ----------
panel_2 = Panel(python)
panel_3 = Panel("""numpy
numpy.linalg
pyconmech""")
list = ValueList({"CRITICAL", "ERROR", "WARNING", "INFO", "DEBUG", "NOTSET"}, selected="DEBUG")
ghpythonremote = GHPythonRemote(location=panel, run=Toggle(True), modules=panel_3, log_level=list, working_dir=panel_2)  # -> out, linked_modules, rpy; inputs run: Boolean, modules: list
# ---------- ghpythonremote: Python ----------
import sys
import scriptcontext
import logging
import inspect
import ghpythonremote
from ghpythonremote.connectors import GrasshopperToPythonRemote
from os import path
from time import sleep

local_log_level = getattr(logging, log_level, logging.WARNING)
logger = logging.getLogger('ghpythonremote')
logger.setLevel(local_log_level)
ch = logging.StreamHandler()
ch.setLevel(local_log_level)
formatter = logging.Formatter('%(levelname)s: %(name)s:\n%(message)s')
ch.setFormatter(formatter)
logger.handlers = []
logger.addHandler(ch)
logger = logging.getLogger('ghpythonremote.GH_to_python')

ROOT = path.abspath(path.dirname(inspect.getfile(ghpythonremote)))
rpyc_server_py = path.join(ROOT, 'pythonservice.py')

# Set connection to CLOSED if this is the first run
# and initialize set of linked modules
try:
    remote_python_status
except NameError:
    remote_python_status = 'CLOSED'
    lkd_modules = set()

# Wait for connection to connect or terminate
timer = 0
while remote_python_status == 'CONNECTING' or remote_python_status == 'CLOSING':
    sleep(1)
    timer += 1
    if timer == 10:
        try:
            gh2py_manager.__exit__(*sys.exc_info())
        except Exception:
            pass
        remote_python_status = 'CLOSED'
        lkd_modules = set()
        raise RuntimeError("Connection left in an inconsistent state and not returning. Reset everything.")

if run:
    if not remote_python_status == 'OPEN':
        remote_python_status = 'CONNECTING'
        gh2py_manager = GrasshopperToPythonRemote(rpyc_server_py, location=location, timeout=10,
                                                  port=None, log_level=log_level, working_dir=working_dir)
        gh2py = gh2py_manager.__enter__()
        remote_python_status = 'OPEN'

    # Stuff that we can reach
    rpymod = gh2py.py_remote_modules  # A getter function for a named python module
    rpy = gh2py.connection  # Represents the remote instance root object
    scriptcontext.sticky['rpy'] = rpy
    # Add modules
    for mod in modules:
        try:
            scriptcontext.sticky[mod] = rpymod(mod)
            lkd_modules.add(mod)
        except ImportError:
            gh2py_manager.__exit__(*sys.exc_info())
            raise

elif not remote_python_status == 'CLOSED':
    remote_python_status = 'CLOSING'
    # Remove linked modules
    for mod in lkd_modules:
        del scriptcontext.sticky[mod]
    del scriptcontext.sticky['rpy']
    gh2py_manager.__exit__(*sys.exc_info())
    lkd_modules = set()
    remote_python_status = 'CLOSED'

# Change variable name because ghpython resets outputs to None before each run
linked_modules = lkd_modules

logger.info('GH to python connection is {}'.format(remote_python_status))
# ---------- end ghpythonremote ----------
python_2 = PythonScript(module_names=ghpythonremote.linked_modules)  # -> import_statements; inputs module_names: list
# ---------- python_2: Python ----------
import_statements = ["import scriptcontext as sc"]
for module_name in module_names:
    import_statements.append("{0} = sc.sticky['{0}']".format(module_name))

if len(module_names) == 0:
    import_statements = []
# ---------- end python_2 ----------
panel_4 = Panel(python_2)

# ----
panel_5 = Panel("C:\Users\yijiangh\Documents\pb_ws\pb-construction\assembly_instances\extrusion")
number_slider = Slider(100, range=0..100)
number = Number(number_slider)
concatenate = Concatenate(Fragment_A=panel_5, A="\", Fragment_B="voronoi_S1_03-14-2019_w_layer.json")
text = Text(concatenate)
ghpython_script = GhPythonScript(frame_json_file_path=text, scale=Slider(1, range=0..1000))  # -> out, all_nodes, all_elements, simplify(all_element_node_ids), all_fix_node_ids, material_name, E, E_unit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
# ---------- ghpython_script: Python ----------
import rhinoscriptsyntax as rs
import Rhino.Geometry as rg
from Grasshopper import DataTree as datatree
from Grasshopper.Kernel.Data import GH_Path as ghpath
import System
import math

from ghpythonlib.treehelpers import list_to_tree, tree_to_list

import scriptcontext as sc
pyconmech = sc.sticky['pyconmech']
np = sc.sticky['numpy']

def rvector2list(rv):
    return [rv.X, rv.Y, rv.Z]

frame_info = pyconmech.frame_analysis.frame_file_io.read_frame_json(frame_json_file_path, verbose=True)

node_points, element_vids, fix_node_ids, fix_specs, model_type, material_dicts, model_name = frame_info

all_nodes = [rs.CreatePoint(scale*pt[0], scale*pt[1], scale*pt[2]) for pt in node_points]
all_elements = [rg.Line(all_nodes[n1], all_nodes[n2]) for n1, n2 in element_vids]

all_element_node_ids = list_to_tree(element_vids)
all_fix_node_ids = [int(v) for v in fix_node_ids]

material_name = material_dicts[0]['material_name']
E = material_dicts[0]['youngs_modulus']
E_unit = material_dicts[0]['youngs_modulus_unit']

G = material_dicts[0]['shear_modulus']
G_unit = material_dicts[0]['shear_modulus_unit']

if 'tensile_yeild_stress' in material_dicts[0]:
    sigma = material_dicts[0]['tensile_yeild_stress']
    sigma_unit = material_dicts[0]['tensile_yeild_stress_unit']

rho = material_dicts[0]['density']
rho_unit = material_dicts[0]['density_unit']

r = math.sqrt(material_dicts[0]['cross_sec_area'] / math.pi)
r_unit = 'centimeter'
# ---------- end ghpython_script ----------
number_2 = Number(2.846569754e-07)
data = Data(ghpython_script.G_unit)
data_2 = Data(ghpython_script.material_name)
data_3 = Data(ghpython_script.E)
data_4 = Data(ghpython_script.G)
data_5 = Data(ghpython_script.E_unit)
data_6 = Data(ghpython_script.r)
data_7 = Data(ghpython_script.sigma)
data_8 = Data(ghpython_script.rho)
data_9 = Data(ghpython_script.sigma_unit)
data_10 = Data(ghpython_script.rho_unit)
data_11 = Data(ghpython_script.r_unit)
panel_6 = Panel(data_3)
panel_7 = Panel(data_4)
panel_8 = Panel(data_5)
panel_9 = Panel(data_11)
panel_10 = Panel(data_10)
panel_11 = Panel(data_2)
panel_12 = Panel(data)
panel_13 = Panel(data_7)
panel_14 = Panel(data_8)
panel_15 = Panel(data_9)
panel_16 = Panel(data_6)
panel_17 = Panel(number_2)
curve = Curve(ghpython_script.all_elements)
curve_2 = Curve(curve)
list_length = ListLength(List=curve_2)
series = Series(Start=0, Step=1, Count=list_length)
integer = Integer(series)
ghpython_script_2 = GhPythonScript(frame_json_file_path=concatenate, existing_ids=integer, include_sw=Toggle(True), gravity_scale=number)  # -> out, solve_success, element_reaction, node_displacement, fixities_reaction, local_coordinate_frames, compliance; inputs existing_ids: list of Int32, include_sw: Boolean
# ---------- ghpython_script_2: Python ----------
import rhinoscriptsyntax as rs
import Rhino.Geometry as rg
from Grasshopper import DataTree as datatree
from Grasshopper.Kernel.Data import GH_Path as ghpath
import System
import os
import json

from ghpythonlib.treehelpers import list_to_tree

import scriptcontext as sc
pyconmech = sc.sticky['pyconmech']
#numpy = sc.sticky['numpy']
#numpy.linalg = sc.sticky['numpy.linalg']

sc = pyconmech.frame_analysis.stiffness_checker.StiffnessChecker(json_file_path=frame_json_file_path)
sc.set_loads(include_self_weight=include_sw, gravity_direction=[0,0,-gravity_scale])
sc.solve(existing_ids)

json_data = sc.get_result_data(output_frame_transf=True)

print('trans tol : {}, rot_tol : {}'.format(json_data['trans_tol'], json_data['rot_tol']))

nd_tree = datatree[System.Double]()
er_tree = datatree[System.Double]()
fr_tree = datatree[System.Double]()
local_planes = datatree[System.Double]()

for nd_data in json_data['node_displacement']:
    n_id = nd_data['node_id']
    nd_tree.AddRange(list(nd_data['displacement']), ghpath(n_id))

for fr_data in json_data['fixity_reaction']:
    n_id = fr_data['node_id']
    fr_tree.AddRange(list(fr_data['reaction']), ghpath(n_id))

for er_data in json_data['element_reaction']:
    e_id = er_data['element_id']
    er_tree.AddRange(list(er_data['reaction'][0]), ghpath(e_id, 0))
    er_tree.AddRange(list(er_data['reaction'][1]), ghpath(e_id, 1))
    e_LG = er_data['local_to_global_transformation']
    for i in range(3):
        for j in range(3):
            num = e_LG[j][i]
            local_planes.Add(num, ghpath(e_id, j))

element_reaction = er_tree
node_displacement = nd_tree
fixities_reaction = fr_tree
local_coordinate_frames = local_planes
compliance = sc.get_compliance()
# ---------- end ghpython_script_2 ----------
integer_2 = Integer(integer)
ghpython_script_3 = GhPythonScript(
    existing_e_ids=integer_2,
    all_element_node_ids=ghpython_script.all_element_node_ids,
    all_fix_node_ids=ghpython_script.all_fix_node_ids)  # -> out, exist_fix_node_ids; inputs existing_e_ids: list of Int32, all_element_node_ids: tree of Int32, all_fix_node_ids: list of Int32
# ---------- ghpython_script_3: Python ----------
from ghpythonlib.treehelpers import list_to_tree, tree_to_list

element_vids = tree_to_list(all_element_node_ids, lambda x : x)
existing_e_ids = existing_e_ids or list(range(len(element_vids)))

existing_node_ids = set()
for e_id, e_tuple in enumerate(element_vids):
    if e_id in existing_e_ids:
        existing_node_ids.update(e_tuple)

print(all_fix_node_ids)

exist_fix_node_ids = [int(v) for v in all_fix_node_ids if v in existing_node_ids]

#existing_elements = datatree[System.Object]()
#for e_id in existing_ids:
#    existing_elements.Add(rg.Line(all_nodes[element_vids[e_id][0]], all_nodes[element_vids[e_id][1]]), ghpath(e_id))
#
#existing_nodes = datatree[System.Object]()
#for n_id in existing_node_ids:
#    existing_nodes.Add(all_nodes[n_id], ghpath(n_id))
# ---------- end ghpython_script_3 ----------
panel_18 = Panel(ghpython_script_2.out)
number_3 = Number(ghpython_script_2.compliance)
number_4 = Number(ghpython_script_2.local_coordinate_frames)
panel_19 = Panel(number_3)
point = Point(ghpython_script.all_nodes)
panel_20 = Panel(ghpython_script_3.exist_fix_node_ids)
list_item = ListItem(List=curve, Index=integer_2, Wrap=True)
material_properties_karamba3d = MaterialPropertiesKaramba3D(
    FamilyOfMaterial=panel_11,
    Name="0",
    YoungsModulus_kN_cm2=panel_6,
    InPlaneShearModulus_kN_cm2=panel_7,
    TransverseShearModulus_kN_cm2=panel_7,
    SpecificWeight_kN_m3=panel_14,
    CoefficientOfThermalExpansion_1_C=1e-05,
    YieldStrength_kN_cm2=Slider(23.5, range=0..100),
    mode="Isotrop")
material_properties_karamba3d_2 = MaterialPropertiesKaramba3D(
    FamilyOfMaterial="Steel",
    Name="S235",
    YoungsModulus_kN_cm2=21000,
    InPlaneShearModulus_kN_cm2=8076,
    TransverseShearModulus_kN_cm2=8076,
    SpecificWeight_kN_m3=78.5,
    CoefficientOfThermalExpansion_1_C=1e-05,
    YieldStrength_kN_cm2=23.5,
    mode="Isotrop")
curve_3 = Curve(list_item)
end_points = EndPoints(Curve=curve_3)  # -> Start, End
remove_duplicate_points_karamba3d = RemoveDuplicatePointsKaramba3D(Point=[end_points.Start, end_points.End], LimitDistance=0.005)  # -> OutPoint, Info, Indexes
panel_21 = Panel(material_properties_karamba3d)
panel_22 = Panel(material_properties_karamba3d_2)
point_2 = Point(remove_duplicate_points_karamba3d.OutPoint)
integer_3 = Integer(ghpython_script_3.exist_fix_node_ids)

# ----
# all nodes
point_3 = Point(point)

list_item_2 = ListItem(List=point_3, Index=integer_3, Wrap=True)

# ----
# existing nodes
point_4 = Point(flatten(point_2))

# ----
# existing elements
curve_4 = Curve(flatten(curve_3))

# ----
# grounded nodes
point_5 = Point(list_item_2)

cluster = Cluster_3(model=curve_4)
point_6 = Point(point_4)
cluster_2 = Cluster_4(pts=point_6, target_pts=point_5, list=point_6)
curve_5 = Curve(curve)
point_7 = Point(point)
integer_4 = Integer(ghpython_script.all_fix_node_ids)
list_item_3 = ListItem(List=point_7, Index=integer_4, Wrap=True)
number_5 = Number(number_slider)
number_6 = Number(panel_16)
curve_6 = Curve(curve_4)
curve_7 = Curve(curve_5)
number_7 = Number(panel_16)
cluster_3 = Cluster_2(
    number=number_5,
    point=point_5,
    point_2=point_6,
    line=curve_6,
    material=material_properties_karamba3d,
    thickness=number_6)  # -> result, data, result_2, keys, elastic_energy_knm, calculated_model
number_8 = Number(cluster_3.elastic_energy_knm)
panel_23 = Panel(number_8)
cluster_4 = Cluster_2(
    number=number_5,
    point=list_item_3,
    point_2=point_7,
    line=curve_7,
    material=material_properties_karamba3d,
    thickness=number_6)  # -> result, data, result_2, keys, elastic_energy_knm, calculated_model
number_9 = Number(ghpython_script_2.fixities_reaction)
number_10 = Number(cluster_3.result_2)
model_view_karamba3d = ModelViewKaramba3D(Model=cluster_3.calculated_model, LoadCaseFactorsForLinearSuperposition=1, IndexOfVisibleLoadcase=-1)  # -> Model, DeformedMesh, DeformedAxes, DeformedModel

number_11 = Number(cluster_3.result)
number_12 = Number(ghpython_script_2.element_reaction)
internal_froce_kn_moment_kn_m = Panel(number_11)
panel_24 = Panel(number_12)

match_tree = MatchTree(Tree=number_9, Guide=number_10)

number_13 = Number(ghpython_script_2.node_displacement)
number_14 = Number(cluster_3.data)
nodal_displacement_m_rad = Panel(number_14)
panel_25 = Panel(number_13)

reaction_force_kn_reaction_moment_kn_m = Panel(number_10)
panel_26 = Panel(match_tree)
beam_view_karamba3d = BeamViewKaramba3D(Model=model_view_karamba3d.Model)  # -> Model, MeshesOfRenderedBeams, DeformedBeamAxes, LegendColors, LegendTags
absolute = Absolute(Value=number_14)
subtraction = Subtraction(A=number_14, B=number_13)
split_tree = SplitTree(Data=number_11, Masks=flatten("{*;0}"))  # -> Positive, Negative
split_tree_2 = SplitTree(Data=number_12, Masks=flatten("{*;0}"))  # -> Positive, Negative
absolute_2 = Absolute(Value=subtraction)
number_15 = Number(split_tree.Positive)
legend = Legend(Colour=beam_view_karamba3d.LegendColors, Tags=beam_view_karamba3d.LegendTags, LegendType=1)
division = Division(A=absolute_2, B=absolute)

subtraction_2 = Subtraction(A=number_10, B=match_tree)
absolute_3 = Absolute(Value=number_10)
absolute_4 = Absolute(Value=subtraction_2)
division_2 = Division(A=absolute_4, B=absolute_3)
panel_27 = Panel(division_2)
list_item_4 = ListItem(List=division_2, Index=0, Wrap=True)  # -> flatten(Item), flatten(Item1), flatten(Item2), flatten(Item3), flatten(Item4), flatten(Item5)
X = BarGraph(list_item_4.Item, BarColor=RGB(255, 0, 90))
bar_graph = BarGraph(list_item_4.Item1, BarColor=RGB(255, 0, 90))
bar_graph_2 = BarGraph(list_item_4.Item2, BarColor=RGB(255, 0, 90))
bar_graph_3 = BarGraph(list_item_4.Item4, BarColor=RGB(255, 0, 90))
bar_graph_4 = BarGraph(list_item_4.Item5, BarColor=RGB(255, 0, 90))
bar_graph_5 = BarGraph(list_item_4.Item3, BarColor=RGB(255, 0, 90))
number_16 = Number(split_tree.Negative)

list_item_5 = ListItem(List=division, Index=0, Wrap=True)  # -> flatten(Item), flatten(Item1), flatten(Item2), flatten(Item3), flatten(Item4), flatten(Item5)
panel_28 = Panel(division)

subtraction_3 = Subtraction(A=number_15, B=split_tree_2.Positive)
absolute_5 = Absolute(Value=number_15)
absolute_6 = Absolute(Value=subtraction_3)
division_3 = Division(A=absolute_6, B=absolute_5)
panel_29 = Panel(division_3)
list_item_6 = ListItem(List=division_3, Index=0, Wrap=True)  # -> flatten(Item), flatten(Item1), flatten(Item2), flatten(Item3), flatten(Item4), flatten(Item5)
X_2 = BarGraph(list_item_6.Item, BarColor=RGB(255, 0, 90))
bar_graph_6 = BarGraph(list_item_6.Item1, BarColor=RGB(255, 0, 90))
bar_graph_7 = BarGraph(list_item_6.Item2, BarColor=RGB(255, 0, 90))
bar_graph_8 = BarGraph(list_item_6.Item4, BarColor=RGB(255, 0, 90))
bar_graph_9 = BarGraph(list_item_6.Item5, BarColor=RGB(255, 0, 90))
bar_graph_10 = BarGraph(list_item_6.Item3, BarColor=RGB(255, 0, 90))

X_3 = BarGraph(list_item_5.Item, BarColor=RGB(255, 0, 90))
bar_graph_11 = BarGraph(list_item_5.Item1, BarColor=RGB(255, 0, 90))
bar_graph_12 = BarGraph(list_item_5.Item2, BarColor=RGB(255, 0, 90))
bar_graph_13 = BarGraph(list_item_5.Item4, BarColor=RGB(255, 0, 90))
bar_graph_14 = BarGraph(list_item_5.Item5, BarColor=RGB(255, 0, 90))
bar_graph_15 = BarGraph(list_item_5.Item3, BarColor=RGB(255, 0, 90))

number_17 = Number(split_tree.Negative)

subtraction_4 = Subtraction(A=number_17, B=split_tree_2.Negative)
absolute_7 = Absolute(Value=number_17)
absolute_8 = Absolute(Value=subtraction_4)
division_4 = Division(A=absolute_8, B=absolute_7)
panel_30 = Panel(division_4)
list_item_7 = ListItem(List=division_4, Index=0, Wrap=True)  # -> flatten(Item), flatten(Item1), flatten(Item2), flatten(Item3), flatten(Item4), flatten(Item5)
X_4 = BarGraph(list_item_7.Item, BarColor=RGB(255, 0, 90))
bar_graph_16 = BarGraph(list_item_7.Item1, BarColor=RGB(255, 0, 90))
bar_graph_17 = BarGraph(list_item_7.Item2, BarColor=RGB(255, 0, 90))
bar_graph_18 = BarGraph(list_item_7.Item4, BarColor=RGB(255, 0, 90))
bar_graph_19 = BarGraph(list_item_7.Item5, BarColor=RGB(255, 0, 90))
bar_graph_20 = BarGraph(list_item_7.Item3, BarColor=RGB(255, 0, 90))

# ==== cluster Cluster_2
number = ClusterInput()
point = ClusterInput()
material = ClusterInput()
thickness = ClusterInput()
line = ClusterInput()
point_2 = ClusterInput()
number_2 = Number(number)
point_3 = Point(point)
# Gravity load
unit_z = UnitZ(Factor=number_2)
# Supports
support_karamba3d = SupportKaramba3D(PosInd=point_3, menu=[buttons(on, on, on, on, on, on)])
negative = Negative(Value=unit_z)
multiplication = Multiplication(A=thickness, B="2")
loads_karamba3d = LoadsKaramba3D(Vector=negative, LCase=0, mode="Gravity")
support_karamba3d_2 = SupportKaramba3D(support_karamba3d)
cross_section_karamba3d = CrossSectionKaramba3D(
    FamilyNameOfCrossSection="DefaultCroSec",
    Material=material,
    Diameter_cm=multiplication,
    WallThickness_cm=thickness,
    mode="Circular Hollow")
point_4 = Point(point_2)
line_to_beam_karamba3d = LineToBeamKaramba3D(Line=line, CrossSection=cross_section_karamba3d, Points=point_4, New=True, Remove=True, LimitDistance_m=0.005)  # -> Element, Points, Info
load_karamba3d = LoadKaramba3D(loads_karamba3d)
assemble_model_karamba3d = AssembleModelKaramba3D(
    Point=point_4,
    Elem=line_to_beam_karamba3d.Element,
    Support=support_karamba3d_2,
    Load=load_karamba3d,
    LimitDistance_m=0.005)  # -> Model, Info, Mass_kg, CenterOfGravity
analyze_karamba3d = AnalyzeKaramba3D(Model=assemble_model_karamba3d.Model)  # -> CalculatedModel, MaximumDisplacement_cm, ResultingForceOfGravity_kN, ElasticEnergy_kNm
reaction_forces_karamba3d = ReactionForcesKaramba3D(AnalyzedModel=analyze_karamba3d.CalculatedModel, LoadCase=0)  # -> AnalyzedModel, ReactionForces_kN, ReactionMoments_kNm, SupportPosition, SumOfReactionForces_kN, SumOfReactionMoments_kNm
nodal_displacements_karamba3d = NodalDisplacementsKaramba3D(AnalyzedModel=analyze_karamba3d.CalculatedModel, LoadCase=0)  # -> AnalyzedModel, NodalTranslations_m, NodalRotations_rad
beam_forces_karamba3d = BeamForcesKaramba3D(
    AnalyzedModel=analyze_karamba3d.CalculatedModel,
    LCase=-1,
    MaximumDistanceBetweenResults_m=-1,
    NumberOfResultsPerBeamElement=2)  # -> AnalyzedModel, NormalForce_kN, ShearForceVz_kN, ShearForceVy_kN, BendingMomentMt_kNm, BendingMomentMy_kNm, BendingMomentMz_kNm
deconstruct = Deconstruct(Point=simplify(graft(reaction_forces_karamba3d.ReactionForces_kN)))  # -> XComponent, YComponent, ZComponent
deconstruct_2 = Deconstruct(Point=simplify(graft(reaction_forces_karamba3d.ReactionMoments_kNm)))  # -> XComponent, YComponent, ZComponent
merge = Merge(
    Data1=simplify(graft(nodal_displacements_karamba3d.NodalTranslations_m)),
    Data2=simplify(graft(nodal_displacements_karamba3d.NodalRotations_rad)))
evaluate = Evaluate(Expression="format(\"{0:E} {1:E} {2:E}\",x.x,x.y,x.z)", x=merge)
merge_2 = Merge(
    Data1=deconstruct.XComponent,
    Data2=deconstruct.YComponent,
    Data3=deconstruct.ZComponent,
    Data4=deconstruct_2.XComponent,
    Data5=deconstruct_2.YComponent,
    Data6=deconstruct_2.ZComponent)
merge_3 = Merge(
    Data1=graft(beam_forces_karamba3d.NormalForce_kN),
    Data2=graft(beam_forces_karamba3d.ShearForceVz_kN),
    Data3=graft(beam_forces_karamba3d.ShearForceVy_kN),
    Data4=graft(beam_forces_karamba3d.BendingMomentMt_kNm),
    Data5=graft(beam_forces_karamba3d.BendingMomentMy_kNm),
    Data6=graft(beam_forces_karamba3d.BendingMomentMz_kNm))  # -> simplify(Result)
evaluate_2 = Evaluate(Expression="format(\"{0:E}\",x)", x=merge_2)
cluster = Cluster(text=evaluate, separators=" ")
evaluate_3 = Evaluate(Expression="format(\"{0:E}\",x)", x=merge_3)
reaction_force_kn_reaction_moment_kn_m = Panel(merge_2)
shift_paths = ShiftPaths(Data=cluster, Offset=-1)
list_item = ListItem(List=shift_paths, Index=0, Wrap=True)  # -> Item, Item1, Item2
froce_kn_moment_kn_m = Panel(merge_3)
nodal_displacement_m_rad = Panel(shift_paths)
merge_4 = Merge(Data1=list_item.Item, Data2=list_item.Item1, Data3=list_item.Item2)
number_3 = Number(merge_4)
square = Square(Value=number_3)
mass_addition = MassAddition(Input=square)  # -> Result, PartialResults
square_root = SquareRoot(Value=mass_addition.Result)  # -> flatten(Result)
sort_list = SortList(Keys=square_root)  # -> reverse(Keys), ValuesValuesA
elastic_energy_knm = ClusterOutput(analyze_karamba3d.ElasticEnergy_kNm)
calculated_model = ClusterOutput(analyze_karamba3d.CalculatedModel)
result = ClusterOutput(merge_3)
data = ClusterOutput(shift_paths)
result_2 = ClusterOutput(merge_2)
keys = ClusterOutput(sort_list.Keys)

# ==== cluster Cluster_3
curve = Curve()
model = ClusterInput()
entwine = Entwine(Branch00=curve, FlattenInputs=True)
# element id shower
c_script = CSharpScript(model=model, layers=entwine)  # -> out, A, edge_layer_list; inputs model: list of Curve, layers: tree of Curve
# ---------- c_script: C# usings ----------
using System.IO;
using System.Linq;
using System.Data;
using System.Drawing;
using System.Reflection;
using System.Windows.Forms;
using System.Xml;
using System.Xml.Linq;
using System.Runtime.InteropServices;

using Rhino.DocObjects;
using Rhino.Collections;
using GH_IO;
using GH_IO.Serialization;
# ---------- c_script: C# ----------
    DataTree<int> index_tree = new DataTree<int>();
    List<int> edge_layer = new List<int>(new int[model.Count()]);

    foreach(var path in layers.Paths)
    {
      foreach(var line in layers.Branch(path.Indices))
      {
        for(int i = 0; i < model.Count(); i++)
        {
          var compare_line = model[i];

          if(line.PointAt(0) == compare_line.PointAt(0))
          {
            if(line.PointAt(1) == compare_line.PointAt(1))
            {
              index_tree.Add(i, path);
              edge_layer[i] = path.Indices[0];
              //              GH_Path p = new GH_Path(0);
              //              p.Indices
              continue;
            }
          }

          if(line.PointAt(0) == compare_line.PointAt(1))
          {
            if(line.PointAt(1) == compare_line.PointAt(0))
            {
              index_tree.Add(i, path);
              edge_layer[i] = path.Indices[0];
              continue;
            }
          }
        }
      }
    }

    A = index_tree;
    edge_layer_list = edge_layer;
# ---------- end c_script ----------
list_item = ListItem(List=model, Index=c_script.A, Wrap=True)
panel = Panel(c_script.A)
ghpython_script = GhPythonScript(x=panel)  # -> out, a; inputs x: list
# ---------- ghpython_script: Python ----------
__author__ = "harry"
__version__ = "2019.08.22"

import rhinoscriptsyntax as rs

print([int(v) for v in x])
# ---------- end ghpython_script ----------

# ==== cluster Cluster_4
pts = ClusterInput()
target_pts = ClusterInput()
c_script = CSharpScript(pts=pts, target_pts=target_pts, dist_tol=0.001)  # -> out, A; inputs pts: list of Point3d, target_pts: list of Point3d, dist_tol: Double; disabled
# ---------- c_script: C# usings ----------
using System.IO;
using System.Linq;
using System.Data;
using System.Drawing;
using System.Reflection;
using System.Windows.Forms;
using System.Xml;
using System.Xml.Linq;
using System.Runtime.InteropServices;

using Rhino.DocObjects;
using Rhino.Collections;
using GH_IO;
using GH_IO.Serialization;
# ---------- c_script: C# ----------
    List<int> id = new List<int>();

    foreach(Point3d t_pt in target_pts)
    {
      for(int i = 0; i < pts.Count(); i++)
      {
        if(t_pt.DistanceTo(pts[i]) < dist_tol)
        {
          id.Add(i);
          break;
        }
      }
    }

    A = id;
# ---------- end c_script ----------
list = ClusterInput()
list_item = ListItem(List=list, Index=c_script.A, Wrap=True)  # disabled

# ==== cluster Cluster
text = ClusterInput()
separators = ClusterInput()
text_split = TextSplit(Text=text, Separators=separators)
number = Number(text_split)
clean_tree = CleanTree(RemoveNulls=True, RemoveInvalid=True, RemoveEmpty=False, Tree=number)
tree = ClusterOutput(clean_tree)
