# Grasshopper definition stiffness_checker_in_gh_python_remote.ghx (Grasshopper 1.0.7)

panel = Panel("C:\Users\harry\Documents\pb-construction\conmech\tests\gh_scripts")
python = PythonScript()  # -> rhino_doc_dir
# ---------- python: Python ----------
import scriptcontext as sc
from os import path

rhino_doc_dir = path.abspath(path.dirname(sc.doc.Path))
# ---------- end python ----------
concatenate = Concatenate(Fragment_A=panel, A="\", Fragment_B="voronoi_solution.json")
concatenate_2 = Concatenate(Fragment_A=panel, A="\", Fragment_B="voronoi_analysis_res.json")
panel_2 = Panel("C:\Users\harry\Documents\pb-construction\conmech\tests\assembly_instances\extrusion")

# ----
# file name
panel_3 = Panel("voronoi_S1_03-14-2019_w_layer.json")

ghpython_script = GhPythonScript(seq_result_file_path=concatenate)  # -> out, seq_e_ids
# ---------- ghpython_script: Python ----------
__author__ = "harry"
__version__ = "2019.08.22"

import rhinoscriptsyntax as rs
import json

with open(seq_result_file_path, 'r') as f:
    json_data = json.loads(f.read())

seq_e_ids = json_data['plan']
del json_data['plan']
print(json_data)
# ---------- end ghpython_script ----------
list = ValueList({"CRITICAL", "ERROR", "WARNING", "INFO", "DEBUG", "NOTSET"}, selected="DEBUG")

# ---- group: Import remote python modules
panel_4 = Panel(python)
# Turn me on!   -->
panel_5 = Panel("""numpy
numpy.linalg
pyconmech.frame_analysis""")
ghpythonremote = GHPythonRemote(location="conda://py2", run=Toggle(False), modules=panel_5, log_level=list, working_dir=panel_4)  # -> out, linked_modules, rpy; inputs run: Boolean, modules: list
# ---------- ghpythonremote: Python ----------
import sys
import scriptcontext
import logging
import inspect
import ghpythonremote
from ghpythonremote.connectors import GrasshopperToPythonRemote
from os import path
from time import sleep

local_log_level = getattr(logging, log_level, logging.WARNING)
logger = logging.getLogger('ghpythonremote')
logger.setLevel(local_log_level)
ch = logging.StreamHandler()
ch.setLevel(local_log_level)
formatter = logging.Formatter('%(levelname)s: %(name)s:\n%(message)s')
ch.setFormatter(formatter)
logger.handlers = []
logger.addHandler(ch)
logger = logging.getLogger('ghpythonremote.GH_to_python_sticky')

ROOT = path.abspath(path.dirname(inspect.getfile(ghpythonremote)))
rpyc_server_py = path.join(ROOT, 'pythonservice.py')

# Set connection to CLOSED if this is the first run
# and initialize set of linked modules
try:
    remote_python_status
except NameError:
    remote_python_status = 'CLOSED'
    lkd_modules = set()

# Wait for connection to connect or terminate
timer = 0
while remote_python_status == 'CONNECTING' or remote_python_status == 'CLOSING':
    sleep(1)
    timer += 1
    if timer == 10:
        try:
            gh2py_manager.__exit__(*sys.exc_info())
        except Exception:
            pass
        remote_python_status = 'CLOSED'
        lkd_modules = set()
        raise RuntimeError("Connection left in an inconsistent state and not returning. Reset everything.")

if run:
    if not remote_python_status == 'OPEN':
        remote_python_status = 'CONNECTING'
        gh2py_manager = GrasshopperToPythonRemote(rpyc_server_py, location=location, timeout=10,
                                                  port=None, log_level=log_level, working_dir=working_dir)
        gh2py = gh2py_manager.__enter__()
        remote_python_status = 'OPEN'

    # Stuff that we can reach
    rpymod = gh2py.py_remote_modules  # A getter function for a named python module
    rpy = gh2py.connection  # Represents the remote instance root object
    scriptcontext.sticky['rpy'] = rpy
    # Add modules
    for mod in modules:
        try:
            scriptcontext.sticky[mod] = rpymod(mod)
            lkd_modules.add(mod)
        except ImportError:
            gh2py_manager.__exit__(*sys.exc_info())
            raise

elif not remote_python_status == 'CLOSED':
    remote_python_status = 'CLOSING'
    # Remove linked modules
    for mod in lkd_modules:
        del scriptcontext.sticky[mod]
    del scriptcontext.sticky['rpy']
    gh2py_manager.__exit__(*sys.exc_info())
    lkd_modules = set()
    remote_python_status = 'CLOSED'

# Change variable name because ghpython resets outputs to None before each run
linked_modules = lkd_modules

logger.info('GH to python connection is {}'.format(remote_python_status))
# ---------- end ghpythonremote ----------
panel_6 = Panel(ghpythonremote.out)

# ----
python_2 = PythonScript(module_names=ghpythonremote.linked_modules)  # -> import_statements; inputs module_names: list
# ---------- python_2: Python ----------
import_statements = ["import scriptcontext as sc"]
for module_name in module_names:
    import_statements.append("{0} = sc.sticky['{0}']".format(module_name))

if len(module_names) == 0:
    import_statements = []
# ---------- end python_2 ----------
integer = Integer(ghpython_script.seq_e_ids)
panel_7 = Panel(ghpython_script.out)
concatenate_3 = Concatenate(Fragment_A=panel_2, A="\", Fragment_B=panel_3)
panel_8 = Panel(python_2)
split_list = SplitList(List=integer, Index=Slider(100, range=1..306))  # -> flatten(ListA), ListB
integer_2 = Integer(split_list.ListA)
ghpython_script_2 = GhPythonScript(
    frame_json_file_path=concatenate_3,
    result_file_path=concatenate_2,
    existing_ids=split_list.ListA,
    include_sw=Toggle(True))  # -> out, solve_success, element_reaction, local_coordinate_frames; inputs existing_ids: list of Int32, include_sw: Boolean
# ---------- ghpython_script_2: Python ----------
import rhinoscriptsyntax as rs
import Rhino.Geometry as rg
from Grasshopper import DataTree as datatree
from Grasshopper.Kernel.Data import GH_Path as ghpath
import System
import os
import json

from ghpythonlib.treehelpers import list_to_tree
#from compas.rpc import Proxy
#cm = Proxy('pyconmech.frame_analysis.stiffness_solve_fn')

import scriptcontext as sc
cm = sc.sticky['pyconmech.frame_analysis']
#numpy = sc.sticky['numpy']
#numpy.linalg = sc.sticky['numpy.linalg']

cm.stiffness_checker_parse_file_and_save_result(frame_json_file_path, result_file_path, existing_ids=existing_ids, include_sw=include_sw)

assert os.path.exists(result_file_path) and "json file path does not exist!"
with open(result_file_path, 'r') as f:
    json_data = json.loads(f.read())


solve_success = json_data['solve_success']

print('trans tol : {}, rot_tol : {}'.format(json_data['trans_tol'], json_data['rot_tol']))

er_tree = datatree[System.Double]()
local_planes = datatree[System.Double]()

for er_data in json_data['element_reaction']:
    e_id = er_data['element_id']
    for val in er_data['reaction']['0']:
        er_tree.Add(val, ghpath(e_id, 0))
    for val in er_data['reaction']['1']:
        er_tree.Add(val, ghpath(e_id, 1))
    e_LG = er_data['local_to_global_transformation']
    for i in range(3):
        for j in range(3):
            num = e_LG[j][i]
            local_planes.Add(num, ghpath(e_id, j))

element_reaction = er_tree
local_coordinate_frames = local_planes
# ---------- end ghpython_script_2 ----------
ghpython_script_3 = GhPythonScript(frame_json_file_path=concatenate_3, existing_ids=split_list.ListA, scale=Slider(1000, range=0..1000))  # -> out, simplify(all_element_ids), all_nodes, all_elements, existing_elements, fix_node_ids; inputs existing_ids: list of Int32
# ---------- ghpython_script_3: Python ----------
import rhinoscriptsyntax as rs
import Rhino.Geometry as rg
from Grasshopper import DataTree as datatree
from Grasshopper.Kernel.Data import GH_Path as ghpath
import System

from ghpythonlib.treehelpers import list_to_tree
#from compas.rpc import Proxy
#cm = Proxy('pyconmech.frame_analysis.stiffness_solve_fn')

import scriptcontext as sc
cm = sc.sticky['pyconmech.frame_analysis']
numpy = sc.sticky['numpy']
numpy.linalg = sc.sticky['numpy.linalg']

def rvector2list(rv):
    return [rv.X, rv.Y, rv.Z]


frame_info = cm.read_frame_json(frame_json_file_path)

node_points, element_vids, _fix_node_ids, fix_specs, model_type, material_dict, model_name = frame_info

all_nodes = [rs.CreatePoint(scale*pt[0], scale*pt[1], scale*pt[2]) for pt in node_points]
all_elements = [rg.Line(all_nodes[n1], all_nodes[n2]) for n1, n2 in element_vids]
existing_elements = [rg.Line(all_nodes[element_vids[e_id][0]], all_nodes[element_vids[e_id][1]]) for e_id in existing_ids]

fix_node_ids = [int(v) for v in _fix_node_ids]
# ---------- end ghpython_script_3 ----------
panel_9 = Panel(ghpython_script_2.out)
concatenate_4 = Concatenate(B="{", Fragment_A=integer_2, A=";", Fragment_B="1", C="}")
concatenate_5 = Concatenate(B="{", Fragment_A=integer_2, A=";", Fragment_B="0", C="}")
number = Number(ghpython_script_2.local_coordinate_frames)
curve = Curve(reparameterize(simplify(graft(ghpython_script_3.all_elements))))
split_tree = SplitTree(Data=number, Masks=flatten(concatenate_4))  # -> Positive, Negative
split_tree_2 = SplitTree(Data=number, Masks=flatten(concatenate_5))  # -> Positive, Negative
list_item = ListItem(List=ghpython_script_2.element_reaction, Index=0, Wrap=True)
panel_10 = Panel(ghpython_script_2.element_reaction)
split_tree_3 = SplitTree(Data=list_item, Masks=flatten("{*;0}"))  # -> Positive, Negative
list_item_2 = ListItem(List=split_tree.Positive, Index=0, Wrap=True)  # -> Item, Item1, Item2
list_item_3 = ListItem(List=split_tree_2.Positive, Index=0, Wrap=True)  # -> Item, Item1, Item2
construct_path = ConstructPath(Indices=simplify(graft(integer_2)))  # -> flatten(Branch)
evaluate_curve = EvaluateCurve(Curve=curve, Parameter=Slider(0.5, range=0..1))  # -> Point, Tangent, Angle
vector_xyz = VectorXYZ(XComponent=list_item_2.Item, YComponent=list_item_2.Item1, ZComponent=list_item_2.Item2)  # -> simplify(Vector), Length
vector_xyz_2 = VectorXYZ(XComponent=list_item_3.Item, YComponent=list_item_3.Item1, ZComponent=list_item_3.Item2)  # -> simplify(Vector), Length
panel_11 = Panel(ghpython_script_2.local_coordinate_frames)
shift_paths = ShiftPaths(Data=split_tree_3.Positive, Offset=-1)
tree_statistics = TreeStatistics(Tree=shift_paths)  # -> Paths, Length, Count
curve_2 = Curve(curve)
split_tree_4 = SplitTree(Data=evaluate_curve.Point, Masks=flatten(construct_path))  # -> Positive, Negative
split_tree_5 = SplitTree(Data=curve_2, Masks=flatten(tree_statistics.Paths))  # -> Positive, Negative
point = Point(split_tree_4.Positive)
curve_3 = Curve(flatten(split_tree_5.Positive))
number_2 = Number(flatten(shift_paths))
construct_plane = ConstructPlane(Origin=point, XAxis=vector_xyz_2.Vector, YAxis=vector_xyz.Vector)

# ----
# at node 0,
# force > 0 tension
# force < 0 compression
panel_12 = Panel("0")
larger_than = LargerThan(FirstNumber=number_2, SecondNumber=panel_12)  # -> LargerThan, OrEqualTo
dispatch = Dispatch(List=curve_3, DispatchPattern=larger_than.LargerThan)  # -> ListA, ListB

curve_4 = Curve(dispatch.ListB)
number_slider = Slider(256, range=0..256)
curve_5 = Curve(dispatch.ListA)
colour_rgb = ColourRGB(Alpha=255, Red=0, Green=0, Blue=number_slider)
colour_rgb_2 = ColourRGB(Alpha=255, Red=number_slider, Green=0, Blue=0)
custom_preview = CustomPreview(Geometry=curve_5, Material=colour_rgb)
custom_preview_2 = CustomPreview(Geometry=curve_4, Material=colour_rgb_2)
